# Grasshopper definition 170131 isovist.gh (Grasshopper 1.0.4)

eye_height_in_mm = Panel("1500")
station = Point(Point(1.823683444, -24.2808641, 0))
px_width = Panel("60")
px_height = Panel("30")
Z = UnitZ(Factor=eye_height_in_mm)
move = Move(Geometry=station, Motion=Z)  # -> Geometry, Transform
eye = Point(move.Geometry)
box = Box([{Plane=PlaneXY(-2870.865427, 1064.441471, 0), X=Domain(0, 1147.820252), Y=Domain(0, 1165.620441), Z=Domain(0, 3012.821609)}, {Plane=PlaneXY(3432.733464, -5774.414852, 0), X=Domain(0, 878.7437853), Y=Domain(0, 7616.430358), Z=Domain(0, 2500.115708)}, {Plane=PlaneXY(-3061.884312, -5254.581352, 0), X=Domain(0, 4142.667374), Y=Domain(0, 370.2286594), Z=Domain(0, 1449.532523)}])
pi = Pi(Factor=Slider(-0.5, range=-1..1))
line = LineSDL(Start=eye, Direction=Vector(1, 0, 0), Length="200")
Z_2 = UnitZ(Factor=1)
px_w = Integer(px_width)
px_h = Integer(px_height)
rotate = Rotate(Geometry=line, Angle=pi, Plane=eye)  # -> Geometry, Transform
sphere_radius_in_mm = Panel("10000")
xprod = CrossProduct(VectorA=rotate.Geometry, VectorB=Z_2, Unitize=False)  # -> Vector, Length
brep = Brep(box)
pi_2 = Pi(Factor=Slider(0, range=-1..1))
pi_3 = Pi(Factor=Slider(0, range=-0.5..0.5))
view_line = Line(rotate.Geometry)
pl = ConstructPlane(Origin=eye, XAxis=rotate.Geometry, YAxis=xprod.Vector)
pt = PointPolar(BasePlane=pl, XYAngle=pi_2, ZAngle=pi_3, Offset=sphere_radius_in_mm)
range = Range(Domain="-pi to pi", Steps=expr("x-1", px_h))  # -> graft(Range)
range_2 = Range(Domain="-pi/2 to pi/2", Steps=expr("x-1", px_w))
number_slider = Slider(0, range=0..10)  # disabled
pt_2 = PointPolar(BasePlane=pl, XYAngle=range, ZAngle=range_2, Offset=sphere_radius_in_mm)  # -> simplify(Point)
pt_3 = ConstructPoint(XCoordinate=range, YCoordinate=range_2, ZCoordinate=0)  # -> simplify(Point); disabled
eye_2 = Point(eye)
branch = TreeBranch(Tree=pt_3, Path=number_slider, MaintainPaths=True)  # disabled
branch_2 = TreeBranch(Tree=pt_2, Path=number_slider, MaintainPaths=True)  # disabled
box_2 = Box({Plane=PlaneXY(-3562.094566, -5067.860569, 0), X=Domain(0, 1622.457843), Y=Domain(0, 2010.551851), Z=Domain(0, 1489.906479)})  # disabled
ln = Line(StartPoint=eye_2, EndPoint=pt_2)  # -> flatten(Line)
line_2 = Line(Line((-5711.801958, -4581.599666, 0), (-2910.789467, -4145.457386, 0)))  # disabled
rays = Line(flatten(ln))
brep_2 = Brep(box_2)  # disabled
blx = BrepLine(Brep=graft(brep), Line=rays, LimitToFirst=False, UseTasks=False)  # -> Curves, simplify(Points)
c_script = CSharpScript(brep=brep_2, line=line_2)  # -> out, A; inputs brep: Brep, line: Line; disabled
# ---------- c_script: C# ----------
    
    Rhino.Geometry.Intersect.Intersection.CurveBrep(line, brep);
# ---------- end c_script ----------
lng = ListLength(List=rays)
path_mapper = PathMapper(blx.Points, source="{A;B}", target="{B}")
series = Series(Start=0, Step=1, Count=lng)
c_script_2 = CSharpScript(pts=path_mapper, line=graft(rays), idx=graft(series))  # -> out, flatten(A), flatten(B), flatten(C), flatten(D), flatten(E); inputs pts: list, line: Line, idx: Int32
# ---------- c_script_2: C# ----------
    var tVals = new List<double>();

    foreach (object obj in pts)
    {
      if (obj == null) {
        //Print("nnull");
      } else {
        Point3d pt = (Point3d) obj;
        Double t = line.ClosestParameter(pt);
        if ((t >= 0) && (t <= 1)){
          tVals.Add(t);
        }
      }
    }

    if (tVals.Count != 0) {
      double t = tVals.Min();
      A = true;
      B = t;
      C = (line.Length) *t;
      D = idx;
      E = line.PointAt(t);
    } else {
      A = false;
    }
# ---------- end c_script_2 ----------
cull = CullPattern(List=c_script_2.E, CullPattern=c_script_2.A)
cull_2 = CullPattern(List=c_script_2.D, CullPattern=c_script_2.A)
cull_3 = CullPattern(List=c_script_2.C, CullPattern=c_script_2.A)
cull_4 = CullPattern(List=c_script_2.B, CullPattern=c_script_2.A)
item = ListItem(List=rays, Index=cull_2, Wrap=True)
end = EndPoints(Curve=item)  # -> Start, End
ln_2 = Line(StartPoint=end.Start, EndPoint=cull)
