# Grasshopper definition 170201 brep line crash.gh (Grasshopper 1.0.4)

range = Range(Domain="1 to 10", Steps=Slider(60, range=0..500))
Z = UnitZ(Factor=1)
line = Line([Line((9.933826216, -5.596270688, 0), (7.232763222, -2.647413668, 0)), Line((8.304235371, -1.686702872, 0), (11.45101907, -4.754693271, 0)), Line((10.12928162, -0.288375809, 0), (12.075737, -0.2672713183, 0))])
move = Move(Geometry=line, Motion=graft(Z))  # -> Geometry, Transform
box = Box([{Plane=PlaneXY(0.08578076844, -0.7997429306, 0), X=Domain(0, 8.819147992), Y=Domain(0, 1.085406776), Z=Domain(0, 10.24984535)}, {Plane=PlaneXY(12.85367527, -11.01480816, 0), X=Domain(0, 3.231932374), Y=Domain(0, 18.67793524), Z=Domain(0, 8.593202361)}])
blx = BrepLine(Brep=graft(box), Line=flatten(move.Geometry), LimitToFirst=True, UseTasks=False)  # -> Curves, simplify(Points)
c_script = CSharpScript(breps=flatten(box), rays=flatten(move.Geometry))  # -> out, hitCounts, hitPts, hitTs, hitDists; inputs breps: list of Brep, rays: list of Line
# ---------- c_script: C# ----------
    List<object> hCounts = new List<object>();
    List<object> hPts = new List<object>();
    List<object> hTs = new List<object>();
    List<object> hDists = new List<object>();

    foreach (Line seg in rays){
      Point3d xpt = new Point3d();
      Double xt = Double.MaxValue;

      Ray3d ray = new Ray3d(seg.PointAt(0), seg.UnitTangent);

      var points = Rhino.Geometry.Intersect.Intersection.ProjectPointsToBreps(
        breps,
        new List<Point3d> {seg.PointAt(0)},
        seg.UnitTangent,
        doc.ModelAbsoluteTolerance
        );


      foreach (Point3d pt in points){
        Double t = seg.ClosestParameter(pt);
        if ((t >= 0) && (t < xt)){
          xt = t;
          xpt = pt;
        }
      }

      if (xt < Double.MaxValue){
        hCounts.Add(-1);
        hPts.Add(xpt);
        hTs.Add(xt);
        hDists.Add(xt * seg.Length);
      } else {
        hCounts.Add(0);
        hPts.Add(null);
        hTs.Add(null);
        hDists.Add(null);
      }
    }

    hitCounts = hCounts;
    hitPts = hPts;
    hitTs = hTs;
    hitDists = hDists;
# ---------- end c_script ----------
pt = Point(blx.Points)
panel = Panel(c_script.hitDists)
