# Grasshopper definition 170201 isovist.gh (Grasshopper 1.0.4)

px_width = Panel("64")
px_height = Panel("48")
px_height_2 = Integer(px_height)
px_width_2 = Integer(px_width)
panel = Panel("""0.0
0.5
0.1""")
line = Line(Line((-9064.677144, -2642.135813, 0), (10928.96351, -5277.397349, 0)))
eye_height_in_mm = Panel("1500")
eval = EvaluateCurve(Curve=line, Parameter=Slider(0.1, range=0..1))  # -> Point, Tangent, Angle
station = Point(eval.Point)
Z = UnitZ(Factor=eye_height_in_mm)
move = Move(Geometry=station, Motion=Z)  # -> Geometry, Transform
pl_origin = PlaneOrigin(Base=PlaneXY(0, 0, 0), Origin=move.Geometry)
pi = Pi(Factor=Slider(0, range=-1..1))
eye = Point(move.Geometry)
rotate = Rotate(Geometry=pl_origin, Angle=pi, Plane=pl_origin)  # -> Geometry, Transform
sphere_radius_in_mm = Panel("1000")
px_height_3 = Integer(px_height_2)
px_width_3 = Integer(px_width_2)
c_script = CSharpScript(pxWidth=px_width_3, pxHeight=px_height_3, radius=sphere_radius_in_mm, originPlane=rotate.Geometry)  # -> out, A; inputs pxWidth: Int32, pxHeight: Int32, radius: Double, originPlane: Plane
# ---------- c_script: C# ----------
    List<Point3d> pts = new List<Point3d>();

    Interval ivalPhi = new Interval(0, 2.0 * Math.PI);
    Interval ivalTheta = new Interval(0, Math.PI);
    Double divPhi = (ivalPhi.T1 - ivalPhi.T0) / (pxWidth);
    Double divTheta = (ivalTheta.T1 - ivalTheta.T0) / (pxHeight);
    Double nudPhi = divPhi / 2;
    Double nudTheta = divTheta / 2;

    for (Double phi = ivalPhi.T0 + nudPhi; phi <= ivalPhi.T1 - nudPhi; phi += divPhi ){
      for (Double theta = ivalTheta.T0 + nudTheta; theta <= ivalTheta.T1 - nudTheta; theta += divTheta ){
        //Print(String.Format("{0},{1}", ivalPhi.NormalizedParameterAt(phi), ivalTheta.NormalizedParameterAt(theta)));

        Double x = radius * Math.Sin(theta) * Math.Cos(phi);
        Double y = radius * Math.Sin(theta) * Math.Sin(phi);
        Double z = radius * Math.Cos(theta);
        pts.Add(originPlane.PointAt(x, y, z));
      }
    }

    A = pts;
# ---------- end c_script ----------
ln = Line(StartPoint=eye, EndPoint=c_script.A)
rays = Line(ln)
box = Box([{Plane=PlaneXY(-3201.942755, 155.6131349, 0), X=Domain(0, 1510.104349), Y=Domain(0, 1462.39236), Z=Domain(0, 3321.483523)}, {Plane=PlaneXY(-5721.749, -9005.671508, 0), X=Domain(0, 14880.3878), Y=Domain(0, 551.786445), Z=Domain(0, 946.6027618)}, {Plane=PlaneXY(14308.88262, -4041.761715, 0), X=Domain(0, 4195.325487), Y=Domain(0, 18402.82453), Z=Domain(0, 26855.07267)}])
lng = ListLength(List=c_script.A)
brep = Brep(box)
multiplication = Multiplication(A=lng, B=Slider(0, range=0..1))
item = ListItem(List=c_script.A, Index=multiplication, Wrap=True)
item_2 = ListItem(List=rays, Index=multiplication, Wrap=True)
c_script_2 = CSharpScript(breps=brep, rays=rays, domPad="0.125")  # -> out, hitCounts, hitPts, hitTs, hitDists, distDom; inputs breps: list of Brep, rays: list of Line, domPad: Double
# ---------- c_script_2: C# ----------
    List<int> hCounts = new List<int>();
    List<object> hPts = new List<object>();
    List<object> hTs = new List<object>();
    List<object> hDists = new List<object>();
    Interval dom = new Interval(Double.MinValue, Double.MaxValue);

    foreach (Line seg in rays){
      Point3d xpt = new Point3d();
      Double xt = Double.MaxValue;

      Ray3d ray = new Ray3d(seg.PointAt(0), seg.UnitTangent);

      var points = Rhino.Geometry.Intersect.Intersection.ProjectPointsToBreps(
        breps,
        new List<Point3d> {seg.PointAt(0)},
        seg.UnitTangent,
        doc.ModelAbsoluteTolerance
        );

      int validHits = 0;
      foreach (Point3d pt in points){
        Double t = seg.ClosestParameter(pt);
        if ((t >= 0) && (t < xt)){
          xt = t;
          xpt = pt;
        }

        if (t >= 0) validHits++;
      }

      if (xt < Double.MaxValue){
        hCounts.Add(validHits);
        hPts.Add(xpt);
        hTs.Add(xt);
        Double dist = xt * seg.Length;
        hDists.Add(dist);

        if ((dom.Min == Double.MinValue ) || (dist < dom.Min)) dom.T0 = dist;
        if ((dom.Max == Double.MaxValue ) || (dist > dom.Max)) dom.T1 = dist;

      } else {
        hCounts.Add(0);
        hPts.Add(null);
        hTs.Add(null);
        hDists.Add(null);
      }
    }

    Double delt = dom.Max - dom.Min;
    Interval dDom = new Interval(Math.Max(dom.Min - delt * domPad, 0), dom.Max + delt * domPad);


    hitCounts = hCounts;
    hitPts = hPts;
    hitTs = hTs;
    hitDists = hDists;
    distDom = dDom;
# ---------- end c_script_2 ----------
panel_2 = Panel(c_script_2.distDom)
panel_3 = Panel(c_script_2.out)
dedomain = DeconstructDomain(Domain=c_script_2.distDom)  # -> Start, End
nullrep = ReplaceNulls(Items=c_script_2.hitDists, Replacements=dedomain.End)  # -> Items, Count
gradient = Gradient(
    LowerLimit=dedomain.Start,
    UpperLimit=dedomain.End,
    Parameter=nullrep.Items,
    stops=[0: RGB(255, 255, 255), 1: RGB(0, 0, 0)])
px_height_4 = Integer(px_height_2)

# ---- group: PATH TO LOCAL IMAGE
path = FilePath("C:\Users\ksteinfe\Desktop\")

# ----
px_width_4 = Integer(px_width_2)
c_script_3 = CSharpScript(savepath=path, filename="test", pxColors=gradient, pxWidth=px_width_4, pxHeight=px_height_4)  # -> out, A; inputs savepath: String, filename: String, pxColors: list of Color, pxWidth: Int32, pxHeight: Int32
# ---------- c_script_3: C# ----------
    if (pxColors.Count != pxWidth * pxHeight) {
      String msg = "Pixel dimension does not match number of colors provided!";
      Print(msg);
      Component.AddRuntimeMessage(GH_RuntimeMessageLevel.Error, msg);
      //GrasshopperDocument.RequestAbortSolution();
      return;
    }

    System.Drawing.Bitmap img = new Bitmap(pxWidth, pxHeight);

    for (var i = 0; i < pxColors.Count; i++) {
      int y = i % pxHeight;
      int x = i / pxHeight;
      //Print(String.Format("{0},{1}", x.ToString(), y.ToString()));
      img.SetPixel(x, y, pxColors[i]);
    }
    img.Save(savepath + filename + ".png", System.Drawing.Imaging.ImageFormat.Png);

    
    A = img;
# ---------- end c_script_3 ----------
