# Grasshopper definition 170206 isovist.gh (Grasshopper 1.0.4)

box = Box([{Plane=PlaneXY(-5.389979, 8.105527468, 0), X=Domain(0, 1.34845751), Y=Domain(0, 1.534488964), Z=Domain(0, 5.725077128)}, {Plane=PlaneXY(18.59763075, -5.643567821, 0), X=Domain(0, 1.504359828), Y=Domain(0, 18.68388291), Z=Domain(0, 19.20471726)}, {Plane=PlaneXY(-4.501902364, -3.508139142, 0), X=Domain(0, 18.38781225), Y=Domain(0, 1.327492966), Z=Domain(0, 1.314101371)}])
px_width = Panel("80")
px_height = Panel("40")
context = Brep(box)

# ---- group: curve trajectory style
range = Range(Domain=Domain(0, 1), Steps=Slider(3, range=0..50))
crv = Curve(reparameterize(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))
eye_height_in_meters = Panel("1.50")
eval = EvaluateCurve(Curve=crv, Parameter=Slider(0.35, range=0..1))  # -> Point, Tangent, Angle
align = AlignPlane(Plane=eval.Point, Direction=eval.Tangent)  # -> Plane, Angle
Z = UnitZ(Factor=eye_height_in_meters)
move = Move(Geometry=align.Plane, Motion=Z)  # -> Geometry, Transform
sample_planes = Plane(move.Geometry)

# ----
px_height_2 = Integer(px_height)

# ---- group: single point style
station = Point(Point(14.77651813, -1.489363439, 0))
eye_height_in_meters_2 = Panel("1.5")
Z_2 = UnitZ(Factor=eye_height_in_meters_2)
move_2 = Move(Geometry=station, Motion=Z_2)  # -> Geometry, Transform
pl_origin = PlaneOrigin(Base=PlaneXY(0, 0, 0), Origin=move_2.Geometry)
pi = Pi(Factor=Slider(-0.49, range=-1..1))
eye = Point(move_2.Geometry)
rotate = Rotate(Geometry=pl_origin, Angle=pi, Plane=pl_origin)  # -> Geometry, Transform
sample_plane = Plane(rotate.Geometry)

# ----
px_width_2 = Integer(px_width)

# ---- group: define ground
# DEFINE GROUND: The ground is defined at the lower edge of the bounding box of the given Breps. Ground box is sized to 1000 times the size of the bounding box. Maximum x-y dimension of bounding box is returned.
cluster = Cluster(breps=context)  # -> ground_2, max_dim_2

# ----
fixed_domain = Panel("0 to 30")
pi_2 = Pi(Factor=Slider(0.25, range=0..0.333))
hit_domain = Domain(fixed_domain)
theta_crop = Number(pi_2)
merge = Merge(Data1=cluster.ground_2, Data2=context)

max_dim = Number(cluster.max_dim_2)
breps = Brep(merge)

max_dim_2 = Number(max_dim)
dom = ConstructDomain(DomainStart=0, DomainEnd=max_dim_2)
calculated_domain = Domain(dom)
sample_planes_2 = Plane(sample_plane)
sphere_radius_in_meters = Panel("1.0")
hit_domain_2 = Domain(hit_domain)
theta_crop_2 = Number(theta_crop)
px_height_3 = Integer(px_height_2)
theta_crop_3 = Number(theta_crop)
px_width_3 = Integer(px_width_2)
px_width_4 = Integer(px_width_2)
px_height_4 = Integer(px_height_2)
breps_2 = Brep(breps)
c_script = CSharpScript(
    showPts=Toggle(True),
    pxWidth=px_width_3,
    pxHeight=px_height_3,
    samplePlanes=sample_planes_2,
    breps=breps_2,
    hitDomain=hit_domain_2,
    thetaCrop=theta_crop_2)  # -> out, hitCounts, hitPts, hitDists, A; inputs showPts: Boolean, pxWidth: Int32, pxHeight: Int32, samplePlanes: list of Plane, breps: list of Brep, thetaCrop: Double
# ---------- c_script: C# ----------
    DataTree<int> hCounts = new DataTree<int>();
    DataTree<object> hPts = new DataTree<object>();
    DataTree<object> hDists = new DataTree<object>();
    Interval dom = new Interval(Double.MinValue, Double.MaxValue);

    Interval ivalPhi = new Interval(0, 2.0 * Math.PI);
    Interval ivalTheta = new Interval(thetaCrop, Math.PI - thetaCrop);

    for (int p = 0; p < samplePlanes.Count; p++){
      Plane samplePlane = samplePlanes[p];

      for (int xi = pxWidth; xi > 0; xi--){
        for (int yi = 0; yi < pxHeight; yi++){
          Double phi = ivalPhi.ParameterAt((Double) xi / (Double) (pxWidth - 1));
          Double theta = ivalTheta.ParameterAt((Double) yi / (Double) (pxHeight - 1));

          Point3d xpt = new Point3d();
          Double xt = Double.MaxValue;

          Double radius = 1.0;
          Double x = radius * Math.Sin(theta) * Math.Cos(phi);
          Double y = radius * Math.Sin(theta) * Math.Sin(phi);
          Double z = radius * Math.Cos(theta);

          Point3d plnPt = samplePlane.PointAt(x, y, z);
          Vector3d rayVec = plnPt - samplePlane.Origin;
          Ray3d ray = new Ray3d(plnPt, rayVec);
          Line seg = new Line(samplePlane.Origin, samplePlane.PointAt(x, y, z));

          var points = Rhino.Geometry.Intersect.Intersection.ProjectPointsToBreps(
            breps,
            new List<Point3d> {samplePlane.Origin},
            ray.Direction,
            doc.ModelAbsoluteTolerance
            );

          int validHits = 0;
          foreach (Point3d pt in points){
            Double t = seg.ClosestParameter(pt);
            if ((t >= 0) && (t < xt)){
              xt = t;
              xpt = pt;
            }

            if (t >= 0) validHits++;
          }

          if (xt < Double.MaxValue){
            hCounts.Add(validHits, new GH_Path(p));
            if (showPts) hPts.Add(xpt, new GH_Path(p));
            //hTs.Add(x, new GH_Path(p)t);
            Double dist = xt * seg.Length;
            Double domDist = hitDomain.NormalizedParameterAt(dist);
            if (domDist > 1.0) domDist = 1.0;
            hDists.Add(domDist, new GH_Path(p));

            if ((dom.Min == Double.MinValue ) || (dist < dom.Min)) dom.T0 = dist;
            if ((dom.Max == Double.MaxValue ) || (dist > dom.Max)) dom.T1 = dist;

          } else {
            hCounts.Add(0, new GH_Path(p));
            if (showPts) hPts.Add(null, new GH_Path(p));
            //hTs.Add(null, new GH_Path(p));
            hDists.Add(null, new GH_Path(p));
          }



        }
      }

      hitCounts = hCounts;
      if (showPts) hitPts = hPts;
      hitDists = hDists;
    }
# ---------- end c_script ----------
c_script_2 = CSharpScript(
    thetaCrop=theta_crop_3,
    pxWidth=px_width_4,
    pxHeight=px_height_4,
    samplePlanes=sample_planes_2,
    radius=sphere_radius_in_meters)  # -> out, A; inputs thetaCrop: Double, pxWidth: Int32, pxHeight: Int32, samplePlanes: list of Plane, radius: Double
# ---------- c_script_2: C# ----------
    Double nudge = RhinoDocument.ModelAbsoluteTolerance;
    Interval ivalPhi = new Interval(nudge, 2.0 * Math.PI - nudge);
    Interval ivalTheta = new Interval(thetaCrop, Math.PI - thetaCrop);
    List<Brep> retBreps = new List<Brep>();
    List<Curve> retCrvs = new List<Curve>();

    for (int p = 0; p < samplePlanes.Count; p++){
      Plane samplePlane = samplePlanes[p];
      List<Curve> crvs = new List<Curve>();
      for (int xi = 0; xi < pxWidth; xi++){
        List<Point3d> pts = new List<Point3d>();
        for (int yi = 0; yi < pxHeight; yi++){
          Double phi = ivalPhi.ParameterAt((Double) xi / (Double) (pxWidth - 1));
          Double theta = ivalTheta.ParameterAt((Double) yi / (Double) (pxHeight - 1));

          Double x = radius * Math.Sin(theta) * Math.Cos(phi);
          Double y = radius * Math.Sin(theta) * Math.Sin(phi);
          Double z = radius * Math.Cos(theta);

          Point3d pt = samplePlane.PointAt(x, y, z);
          pts.Add(pt);


        }

        Curve cv = Curve.CreateInterpolatedCurve(pts, 3);
        crvs.Add(cv);
        retCrvs.Add(cv);
      }

      Brep[] breps = Brep.CreateFromLoft(crvs, Point3d.Unset, Point3d.Unset, LoftType.Normal, true);
      retBreps.Add(breps[0]);
    }

    A = retBreps;
    //B = retCrvs;
# ---------- end c_script_2 ----------
panel = Panel(c_script.out)
sqrt = SquareRoot(Value=c_script.hitDists)
nullrep = ReplaceNulls(Items=sqrt, Replacements="1.0")  # -> Items, Count
gradient = Gradient(LowerLimit=0, UpperLimit=1, Parameter=nullrep.Items, stops=[0: RGB(255, 255, 255), 1: RGB(0, 0, 0)])
tstat = TreeStatistics(Tree=simplify(gradient))  # -> Paths, Length, Count
filename = Panel("test")
series = Series(Start=0, Step=1, Count=tstat.Count)
expression = Expression(x=series, y=filename, Expression="Format(\"{1}_{0:0000}\", x, y)")
txt = Text(graft(expression))
px_height_5 = Integer(px_height_2)
px_width_5 = Integer(px_width_2)

# ---- group: PATH TO LOCAL IMAGE
path = FilePath("C:\Users\ksteinfe\Desktop\")

# ----
c_script_3 = CSharpScript(doSave=Button(), savepath=path, filename=txt, pxColors=gradient, pxWidth=px_width_5, pxHeight=px_height_5)  # -> out, A; inputs doSave: Boolean, savepath: String, filename: String, pxColors: list of Color, pxWidth: Int32, pxHeight: Int32
# ---------- c_script_3: C# ----------
    if (!doSave) return;

    if (pxColors.Count != pxWidth * pxHeight) {
      String msg = "Pixel dimension does not match number of colors provided!";
      Print(msg);
      Component.AddRuntimeMessage(GH_RuntimeMessageLevel.Error, msg);
      //GrasshopperDocument.RequestAbortSolution();
      return;
    }

    System.Drawing.Bitmap img = new Bitmap(pxWidth, pxHeight);

    for (var i = 0; i < pxColors.Count; i++) {
      int y = i % pxHeight;
      int x = i / pxHeight;
      //Print(String.Format("{0},{1}", x.ToString(), y.ToString()));
      img.SetPixel(x, y, pxColors[i]);
    }
    img.Save(savepath + filename + ".png", System.Drawing.Imaging.ImageFormat.Png);


    A = img;
# ---------- end c_script_3 ----------

# ==== cluster Cluster
breps = ClusterInput()
breps_2 = Brep(breps)
bbox = BoundingBox(Content=breps_2, Plane=PlaneXY(0, 0, 0), UnionBox=True)  # -> Box, Box_2
debox = DeconstructBox(Box=bbox.Box)  # -> Plane, X, Y, Z
dedomain = DeconstructDomain(Domain=debox.X)  # -> Start, End
dedomain_2 = DeconstructDomain(Domain=debox.Y)  # -> Start, End
avr = Average(Input=[dedomain.Start, dedomain.End])
subtraction = Subtraction(A=dedomain.End, B=dedomain.Start)
avr_2 = Average(Input=[dedomain_2.Start, dedomain_2.End])
subtraction_2 = Subtraction(A=dedomain_2.End, B=dedomain_2.Start)
multiplication = Multiplication(A=subtraction, B="1000")
multiplication_2 = Multiplication(A=subtraction_2, B="1000")
pt = ConstructPoint(XCoordinate=avr, YCoordinate=avr_2, ZCoordinate=expr("-x", "1"))
max = Maximum(A=subtraction, B=subtraction_2)
max_dim = Number(max)
box = CenterBox(Base=pt, X=multiplication, Y=multiplication_2, Z="1")
ground = Box(box)
max_dim_2 = ClusterOutput(max_dim)
ground_2 = ClusterOutput(ground)
