# Grasshopper definition 180213 massing.gh (Grasshopper 1.0.4)

image_tiling = ValueList({"1 row per plane": 4, "2 rows per plane": 16, "3 rows per plane (DON'T DO IT)": 36}, selected="1 row per plane")
mesh = Mesh([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])
mesh_2 = Mesh(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)
number_slider = Slider(10, range=3..40)
slices_per_plane = Panel(image_tiling)
gnd_cut_msh = Mesh(mesh_2)
mass_mshs = Mesh(mesh)
expression = Expression(x=number_slider, y=slices_per_plane, Expression="Format(\"{0}x{0} px\", x*y)")
c_script = CSharpScript(masses=mass_mshs, grndVoids=gnd_cut_msh, pad=Slider(0.125, range=0..0.25))  # -> out, cutBox, ground, dim, depth; inputs masses: list of Mesh, grndVoids: list of Mesh, pad: Double
# ---------- c_script: C# ----------
    List<Mesh> mshs = new List<Mesh>();
    mshs.AddRange(masses);
    mshs.AddRange(grndVoids);


    // Find center of mass
    //
    VolumeMassProperties vmp = null;
    foreach (Mesh msh in mshs){
      if (vmp == null) vmp = VolumeMassProperties.Compute(msh);
      else vmp.Sum(VolumeMassProperties.Compute(msh));
    }

    // Find best rotation in xy plane
    //
    int cnt = 360;
    Double bestRot = 0;
    Double bestVol = Double.MaxValue;
    for (int n = 0; n < cnt; n++){
      Double rot = Math.PI * n / cnt;
      BoundingBox ubx = new BoundingBox();
      foreach (Mesh msh in mshs){
        Transform xf = Transform.Rotation(rot, vmp.Centroid);
        BoundingBox bx = msh.GetBoundingBox(xf);
        ubx.Union(bx);
      }
      if (ubx.Volume < bestVol) {
        bestVol = ubx.Volume;
        bestRot = rot;
      }
    }
    //Print(bestRot.ToString());

    // Construct base plane at center of mass in XY, at Z=0
    //
    Plane bPln = new Plane(vmp.Centroid, new Vector3d(0, 0, 1));
    bPln.Rotate(-bestRot, bPln.Normal);
    bPln.Translate(new Vector3d(0, 0, -bPln.Origin.Z));

    // Construct bounding intervals on plane
    //
    BoundingBox bBox = new BoundingBox();
    foreach (Mesh msh in mshs) bBox.Union(msh.GetBoundingBox(bPln));

    Double diagDim = (new Vector2d(bBox.Diagonal.X, bBox.Diagonal.Y)).Length;
    dim = diagDim;
    cutBox = bBox;

    Interval ival_x = new Interval(bBox.Min.X, bBox.Max.X);
    Interval ival_y = new Interval(bBox.Min.Y, bBox.Max.Y);
    Interval ival_z = new Interval(bBox.Min.Z, bBox.Max.Z);

    ival_x = scaleIval(ival_x, (1 + pad));
    ival_y = scaleIval(ival_y, (1 + pad));
    ival_z.T1 = ival_z.T1 + ival_z.Length * pad;

    Box cBox = new Box(bPln, ival_x, ival_y, ival_z);
    cutBox = cBox;

    Plane basePlane = new Plane(cBox.PointAt(0.5, 0.5, 0), bPln.XAxis, bPln.YAxis);
    basePlane.Translate(new Vector3d(0, 0, -Math.Abs(cBox.Z.T0)));

    Cylinder cyl = new Rhino.Geometry.Cylinder(
      new Circle(basePlane, diagDim * (0.75 + pad)), // ensure overlap
      Math.Abs(cBox.Z.T0) * (2 - RhinoDocument.ModelAbsoluteTolerance * 10)// this might ensure that the meshes don't align perfectly, which is better for booleans.
      );

    Mesh mCyl = Mesh.CreateFromBrep(cyl.ToBrep(true, true), new MeshingParameters())[0];
    mCyl = Mesh.CreateFromCylinder(cyl, 1, 36);

    //foreach (Mesh msh in grndVoids) msh.Faces.ConvertQuadsToTriangles();

    Mesh cutGround = Mesh.CreateBooleanDifference(new List<Mesh>(new Mesh[] {mCyl}), grndVoids)[0];



    ground = cutGround;

    /*
    ival_z.Grow(-bPln.Origin.Z);
    Double maxDim = Math.Max(Math.Max(ival_x.Length, ival_y.Length), ival_z.Length);

    Box cBox = new Box(bPln, ival_x, ival_y, ival_z);
    cutBox = cBox;
    dim = cBox.Z.Length;
    depth = Math.Abs(cBox.Z.T0);

    Plane basePlane = new Plane(cBox.PointAt(0.5, 0.5, 0), bPln.XAxis, bPln.YAxis);
    basePlane.Translate(new Vector3d(0, 0, -Math.Abs(cBox.Z.T0)));

    Cylinder cyl = new Rhino.Geometry.Cylinder(
      new Circle(basePlane, Math.Sqrt(Math.Pow(ival_x.Length, 2) + Math.Pow(ival_y.Length, 2))),
      Math.Abs(cBox.Z.T0) * 2
      );

    Mesh mCyl = Mesh.CreateFromBrep(cyl.ToBrep(true, true), new MeshingParameters())[0];
    mCyl = Mesh.CreateFromCylinder(cyl, 30, 30);

    Mesh cutGround = Mesh.CreateBooleanDifference(new List<Mesh>(new Mesh[] {mCyl}), grndVoids)[0];

    ground = cutGround;

 */
# ---------- c_script: C# additional code ----------
  Interval scaleIval(Interval ival, Double fac){
    Double delt = ival.Length * fac - ival.Length;
    //if (fixMin) return new Interval(ival.T0, ival.T1 + delt);
    return new Interval(ival.T0 - delt / 2, ival.T1 + delt / 2);
  }
# ---------- end c_script ----------
c_script_2 = CSharpScript()  # -> out, cutBox, ground, dim, depth; inputs masses: list of Mesh, grndVoids: list of Mesh, pad: Double; disabled
# ---------- c_script_2: C# ----------
    List<Mesh> mshs = new List<Mesh>();
    mshs.AddRange(masses);
    mshs.AddRange(grndVoids);


    // Find center of mass
    //
    VolumeMassProperties vmp = null;
    foreach (Mesh msh in mshs){
      if (vmp == null) vmp = VolumeMassProperties.Compute(msh);
      else vmp.Sum(VolumeMassProperties.Compute(msh));
    }

    // Find best rotation in xy plane
    //
    int cnt = 360;
    Double bestRot = 0;
    Double bestVol = Double.MaxValue;
    for (int n = 0; n < cnt; n++){
      Double rot = Math.PI * n / cnt;
      BoundingBox ubx = new BoundingBox();
      foreach (Mesh msh in mshs){
        Transform xf = Transform.Rotation(rot, vmp.Centroid);
        BoundingBox bx = msh.GetBoundingBox(xf);
        ubx.Union(bx);
      }
      if (ubx.Volume < bestVol) {
        bestVol = ubx.Volume;
        bestRot = rot;
      }
    }
    Print(bestRot.ToString());

    // Construct base plane at center of mass in XY, at Z=0
    //
    Plane bPln = new Plane(vmp.Centroid, new Vector3d(0, 0, 1));
    bPln.Rotate(-bestRot, bPln.Normal);
    bPln.Translate(new Vector3d(0, 0, -bPln.Origin.Z));

    // Construct bounding intervals on plane
    //
    BoundingBox bBox = new BoundingBox();
    foreach (Mesh msh in mshs) bBox.Union(msh.GetBoundingBox(bPln));

    dim = (new Vector2d(bBox.Diagonal.X, bBox.Diagonal.Y)).Length;
    cutBox = bBox;

    /*
    Interval ival_x = new Interval(bBox.Min.X, bBox.Max.X);
    Interval ival_y = new Interval(bBox.Min.Y, bBox.Max.Y);
    Interval ival_z = new Interval(bBox.Min.Z, bBox.Max.Z);
    ival_z.Grow(-bPln.Origin.Z);

    Double maxDim = Math.Max(Math.Max(ival_x.Length, ival_y.Length), ival_z.Length);

    ival_x = scaleIval(ival_x, maxDim / ival_x.Length * (1 + pad));
    ival_y = scaleIval(ival_y, maxDim / ival_y.Length * (1 + pad));
    ival_z = scaleIval(ival_z, maxDim / ival_z.Length * (1 + pad), true);


    Box cBox = new Box(bPln, ival_x, ival_y, ival_z);
    cutBox = cBox;
    dim = cBox.Z.Length;
    depth = Math.Abs(cBox.Z.T0);

    Plane basePlane = new Plane(cBox.PointAt(0.5, 0.5, 0), bPln.XAxis, bPln.YAxis);
    basePlane.Translate(new Vector3d(0, 0, -Math.Abs(cBox.Z.T0)));

    Cylinder cyl = new Rhino.Geometry.Cylinder(
      new Circle(basePlane, Math.Sqrt(Math.Pow(ival_x.Length, 2) + Math.Pow(ival_y.Length, 2))),
      Math.Abs(cBox.Z.T0) * 2
      );

    Mesh mCyl = Mesh.CreateFromBrep(cyl.ToBrep(true, true), new MeshingParameters())[0];
    mCyl = Mesh.CreateFromCylinder(cyl, 30, 30);

    Mesh cutGround = Mesh.CreateBooleanDifference(new List<Mesh>(new Mesh[] {mCyl}), grndVoids)[0];

    ground = cutGround;

 */
# ---------- c_script_2: C# additional code ----------
  Interval scaleIval(Interval ival, Double fac, Boolean fixMin = false){
    Double delt = ival.Length * fac - ival.Length;
    if (fixMin) return new Interval(ival.T0, ival.T1 + delt);
    return new Interval(ival.T0 - delt / 2, ival.T1 + delt / 2);
  }
# ---------- end c_script_2 ----------
grndmsh = Mesh(c_script.ground)
box = Box(c_script.cutBox)
training_image_size = Panel(expression)
c_script_3 = CSharpScript(cutBox=c_script.cutBox, pxCnt=number_slider, sliceCnt=slices_per_plane)  # -> out, basePlanes, sampleRays; inputs cutBox: Box, pxCnt: Int32, sliceCnt: Int32
# ---------- c_script_3: C# ----------
    List<Plane> plns = new List<Plane>();

    Plane plnXY = new Plane(cutBox.PointAt(0.5, 0.5, 1.0), cutBox.Plane.XAxis, cutBox.Plane.YAxis);
    Plane plnXZ = new Plane(cutBox.PointAt(0.5, 0.0, 0.5), cutBox.Plane.XAxis, cutBox.Plane.ZAxis);
    Plane plnYZ = new Plane(cutBox.PointAt(0.0, 0.5, 0.5), -cutBox.Plane.YAxis, cutBox.Plane.ZAxis);
    Plane plnOB = new Plane(cutBox.PointAt(0.0, 0.0, 0.5), cutBox.PointAt(1, 0, 0) - cutBox.PointAt(0, 1, 0), cutBox.Plane.ZAxis);

    // center planes
    //plnXY.Origin = plnXY.ClosestPoint(cutBox.Plane.Origin);

    plns.AddRange(new Plane[] {plnXY, plnXZ, plnYZ, plnOB});

    basePlanes = plns;

    DataTree<Ray3d> rays = new DataTree<Ray3d>();
    rays.MergeTree(plotRays(0, plnXY, cutBox, pxCnt - 1, sliceCnt - 1));
    rays.MergeTree(plotRays(1, plnXZ, cutBox, pxCnt - 1, sliceCnt - 1));
    rays.MergeTree(plotRays(2, plnYZ, cutBox, pxCnt - 1, sliceCnt - 1));
    rays.MergeTree(plotRays(3, plnOB, cutBox, pxCnt - 1, sliceCnt - 1));
    sampleRays = rays;

    /*
    DataTree<Point3d> pts = new DataTree<Point3d>();
    foreach(GH_Path pth in rays.Paths){
      foreach(Ray3d ray in rays.Branch(pth)){
        pts.Add(ray.Position, pth);
      }
    }

    samplePts = pts;
*/
# ---------- c_script_3: C# additional code ----------
  private DataTree<Ray3d> plotRays(int pth, Plane pln, Box bx, int pxCount, int slCount){
    int cntU = pxCount;
    int cntV = cntU;
    int cntW = slCount;

    Interval[] ivals = boxIntervals(pln, bx);
    Interval ival_u = ivals[0];
    Interval ival_v = ivals[1];
    Interval ival_w = ivals[2];

    DataTree<Ray3d> pts = new DataTree<Ray3d>();

    //Print(ival_u.T0.ToString() + " -> " + ival_u.T1.ToString());
    //Print(ival_v.T0.ToString() + " -> " + ival_v.T1.ToString());

    int zi = 0;
    for (int wi = cntW; wi >= 0; wi--){
      Double w = ival_w.ParameterAt(wi / (Double) cntW);
      for (int ui = 0; ui <= cntU; ui++){
        Double u = ival_u.ParameterAt(ui / (Double) cntU);
        for (int vi = cntV; vi >= 0; vi--){
          Double v = ival_v.ParameterAt(vi / (Double) cntV);

          pts.Add(new Ray3d(pln.PointAt(u, v, w), pln.Normal), new GH_Path(new int[] {pth, zi}));

        }
      }
      zi++;
    }
    return pts;

  }


  private Interval[] boxIntervals(Plane pln, Box bx){

    Interval ival_u = new Interval(Double.MaxValue, Double.MinValue);
    Interval ival_v = new Interval(Double.MaxValue, Double.MinValue);
    Interval ival_w = new Interval(Double.MaxValue, Double.MinValue);
    foreach (Point3d pt in bx.GetCorners()){
      Double u;
      Double v;
      pln.ClosestParameter(pt, out u, out v);
      Double w = pln.DistanceTo(pt);

      if (u < ival_u.T0) ival_u.T0 = u;
      if (u > ival_u.T1) ival_u.T1 = u;
      if (v < ival_v.T0) ival_v.T0 = v;
      if (v > ival_v.T1) ival_v.T1 = v;
      if (w < ival_w.T0) ival_w.T0 = w;
      if (w > ival_w.T1) ival_w.T1 = w;
    }

    return new Interval[]{ival_u,ival_v,ival_w};

  }
# ---------- end c_script_3 ----------
mass_mshs_2 = Mesh(mass_mshs)
branch = TreeBranch(Tree=c_script_3.sampleRays, Path="0;0", MaintainPaths=True)
c_script_4 = CSharpScript(sampleRays=branch, massMshs=mass_mshs_2, grndMsh=grndmsh)  # -> out, A, B; inputs sampleRays: tree, massMshs: list of Mesh, grndMsh: Mesh
# ---------- c_script_4: C# ----------
    List<Mesh> allMshs = new List<Mesh>(massMshs);
    allMshs.Add(grndMsh);
    Print(allMshs.Count.ToString());



    DataTree<Point3d> ptsIn = new DataTree<Point3d>();
    DataTree<Point3d> ptsOut = new DataTree<Point3d>();
    DataTree<Point3d> ptsProj = new DataTree<Point3d>();
    DataTree<Line> segsProj = new DataTree<Line>();
    DataTree<Double> dists = new DataTree<Double>();

    foreach(GH_Path pth in sampleRays.Paths){
      foreach(Ray3d ray in sampleRays.Branch(pth)){
        bool isInside = false;
        if ( grndMsh.IsPointInside(ray.Position, RhinoDocument.ModelAbsoluteTolerance, false)){
          ptsIn.Add(ray.Position, pth);
          dists.Add(-2, pth);
          isInside = true;
          continue;
        }

        foreach(Mesh msh in massMshs){
          if ( msh.IsPointInside(ray.Position, RhinoDocument.ModelAbsoluteTolerance, false)){
            ptsIn.Add(ray.Position, pth);
            dists.Add(-1, pth);
            isInside = true;
            break;
          }
        }

        if (!isInside){
          ptsOut.Add(ray.Position, pth);
          dists.Add(1, pth);



          Point3d[] proj = Rhino.Geometry.Intersect.Intersection.ProjectPointsToMeshes(
            allMshs,
            new List<Point3d> {ray.Position},
            ray.Direction,
            doc.ModelAbsoluteTolerance
            );
          if (proj.Length > 0) {
            Double[] dists = from Point3d pt in proj select pt.DistanceTo(ray.Position);
            

            ptsProj.Add(proj[0]);
            segsProj.Add(new Line(ray.Position, proj[0]));
          } else {

          }

        }

      }
    }

    A = ptsProj;
    B = segsProj;
# ---------- end c_script_4 ----------
panel = Panel(c_script_4.out)
panel_2 = Panel(c_script_4.A)
