# Grasshopper definition 180214 massing.gh (Grasshopper 1.0.4)

image_tiling = ValueList({"1 row per plane": 4, "2 rows per plane": 16, "3 rows per plane (DON'T DO IT)": 36}, selected="1 row per plane")

mesh = Mesh([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])
mesh_2 = Mesh(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)

gnd_cut_msh = Mesh(mesh_2)
mass_mshs = Mesh(mesh)
c_script = CSharpScript(masses=mass_mshs, grndVoids=gnd_cut_msh, pad=Slider(0.125, range=0..0.25))  # -> out, cutBox, ground, maxDim, depth; inputs masses: list of Mesh, grndVoids: list of Mesh, pad: Double
# ---------- c_script: C# ----------
    List<Mesh> mshs = new List<Mesh>();
    mshs.AddRange(masses);
    mshs.AddRange(grndVoids);


    // Find center of mass
    //
    VolumeMassProperties vmp = null;
    foreach (Mesh msh in mshs){
      if (vmp == null) vmp = VolumeMassProperties.Compute(msh);
      else vmp.Sum(VolumeMassProperties.Compute(msh));
    }

    // Find best rotation in xy plane
    //
    int cnt = 360;
    Double bestRot = 0;
    Double bestVol = Double.MaxValue;
    for (int n = 0; n < cnt; n++){
      Double rot = Math.PI * n / cnt;
      BoundingBox ubx = new BoundingBox();
      foreach (Mesh msh in mshs){
        Transform xf = Transform.Rotation(rot, vmp.Centroid);
        BoundingBox bx = msh.GetBoundingBox(xf);
        ubx.Union(bx);
      }
      if (ubx.Volume < bestVol) {
        bestVol = ubx.Volume;
        bestRot = rot;
      }
    }
    //Print(bestRot.ToString());

    // Construct base plane at center of mass in XY, at Z=0
    //
    Plane bPln = new Plane(vmp.Centroid, new Vector3d(0, 0, 1));
    bPln.Rotate(-bestRot, bPln.Normal);
    bPln.Translate(new Vector3d(0, 0, -bPln.Origin.Z));

    // Construct bounding intervals on plane
    //
    BoundingBox bBox = new BoundingBox();
    foreach (Mesh msh in mshs) bBox.Union(msh.GetBoundingBox(bPln));

    Double diagDim = (new Vector2d(bBox.Diagonal.X, bBox.Diagonal.Y)).Length;
    maxDim = diagDim;
    cutBox = bBox;

    Interval ival_x = new Interval(bBox.Min.X, bBox.Max.X);
    Interval ival_y = new Interval(bBox.Min.Y, bBox.Max.Y);
    Interval ival_z = new Interval(bBox.Min.Z, bBox.Max.Z);

    ival_x = scaleIval(ival_x, (1 + pad));
    ival_y = scaleIval(ival_y, (1 + pad));
    ival_z.T1 = ival_z.T1 + ival_z.Length * pad;

    Box cBox = new Box(bPln, ival_x, ival_y, ival_z);
    cutBox = cBox;

    Plane basePlane = new Plane(cBox.PointAt(0.5, 0.5, 0), bPln.XAxis, bPln.YAxis);
    basePlane.Translate(new Vector3d(0, 0, -Math.Abs(cBox.Z.T0)));

    Cylinder cyl = new Rhino.Geometry.Cylinder(
      new Circle(basePlane, diagDim * (0.75 + pad)), // ensure overlap
      Math.Abs(cBox.Z.T0) * (2 - RhinoDocument.ModelAbsoluteTolerance * 10)// this might ensure that the meshes don't align perfectly, which is better for booleans.
      );

    Mesh mCyl = Mesh.CreateFromBrep(cyl.ToBrep(true, true), new MeshingParameters())[0];
    mCyl = Mesh.CreateFromCylinder(cyl, 1, 36);

    //foreach (Mesh msh in grndVoids) msh.Faces.ConvertQuadsToTriangles();

    Mesh cutGround = Mesh.CreateBooleanDifference(new List<Mesh>(new Mesh[] {mCyl}), grndVoids)[0];



    ground = cutGround;

    /*
    ival_z.Grow(-bPln.Origin.Z);
    Double maxDim = Math.Max(Math.Max(ival_x.Length, ival_y.Length), ival_z.Length);

    Box cBox = new Box(bPln, ival_x, ival_y, ival_z);
    cutBox = cBox;
    dim = cBox.Z.Length;
    depth = Math.Abs(cBox.Z.T0);

    Plane basePlane = new Plane(cBox.PointAt(0.5, 0.5, 0), bPln.XAxis, bPln.YAxis);
    basePlane.Translate(new Vector3d(0, 0, -Math.Abs(cBox.Z.T0)));

    Cylinder cyl = new Rhino.Geometry.Cylinder(
      new Circle(basePlane, Math.Sqrt(Math.Pow(ival_x.Length, 2) + Math.Pow(ival_y.Length, 2))),
      Math.Abs(cBox.Z.T0) * 2
      );

    Mesh mCyl = Mesh.CreateFromBrep(cyl.ToBrep(true, true), new MeshingParameters())[0];
    mCyl = Mesh.CreateFromCylinder(cyl, 30, 30);

    Mesh cutGround = Mesh.CreateBooleanDifference(new List<Mesh>(new Mesh[] {mCyl}), grndVoids)[0];

    ground = cutGround;

 */
# ---------- c_script: C# additional code ----------
  Interval scaleIval(Interval ival, Double fac){
    Double delt = ival.Length * fac - ival.Length;
    //if (fixMin) return new Interval(ival.T0, ival.T1 + delt);
    return new Interval(ival.T0 - delt / 2, ival.T1 + delt / 2);
  }
# ---------- end c_script ----------

# ----
# The number of slices per orientation plane.
# 
# Due to tiling, is limited to specific numbers: 4,16,32
slice_cnt = Integer(image_tiling)

# ----
# The pixel dimension of each slice. All slice images are square.
px_cnt = Integer(Slider(10, range=3..40))

grndmsh = Mesh(c_script.ground)
dom = ConstructDomain(DomainStart=0, DomainEnd=c_script.maxDim)
slices_per_plane = Panel(slice_cnt)
expression = Expression(x=px_cnt, y=slice_cnt, Expression="Format(\"{0}x{0} px\", x*y)")
hit_domain = Domain(dom)
slice_cnt_2 = Integer(slice_cnt)
px_cnt_2 = Integer(px_cnt)
c_script_2 = CSharpScript(cutBox=c_script.cutBox, pxCnt=px_cnt_2, sliceCnt=slice_cnt_2)  # -> out, basePlanes, sampleRays; inputs cutBox: Box, pxCnt: Int32, sliceCnt: Int32
# ---------- c_script_2: C# ----------
    List<Plane> plns = new List<Plane>();

    Plane plnXY = new Plane(cutBox.PointAt(0.5, 0.5, 1.0), cutBox.Plane.XAxis, cutBox.Plane.YAxis);
    Plane plnXZ = new Plane(cutBox.PointAt(0.5, 0.0, 0.5), cutBox.Plane.XAxis, cutBox.Plane.ZAxis);
    Plane plnYZ = new Plane(cutBox.PointAt(0.0, 0.5, 0.5), -cutBox.Plane.YAxis, cutBox.Plane.ZAxis);
    Plane plnOB = new Plane(cutBox.PointAt(0.0, 0.0, 0.5), cutBox.PointAt(1, 0, 0) - cutBox.PointAt(0, 1, 0), cutBox.Plane.ZAxis);

    // center planes
    //plnXY.Origin = plnXY.ClosestPoint(cutBox.Plane.Origin);

    plns.AddRange(new Plane[] {plnXY, plnXZ, plnYZ, plnOB});

    basePlanes = plns;

    DataTree<Ray3d> rays = new DataTree<Ray3d>();
    rays.MergeTree(plotRays(0, plnXY, cutBox, pxCnt - 1, sliceCnt - 1));
    rays.MergeTree(plotRays(1, plnXZ, cutBox, pxCnt - 1, sliceCnt - 1));
    rays.MergeTree(plotRays(2, plnYZ, cutBox, pxCnt - 1, sliceCnt - 1));
    rays.MergeTree(plotRays(3, plnOB, cutBox, pxCnt - 1, sliceCnt - 1));
    sampleRays = rays;

    /*
    DataTree<Point3d> pts = new DataTree<Point3d>();
    foreach(GH_Path pth in rays.Paths){
      foreach(Ray3d ray in rays.Branch(pth)){
        pts.Add(ray.Position, pth);
      }
    }

    samplePts = pts;
*/
# ---------- c_script_2: C# additional code ----------
  private DataTree<Ray3d> plotRays(int pth, Plane pln, Box bx, int pxCount, int slCount){
    int cntU = pxCount;
    int cntV = cntU;
    int cntW = slCount;

    Interval[] ivals = boxIntervals(pln, bx);
    Interval ival_u = ivals[0];
    Interval ival_v = ivals[1];
    Interval ival_w = ivals[2];

    DataTree<Ray3d> pts = new DataTree<Ray3d>();

    //Print(ival_u.T0.ToString() + " -> " + ival_u.T1.ToString());
    //Print(ival_v.T0.ToString() + " -> " + ival_v.T1.ToString());

    int zi = 0;
    for (int wi = cntW; wi >= 0; wi--){
      Double w = ival_w.ParameterAt(wi / (Double) cntW);
      for (int ui = 0; ui <= cntU; ui++){
        Double u = ival_u.ParameterAt(ui / (Double) cntU);
        for (int vi = cntV; vi >= 0; vi--){
          Double v = ival_v.ParameterAt(vi / (Double) cntV);

          pts.Add(new Ray3d(pln.PointAt(u, v, w), pln.Normal), new GH_Path(new int[] {pth, zi}));

        }
      }
      zi++;
    }
    return pts;

  }


  private Interval[] boxIntervals(Plane pln, Box bx){

    Interval ival_u = new Interval(Double.MaxValue, Double.MinValue);
    Interval ival_v = new Interval(Double.MaxValue, Double.MinValue);
    Interval ival_w = new Interval(Double.MaxValue, Double.MinValue);
    foreach (Point3d pt in bx.GetCorners()){
      Double u;
      Double v;
      pln.ClosestParameter(pt, out u, out v);
      Double w = pln.DistanceTo(pt);

      if (u < ival_u.T0) ival_u.T0 = u;
      if (u > ival_u.T1) ival_u.T1 = u;
      if (v < ival_v.T0) ival_v.T0 = v;
      if (v > ival_v.T1) ival_v.T1 = v;
      if (w < ival_w.T0) ival_w.T0 = w;
      if (w > ival_w.T1) ival_w.T1 = w;
    }

    return new Interval[]{ival_u,ival_v,ival_w};

  }
# ---------- end c_script_2 ----------
panel = Panel(hit_domain)
training_image_size = Panel(expression)
mass_mshs_2 = Mesh(mass_mshs)
grndmsh_2 = Mesh(grndmsh)
c_script_3 = CSharpScript(sampleRays=c_script_2.sampleRays, massMshs=mass_mshs_2, grndMsh=grndmsh_2, hitDomain=hit_domain)  # -> out, A, B, hitDists; inputs sampleRays: tree, massMshs: list of Mesh, grndMsh: Mesh
# ---------- c_script_3: C# ----------
    List<Mesh> allMshs = new List<Mesh>(massMshs);
    allMshs.Add(grndMsh);
    Print(allMshs.Count.ToString());



    DataTree<Point3d> ptsIn = new DataTree<Point3d>();
    DataTree<Point3d> ptsOut = new DataTree<Point3d>();
    //DataTree<Point3d> ptsProj = new DataTree<Point3d>();
    DataTree<Line> segsProj = new DataTree<Line>();
    DataTree<Double> hDists = new DataTree<Double>();

    foreach(GH_Path pth in sampleRays.Paths){
      foreach(Ray3d ray in sampleRays.Branch(pth)){
        bool isInside = false;
        if ( grndMsh.IsPointInside(ray.Position, RhinoDocument.ModelAbsoluteTolerance, false)){
          ptsIn.Add(ray.Position, pth);
          hDists.Add(-2, pth);
          isInside = true;
          continue;
        }

        foreach(Mesh msh in massMshs){
          if ( msh.IsPointInside(ray.Position, RhinoDocument.ModelAbsoluteTolerance, false)){
            ptsIn.Add(ray.Position, pth);
            hDists.Add(-1, pth);
            isInside = true;
            break;
          }
        }

        if (!isInside){
          ptsOut.Add(ray.Position, pth);

          Point3d[] proj = Rhino.Geometry.Intersect.Intersection.ProjectPointsToMeshes(
            allMshs,
            new List<Point3d> {ray.Position},
            ray.Direction,
            doc.ModelAbsoluteTolerance
            );
          if (proj.Length > 0) {
            Double[] dists = (from Point3d pt in proj select pt.DistanceTo(ray.Position)).ToArray();
            Array.Sort(dists, proj);

            Double normDist = hitDomain.NormalizedParameterAt(dists[0]);
            if (normDist > 1.0) normDist = 1.0;
            hDists.Add(normDist, pth);

            //ptsProj.Add(proj[0]);
            segsProj.Add(new Line(ray.Position, proj[0]));
          } else {
            hDists.Add(1.0, pth);
          }

        }

      }
    }

    A = ptsOut;
    B = segsProj;
    hitDists = hDists;
# ---------- end c_script_3 ----------
item = CherryPicker(c_script_3.A, ListIndex=0)
c_script_4 = CSharpScript(
    hitDists=c_script_3.hitDists,
    clrNear=ColourSwatch(SwatchColor=RGB(255, 255, 255)),
    clrFar=ColourSwatch(SwatchColor=RGB(0, 0, 0)),
    clrGround=ColourSwatch(SwatchColor=RGB(255, 0, 0)),
    clrMass=ColourSwatch(SwatchColor=RGB(0, 0, 255)))  # -> out, pxColors; inputs hitDists: tree of Double, clrNear: Color, clrFar: Color, clrGround: Color, clrMass: Color
# ---------- c_script_4: C# ----------
    DataTree<Color> clrOut = new DataTree<Color>();

    foreach(GH_Path pth in hitDists.Paths){
      foreach(Double dist in hitDists.Branch(pth)){    
        Color clr = Color.Magenta;
        if (dist >= 0){
          clr = ClrInterp(clrNear, clrFar, dist);
        }
        clrOut.Add(clr, pth);
      }
    }
    
    pxColors = clrOut;
# ---------- c_script_4: C# additional code ----------
  public static Color ClrInterp( Color c1,  Color c2, double t) {
    if (t < 0 || t > 1) throw new ArgumentOutOfRangeException("t");   
    return Color.FromArgb( (int) (c1.R + (c2.R-c1.R)*t), (int) (c1.G + (c2.G-c1.G)*t), (int) (c1.B + (c2.R-c1.B)*t));
  }
# ---------- end c_script_4 ----------
do_save_images = Boolean(Button())
do_save_images_2 = Boolean(do_save_images)
save_path = FilePath("C:\Users\kyle\Desktop\")
txt = Text("test")
c_script_5 = CSharpScript(doSave=do_save_images_2, savepath=save_path, filename=txt, pxColors=c_script_4.pxColors)  # -> out, A; inputs doSave: Boolean, savepath: String, filename: String, pxColors: tree of Color
# ---------- c_script_5: C# ----------
    //if (!doSave) return;

    int slicesPerDirection = validateSlices(pxColors);
    if (slicesPerDirection < 1) return;
    Print(slicesPerDirection.ToString() + " slices per direction");


    foreach(GH_Path pth in pxColors.Paths){
      List<Color> pxColorLst = pxColors.Branch(pth);
      int pxDim = validatePixels(pxColorLst);

      System.Drawing.Bitmap img = new Bitmap(pxDim, pxDim);

      if (pxDim > 0){
        for (var i = 0; i < pxColorLst.Count; i++) {
          int y = i % pxDim;
          int x = i / pxDim;
          //Print(String.Format("{0},{1}", x.ToString(), y.ToString()));
          img.SetPixel(x, y, pxColorLst[i]);
        }
        img.Save(savepath + filename + pth.ToString() + ".png", System.Drawing.Imaging.ImageFormat.Png);
      }
    }

    /*
    if (pxColors.Count != pxWidth * pxHeight) {
      String msg = "Pixel dimension does not match number of colors provided!";
      Print(msg);
      Component.AddRuntimeMessage(GH_RuntimeMessageLevel.Error, msg);
      //GrasshopperDocument.RequestAbortSolution();
      return;
    }


    System.Drawing.Bitmap img = new Bitmap(pxWidth, pxHeight);

    for (var i = 0; i < pxColors.Count; i++) {
      int y = i % pxHeight;
      int x = i / pxHeight;
      //Print(String.Format("{0},{1}", x.ToString(), y.ToString()));
      img.SetPixel(x, y, pxColors[i]);
    }
    img.Save(savepath + filename + ".png", System.Drawing.Imaging.ImageFormat.Png);


    A = img;
 */
# ---------- c_script_5: C# additional code ----------
  public int validatePixels(List<Color> pxColors){
    Double cnt = Math.Sqrt(pxColors.Count());
    //Print((cnt % 1.0).ToString());
    if (cnt % 1.0 != 0){
      raise("Pixel count is all wrong. This image is not square.");
      return -1;
    }
    return Convert.ToInt32(cnt);
  }

  public int validateSlices(DataTree<Color> pxColors){

    if ( pxColors.Paths.Count % 4 != 0 ){
      raise("Data Tree isn't structured properly. Number of slices not divisible by 4.");
      return -1;
    }
    int[] sliceCnts = new int[]{0,0,0,0};
    int slicesPerDirection = -1;
    foreach(GH_Path pth in pxColors.Paths){
      //Print(pth.ToString());
      int idx = pth.Indices[0];
      if (idx > 3){
        raise("Data Tree isn't structured properly. Maybe not the right number of slice directions? First index greater than 3.");
        return -1;
      }
      sliceCnts[idx]++;
    }
    if (sliceCnts.Any(i => i != 4 && i != 16 && i != 36)){
      Print(sliceCnts[0].ToString() + "," + sliceCnts[1].ToString() + "," + sliceCnts[2].ToString() + "," + sliceCnts[3].ToString());
      raise("Data Tree isn't structured properly. There should be 4 or 16 or 36 slices per direction.");
      return -1;
    } else {
      slicesPerDirection = sliceCnts[0];
    }


    // TODO: check the number of pixels in each slice

    return slicesPerDirection;
  }


  public void raise(String msg){
    Print(msg);
    Component.AddRuntimeMessage(GH_RuntimeMessageLevel.Error, msg);
  }
# ---------- end c_script_5 ----------
panel_2 = Panel(c_script_5.out)
