# Grasshopper definition 180215 massing broken.gh (Grasshopper 1.0.4)

# SAMPLING SETTINGS: Extra Coarse = 25 slices in a 200x200 image
# Coarse = 100 slices in a 400x400 image
# Medium = 225 slices in a 600x600 image
# Fine = 400 slices in a 800x800 image
# Extra Fine = 625 slices in a 1000x1000 image
sampling = ValueList({"Extra Coarse": 1, "Coarse": 2, "Medium": 3, "Fine": 4, "Extra Fine": 5}, selected="Extra Coarse")

mesh = Mesh(<mesh referenced from the Rhino model>)
mesh_2 = Mesh(<mesh referenced from the Rhino model>)

brep = Brep(<brep referenced from the Rhino model>)
mass_mshs = Mesh(mesh)
mesh_3 = Mesh(<mesh referenced from the Rhino model>)
c_script = CSharpScript(rowsPer=sampling)  # -> out, A; inputs rowsPer: Int32
# ---------- c_script: C# ----------
    if (rowsPer == 1) A = 5;
    else if (rowsPer == 2) A = 20;
    else if (rowsPer == 3) A = 45;
    else if (rowsPer == 4) A = 80;
    else if (rowsPer == 5) A = 125;
    else A = 5;
# ---------- end c_script ----------
gnd_cut_mshs = Mesh(mesh_2)

# ---- group: with ground voids
c_script_2 = CSharpScript(masses=mass_mshs)  # -> out, cutBox, ground, maxDim, depth; inputs masses: list of Mesh, grndVoids: list of Mesh, pad: Double
# ---------- c_script_2: C# ----------
    //List<Mesh> grndVoids = new List<Mesh>();

    List<Mesh> mshs = new List<Mesh>();
    mshs.AddRange(masses);
    if ((grndVoids != null) && (grndVoids.Count > 0)) mshs.AddRange(grndVoids);


    // Find center of mass
    //
    VolumeMassProperties vmp = null;
    foreach (Mesh msh in mshs){
      if (vmp == null) vmp = VolumeMassProperties.Compute(msh);
      else vmp.Sum(VolumeMassProperties.Compute(msh));
    }

    // Find best rotation in xy plane
    //
    int cnt = 360;
    Double bestRot = 0;
    Double bestVol = Double.MaxValue;
    for (int n = 0; n < cnt; n++){
      Double rot = Math.PI * n / cnt;
      BoundingBox ubx = new BoundingBox();
      foreach (Mesh msh in mshs){
        Transform xf = Transform.Rotation(rot, vmp.Centroid);
        BoundingBox bx = msh.GetBoundingBox(xf);
        ubx.Union(bx);
      }
      if (ubx.Volume < bestVol) {
        bestVol = ubx.Volume;
        bestRot = rot;
      }
    }
    //Print(bestRot.ToString());

    // Construct base plane at center of mass in XY, at Z=0
    //
    Plane bPln = new Plane(vmp.Centroid, new Vector3d(0, 0, 1));
    bPln.Rotate(-bestRot, bPln.Normal);
    bPln.Translate(new Vector3d(0, 0, -bPln.Origin.Z));

    // Construct bounding intervals on plane
    //
    BoundingBox bBox = new BoundingBox();
    foreach (Mesh msh in mshs) bBox.Union(msh.GetBoundingBox(bPln));

    Double diagDim = (new Vector2d(bBox.Diagonal.X, bBox.Diagonal.Y)).Length;
    maxDim = diagDim;
    cutBox = bBox;

    Interval ival_x = new Interval(bBox.Min.X, bBox.Max.X);
    Interval ival_y = new Interval(bBox.Min.Y, bBox.Max.Y);
    Interval ival_z = new Interval(bBox.Min.Z, bBox.Max.Z);

    ival_x = scaleIval(ival_x, (1 + pad));
    ival_y = scaleIval(ival_y, (1 + pad));
    ival_z.T1 = ival_z.T1 + ival_z.Length * pad;

    Box cBox = new Box(bPln, ival_x, ival_y, ival_z);
    cutBox = cBox;

    Plane basePlane = new Plane(cBox.PointAt(0.5, 0.5, 0), bPln.XAxis, bPln.YAxis);
    basePlane.Translate(new Vector3d(0, 0, -Math.Abs(cBox.Z.T0)));

    Cylinder cyl = new Rhino.Geometry.Cylinder(
      new Circle(basePlane, diagDim * (0.75 + pad)), // ensure overlap
      Math.Abs(cBox.Z.T0) * (2 - RhinoDocument.ModelAbsoluteTolerance * 10)// this might ensure that the meshes don't align perfectly, which is better for booleans.
      );

    Mesh mCyl = Mesh.CreateFromBrep(cyl.ToBrep(true, true), new MeshingParameters())[0];
    mCyl = Mesh.CreateFromCylinder(cyl, 1, 36);

    //foreach (Mesh msh in grndVoids) msh.Faces.ConvertQuadsToTriangles();

    if (grndVoids.Count > 0){
      Mesh cutGround = Mesh.CreateBooleanDifference(new List<Mesh>(new Mesh[] {mCyl}), grndVoids)[0];
      ground = cutGround;
    } else {
      ground = mCyl;
    }
    /*
    ival_z.Grow(-bPln.Origin.Z);
    Double maxDim = Math.Max(Math.Max(ival_x.Length, ival_y.Length), ival_z.Length);

    Box cBox = new Box(bPln, ival_x, ival_y, ival_z);
    cutBox = cBox;
    dim = cBox.Z.Length;
    depth = Math.Abs(cBox.Z.T0);

    Plane basePlane = new Plane(cBox.PointAt(0.5, 0.5, 0), bPln.XAxis, bPln.YAxis);
    basePlane.Translate(new Vector3d(0, 0, -Math.Abs(cBox.Z.T0)));

    Cylinder cyl = new Rhino.Geometry.Cylinder(
      new Circle(basePlane, Math.Sqrt(Math.Pow(ival_x.Length, 2) + Math.Pow(ival_y.Length, 2))),
      Math.Abs(cBox.Z.T0) * 2
      );

    Mesh mCyl = Mesh.CreateFromBrep(cyl.ToBrep(true, true), new MeshingParameters())[0];
    mCyl = Mesh.CreateFromCylinder(cyl, 30, 30);

    Mesh cutGround = Mesh.CreateBooleanDifference(new List<Mesh>(new Mesh[] {mCyl}), grndVoids)[0];

    ground = cutGround;

 */
# ---------- c_script_2: C# additional code ----------
  Interval scaleIval(Interval ival, Double fac){
    Double delt = ival.Length * fac - ival.Length;
    //if (fixMin) return new Interval(ival.T0, ival.T1 + delt);
    return new Interval(ival.T0 - delt / 2, ival.T1 + delt / 2);
  }
# ---------- end c_script_2 ----------

# ----
c_script_3 = CSharpScript(masses=mass_mshs, pad=Slider(0.125, range=0..0.25))  # -> out, cutBox, ground, maxDim, depth; inputs masses: list of Mesh, pad: Double
# ---------- c_script_3: C# ----------
    List<Mesh> grndVoids = new List<Mesh>();

    List<Mesh> mshs = new List<Mesh>();
    mshs.AddRange(masses);
    //if ((grndVoids != null) && (grndVoids.Count > 0)) mshs.AddRange(grndVoids);


    // Find center of mass
    //
    VolumeMassProperties vmp = null;
    foreach (Mesh msh in mshs){
      if (vmp == null) {
        vmp = VolumeMassProperties.Compute(msh);
      }
      else vmp.Sum(VolumeMassProperties.Compute(msh));
    }

    // Find best rotation in xy plane
    //
    int cnt = 360;
    Double bestRot = 0;
    Double bestVol = Double.MaxValue;
    for (int n = 0; n < cnt; n++){
      Double rot = Math.PI * n / cnt;
      BoundingBox ubx = new BoundingBox();
      foreach (Mesh msh in mshs){
        Transform xf = Transform.Rotation(rot, vmp.Centroid);
        BoundingBox bx = msh.GetBoundingBox(xf);
        ubx.Union(bx);
      }
      if (ubx.Volume < bestVol) {
        bestVol = ubx.Volume;
        bestRot = rot;
      }
    }
    //Print(bestRot.ToString());

    // Construct base plane at center of mass in XY, at Z=0
    //
    Plane bPln = new Plane(vmp.Centroid, new Vector3d(0, 0, 1));
    bPln.Rotate(-bestRot, bPln.Normal);
    bPln.Translate(new Vector3d(0, 0, -bPln.Origin.Z));

    // Construct bounding intervals on plane
    //
    BoundingBox bBox = new BoundingBox();
    foreach (Mesh msh in mshs) bBox.Union(msh.GetBoundingBox(bPln));

    Double diagDim = (new Vector2d(bBox.Diagonal.X, bBox.Diagonal.Y)).Length;
    maxDim = diagDim;
    cutBox = bBox;

    Interval ival_x = new Interval(bBox.Min.X, bBox.Max.X);
    Interval ival_y = new Interval(bBox.Min.Y, bBox.Max.Y);
    Interval ival_z = new Interval(bBox.Min.Z, bBox.Max.Z);

    ival_x = scaleIval(ival_x, (1 + pad));
    ival_y = scaleIval(ival_y, (1 + pad));
    ival_z.T1 = ival_z.T1 + ival_z.Length * pad;

    Box cBox = new Box(bPln, ival_x, ival_y, ival_z);
    cutBox = cBox;

    Plane basePlane = new Plane(cBox.PointAt(0.5, 0.5, 0), bPln.XAxis, bPln.YAxis);
    basePlane.Translate(new Vector3d(0, 0, -Math.Abs(cBox.Z.T0)));

    Cylinder cyl = new Rhino.Geometry.Cylinder(
      new Circle(basePlane, diagDim * (0.75 + pad)), // ensure overlap
      Math.Abs(cBox.Z.T0) * (2 - RhinoDocument.ModelAbsoluteTolerance * 10)// this might ensure that the meshes don't align perfectly, which is better for booleans.
      );

    Mesh mCyl = Mesh.CreateFromBrep(cyl.ToBrep(true, true), new MeshingParameters())[0];
    mCyl = Mesh.CreateFromCylinder(cyl, 1, 36);

    //foreach (Mesh msh in grndVoids) msh.Faces.ConvertQuadsToTriangles();

    if (grndVoids.Count > 0){
      Mesh cutGround = Mesh.CreateBooleanDifference(new List<Mesh>(new Mesh[] {mCyl}), grndVoids)[0];
      ground = cutGround;
    } else {
      ground = mCyl;
    }
    /*
    ival_z.Grow(-bPln.Origin.Z);
    Double maxDim = Math.Max(Math.Max(ival_x.Length, ival_y.Length), ival_z.Length);

    Box cBox = new Box(bPln, ival_x, ival_y, ival_z);
    cutBox = cBox;
    dim = cBox.Z.Length;
    depth = Math.Abs(cBox.Z.T0);

    Plane basePlane = new Plane(cBox.PointAt(0.5, 0.5, 0), bPln.XAxis, bPln.YAxis);
    basePlane.Translate(new Vector3d(0, 0, -Math.Abs(cBox.Z.T0)));

    Cylinder cyl = new Rhino.Geometry.Cylinder(
      new Circle(basePlane, Math.Sqrt(Math.Pow(ival_x.Length, 2) + Math.Pow(ival_y.Length, 2))),
      Math.Abs(cBox.Z.T0) * 2
      );

    Mesh mCyl = Mesh.CreateFromBrep(cyl.ToBrep(true, true), new MeshingParameters())[0];
    mCyl = Mesh.CreateFromCylinder(cyl, 30, 30);

    Mesh cutGround = Mesh.CreateBooleanDifference(new List<Mesh>(new Mesh[] {mCyl}), grndVoids)[0];

    ground = cutGround;

 */
# ---------- c_script_3: C# additional code ----------
  Interval scaleIval(Interval ival, Double fac){
    Double delt = ival.Length * fac - ival.Length;
    //if (fixMin) return new Interval(ival.T0, ival.T1 + delt);
    return new Interval(ival.T0 - delt / 2, ival.T1 + delt / 2);
  }
# ---------- end c_script_3 ----------
division = Division(A=c_script.A, B=sampling)

# ----
# The number of slices per orientation plane.
# 
# Due to tiling, is limited to specific numbers: 5,20,45,80,125
slice_cnt = Integer(c_script.A)

# ----
# The pixel dimension of each slice. All slice images are square.
px_cnt = Integer(Slider(40, range=3..40))

grndmsh = Mesh(c_script_3.ground)
dom = ConstructDomain(DomainStart=0, DomainEnd=c_script_3.maxDim)
tile_rows_per_plane = Panel(sampling)
slices_per_plane = Panel(slice_cnt)
box = Box(c_script_3.cutBox)
hit_domain = Domain(dom)
expression = Expression(x=px_cnt, y=division, Expression="Format(\"{0}x{0} px\", x*y)")
panel = Panel(c_script_3.out)
panel_2 = Panel(hit_domain)
mass_mshs_2 = Mesh(mass_mshs)
slice_cnt_2 = Integer(slice_cnt)
px_cnt_2 = Integer(px_cnt)
c_script_4 = CSharpScript(
    showRays=Toggle(False),
    cutBox=c_script_3.cutBox,
    pxCnt=px_cnt_2,
    sliceCnt=slice_cnt_2,
    massMshs=mass_mshs_2,
    grndMsh=grndmsh,
    hitDomain=hit_domain)  # -> out, basePlanes, sampleRays, hitDists; inputs showRays: Boolean, cutBox: Box, pxCnt: Int32, sliceCnt: Int32, massMshs: list of Mesh, grndMsh: Mesh
# ---------- c_script_4: C# ----------
    List<Mesh> allMshs = new List<Mesh>(massMshs);
    allMshs.Add(grndMsh);
    //Print(allMshs.Count.ToString());

    // DEFINE CUT PLANES
    //
    List<Plane> plns = new List<Plane>();
    Plane plnXY = new Plane(cutBox.PointAt(0.5, 0.5, 1.0), cutBox.Plane.XAxis, cutBox.Plane.YAxis);
    Plane plnXZ = new Plane(cutBox.PointAt(0.5, 0.0, 0.5), cutBox.Plane.XAxis, cutBox.Plane.ZAxis);
    Plane plnYZ = new Plane(cutBox.PointAt(0.0, 0.5, 0.5), -cutBox.Plane.YAxis, cutBox.Plane.ZAxis);
    Plane plnOA = new Plane(cutBox.PointAt(0.0, 0.0, 0.5), cutBox.PointAt(1, 0, 0) - cutBox.PointAt(0, 1, 0), cutBox.Plane.ZAxis);
    Plane plnOB = new Plane(cutBox.PointAt(1.0, 0.0, 0.5), cutBox.PointAt(1, 1, 0) - cutBox.PointAt(0, 0, 0), cutBox.Plane.ZAxis);
    plns.AddRange(new Plane[] {plnXY, plnXZ, plnYZ, plnOA, plnOB});

    basePlanes = plns; // OUT

    // PLOT RAYS
    //
    DataTree<Ray3d> rays = new DataTree<Ray3d>();
    rays.MergeTree(plotRays(0, plnXY, cutBox, pxCnt - 1, sliceCnt - 1));
    rays.MergeTree(plotRays(1, plnXZ, cutBox, pxCnt - 1, sliceCnt - 1));
    rays.MergeTree(plotRays(2, plnYZ, cutBox, pxCnt - 1, sliceCnt - 1));
    rays.MergeTree(plotRays(3, plnOA, cutBox, pxCnt - 1, sliceCnt - 1));
    rays.MergeTree(plotRays(4, plnOB, cutBox, pxCnt - 1, sliceCnt - 1));

    if (showRays) sampleRays = rays; // OUT



    // TRACE RAYS
    //

    //DataTree<Point3d> ptsIn = new DataTree<Point3d>();
    //DataTree<Point3d> ptsOut = new DataTree<Point3d>();
    //DataTree<Point3d> ptsProj = new DataTree<Point3d>();
    //DataTree<Line> segsProj = new DataTree<Line>();
    DataTree<Double> hDists = new DataTree<Double>();

    foreach(GH_Path pth in rays.Paths){
      foreach(Ray3d ray in rays.Branch(pth)){
        bool isInside = false;
        if ( grndMsh.IsPointInside(ray.Position, RhinoDocument.ModelAbsoluteTolerance, false)){
          //ptsIn.Add(ray.Position, pth);
          hDists.Add(-2, pth);
          isInside = true;
          continue;
        }

        foreach(Mesh msh in massMshs){
          if ( msh.IsPointInside(ray.Position, RhinoDocument.ModelAbsoluteTolerance, false)){
            //ptsIn.Add(ray.Position, pth);
            hDists.Add(-1, pth);
            isInside = true;
            break;
          }
        }

        if (!isInside){
          //ptsOut.Add(ray.Position, pth);

          Point3d[] proj = Rhino.Geometry.Intersect.Intersection.ProjectPointsToMeshes(
            allMshs,
            new List<Point3d> {ray.Position},
            ray.Direction,
            doc.ModelAbsoluteTolerance
            );
          if (proj.Length > 0) {
            Double[] dists = (from Point3d pt in proj select pt.DistanceTo(ray.Position)).ToArray();
            Array.Sort(dists, proj);

            Double normDist = hitDomain.NormalizedParameterAt(dists[0]);
            if (normDist > 1.0) normDist = 1.0;
            hDists.Add(normDist, pth);

            //ptsProj.Add(proj[0]);
            //segsProj.Add(new Line(ray.Position, proj[0]));
          } else {
            hDists.Add(1.0, pth);
          }

        }

      }
    }

    hitDists = hDists;
# ---------- c_script_4: C# additional code ----------
  private DataTree<Ray3d> plotRays(int pth, Plane pln, Box bx, int pxCount, int slCount){
    int cntU = pxCount;
    int cntV = cntU;
    int cntW = slCount;

    Interval[] ivals = boxIntervals(pln, bx);
    Interval ival_u = ivals[0];
    Interval ival_v = ivals[1];
    Interval ival_w = ivals[2];

    DataTree<Ray3d> pts = new DataTree<Ray3d>();

    //Print(ival_u.T0.ToString() + " -> " + ival_u.T1.ToString());
    //Print(ival_v.T0.ToString() + " -> " + ival_v.T1.ToString());

    int zi = 0;
    Double epsilon = 0.001; // relative to normalized intervals
    for (int wi = cntW; wi >= 0; wi--){
      Double w = ival_w.ParameterAt(wi / (Double) cntW);

      // back a bit off the first and last planes
      if (wi == cntW) w = ival_w.ParameterAt(1.0 - epsilon);
      if (wi == 0) w = ival_w.ParameterAt(epsilon);

      for (int ui = 0; ui <= cntU; ui++){
        Double u = ival_u.ParameterAt(ui / (Double) cntU);
        for (int vi = cntV; vi >= 0; vi--){
          Double v = ival_v.ParameterAt(vi / (Double) cntV);

          pts.Add(new Ray3d(pln.PointAt(u, v, w), pln.Normal), new GH_Path(new int[] {pth, zi}));

        }
      }
      zi++;
    }
    return pts;

  }


  private Interval[] boxIntervals(Plane pln, Box bx){

    Interval ival_u = new Interval(Double.MaxValue, Double.MinValue);
    Interval ival_v = new Interval(Double.MaxValue, Double.MinValue);
    Interval ival_w = new Interval(Double.MaxValue, Double.MinValue);
    foreach (Point3d pt in bx.GetCorners()){
      Double u;
      Double v;
      pln.ClosestParameter(pt, out u, out v);
      Double w = pln.DistanceTo(pt);

      if (u < ival_u.T0) ival_u.T0 = u;
      if (u > ival_u.T1) ival_u.T1 = u;
      if (v < ival_v.T0) ival_v.T0 = v;
      if (v > ival_v.T1) ival_v.T1 = v;
      if (w < ival_w.T0) ival_w.T0 = w;
      if (w > ival_w.T1) ival_w.T1 = w;
    }

    return new Interval[]{ival_u,ival_v,ival_w};

  }
# ---------- end c_script_4 ----------
training_image_size = Panel(expression)
list = ValueList({"plnXY": 0, "plnXZ": 1, "plnYZ": 2, "plnOA": 3, "plnOB": 4}, selected="plnOA")
c_script_5 = CSharpScript(planeIdx=list, sliceIdx=Slider(11, range=0..19), sampleRays=c_script_4.sampleRays)  # -> out, A, B; inputs planeIdx: Int32, sliceIdx: Int32, sampleRays: tree
# ---------- c_script_5: C# ----------
    if (!sampleRays.PathExists(new GH_Path(new int[] {planeIdx,sliceIdx}))) return;
    
    List<object> rays = sampleRays.Branch(new GH_Path(new int[] {planeIdx,sliceIdx}));
    List<Point3d> pts = new List<Point3d>();
    List<Line> segs = new List<Line>();
    foreach (object obj in rays){
      Ray3d ray = (Ray3d) obj;
      pts.Add(ray.Position);
      segs.Add(new Line(ray.Position, ray.Position + ray.Direction));
    }
    
    A = pts;
    B = segs;
# ---------- end c_script_5 ----------
swatch = ColourSwatch(SwatchColor=RGB(255, 0, 0))
panel_3 = Panel(c_script_5.out)
c_script_6 = CSharpScript(
    hitDists=c_script_4.hitDists,
    clrNear=ColourSwatch(SwatchColor=RGB(255, 255, 255)),
    clrFar=ColourSwatch(SwatchColor=RGB(0, 0, 0)),
    clrGround=swatch,
    clrMass=swatch)  # -> out, pxColors; inputs hitDists: tree of Double, clrNear: Color, clrFar: Color, clrGround: Color, clrMass: Color
# ---------- c_script_6: C# ----------
    DataTree<Color> clrOut = new DataTree<Color>();

    foreach(GH_Path pth in hitDists.Paths){
      foreach(Double dist in hitDists.Branch(pth)){
        Color clr = clrFar;
        if (dist >= 0){
          clr = ClrInterp(clrNear, clrFar, dist);
        } else if( dist == -1){
          clr = clrMass;
        } else if( dist == -2){
          clr = clrGround;
        }
        clrOut.Add(clr, pth);
      }
    }

    pxColors = clrOut;
# ---------- c_script_6: C# additional code ----------
  public static Color ClrInterp(Color c1, Color c2, double t) {
    if (t < 0 || t > 1) throw new ArgumentOutOfRangeException("t");
    return Color.FromArgb((int) (c1.R + (c2.R - c1.R) * t), (int) (c1.G + (c2.G - c1.G) * t), (int) (c1.B + (c2.R - c1.B) * t));
  }
# ---------- end c_script_6 ----------
do_save_images = Boolean(Button())
do_save_images_2 = Boolean(do_save_images)
save_path = FilePath("C:\Users\ksteinfe\Desktop\TEMP\")
txt = Text("test")
bool = Boolean(True)
c_script_7 = CSharpScript(doSave=bool, savepath=save_path, filename=txt, pxColors=c_script_6.pxColors)  # -> out, tiles; inputs doSave: Boolean, savepath: String, filename: String, pxColors: tree of Color
# ---------- c_script_7: C# ----------
    if(!Directory.Exists(savepath)){
      raise("Save path does not exist.");
      return;
    }

    if (!doSave) return;

    int slicesPerDirection = validateSlices(pxColors);
    if (slicesPerDirection < 1) return;
    Print(slicesPerDirection.ToString() + " slices per each of 5 directions");


    DataTree<System.Drawing.Bitmap> imgsOut = new DataTree<System.Drawing.Bitmap>();


    foreach(GH_Path pth in pxColors.Paths){
      List<Color> pxColorLst = pxColors.Branch(pth);
      int pxDim = validatePixels(pxColorLst);

      System.Drawing.Bitmap img = new Bitmap(pxDim, pxDim);

      if (pxDim > 0){
        for (var i = 0; i < pxColorLst.Count; i++) {
          int y = i % pxDim;
          int x = i / pxDim;
          //Print(String.Format("{0},{1}", x.ToString(), y.ToString()));
          img.SetPixel(x, y, pxColorLst[i]);
        }

        //String pthStr = String.Join("", from num in pth.Indices select num );
        String pthStr = pth.Indices[0].ToString() + pth.Indices[1].ToString("D2");
        img.Save(savepath + filename + pthStr + ".png", System.Drawing.Imaging.ImageFormat.Png);

        imgsOut.Add(img, new GH_Path(pth.Indices[0]));

      }
    }

    tiles = imgsOut;
# ---------- c_script_7: C# additional code ----------
  public int validatePixels(List<Color> pxColors){
    Double cnt = Math.Sqrt(pxColors.Count());
    //Print((cnt % 1.0).ToString());
    if (cnt % 1.0 != 0){
      raise("Pixel count is all wrong. This image is not square.");
      return -1;
    }
    return Convert.ToInt32(cnt);
  }

  public int validateSlices(DataTree<Color> pxColors){

    int expectedDirectionCount = 5;

    if ( pxColors.Paths.Count % expectedDirectionCount != 0 ){
      raise("Data Tree isn't structured properly. Number of slices not divisible by expectedDirectionCount.");
      return -1;
    }
    int[] sliceCnts = new int[]{0,0,0,0,0}; // UPDATE THESE VALUES IF NEEDED
    int slicesPerDirection = -1;
    foreach(GH_Path pth in pxColors.Paths){
      //Print(pth.ToString());
      int idx = pth.Indices[0];
      if (idx > expectedDirectionCount - 1){
        raise("Data Tree isn't structured properly. Maybe not the right number of slice directions? First index greater than expectedDirectionCount.");
        return -1;
      }
      sliceCnts[idx]++;
    }

    //Print(String.Join("; ", sliceCnts));

    if (sliceCnts.Any(i => i != 5 && i != 20 && i != 45 && i != 80 && i != 125)){ // UPDATE THESE VALUES IF NEEDED
      Print(sliceCnts[0].ToString() + "," + sliceCnts[1].ToString() + "," + sliceCnts[2].ToString() + "," + sliceCnts[3].ToString());
      raise("Data Tree isn't structured properly. There should be 5, 20, 45, 80, or 125 slices per direction.");
      return -1;
    } else {
      slicesPerDirection = sliceCnts[0];
    }

    return slicesPerDirection;
  }


  public void raise(String msg){
    Print(msg);
    Component.AddRuntimeMessage(GH_RuntimeMessageLevel.Error, msg);
  }
# ---------- end c_script_7 ----------
c_script_8 = CSharpScript(tiles=c_script_7.tiles, savepath=save_path, filename=txt)  # -> out, A; inputs tiles: tree, savepath: String, filename: String
# ---------- c_script_8: C# ----------
    if (tiles.BranchCount != 5){
      raise("Data Tree isn't structured properly. There should be 5 branches - one for each slice direction");
      return;
    }
    var sliceCnts = from n in Enumerable.Range(0, tiles.BranchCount) select tiles.Branch(n).Count;
    if (sliceCnts.Any(i => i != 5 && i != 20 && i != 45 && i != 64 && i != tiles.Branch(0).Count)){
      raise("Data Tree isn't structured properly. There should be 5 or 20 or 45 or 64 slices per direction.");
      Print(String.Join(" ", sliceCnts));
      return;
    }

    int slicesPer = tiles.Branch(0).Count;
    int pxDimTile = ((System.Drawing.Bitmap) tiles.Branch(0)[0] ).Width;
    int pxDimBig = -1;
    List<Vector2d> offsets = new List<Vector2d>();
    Vector2d grpOffset = new Vector2d(0, pxDimTile);


    int tileRows = -1;
    if (slicesPer == 5) tileRows = 1;
    if (slicesPer == 20) tileRows = 2;
    if (slicesPer == 45) tileRows = 3;
    if (slicesPer == 80) tileRows = 4;
    if (slicesPer == 125) tileRows = 5;

    if (tileRows > 0){

      pxDimBig = pxDimTile * slicesPer / tileRows;
      for (int n = 0; n < slicesPer; n++) offsets.Add(new Vector2d((n % (slicesPer / tileRows)) * pxDimTile, (n / (slicesPer / tileRows) * pxDimTile)));
      grpOffset *= tileRows;

      System.Drawing.Bitmap bigImageOut = new System.Drawing.Bitmap(pxDimBig, pxDimBig);

      foreach(GH_Path pth in tiles.Paths){
        List<object> imgs = tiles.Branch(pth);
        for (int n = 0; n < slicesPer; n++){
          Bitmap img = (Bitmap) imgs[n];
          Vector2d offset = offsets[n] + grpOffset * pth.Indices[0];
          ImageToImageRegion(img, ref bigImageOut, new Rectangle(Convert.ToInt32(offset.X), Convert.ToInt32(offset.Y), pxDimTile, pxDimTile));
        }

      }


      bigImageOut.Save(savepath + filename + ".png", System.Drawing.Imaging.ImageFormat.Png);
    }
# ---------- c_script_8: C# additional code ----------
  public static void ImageToImageRegion(Bitmap srcBitmap, ref Bitmap destBitmap, Rectangle destRegion)
  {
    Rectangle srcRegion = new Rectangle(0, 0, srcBitmap.Width, srcBitmap.Height);
    using (Graphics grD = Graphics.FromImage(destBitmap))
    {
      grD.DrawImage(srcBitmap, destRegion, srcRegion, GraphicsUnit.Pixel);
    }
  }


  public void raise(String msg){
    Print(msg);
    Component.AddRuntimeMessage(GH_RuntimeMessageLevel.Error, msg);
  }
# ---------- end c_script_8 ----------
panel_4 = Panel(c_script_8.out)
