# Grasshopper definition 180218_isovist trainer.gh (Grasshopper 1.0.4)

# GENERAL CONTROLS
button = Button()
# SPATIAL CONTROLS
list = ValueList({"NONE": 0, "1 Column": 1, "2 Collonade": 2, "3 Collonade and Roof": 3, "4 Column Grid": 4, "5 Column Grid and Roof": 5, "6 One Wall": 6, "7 One Wall and Roof": 7, "8 Two Parallel Walls": 8, "9 Two Parallel Walls and Roof": 9, "10 Interior Corner": 10, "11 Interior Corner and Roof": 11, "12 Exterior Corner": 12, "13 Exterior Corner and Roof": 13, "14 Three Walls": 14, "15 Three Walls and Roof": 15, "16 Four Walls": 16, "17 Four Walls and Roof": 17}, selected="8 Two Parallel Walls")
list_2 = ValueList({"Debug": False, "Production": True}, selected="Debug")

# ---- group: path to image save directory
# GLOBALS
# The following values should be set for each spatial data type, and possibly for each run of parametric variation of the context.
path = FilePath("C:\Users\ksteinfe\Desktop\")

# ----
run_number = Panel("6")
do_production = Boolean(list_2)
do_save_images = Boolean(button)
save_path = FilePath(path)
do_production_2 = Boolean(do_production)
production_sample_count = Integer(Slider(6, range=3..20))
space_type_idx = Integer(list)
col_wall_extent = Number(Slider(3, range=0.5..3))
sphere_radius_in_meters = Panel("1.0")
apx_col_count = Integer(Slider(64, range=9..64))
col_height = Number(Slider(6.6, range=0..10))
x_wall_length = Number(Slider(1.49, range=0.5..3))
y_wall_length = Number(Slider(1.49, range=0.5..3))
col_width = Number(Slider(0.17, range=0.1..0.75))
int = Integer(run_number)
production_sample_count_2 = Integer(production_sample_count)
not = GateNot(A=do_production_2)
debug_station_pt = Point(Point(-4.217638571, 6.189115276, 0))
expression = Expression(x=space_type_idx, y=int, Expression="Format(\"t{0:00}r{1:00}\", x, y)")
sqrt = SquareRoot(Value=apx_col_count)
debug_station_pt_2 = Point(debug_station_pt)
# CONSTANTS
# The following values should remain constant across a training set of all spatial types.
number_slider = Slider(0.25, range=0..0.333)
col_count = Integer(expr("x-1", sqrt))
eye_height_in_meters = Panel("1.5")
fixed_domain = Panel("0 to 30")
px_width = Panel("80")
px_height = Panel("40")
px_width_2 = Integer(px_width)
px_width_3 = Integer(px_width_2)
px_width_4 = Integer(px_width_2)
px_height_2 = Integer(px_height)
px_height_3 = Integer(px_height_2)
px_height_4 = Integer(px_height_2)
do_production_3 = Boolean(do_production)
hit_domain = Domain(fixed_domain)
hit_domain_2 = Domain(hit_domain)
hit_domain_3 = Domain(hit_domain)
# KEEP WIDTH DIVISIBLE BY 4 TO MAKE EASY PANORAMA ROTATIONS
eye_height = Number(eye_height_in_meters)
pi = Pi(Factor=number_slider)
panel = Panel(expression)
filename_prefix = Text(expression)
theta_crop = Number(pi)
theta_crop_2 = Number(theta_crop)
theta_crop_3 = Number(theta_crop)
hit_domain_4 = Domain(hit_domain)
remap = RemapNumbers(Value=0.5, Source=Domain(0, 1), Target=hit_domain_4)  # -> Mapped, Clipped
pt = ConstructPoint(XCoordinate=expr("3*x", remap.Mapped), YCoordinate=expr("3*x", remap.Mapped), ZCoordinate=0)
pt_2 = ConstructPoint(XCoordinate=expr("-x", remap.Mapped), YCoordinate=expr("-x", remap.Mapped), ZCoordinate=0)
pt_3 = ConstructPoint(XCoordinate=expr("-3*x", remap.Mapped), YCoordinate=expr("-3*x", remap.Mapped), ZCoordinate=0)
rectangle = Rectangle(Plane=pt_2, XSize=hit_domain_4, YSize=hit_domain_4, Radius=0)  # -> Rectangle, Length
rec_2pt = Rectangle2Pt(Plane=PlaneXY(0, 0, 0), PointA=pt_3, PointB=pt, Radius=0)  # -> Rectangle, Length
filename_prefix_2 = Text(filename_prefix)
in_bnds = Curve(rectangle.Rectangle)

# ---- group: choose
in_bnds_2 = Curve(in_bnds)
crv = Curve(<curve referenced from the Rhino model>)

# ----
scale = Scale(Geometry=in_bnds_2, Center=Point(0, 0, 0), Factor=0.5)  # -> Geometry, Transform
bounds_of_possible_positions = Curve(scale.Geometry)
bounds_of_possible_positions_2 = Curve(bounds_of_possible_positions)
boundary = BoundarySurfaces(Edges=bounds_of_possible_positions_2)
popgeo = PopulateGeometry(Geometry=boundary, Count=production_sample_count_2, Seed=1)
cluster = Cluster_2(bnd_crv=bounds_of_possible_positions, pt2d=debug_station_pt_2, eye_height=eye_height)
cluster_2 = Cluster_2(bnd_crv=bounds_of_possible_positions_2, pt2d=popgeo, eye_height=eye_height)
c_script = CSharpScript(doProduction=do_production_3, debugPln=cluster, prodPln=cluster_2)  # -> out, A; inputs doProduction: Boolean, debugPln: Plane, prodPln: list of Plane
# ---------- c_script: C# ----------
    
    if (doProduction) A = prodPln;
    else A = debugPln;
# ---------- end c_script ----------
sample_planes = Plane(c_script.A)
sample_planes_2 = Plane(sample_planes)
c_script_2 = CSharpScript(
    thetaCrop=theta_crop_3,
    pxWidth=px_width_4,
    pxHeight=px_height_4,
    samplePlanes=sample_planes_2,
    hitDomain=hit_domain_3,
    radius=sphere_radius_in_meters)  # -> out, A, B; inputs thetaCrop: Double, pxWidth: Int32, pxHeight: Int32, samplePlanes: list of Plane, radius: Double
# ---------- c_script_2: C# ----------
    Double nudge = RhinoDocument.ModelAbsoluteTolerance;
    Interval ivalPhi = new Interval(nudge, 2.0 * Math.PI - nudge);
    Interval ivalTheta = new Interval(thetaCrop, Math.PI - thetaCrop);
    List<Brep> retBreps = new List<Brep>();
    List<Curve> retCrvs = new List<Curve>();
    List<Circle> retCircs = new List<Circle>();

    for (int p = 0; p < samplePlanes.Count; p++){
      Plane samplePlane = samplePlanes[p];
      List<Curve> crvs = new List<Curve>();
      for (int xi = 0; xi < pxWidth; xi++){
        List<Point3d> pts = new List<Point3d>();
        for (int yi = 0; yi < pxHeight; yi++){
          Double phi = ivalPhi.ParameterAt((Double) xi / (Double) (pxWidth - 1));
          Double theta = ivalTheta.ParameterAt((Double) yi / (Double) (pxHeight - 1));

          Double x = radius * Math.Sin(theta) * Math.Cos(phi);
          Double y = radius * Math.Sin(theta) * Math.Sin(phi);
          Double z = radius * Math.Cos(theta);

          Point3d pt = samplePlane.PointAt(x, y, z);
          pts.Add(pt);


        }

        Curve cv = Curve.CreateInterpolatedCurve(pts, 3);
        crvs.Add(cv);
        retCrvs.Add(cv);
      }

      Brep[] breps = Brep.CreateFromLoft(crvs, Point3d.Unset, Point3d.Unset, LoftType.Normal, true);
      retBreps.Add(breps[0]);
      
      Circle circIn = new Rhino.Geometry.Circle(samplePlane.Origin, hitDomain.T0);
      Circle circOut = new Rhino.Geometry.Circle(samplePlane.Origin, hitDomain.T1);
      retCircs.Add(circIn);
      retCircs.Add(circOut);
    }

    A = retBreps;
    B = retCircs;
# ---------- end c_script_2 ----------
out_bnds = Curve(rec_2pt.Rectangle)
out_bnds_2 = Curve(out_bnds)
do_save_images_2 = Boolean(do_save_images)
save_path_2 = FilePath(save_path)
px_height_5 = Integer(px_height_2)
px_width_5 = Integer(px_width_2)
hit_domain_5 = Domain(hit_domain)
col_count_2 = Integer(col_count)
col_wall_extent_2 = Number(col_wall_extent)
dedomain = DeconstructDomain(Domain=hit_domain_5)  # -> Start, End
multiplication = Multiplication(A=dedomain.End, B=col_wall_extent_2)
col_count_3 = Integer(col_count)
pt_4 = ConstructPoint(XCoordinate=expr("-x/2", multiplication), YCoordinate=expr("-x/2", multiplication), ZCoordinate=0)
division = Division(A=multiplication, B=col_count_3)
recgrid = Rectangular(Plane=pt_4, SizeX=division, SizeY=division, ExtentX=col_count_3, ExtentY=col_count_3)  # -> Cells, flatten(Points)
col_height_2 = Number(col_height)
pt_5 = Point(recgrid.Points)
Z = UnitZ(Factor=expr("x/2", col_height_2))
col_wall_width = Number(col_width)
col_height_3 = Number(col_height)
move = Move(Geometry=pt_5, Motion=Z)  # -> Geometry, Transform
column_grid = CenterBox(Base=move.Geometry, X=col_wall_width, Y=col_wall_width, Z=expr("x/2", col_height_3))
column_grid_2 = Box(column_grid)
column_grid_3 = Box(column_grid_2)
group = Group(Objects=column_grid_3)
bbox = BoundingBox(Content=group, Plane=PlaneXY(0, 0, 0))  # -> Box, Box_2
column_grid_4 = Box(column_grid_2)
debrep = DeconstructBrep(Brep=bbox.Box)  # -> Faces, Edges, Vertices
lng = ListLength(List=column_grid_4)
split = SplitList(List=column_grid_4, Index=expr("x+1", col_count_2))  # -> ListA, ListB
single_column = ListItem(List=column_grid_4, Index=expr("x/2", lng), Wrap=True)
x_wall1 = ListItem(List=debrep.Faces, Index="0", Wrap=True)
ywall1 = ListItem(List=debrep.Faces, Index="1", Wrap=True)
xwall2 = ListItem(List=debrep.Faces, Index="2", Wrap=True)
ywall2 = ListItem(List=debrep.Faces, Index="3", Wrap=True)
roof = ListItem(List=debrep.Faces, Index="5", Wrap=True)
column = Box(single_column)
collonade = Brep(split.ListA)
column_grid_5 = Box(column_grid_2)
wall_x1 = Surface(x_wall1)
wall_y1 = Surface(ywall1)
wall_x2 = Surface(xwall2)
wall_y2 = Surface(ywall2)
roof_2 = Surface(roof)
merge = Merge(Data1=collonade, Data2=roof_2)
merge_2 = Merge(Data1=column_grid_5, Data2=roof_2)
merge_3 = Merge(Data1=wall_x1, Data2=roof_2)
merge_4 = Merge(Data1=wall_x1, Data2=wall_x2)
merge_5 = Merge(Data1=wall_x1, Data2=wall_y1)
merge_6 = Merge(Data1=merge_4, Data2=roof_2)
merge_7 = Merge(Data1=merge_4, Data2=wall_y1)
merge_8 = Merge(Data1=merge_5, Data2=roof_2)
merge_9 = Merge(Data1=merge_7, Data2=roof_2)
merge_10 = Merge(Data1=merge_7, Data2=wall_y2)
merge_11 = Merge(Data1=merge_10, Data2=roof_2)
_14_three_walls = Brep(flatten(merge_7))
_17_four_walls_roof_room = Brep(flatten(merge_11))
_1_column = Brep(flatten(column))
_3_collonade_roof = Brep(flatten(merge))
_4_column_grid = Brep(flatten(column_grid_5))
_5_column_grid_roof = Brep(flatten(merge_2))
_6_one_wall = Brep(flatten(wall_x1))
_7_one_wall_roof = Brep(flatten(merge_3))
_8_two_parallel_walls = Brep(flatten(merge_4))
_9_two_parallel_walls_roof = Brep(flatten(merge_6))
_15_three_walls_roof = Brep(flatten(merge_9))
_2_collonade = Brep(flatten(collonade))
_16_four_walls = Brep(flatten(merge_10))
_0_nothing = Geometry()
_10_interior_corner = Brep(flatten(merge_5))
_11_interior_corner_roof = Brep(flatten(merge_8))
_12_exterior_corner_roof = Brep()
_13_exterior_corner_roof = Brep()
space_type_idx_2 = Integer(space_type_idx)
filter = StreamFilter(
    Gate=space_type_idx_2,
    Stream0=_0_nothing,
    Stream1=_1_column,
    Stream2=_2_collonade,
    Stream3=_3_collonade_roof,
    Stream4=_4_column_grid,
    Stream5=_5_column_grid_roof,
    Stream6=_6_one_wall,
    Stream7=_7_one_wall_roof,
    Stream8=_8_two_parallel_walls,
    Stream9=_9_two_parallel_walls_roof,
    Stream10=_10_interior_corner,
    Stream11=_11_interior_corner_roof,
    Stream12=_12_exterior_corner_roof,
    Stream13=_13_exterior_corner_roof,
    Stream14=_14_three_walls,
    Stream15=_15_three_walls_roof,
    Stream16=_16_four_walls,
    Stream17=_17_four_walls_roof_room)
context = Brep(filter)
context_2 = Brep(context)

# ---- group: define ground
# DEFINE GROUND: The ground is defined at the lower edge of the bounding box of the given Breps. Ground box is sized to 1000 times the size of the bounding box. Maximum x-y dimension of bounding box is returned.
cluster_3 = Cluster(bounds=out_bnds_2, breps=context_2)  # -> ground_2, max_dim_2

# ----
merge_12 = Merge(Data1=cluster_3.ground_2, Data2=context_2)
breps = Brep(merge_12)
breps_2 = Brep(breps)
c_script_3 = CSharpScript(
    showPts=not,
    pxWidth=px_width_3,
    pxHeight=px_height_3,
    samplePlanes=sample_planes_2,
    breps=breps_2,
    hitDomain=hit_domain_2,
    thetaCrop=theta_crop_2)  # -> out, hitCounts, hitPts, hitDists, hitNormDists, A; inputs showPts: Boolean, pxWidth: Int32, pxHeight: Int32, samplePlanes: list of Plane, breps: list of Brep, thetaCrop: Double
# ---------- c_script_3: C# ----------
    DataTree<int> hCounts = new DataTree<int>();
    DataTree<object> hPts = new DataTree<object>();
    DataTree<object> hDists = new DataTree<object>();
    DataTree<object> hNDists = new DataTree<object>();
    Interval dom = new Interval(Double.MinValue, Double.MaxValue);

    Interval ivalPhi = new Interval(0, 2.0 * Math.PI);
    Interval ivalTheta = new Interval(thetaCrop, Math.PI - thetaCrop);

    for (int p = 0; p < samplePlanes.Count; p++){
      Plane samplePlane = samplePlanes[p];

      for (int xi = pxWidth; xi > 0; xi--){
        for (int yi = 0; yi < pxHeight; yi++){
          Double phi = ivalPhi.ParameterAt((Double) xi / (Double) (pxWidth - 1));
          Double theta = ivalTheta.ParameterAt((Double) yi / (Double) (pxHeight - 1));

          Point3d xpt = new Point3d();
          Double xt = Double.MaxValue;

          Double radius = 1.0;
          Double x = radius * Math.Sin(theta) * Math.Cos(phi);
          Double y = radius * Math.Sin(theta) * Math.Sin(phi);
          Double z = radius * Math.Cos(theta);

          Point3d plnPt = samplePlane.PointAt(x, y, z);
          Vector3d rayVec = plnPt - samplePlane.Origin;
          Ray3d ray = new Ray3d(plnPt, rayVec);
          Line seg = new Line(samplePlane.Origin, samplePlane.PointAt(x, y, z));

          var points = Rhino.Geometry.Intersect.Intersection.ProjectPointsToBreps(
            breps,
            new List<Point3d> {samplePlane.Origin},
            ray.Direction,
            doc.ModelAbsoluteTolerance
            );

          int validHits = 0;
          foreach (Point3d pt in points){
            Double t = seg.ClosestParameter(pt);
            if ((t >= 0) && (t < xt)){
              xt = t;
              xpt = pt;
            }

            if (t >= 0) validHits++;
          }

          if (xt < Double.MaxValue){
            hCounts.Add(validHits, new GH_Path(p));
            if (showPts) hPts.Add(xpt, new GH_Path(p));
            //hTs.Add(x, new GH_Path(p)t);
            Double dist = xt * seg.Length;
            hDists.Add(dist, new GH_Path(p));
            
            Double normDist = hitDomain.NormalizedParameterAt(dist);
            if (normDist > 1.0) normDist = 1.0;
            hNDists.Add(normDist, new GH_Path(p));

            if ((dom.Min == Double.MinValue ) || (dist < dom.Min)) dom.T0 = dist;
            if ((dom.Max == Double.MaxValue ) || (dist > dom.Max)) dom.T1 = dist;

          } else {
            hCounts.Add(0, new GH_Path(p));
            if (showPts) hPts.Add(null, new GH_Path(p));
            hDists.Add(null, new GH_Path(p));
            hNDists.Add(null, new GH_Path(p));
          }



        }
      }

      hitCounts = hCounts;
      if (showPts) hitPts = hPts;
      hitNormDists = hNDists;
      hitDists = hDists;
    }
# ---------- end c_script_3 ----------
panel_2 = Panel(c_script_3.out)
sqrt_2 = SquareRoot(Value=c_script_3.hitNormDists)
bnd = Bounds(Numbers=c_script_3.hitDists)
nullrep = ReplaceNulls(Items=sqrt_2, Replacements="1.0")  # -> Items, Count
panel_3 = Panel(bnd)
gradient = Gradient(LowerLimit=0, UpperLimit=1, Parameter=nullrep.Items, stops=[0: RGB(255, 255, 255), 1: RGB(0, 0, 0)])
tstat = TreeStatistics(Tree=simplify(gradient))  # -> Paths, Length, Count
series = Series(Start=0, Step=1, Count=tstat.Count)
expression_2 = Expression(x=series, y=filename_prefix_2, Expression="Format(\"{1}-{0:0000}\", x, y)")
txt = Text(graft(expression_2))
c_script_4 = CSharpScript(doSave=do_save_images_2, savepath=save_path_2, filename=txt, pxColors=gradient, pxWidth=px_width_5, pxHeight=px_height_5)  # -> out, A; inputs doSave: Boolean, savepath: String, filename: String, pxColors: list of Color, pxWidth: Int32, pxHeight: Int32
# ---------- c_script_4: C# ----------
    if (!doSave) return;

    if (pxColors.Count != pxWidth * pxHeight) {
      String msg = "Pixel dimension does not match number of colors provided!";
      Print(msg);
      Component.AddRuntimeMessage(GH_RuntimeMessageLevel.Error, msg);
      //GrasshopperDocument.RequestAbortSolution();
      return;
    }

    System.Drawing.Bitmap img = new Bitmap(pxWidth, pxHeight);

    for (var i = 0; i < pxColors.Count; i++) {
      int y = i % pxHeight;
      int x = i / pxHeight;
      //Print(String.Format("{0},{1}", x.ToString(), y.ToString()));
      img.SetPixel(x, y, pxColors[i]);
    }
    img.Save(savepath + filename + ".png", System.Drawing.Imaging.ImageFormat.Png);


    A = img;
# ---------- end c_script_4 ----------

# ==== cluster Cluster
bounds = ClusterInput()
breps = ClusterInput()
breps_2 = Brep(breps)
bounds_2 = Curve(bounds)
boundary = BoundarySurfaces(Edges=bounds_2)
merge = Merge(Data1=boundary, Data2=breps_2)
bbox = BoundingBox(Content=merge, Plane=PlaneXY(0, 0, 0), UnionBox=True)  # -> Box, Box_2
debox = DeconstructBox(Box=bbox.Box)  # -> Plane, X, Y, Z
dedomain = DeconstructDomain(Domain=debox.X)  # -> Start, End
dedomain_2 = DeconstructDomain(Domain=debox.Y)  # -> Start, End
avr = Average(Input=[dedomain.Start, dedomain.End])
subtraction = Subtraction(A=dedomain.End, B=dedomain.Start)
avr_2 = Average(Input=[dedomain_2.Start, dedomain_2.End])
subtraction_2 = Subtraction(A=dedomain_2.End, B=dedomain_2.Start)
multiplication = Multiplication(A=subtraction, B="1000")
multiplication_2 = Multiplication(A=subtraction_2, B="1000")
pt = ConstructPoint(XCoordinate=avr, YCoordinate=avr_2, ZCoordinate=expr("-x", "1"))
max = Maximum(A=subtraction, B=subtraction_2)
max_dim = Number(max)
box = CenterBox(Base=pt, X=multiplication, Y=multiplication_2, Z="1")
ground = Box(box)
max_dim_2 = ClusterOutput(max_dim)
ground_2 = ClusterOutput(ground)

# ==== cluster Cluster_2
bnd_crv = ClusterInput()
eye_height = ClusterInput()
pt2d = ClusterInput()
bnd_crv_2 = Curve(bnd_crv)
eye_height_2 = Number(eye_height)
pt2d_2 = Point(pt2d)
area = Area(Geometry=bnd_crv_2)  # -> Area, Centroid
Z = UnitZ(Factor=eye_height_2)
move = Move(Geometry=pt2d_2, Motion=Z)  # -> Geometry, Transform
vec2pt = Vector2Pt(PointA=pt2d_2, PointB=area.Centroid, Unitize=False)  # -> Vector, Length
Z_2 = UnitZ(Factor=1)
rev = Reverse(Vector=vec2pt.Vector)
xprod = CrossProduct(VectorA=rev, VectorB=Z_2, Unitize=False)  # -> Vector, Length
rev_2 = Reverse(Vector=xprod.Vector)
pl = ConstructPlane(Origin=move.Geometry, XAxis=rev, YAxis=rev_2)
plns = Plane(pl)
plns_2 = ClusterOutput(plns)
