# Grasshopper definition 180225 house.gh (Grasshopper 1.0.4)

pipeline = GeometryPipeline(
    GroupByLayer=False,
    GroupByType=False,
    IncludeHidden=True,
    IncludeLocked=True,
    LayerFilter="SITE",
    NameFilter="*",
    SublayerFiltering=True,
    TypeFilter=4)
pipeline_2 = GeometryPipeline(
    GroupByLayer=False,
    GroupByType=False,
    IncludeHidden=True,
    IncludeLocked=True,
    LayerFilter="MASSING",
    NameFilter="*",
    SublayerFiltering=True,
    TypeFilter=1073741848)
pipeline_3 = GeometryPipeline(
    GroupByLayer=False,
    GroupByType=False,
    IncludeHidden=True,
    IncludeLocked=True,
    LayerFilter="DOOR",
    NameFilter="*",
    SublayerFiltering=True,
    TypeFilter=4)
pipeline_4 = GeometryPipeline(
    GroupByLayer=False,
    GroupByType=False,
    IncludeHidden=True,
    IncludeLocked=True,
    LayerFilter="WINDOW",
    NameFilter="*",
    SublayerFiltering=True,
    TypeFilter=4)
windows = Curve(pipeline_4)
massings = Brep(pipeline_2)
site = Curve(pipeline)
doors = Curve(pipeline_3)
site_info = CSharpScript(site=site)  # -> out, w, d, r, n; inputs site: Rectangle3d
# ---------- site_info: C# ----------
    int ww = (int) (site.X.T1 - site.X.T0);
    int dd = (int) (site.Y.T1 - site.Y.T0);

    double rr = Math.Round((double) dd / (double) ww);

    String abr = "";

    if (ww == 18) abr = "A";
    else if (ww == 24) abr = "B";
    else if (ww == 32) abr = "C";
    else if (ww == 40) abr = "D";
    else if (ww == 48) abr = "E";
    else if (ww == 56) abr = "F";
    else if (ww == 64) abr = "G";
    else if (ww == 72) abr = "H";
    else if (ww == 80) abr = "I";
    else if (ww == 88) abr = "J";
    else if (ww == 96) abr = "K";
    else {
      w = false;
      d = false;
      r = false;
      n = false;
      return;
    }
    w = ww;
    d = dd;
    r = rr;
    n = abr + (rr * 10).ToString();
# ---------- end site_info ----------
bbox = BoundingBox(Content=massings, Plane=PlaneXY(0, 0, 0), UnionBox=True)  # -> Box, Box_2
c_script = CSharpScript(masses=massings, pad=Slider(0.125, range=0..1))  # -> out, cutBox, ground, maxDim, depth; inputs masses: list of Brep, pad: Double
# ---------- c_script: C# ----------
    List<Brep> brps = new List<Brep>();



    // Construct bounding intervals on plane
    //
    BoundingBox bBox = new BoundingBox();
    foreach (Brep brp in brps) bBox.Union(brp.GetBoundingBox(false));

    Double diagDim = (new Vector2d(bBox.Diagonal.X, bBox.Diagonal.Y)).Length;
    maxDim = diagDim;
    cutBox = bBox;

    Interval ival_x = new Interval(bBox.Min.X, bBox.Max.X);
    Interval ival_y = new Interval(bBox.Min.Y, bBox.Max.Y);
    Interval ival_z = new Interval(bBox.Min.Z, bBox.Max.Z);

    ival_x = scaleIval(ival_x, (1 + pad));
    ival_y = scaleIval(ival_y, (1 + pad));
    ival_z.T1 = ival_z.T1 + ival_z.Length * pad;

    Box cBox = new Box(Plane.WorldXY, ival_x, ival_y, ival_z);
    cutBox = cBox;

    Double groundDepth = (cBox.Z.T1 - cBox.Z.T0) / 2;
    Plane basePlane = new Plane(cBox.PointAt(0.5, 0.5, 0), Plane.WorldXY.XAxis, Plane.WorldXY.YAxis);
    basePlane.Translate(new Vector3d(0, 0, -groundDepth));

    Cylinder cyl = new Rhino.Geometry.Cylinder(
      new Circle(basePlane, diagDim * (0.75 + pad)), // ensure overlap
      groundDepth - RhinoDocument.ModelAbsoluteTolerance * 100// this might ensure that the meshes don't align perfectly, which is better for booleans.
      );

    Mesh mCyl = Mesh.CreateFromBrep(cyl.ToBrep(true, true), new MeshingParameters())[0];
    mCyl = Mesh.CreateFromCylinder(cyl, 1, 36);
    ground = mCyl;
# ---------- c_script: C# additional code ----------
  Interval scaleIval(Interval ival, Double fac){
    Double delt = ival.Length * fac - ival.Length;
    //if (fixMin) return new Interval(ival.T0, ival.T1 + delt);
    return new Interval(ival.T0 - delt / 2, ival.T1 + delt / 2);
  }
# ---------- end c_script ----------
panel = Panel(site_info.n)
debox = DeconstructBox(Box=bbox.Box)  # -> Plane, X, Y, Z
panel_2 = Panel(debox.Y)
panel_3 = Panel(c_script.out)
