# Grasshopper definition 180302 isovist mapper.gh (Grasshopper 1.0.4)

# ---- group: 200 x 200 ground plane
rec = Rectangle({Plane=PlaneXY(0, 0, 0), Size=Domain2(u=-100..100, v=-100..100)})
out_bnds = Curve(rec)

# ----
test_image_save_path = FilePath("C:\Users\ksteinfe\Desktop\TEMP\")
parallel_walls = Brep([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])
column_row = Brep([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])
single_column = Brep(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)
l_shaped_wall = Brep(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)
one_wall = Brep(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)
rec_2 = Rectangle({Plane=PlaneXY(-4.126537598, 3.452547705, 0), Size=Domain2(u=-20.73274955..20.73274955, v=-9.754636411..9.754636411)})
brep = Brep([column_row, parallel_walls])
number_slider = Slider(20, range=0..100)
sample_count = Integer("3")
context = Brep(brep)
pt = Point(Point(-2.904906024, 3.346597762, 0))
eye_height_in_meters = Panel("1.5")
pop2d = Populate2D(Region=rec_2, Count=sample_count, Seed=Slider(6, range=0..10))
mplane = MeshPlane(Boundary=rec_2, WidthCount=number_slider, HeightCount=number_slider)  # -> Mesh, Area
eye_height = Number(eye_height_in_meters)
sample_pts = Point(pop2d)
sample_mesh = Mesh(mplane.Mesh)
sample_pts_2 = Point(sample_pts)
Z = UnitZ(Factor=eye_height)
move = Move(Geometry=sample_pts_2, Motion=Z)  # -> Geometry, Transform
points = PointList(Points=move.Geometry, Size=Slider(2.1, range=0..10))
# CONSTANTS
# The following values should remain constant across a training set of all spatial types.
number_slider_2 = Slider(0.25, range=0..0.333)
fixed_domain = Panel("0 to 25")

# ---- group: KYLE STYLE
px_width = Panel("80")
px_height = Panel("40")

# ----
xy = XYPlane(Origin=move.Geometry)

# ---- group: PENG STYLE
px_width_2 = Panel("60")
px_height_2 = Panel("30")

# ----
hit_domain = Domain(fixed_domain)
hit_domain_2 = Domain(hit_domain)
out_bnds_2 = Curve(out_bnds)
context_2 = Brep(context)
pi = Pi(Factor=number_slider_2)
px_width_3 = Integer(px_width_2)
px_width_4 = Integer(px_width_3)
px_height_3 = Integer(px_height_2)
px_height_4 = Integer(px_height_3)

# ---- group: define ground
# DEFINE GROUND: The ground is defined at the lower edge of the bounding box of the given Breps. Ground box is sized to 1000 times the size of the bounding box. Maximum x-y dimension of bounding box is returned.
cluster = Cluster(bounds=out_bnds_2, breps=context_2)  # -> ground_2, max_dim_2

# ----
theta_crop = Number(pi)
theta_crop_2 = Number(theta_crop)
merge = Merge(Data1=cluster.ground_2, Data2=context_2)
breps = Brep(merge)
breps_2 = Brep(breps)
c_script = CSharpScript(
    showPts=Toggle(False),
    pxWidth=px_width_4,
    pxHeight=px_height_4,
    samplePlanes=xy,
    breps=breps_2,
    hitDomain=hit_domain_2,
    thetaCrop=theta_crop_2)  # -> out, hitCounts, hitPts, hitDists, hitNormDists, A; inputs showPts: Boolean, pxWidth: Int32, pxHeight: Int32, samplePlanes: list of Plane, breps: list of Brep, thetaCrop: Double
# ---------- c_script: C# ----------
    DataTree<int> hCounts = new DataTree<int>();
    DataTree<object> hPts = new DataTree<object>();
    DataTree<object> hDists = new DataTree<object>();
    DataTree<object> hNDists = new DataTree<object>();
    Interval dom = new Interval(Double.MinValue, Double.MaxValue);

    Interval ivalPhi = new Interval(0, 2.0 * Math.PI);
    Interval ivalTheta = new Interval(thetaCrop, Math.PI - thetaCrop);

    for (int p = 0; p < samplePlanes.Count; p++){
      Plane samplePlane = samplePlanes[p];

      for (int xi = pxWidth; xi > 0; xi--){
        for (int yi = 0; yi < pxHeight; yi++){
          Double phi = ivalPhi.ParameterAt((Double) xi / (Double) (pxWidth - 1));
          Double theta = ivalTheta.ParameterAt((Double) yi / (Double) (pxHeight - 1));

          Point3d xpt = new Point3d();
          Double xt = Double.MaxValue;

          Double radius = 1.0;
          Double x = radius * Math.Sin(theta) * Math.Cos(phi);
          Double y = radius * Math.Sin(theta) * Math.Sin(phi);
          Double z = radius * Math.Cos(theta);

          Point3d plnPt = samplePlane.PointAt(x, y, z);
          Vector3d rayVec = plnPt - samplePlane.Origin;
          Ray3d ray = new Ray3d(plnPt, rayVec);
          Line seg = new Line(samplePlane.Origin, samplePlane.PointAt(x, y, z));

          var points = Rhino.Geometry.Intersect.Intersection.ProjectPointsToBreps(
            breps,
            new List<Point3d> {samplePlane.Origin},
            ray.Direction,
            doc.ModelAbsoluteTolerance
            );

          int validHits = 0;
          foreach (Point3d pt in points){
            Double t = seg.ClosestParameter(pt);
            if ((t >= 0) && (t < xt)){
              xt = t;
              xpt = pt;
            }

            if (t >= 0) validHits++;
          }

          if (xt < Double.MaxValue){
            hCounts.Add(validHits, new GH_Path(p));
            if (showPts) hPts.Add(xpt, new GH_Path(p));
            //hTs.Add(x, new GH_Path(p)t);
            Double dist = xt * seg.Length;
            hDists.Add(dist, new GH_Path(p));
            
            Double normDist = hitDomain.NormalizedParameterAt(dist);
            if (normDist > 1.0) normDist = 1.0;
            hNDists.Add(normDist, new GH_Path(p));

            if ((dom.Min == Double.MinValue ) || (dist < dom.Min)) dom.T0 = dist;
            if ((dom.Max == Double.MaxValue ) || (dist > dom.Max)) dom.T1 = dist;

          } else {
            hCounts.Add(0, new GH_Path(p));
            if (showPts) hPts.Add(null, new GH_Path(p));
            hDists.Add(null, new GH_Path(p));
            hNDists.Add(null, new GH_Path(p));
          }



        }
      }

      hitCounts = hCounts;
      if (showPts) hitPts = hPts;
      hitNormDists = hNDists;
      hitDists = hDists;
    }
# ---------- end c_script ----------
sqrt = SquareRoot(Value=c_script.hitNormDists)
bnd = Bounds(Numbers=c_script.hitDists)
nullrep = ReplaceNulls(Items=sqrt, Replacements="1.0")  # -> Items, Count

# ---- group: PENG STYLE GRADIENT
gradient = Gradient(LowerLimit=0, UpperLimit=1, Parameter=nullrep.Items, stops=[0: RGB(0, 0, 0), 1: RGB(255, 255, 255)])

# ----
px_height_5 = Integer(px_height_3)
px_width_5 = Integer(px_width_3)
c_script_2 = CSharpScript(pxColors=gradient, pxWidth=px_width_5, pxHeight=px_height_5)  # -> out, flatten(A); inputs pxColors: list of Color, pxWidth: Int32, pxHeight: Int32
# ---------- c_script_2: C# ----------
    if (pxColors.Count != pxWidth * pxHeight) {
      String msg = "Pixel dimension does not match number of colors provided!";
      Print(msg);
      Component.AddRuntimeMessage(GH_RuntimeMessageLevel.Error, msg);
      //GrasshopperDocument.RequestAbortSolution();
      return;
    }

    System.Drawing.Bitmap img = new Bitmap(pxWidth, pxHeight);
    
    for (var i = 0; i < pxColors.Count; i++) {
      int y = i % pxHeight;
      int x = i / pxHeight;
      //Print(String.Format("{0},{1}", x.ToString(), y.ToString()));
      img.SetPixel(x, y, pxColors[i]);
    }

    A = img;
# ---------- end c_script_2 ----------
lng = ListLength(List=c_script_2.A)
series = Series(Start=0, Step=1, Count=lng)
test_image_save_path_2 = FilePath(test_image_save_path)
c_script_3 = CSharpScript(doLabel=Toggle(True), doSaveImg=Button(), img=c_script_2.A, n=series, savepath=test_image_save_path_2)  # -> out, A; inputs doLabel: Boolean, doSaveImg: Boolean, savepath: String
# ---------- c_script_3: C# ----------
    //Stream imgStream = ImageToBase64((Bitmap) img, System.Drawing.Imaging.ImageFormat.Png);



    Bitmap bmp = (Bitmap) img;
    if (doSaveImg) bmp.Save(savepath + "TEST_"+n.ToString()+".png", System.Drawing.Imaging.ImageFormat.Png);

    if (doLabel){
      string apikey = "034ce21d-d319-4270-996f-c9ec27981e34&docid=c202eb2c-6ded-4774-a784-8d254eebd551";
      System.Net.WebRequest request = LobeCreateImageRequest(apikey, bmp);
      if (request != null){
        string label = LobeGetSimplePrediction(request);
        A = Int32.Parse(label);
        //B = ImageToBase64(bmp);
      }

    }
# ---------- c_script_3: C# additional code ----------
  public string ImageToBase64(System.Drawing.Image image)
  {

    string base64String = null;
    using(MemoryStream m = new MemoryStream())
    {
      image.Save(m, System.Drawing.Imaging.ImageFormat.Png);
      byte[] imageBytes = m.ToArray();
      base64String = Convert.ToBase64String(imageBytes);
      return base64String;
    }

  }

  public Stream ToStream(Image image, System.Drawing.Imaging.ImageFormat format) {
    var stream = new System.IO.MemoryStream();
    image.Save(stream, format);
    stream.Position = 0;
    return stream;
  }


  String LobeGetSimplePrediction(System.Net.WebRequest request){

    try
    {
      using (var response = request.GetResponse())
      {
        using (var stream = response.GetResponseStream())
        {
          var reader = new StreamReader(stream, System.Text.Encoding.UTF8);
          String jsonResponse = reader.ReadToEnd();
          //return String.Join("...",);
          // TODO: this is SUPER kludgey and fragile
          //

          //Print( jsonResponse.Split(new Char[] {':','}','{','"'})[0]  );
          String label = jsonResponse.Split(new Char[] {'{','}'})[2].Split(new Char[] {':'})[1];
          //return label;
          return label.Substring(2, label.Count() - 3);


        }
      }
    }
    catch (System.Net.WebException e)
    {
      Print("WebException");
      Print(e.Message);
      return null;
    }

  }


  System.Net.WebRequest LobeCreateImageRequest(string apikey, Bitmap img){
    try
    {
      string baseURL = @"http://api.lobe.ai/predict";
      System.Net.WebRequest request = System.Net.WebRequest.Create(baseURL + "?apikey=" + apikey);
      request.Method = "POST";
      request.ContentType = "application/json";
      //request.Timeout = 10000;

      String imagestr = "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";
      //imagestr = " ";
      //string imagestr = Convert.ToBase64String(File.ReadAllBytes(imgpath));


      imagestr = ImageToBase64(img);

      using(var streamWriter = new StreamWriter(request.GetRequestStream()))
      {
        string json = @"{
          ""inputs"":{
          ""image"":""" + imagestr +@"""
          }
          }";

        streamWriter.Write(json);
        streamWriter.Flush();
        streamWriter.Close();
      }
      //Print(request.Headers.ToString());
      return request;
    }
    catch (System.Net.WebException e)
    {
      Print("LobeCreateImageRequest WebException");
      Print(e.Message);
      return null;
    }
  }
# ---------- end c_script_3 ----------
panel = Panel("6 - One Wall")
panel_2 = Panel("8 - Two Paralell Walls")
panel_3 = Panel("1 Column")
panel_4 = Panel("2 - Collonade")
label = Text(c_script_3.A)
int = Integer(1)
int_2 = Integer(2)
int_3 = Integer(6)
int_4 = Integer(8)
swatch = ColourSwatch(SwatchColor=RGB(255, 255, 255))
merge_2 = Merge(Data1=int, Data2=int_2, Data3=int_3, Data4=int_4)
merge_3 = Merge(
    Data1=ColourSwatch(SwatchColor=RGB(255, 0, 0)),
    Data2=ColourSwatch(SwatchColor=RGB(34, 255, 0)),
    Data3=ColourSwatch(SwatchColor=RGB(0, 170, 255)),
    Data4=ColourSwatch(SwatchColor=RGB(255, 0, 225)))
c_script_4 = CSharpScript(label=label, clrs=merge_3, labels=merge_2)  # -> out, A; inputs label: Int32, clrs: list of Color, labels: list of Int32
# ---------- c_script_4: C# ----------
    int idx = labels.IndexOf(label);
    if (idx>=0) A = clrs[idx];
    else A = new Color();
# ---------- end c_script_4 ----------
sample_mesh_2 = Mesh(sample_mesh)
sample_pts_3 = Point(sample_pts)
mspray = MeshSpray(Mesh=sample_mesh_2, Points=sample_pts_3, Colours=c_script_4.A, SprayMode=11)

# ==== cluster Cluster
bounds = ClusterInput()
breps = ClusterInput()
breps_2 = Brep(breps)
bounds_2 = Curve(bounds)
boundary = BoundarySurfaces(Edges=bounds_2)
merge = Merge(Data1=boundary, Data2=breps_2)
bbox = BoundingBox(Content=merge, Plane=PlaneXY(0, 0, 0), UnionBox=True)  # -> Box, Box_2
debox = DeconstructBox(Box=bbox.Box)  # -> Plane, X, Y, Z
dedomain = DeconstructDomain(Domain=debox.X)  # -> Start, End
dedomain_2 = DeconstructDomain(Domain=debox.Y)  # -> Start, End
avr = Average(Input=[dedomain.Start, dedomain.End])
subtraction = Subtraction(A=dedomain.End, B=dedomain.Start)
avr_2 = Average(Input=[dedomain_2.Start, dedomain_2.End])
subtraction_2 = Subtraction(A=dedomain_2.End, B=dedomain_2.Start)
multiplication = Multiplication(A=subtraction, B="1000")
multiplication_2 = Multiplication(A=subtraction_2, B="1000")
pt = ConstructPoint(XCoordinate=avr, YCoordinate=avr_2, ZCoordinate=expr("-x", "1"))
max = Maximum(A=subtraction, B=subtraction_2)
max_dim = Number(max)
box = CenterBox(Base=pt, X=multiplication, Y=multiplication_2, Z="1")
ground = Box(box)
max_dim_2 = ClusterOutput(max_dim)
ground_2 = ClusterOutput(ground)
