# Grasshopper definition 180312 image to base64.gh (Grasshopper 1.0.4)

path = FilePath("W:\Box Sync\SG 2018 Datasets\HOUSE MASSING DATASET\extra coarse\04 - AFrame\CABIN_01_A33-1.png")
c_script = CSharpScript(imgpath=path)  # -> out, A; inputs imgpath: String
# ---------- c_script: C# ----------
    Image img = Image.FromFile(imgpath);
    //Print(img.ToString());
    //A = ImageToBase64(img);
    //B = Convert.ToBase64String(File.ReadAllBytes(imgpath));

    //A = img;

    string imagestr = ImageToBase64(img);
    A = imagestr;
# ---------- c_script: C# additional code ----------
  public string ImageToBase64(System.Drawing.Image image)
  {
    string base64String = null;
    using(MemoryStream m = new MemoryStream())
    {
      image.Save(m, image.RawFormat);
      byte[] imageBytes = m.ToArray();
      base64String = Convert.ToBase64String(imageBytes);
      return base64String;
    }

  }
# ---------- end c_script ----------
panel = Panel(c_script.A)
