# Grasshopper definition 180316 rest api.gh (Grasshopper 1.0.4)

path = FilePath("W:\Box Sync\SG 2018 Datasets\180314 fourview - 10\11 - QueenAnne\QueenAnne-queenanne_v1_01-10.png")
c_script = CSharpScript(imgpath=path)  # -> out, A; inputs imgpath: String
# ---------- c_script: C# ----------
    Image img = Image.FromFile(imgpath);
    A = img;
# ---------- end c_script ----------
house_massing_v02a_no = Panel("034ce21d-d319-4270-996f-c9ec27981e34&docid=2835d607-dffc-4f88-9f80-7861b4df0ee2")
button = Button()
apikey = Text(house_massing_v02a_no)
image = Data(c_script.A)
c_script_2 = CSharpScript(doIt=Toggle(False), apikey=apikey, img=image)  # -> out, jsonResponse; inputs doIt: Boolean, apikey: String
# ---------- c_script_2: C# ----------
    //Stream imgStream = ImageToBase64((Bitmap) img, System.Drawing.Imaging.ImageFormat.Png);
    jsonResponse = null;
    Bitmap bmp = (Bitmap) img;

    if (doIt){
      System.Net.WebRequest request = LobeCreateImageRequest(apikey, bmp);
      if (request != null){
        jsonResponse = LobeGetSimplePrediction(request);
      }
    }
# ---------- c_script_2: C# additional code ----------
  public string ImageToBase64(System.Drawing.Image image)
  {

    string base64String = null;
    using(MemoryStream m = new MemoryStream())
    {
      image.Save(m, System.Drawing.Imaging.ImageFormat.Png);
      byte[] imageBytes = m.ToArray();
      base64String = Convert.ToBase64String(imageBytes);
      return base64String;
    }

  }

  public Stream ToStream(Image image, System.Drawing.Imaging.ImageFormat format) {
    var stream = new System.IO.MemoryStream();
    image.Save(stream, format);
    stream.Position = 0;
    return stream;
  }


  String LobeGetSimplePrediction(System.Net.WebRequest request){

    try
    {
      using (var response = request.GetResponse())
      {
        using (var stream = response.GetResponseStream())
        {
          var reader = new StreamReader(stream, System.Text.Encoding.UTF8);
          String jsonResponse = reader.ReadToEnd();
          return jsonResponse;

        }
      }
    }
    catch (System.Net.WebException e)
    {
      Print("WebException");
      Print(e.Message);
      return null;
    }

  }


  System.Net.WebRequest LobeCreateImageRequest(string apikey, Bitmap img){
    try
    {
      string baseURL = @"https://api.lobe.ai/predict?";
      string fullURL = baseURL + "apikey=" + apikey;
      Print(fullURL);
      System.Net.WebRequest request = System.Net.WebRequest.Create(fullURL);
      request.Method = "POST";
      request.ContentType = "application/json";
      //request.Timeout = 10000;

      //String imagestr = "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";
      //imagestr = " ";
      //String imagestr = Convert.ToBase64String(File.ReadAllBytes(imgpath));

      String imagestr = ImageToBase64(img);

      using(var streamWriter = new StreamWriter(request.GetRequestStream()))
      {
        string json = @"{
          ""inputs"":{
          ""image"":""" + imagestr +@"""
          }
          }";

        streamWriter.Write(json);
        streamWriter.Flush();
        streamWriter.Close();
      }
      //Print(request.Headers.ToString());
      return request;
    }
    catch (System.Net.WebException e)
    {
      Print("LobeCreateImageRequest WebException");
      Print(e.Message);
      return null;
    }
  }
# ---------- end c_script_2 ----------
c_script_3 = CSharpScript(jsonResponse=c_script_2.jsonResponse)  # -> out, confidences, labels; inputs jsonResponse: String
# ---------- c_script_3: C# ----------
    if (jsonResponse == null) return;
    /*
    var pattern = @"\[(.*?)\]";
    var query = "H1-receptor antagonist [HSA:3269] [PATH:hsa04080(3269)]";
    var matches = System.Text.RegularExpressions.Regex.Matches(query, pattern);

    foreach (System.Text.RegularExpressions.Match m in matches) {
      //Print(m.Groups[1].ToString());
    }
    */

    var pattern = @"""confidences"": \[\[(.*?)\]]";
    var matches = System.Text.RegularExpressions.Regex.Matches(jsonResponse, pattern);

    //Print(matches[0].Groups[1].ToString());

    System.Text.RegularExpressions.Regex regex = new System.Text.RegularExpressions.Regex(@"\], \[");

    List<String> ks = new List<String>();
    List<double> vs = new List<double>();
    foreach (String str in regex.Split(matches[0].Groups[1].ToString()) ) {
      String[] sarr = str.Split(',');
      ks.Add(sarr[0].Trim('"'));
      vs.Add(Double.Parse(sarr[1], System.Globalization.NumberStyles.Float));
    }

    labels = ks;
    confidences = vs;
# ---------- end c_script_3 ----------
sort = SortList(Keys=c_script_3.confidences, ValuesA=c_script_3.labels)  # -> reverse(Keys), reverse(ValuesA)
panel = Panel(sort.ValuesA)
panel_2 = Panel(sort.Keys)
