# Grasshopper definition 180317 fourview house optimizer.gh (Grasshopper 1.0.4)

depth = Slider(35, range=18..60)
width = Slider(18, range=18..106)

door_depth_ratio = Number(Slider(1.1, range=0.01..1.1))
door_z_ratio = Number(Slider(0.8, range=0.01..0.8))
door_x_ratio = Number(Slider(0.61, range=0.1..0.9))
set_site_width = Number(width)
set_site_depth = Number(depth)
mass_height = Number(Slider(12, range=10..24))
mass_d_ratio = Number(Slider(0.59, range=0.12..1))
mass_w_ratio = Number(Slider(1, range=0.12..1))
roof_type = Integer(Slider(0, range=0..3))
roof_slope = Integer(Slider(2.08, range=0.01..3))
chim_pos = Number(Slider(0.1, range=0.1..0.5))
chim_z = Number(Slider(0.19, range=0.1..1.5))

save_path = FilePath("C:\Users\ksteinfe\Desktop\TEMP\")

# ---- group: calculate slices & API evaluate
# Calculates slices, cuts images, and pings API for prediction. Turn both off when developing the model, turn on when optimizing.
toggle = BooleanToggle(False)
do_local_calc = Boolean(toggle)
do_api_call = Boolean(Toggle(False))

# ----
cluster = Cluster_3(
    site_w=set_site_width,
    site_d=set_site_depth,
    chim_pos=chim_pos,
    chim_h=chim_z,
    mass_h=mass_height,
    mass_d=mass_d_ratio,
    mass_w=mass_w_ratio,
    roof_type=roof_type,
    roof_slope=roof_slope,
    door_h=door_z_ratio,
    door_w=door_x_ratio,
    door_d=door_depth_ratio)  # -> site_w_4, site_d_4, massing_2

# ----
# The pixel dimension of each slice. All slice images are square.
pixel_count = Slider(1, range=1..10, expression="x*10")
px_cnt = Integer(pixel_count)

# ---- group: debug
# Saves cut image and info to local files. Can only happen if slices and hits are calculated.
toggle_2 = BooleanToggle(False)
# Displays geometry related to the production of image slices and elevations.
toggle_3 = BooleanToggle(False)
visualize_rays = Boolean(toggle_2)
do_save_files = Boolean(toggle_3)

# ----
massings = Brep(cluster.massing_2)

# ---- group: cutbox and ground
# Slices
massings_2 = Brep(massings)
c_script = CSharpScript(masses=massings_2, pad="0.0625")  # -> out, cutBox, ground, maxDim; inputs masses: list of Brep, pad: Double
# ---------- c_script: C# ----------
    if (masses.Count == 0) return;

    // Construct bounding intervals on plane
    //

    BoundingBox bBox = masses[0].GetBoundingBox(true);
    for (int n = 1; n < masses.Count; n++) bBox.Union(masses[n].GetBoundingBox(true));
    IEnumerable<double> edgeLens = from ln in bBox.GetEdges() select (double) ln.Length;
    maxDim = edgeLens.Max(); // OUT
    cutBox = bBox; // OUT

    Double diagDim = (new Vector2d(bBox.Diagonal.X, bBox.Diagonal.Y)).Length;

    Interval ival_x = new Interval(bBox.Min.X, bBox.Max.X);
    Interval ival_y = new Interval(bBox.Min.Y, bBox.Max.Y);
    Interval ival_z = new Interval(bBox.Min.Z, bBox.Max.Z);

    ival_x = scaleIval(ival_x, (1 + pad));
    ival_y = scaleIval(ival_y, (1 + pad));
    ival_z.T1 = ival_z.T1 + ival_z.Length * pad;

    Box cBox = new Box(Plane.WorldXY, ival_x, ival_y, ival_z);
    cutBox = cBox; // OUT

    Double groundDepth = (cBox.Z.T1 - cBox.Z.T0) / 2;
    Plane basePlane = new Plane(cBox.PointAt(0.5, 0.5, 0), Plane.WorldXY.XAxis, Plane.WorldXY.YAxis);
    basePlane.Translate(new Vector3d(0, 0, -groundDepth));

    Cylinder cyl = new Rhino.Geometry.Cylinder(
      new Circle(basePlane, diagDim * (0.75 + pad)), // ensure overlap
      groundDepth - RhinoDocument.ModelAbsoluteTolerance * 10// this might ensure that the breps don't align perfectly, which is better for booleans.
      );

    //Mesh mCyl = Mesh.CreateFromBrep(cyl.ToBrep(true, true), new MeshingParameters())[0];
    //Mesh mCyl = Mesh.CreateFromCylinder(cyl, 1, 36);
    ground = cyl; // OUT
# ---------- c_script: C# additional code ----------
  Interval scaleIval(Interval ival, Double fac){
    Double delt = ival.Length * fac - ival.Length;
    //if (fixMin) return new Interval(ival.T0, ival.T1 + delt);
    return new Interval(ival.T0 - delt / 2, ival.T1 + delt / 2);
  }
# ---------- end c_script ----------
cutbox = Box(c_script.cutBox)
ground = Brep(c_script.ground)

# ---- group: file info
# we add DO CALC and NUDGE here to ensure that any time slices change, the metadata file is updated too.
do_local_calc_2 = Boolean(do_local_calc)
do_save_files_2 = Boolean(do_save_files)
massings_3 = Brep(massings)
px_cnt_2 = Integer(px_cnt)
c_script_2 = CSharpScript(nudge=massings_3, pxCnt=px_cnt_2, doCalc=do_local_calc_2, doSave=do_save_files_2)  # -> out, A, B; inputs nudge: list, pxCnt: Int32, doCalc: Boolean, doSave: Boolean
# ---------- c_script_2: C# ----------
    if (!doCalc) return;
    
    if (RhinoDocument.IsOpening){
      Print("document is opening");
      Component.ExpireSolution(true);
      return;
    }



    Print(GrasshopperDocument.FilePath.ToString());

    //String label = System.IO.Directory.GetParent(RhinoDocument.Path).Name;
    //if (label.Contains('-')) label = label.Split('-')[label.Split('-').Count() - 1].Trim();

    String label = GetTimestamp(DateTime.Now);

    String filename = Path.GetFileNameWithoutExtension(GrasshopperDocument.FilePath);


    A = filename + "-" + pxCnt.ToString() + "-" + label;
    B = label;
# ---------- c_script_2: C# additional code ----------
  public static String GetTimestamp(DateTime value)
  {
    return value.ToString("HHmm_ss_fff");
    //return value.ToString("yyMMdd_HHmmss_fff");
  }
# ---------- end c_script_2 ----------
panel = Panel(c_script_2.B)
filename = Text(c_script_2.A)
# Metadata
panel_2 = Panel(c_script_2.out)
panel_3 = Panel(c_script_2.A)
label = Text(c_script_2.B)

# ----
dom = ConstructDomain(DomainStart=0, DomainEnd=c_script.maxDim)
hit_domain = Domain(dom)

# ---- group: slices and hits
do_local_calc_3 = Boolean(do_local_calc)
visualize_rays_2 = Boolean(visualize_rays)
massings_4 = Brep(massings)
px_cnt_3 = Integer(px_cnt)
c_script_3 = CSharpScript(
    doIt=do_local_calc_3,
    showRays=visualize_rays_2,
    cutBox=cutbox,
    pxCnt=px_cnt_3,
    masses=massings_4,
    ground=ground,
    hitDomain=hit_domain)  # -> out, basePlanes, sampleLines, hitDists, hitCounts; inputs doIt: Boolean, showRays: Boolean, cutBox: Box, pxCnt: Int32, masses: list of Brep, ground: Brep
# ---------- c_script_3: C# ----------
    if (!doIt) return;

    List<Brep> allMasses = new List<Brep>(masses);
    allMasses.Add(ground);
    //Print(allMshs.Count.ToString());

    // DEFINE CUT PLANES
    //
    List<Plane> plns = new List<Plane>();
    Plane plnXY = new Plane(cutBox.PointAt(0.5, 0.5, 1.0), cutBox.Plane.XAxis, cutBox.Plane.YAxis);
    Plane plnXZ = new Plane(cutBox.PointAt(0.5, 0.0, 0.5), cutBox.Plane.XAxis, cutBox.Plane.ZAxis);
    Plane plnYZ = new Plane(cutBox.PointAt(0.0, 0.5, 0.5), -cutBox.Plane.YAxis, cutBox.Plane.ZAxis);
    //Plane plnOA = new Plane(cutBox.PointAt(0.0, 0.0, 0.5), cutBox.PointAt(1, 0, 0) - cutBox.PointAt(0, 1, 0), cutBox.Plane.ZAxis);
    //Plane plnOB = new Plane(cutBox.PointAt(1.0, 0.0, 0.5), cutBox.PointAt(1, 1, 0) - cutBox.PointAt(0, 0, 0), cutBox.Plane.ZAxis);
    //plns.AddRange(new Plane[] {plnXY, plnXZ, plnYZ, plnOA, plnOB});
    plns.AddRange(new Plane[] {plnXY, plnXZ, plnYZ});

    basePlanes = plns; // OUT


    // PLOT RAYS
    //
    DataTree<Ray3d> rays = new DataTree<Ray3d>();
    rays.MergeTree(plotRays(0, plnXY, cutBox, pxCnt - 1, true, false));
    rays.MergeTree(plotRays(1, plnXZ, cutBox, pxCnt - 1, true, false));
    rays.MergeTree(plotRays(2, plnYZ, cutBox, pxCnt - 1, true, true));
    //rays.MergeTree(plotRays(3, plnOA, cutBox, pxCnt - 1));
    //rays.MergeTree(plotRays(4, plnOB, cutBox, pxCnt - 1));

    //if (showRays) sampleRays = rays; // OUT


    // TRACE RAYS
    //

    //DataTree<Point3d> ptsIn = new DataTree<Point3d>();
    //DataTree<Point3d> ptsOut = new DataTree<Point3d>();
    //DataTree<Point3d> ptsProj = new DataTree<Point3d>();
    DataTree<Line> segsProj = new DataTree<Line>();
    DataTree<Double> hDists = new DataTree<Double>();
    DataTree<int> hCounts = new DataTree<int>();

    foreach(GH_Path pth in rays.Paths){
      foreach(Ray3d ray in rays.Branch(pth)){
        bool isInside = false;
        /*
        // SO LONG AS PADDING IS GREATER THAN 1, NO POINTS WILL BE INSIDE
        //
        
        if ( ground.IsPointInside(ray.Position, RhinoDocument.ModelAbsoluteTolerance, false)){
          //ptsIn.Add(ray.Position, pth);
          hDists.Add(-2, pth);
          segsProj.Add(new Line(ray.Position, ray.Position + ray.Direction), pth);
          hCounts.Add(0, pth);
          isInside = true;
          continue;
        }

        foreach(Brep mass in masses){
          if ( mass.IsPointInside(ray.Position, RhinoDocument.ModelAbsoluteTolerance, false)){
            //ptsIn.Add(ray.Position, pth);
            hDists.Add(-1, pth);
            segsProj.Add(new Line(ray.Position, ray.Position + ray.Direction), pth);
            hCounts.Add(0, pth);
            isInside = true;
            break;
          }
        }
        */
        
        if (!isInside){
          //ptsOut.Add(ray.Position, pth);

          Point3d[] proj = Rhino.Geometry.Intersect.Intersection.ProjectPointsToBreps(
            allMasses,
            new List<Point3d> {ray.Position},
            ray.Direction,
            doc.ModelAbsoluteTolerance / 1000
            );
          if (proj.Length > 0) {
            Double[] dists = (from Point3d pt in proj select pt.DistanceTo(ray.Position)).ToArray();
            Array.Sort(dists, proj);

            Double normDist = hitDomain.NormalizedParameterAt(dists[0]);
            if (normDist > 1.0) normDist = 1.0;
            hDists.Add(normDist, pth);

            //ptsProj.Add(proj[0]);
            segsProj.Add(new Line(ray.Position, proj[0]), pth);
            hCounts.Add(proj.Length, pth);
          } else {
            segsProj.Add(new Line(ray.Position, ray.Position + ray.Direction), pth);
            hDists.Add(1.0, pth);
            hCounts.Add(0, pth);
          }

        }

      }
    }

    hitDists = hDists;
    if (showRays) sampleLines = segsProj;
    if (showRays) hitCounts = hCounts;
# ---------- c_script_3: C# additional code ----------
  private DataTree<Ray3d> plotRays(int pth, Plane pln, Box bx, int pxCount, bool plotSide0, bool plotSide1){
    int cntU = pxCount;
    int cntV = cntU;

    Interval[] ivals = boxIntervals(pln, bx);
    Interval ival_u = ivals[0];
    Interval ival_v = ivals[1];
    Interval ival_w = ivals[2];

    DataTree<Ray3d> pts = new DataTree<Ray3d>();

    //Print(ival_u.T0.ToString() + " -> " + ival_u.T1.ToString());
    //Print(ival_v.T0.ToString() + " -> " + ival_v.T1.ToString());

    //int zi = 0;
    Double epsilon = 0.001; // relative to normalized intervals
    Double w1 = ival_w.ParameterAt(epsilon); // note front and back are switched from w values
    Double w0 = ival_w.ParameterAt(1 - epsilon);

    for (int ui = 0; ui <= cntU; ui++){
      Double u = ival_u.ParameterAt(ui / (Double) cntU);
      for (int vi = cntV; vi >= 0; vi--){
        Double v = ival_v.ParameterAt(vi / (Double) cntV);

        // back a bit off the y-direction at the bottom
        if (vi == 0) v = ival_v.ParameterAt(epsilon);

        if (plotSide0) pts.Add(new Ray3d(pln.PointAt(u, v, w0), pln.Normal), new GH_Path(new int[] {pth,0}));
        if (plotSide1) pts.Add(new Ray3d(pln.PointAt(u, v, w1), pln.Normal), new GH_Path(new int[] {pth,1}));
      }
    }

    return pts;

  }


  private Interval[] boxIntervals(Plane pln, Box bx){

    Interval ival_u = new Interval(Double.MaxValue, Double.MinValue);
    Interval ival_v = new Interval(Double.MaxValue, Double.MinValue);
    Interval ival_w = new Interval(Double.MaxValue, Double.MinValue);
    foreach (Point3d pt in bx.GetCorners()){
      Double u;
      Double v;
      pln.ClosestParameter(pt, out u, out v);
      Double w = pln.DistanceTo(pt);

      if (u < ival_u.T0) ival_u.T0 = u;
      if (u > ival_u.T1) ival_u.T1 = u;
      if (v < ival_v.T0) ival_v.T0 = v;
      if (v > ival_v.T1) ival_v.T1 = v;
      if (w < ival_w.T0) ival_w.T0 = w;
      if (w > ival_w.T1) ival_w.T1 = w;
    }

    return new Interval[]{ival_u,ival_v,ival_w};

  }
# ---------- end c_script_3 ----------

# ---- group: siting info
# we add TILES here to ensure that any time slices change, the metadata file is updated too.
do_save_files_3 = Boolean(do_save_files)
site_width = Number(cluster.site_w_4)
site_depth = Number(cluster.site_d_4)
save_path_2 = FilePath(save_path)
tiles = Data()
cutbox_2 = Box(cutbox)
c_script_4 = CSharpScript(
    doSave=do_save_files_3,
    savepath=save_path_2,
    filename=filename,
    cutBox=cutbox_2,
    siteWidth=site_width,
    siteDepth=site_depth,
    label=label,
    tiles=tiles)  # -> out, A, B, C; inputs doSave: Boolean, savepath: String, cutBox: Box, siteWidth: Double, siteDepth: Double, label: String, tiles: tree
# ---------- c_script_4: C# ----------
    if (filename == null) return;

    Plane basePlane = new Plane(cutBox.PointAt(0.5, 0.5, 0), cutBox.PointAt(1.0, 0.5, 0), cutBox.PointAt(0.5, 1.0, 0));

    double x = basePlane.OriginX;
    double y = basePlane.OriginY;
    double z = basePlane.OriginZ;

    double vxx = basePlane.XAxis.X;
    double vxy = basePlane.XAxis.Y;

    double vyx = basePlane.YAxis.X;
    double vyy = basePlane.YAxis.Y;

    double w = cutBox.X.Max - cutBox.X.Min;
    double d = cutBox.Y.Max - cutBox.Y.Min;
    double h = cutBox.Z.Max - cutBox.Z.Min;

    Plane outPlane = new Plane(new Point3d(x, y, z), new Vector3d(vxx, vxy, 0), new Vector3d(vyx, vyy, 0));
    A = outPlane;

    Box bx = new Box(outPlane, new Interval(-w / 2, w / 2), new Interval(-d / 2, d / 2), new Interval(0, h));
    B = bx;

    string fmt = "{0:0.0000}";
    
    IList<string> strings = new List<string>{
        filename + ".png",
        string.Format(fmt, siteWidth),
        string.Format(fmt, siteDepth),
        string.Format(fmt, x),
        string.Format(fmt, y),
        string.Format(fmt, z),
        string.Format(fmt, vxx),
        string.Format(fmt, vxy),
        string.Format(fmt, vyx),
        string.Format(fmt, vyy),
        string.Format(fmt, w),
        string.Format(fmt, d),
        string.Format(fmt, h),
        label
        };
    
    /*
    IList<string> strings = new List<string>{
        filename + ".png",
        siteWidth.ToString(),
        siteDepth.ToString(),
        x.ToString(),
        y.ToString(),
        z.ToString(),
        vxx.ToString(),
        vxy.ToString(),
        vyx.ToString(),
        vyy.ToString(),
        w.ToString(),
        d.ToString(),
        h.ToString(),
        label
        };
    */
    
    
    string content = string.Join(",", strings);
    C = content;

    if (doSave){
      string path = savepath + filename + ".txt";
      System.IO.File.WriteAllText(path, content);

    }
# ---------- end c_script_4 ----------

# ---- group: assign colors
swatch = ColourSwatch(SwatchColor=RGB(255, 0, 0))
c_script_5 = CSharpScript(
    hitDists=c_script_3.hitDists,
    clrNear=ColourSwatch(SwatchColor=RGB(255, 255, 255)),
    clrFar=ColourSwatch(SwatchColor=RGB(0, 0, 0)),
    clrGround=swatch,
    clrMass=swatch)  # -> out, pxColors; inputs hitDists: tree of Double, clrNear: Color, clrFar: Color, clrGround: Color, clrMass: Color
# ---------- c_script_5: C# ----------
    if (hitDists.DataCount <= 1) return; // trees may contain a single Null value

    DataTree<Color> clrOut = new DataTree<Color>();

    foreach(GH_Path pth in hitDists.Paths){
      foreach(Double dist in hitDists.Branch(pth)){
        Color clr = clrFar;
        if (dist >= 0){
          clr = ClrInterp(clrNear, clrFar, dist);
        } else if( dist == -1){
          clr = clrMass;
        } else if( dist == -2){
          clr = clrGround;
        }
        clrOut.Add(clr, pth);
      }
    }

    pxColors = clrOut;
# ---------- c_script_5: C# additional code ----------
  public static Color ClrInterp(Color c1, Color c2, double t) {
    if (t < 0 || t > 1) throw new ArgumentOutOfRangeException("t");
    return Color.FromArgb((int) (c1.R + (c2.R - c1.R) * t), (int) (c1.G + (c2.G - c1.G) * t), (int) (c1.B + (c2.R - c1.B) * t));
  }
# ---------- end c_script_5 ----------

# ----
panel_4 = Panel(c_script_3.out)

# ---- group: api key
panel_5 = Panel("034ce21d-d319-4270-996f-c9ec27981e34")

# ---- group: doc id
tao_leaf_v02_100 = Panel("e7246467-51a6-48e8-84a4-4d500a572991")

# ----
metadata = Number()
split = TextSplit(Text=c_script_4.C, Separators=",")

# ---- group: verify
pln = Plane(c_script_4.A)
box = Box(c_script_4.B)

# ----
# Fitness
do_api_call_2 = Boolean(do_api_call)

# ---- group: visualize sample locations
number_slider = Slider(1578, range=0..3600)
list = ValueList({"plnXY": 0, "plnXZ": 1, "plnYZ": 2, "plnOA": 3, "plnOB": 4}, selected="plnYZ")
c_script_6 = CSharpScript(
    planeIdx=list,
    sliceIdx=Slider(0, range=0..1),
    sampleLines=c_script_3.sampleLines,
    pxColors=c_script_5.pxColors,
    hitCounts=c_script_3.hitCounts)  # -> out, A, B, C, D; inputs planeIdx: Int32, sliceIdx: Int32, sampleLines: tree of Line, pxColors: tree of Color, hitCounts: tree of Int32
# ---------- c_script_6: C# ----------
    if (!sampleLines.PathExists(new GH_Path(new int[] {planeIdx, sliceIdx}))) return;

    List<Line> lines = sampleLines.Branch(new GH_Path(new int[] {planeIdx, sliceIdx}));
    List<Color> colors = pxColors.Branch(new GH_Path(new int[] {planeIdx, sliceIdx}));
    List<int> hits = hitCounts.Branch(new GH_Path(new int[] {planeIdx, sliceIdx}));

    List<Point3d> pts = new List<Point3d>();
    //List<Line> segs = new List<Line>();
    //List<Color> clrs = new List<Color>();
    /*
    for (int n = 0; n < rays.Count; n++){
    Ray3d ray = (Ray3d) rays[n];
    pts.Add(ray.Position);
    segs.Add(new Line(ray.Position, ray.Position + ray.Direction));
    clrs.Add((Color) colors[n]);
    }
    */
    foreach (Line ln in lines){
      pts.Add(ln.PointAt(0));
    }


    A = pts;
    B = lines;
    C = colors;
    D = hits;
# ---------- end c_script_6 ----------
preview = CustomPreview(Geometry=c_script_6.A, Material=c_script_6.C)
preview_2 = CustomPreview(Geometry=c_script_6.B, Material=c_script_6.C)
item = ListItem(List=c_script_6.D, Index=number_slider, Wrap=True)
item_2 = ListItem(List=c_script_6.A, Index=number_slider, Wrap=True)
tag = TextTag(Location=item_2, Text=item)

# ----
metadata_2 = Number(metadata)

# ---- group: siting information
# filename + ".png"
# siteWidth
# siteDepth
# basePlane.OriginX
# basePlane.OriginY
# basePlane.OriginZ
# basePlane.XAxis.X
# basePlane.XAxis.Y
# basePlane.YAxis.X
# basePlane.YAxis.Y
# boxWidth (-x/2 -> x/2)
# boxDepth (-y/2 -> y/2)
# boxHeight (0 -> z)
# Label
panel_6 = Panel(split)

# ----
apikey = Text(panel_5)
docid = Text(tao_leaf_v02_100)

# ---- group: save out images
do_save_files_4 = Boolean(do_save_files)
save_path_3 = FilePath(save_path)
filename_2 = Text(filename)
and = GateAnd(A=do_save_files_4, B=Toggle(False))
small_tiles = CSharpScript(doSave=and, savepath=save_path_3, filename=filename_2, pxColors=c_script_5.pxColors)  # -> out, tiles; inputs doSave: Boolean, savepath: String, filename: String, pxColors: tree of Color
# ---------- small_tiles: C# ----------
    if(!Directory.Exists(savepath)){
      raise("Save path does not exist.");
      return;
    }
    if (filename == null) return;

    if (pxColors.DataCount <= 1) return;// trees may contain a single Null value

    bool slicesPerDirection = validateSlices(pxColors);
    if (!slicesPerDirection) return;

    DataTree<System.Drawing.Bitmap> imgsOut = new DataTree<System.Drawing.Bitmap>();


    foreach(GH_Path pth in pxColors.Paths){
      List<Color> pxColorLst = pxColors.Branch(pth);
      int pxDim = validatePixels(pxColorLst);

      System.Drawing.Bitmap img = new Bitmap(pxDim, pxDim);

      if (pxDim > 0){
        for (var i = 0; i < pxColorLst.Count; i++) {
          int y = i % pxDim;
          int x = i / pxDim;
          //Print(String.Format("{0},{1}", x.ToString(), y.ToString()));
          img.SetPixel(x, y, pxColorLst[i]);
        }

        //String pthStr = String.Join("", from num in pth.Indices select num );
        String pthStr = pth.Indices[0].ToString() + pth.Indices[1].ToString("D2");
        if(doSave) img.Save(savepath + filename + "-" + pthStr + ".png", System.Drawing.Imaging.ImageFormat.Png);

        imgsOut.Add(img, new GH_Path(pth.Indices[0]));

      }
    }

    tiles = imgsOut;
# ---------- small_tiles: C# additional code ----------
  public int validatePixels(List<Color> pxColors){
    Double cnt = Math.Sqrt(pxColors.Count());
    //Print((cnt % 1.0).ToString());
    if (cnt % 1.0 != 0){
      raise("Pixel count is all wrong. This image is not square.");
      return -1;
    }
    return Convert.ToInt32(cnt);
  }

  public bool validateSlices(DataTree<Color> pxColors){

    int expectedSliceCount = 4;

    if ( pxColors.Paths.Count != expectedSliceCount ){
      //Print(pxColors.Paths.Count.ToString());
      raise("Data Tree isn't structured properly. Number of slices not equal to expectedSliceCount.");
      return false;
    }

    if (!pxColors.PathExists(new GH_Path(new int[] {0, 0}))) return false;
    if (!pxColors.PathExists(new GH_Path(new int[] {1, 0}))) return false;
    if (!pxColors.PathExists(new GH_Path(new int[] {2, 0}))) return false;
    if (!pxColors.PathExists(new GH_Path(new int[] {2, 1}))) return false;

    return true;
  }


  public void raise(String msg){
    Print(msg);
    Component.AddRuntimeMessage(GH_RuntimeMessageLevel.Error, msg);
  }
# ---------- end small_tiles ----------
panel_7 = Panel(small_tiles.out)
do_save_files_5 = Boolean(do_save_files)
and_2 = GateAnd(A=do_save_files_5, B=Toggle(True))
big_tiled = CSharpScript(doSave=and_2, tiles=small_tiles.tiles, savepath=save_path_3, filename=filename_2)  # -> out, img; inputs doSave: Boolean, tiles: tree, savepath: String, filename: String
# ---------- big_tiled: C# ----------
    
    if (tiles == null) return;
    if (tiles.DataCount <= 1) return;
    if (filename == null) return;

    int pxDimTile = ((System.Drawing.Bitmap) tiles.Branch(0)[0] ).Width;


    // For a 4-tile image
    //
    int pxDimBig = pxDimTile * 2;
    System.Drawing.Bitmap bigImageOut = new System.Drawing.Bitmap(pxDimBig, pxDimBig);

    ImageToImageRegion((Bitmap) tiles.Branch(0)[0], ref bigImageOut, new Rectangle(0, 0, pxDimTile, pxDimTile));
    ImageToImageRegion((Bitmap) tiles.Branch(1)[0], ref bigImageOut, new Rectangle(0, pxDimTile, pxDimTile, pxDimTile));
    ImageToImageRegion((Bitmap) tiles.Branch(2)[0], ref bigImageOut, new Rectangle(pxDimTile, 0, pxDimTile, pxDimTile));
    ImageToImageRegion((Bitmap) tiles.Branch(2)[1], ref bigImageOut, new Rectangle(pxDimTile, pxDimTile, pxDimTile, pxDimTile));

    if (doSave) bigImageOut.Save(savepath + filename + ".png", System.Drawing.Imaging.ImageFormat.Png);

    img = bigImageOut;


    /*
    foreach(GH_Path pth in tiles.Paths){
      List<object> imgs = tiles.Branch(pth);
      for (int n = 0; n < slicesPer; n++){

      }

    }
 */
# ---------- big_tiled: C# additional code ----------
  public static void ImageToImageRegion(Bitmap srcBitmap, ref Bitmap destBitmap, Rectangle destRegion)
  {
    Rectangle srcRegion = new Rectangle(0, 0, srcBitmap.Width, srcBitmap.Height);
    using (Graphics grD = Graphics.FromImage(destBitmap))
    {
      grD.DrawImage(srcBitmap, destRegion, srcRegion, GraphicsUnit.Pixel);
    }
  }


  public void raise(String msg){
    Print(msg);
    Component.AddRuntimeMessage(GH_RuntimeMessageLevel.Error, msg);
  }
# ---------- end big_tiled ----------

# ----
list_2 = ValueList({"almond", "fan", "heart", "long", "star", "lobed", "jagged"}, selected="jagged")
api_img = Data(big_tiled.img)
api_img_2 = Data(api_img)
c_script_7 = CSharpScript(doIt=do_api_call_2, apikey=apikey, docid=docid, img=api_img_2, numbers=metadata_2)  # -> out, jsonResponse; inputs doIt: Boolean, apikey: String, docid: String
# ---------- c_script_7: C# ----------
    if (img == null) return;
    if (!doIt) return;


    //Stream imgStream = ImageToBase64((Bitmap) img, System.Drawing.Imaging.ImageFormat.Png);
    jsonResponse = null;
    Bitmap bmp = (Bitmap) img;

    System.Net.WebRequest request = LobeCreateImageRequest(apikey, docid, bmp);
    Print(request.RequestUri.ToString());
    if (doIt){
      if (request != null){
        jsonResponse = LobeGetSimplePrediction(request);
      }
    }
# ---------- c_script_7: C# additional code ----------
  public string ImageToBase64(System.Drawing.Image image)
  {

    string base64String = null;
    using(MemoryStream m = new MemoryStream())
    {
      image.Save(m, System.Drawing.Imaging.ImageFormat.Png);
      byte[] imageBytes = m.ToArray();
      base64String = Convert.ToBase64String(imageBytes);
      return base64String;
    }

  }

  public Stream ToStream(Image image, System.Drawing.Imaging.ImageFormat format) {
    var stream = new System.IO.MemoryStream();
    image.Save(stream, format);
    stream.Position = 0;
    return stream;
  }


  String LobeGetSimplePrediction(System.Net.WebRequest request){

    try
    {
      using (var response = request.GetResponse())
      {
        using (var stream = response.GetResponseStream())
        {
          var reader = new StreamReader(stream, System.Text.Encoding.UTF8);
          String jsonResponse = reader.ReadToEnd();
          return jsonResponse;

        }
      }
    }
    catch (System.Net.WebException e)
    {
      Print("WebException");
      Print(e.Message);
      return null;
    }

  }


  System.Net.WebRequest LobeCreateImageRequest(string apikey, string docid, Bitmap img){
    try
    {


      string baseURL = @"https://api.lobe.ai/predict?";
      string fullURL = baseURL + "apikey=" + apikey + "&docid=" + docid;

      System.Net.WebRequest request = System.Net.WebRequest.Create(fullURL);
      request.Method = "POST";
      request.ContentType = "application/json";
      //request.Timeout = 10000;

      //String imagestr = "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";
      //imagestr = " ";
      //String imagestr = Convert.ToBase64String(File.ReadAllBytes(imgpath));

      String imagestr = ImageToBase64(img);

      using(var streamWriter = new StreamWriter(request.GetRequestStream()))
      {
        string json = @"{
          ""inputs"":{
          ""image"":""" + imagestr +@"""
          }
          }";

        streamWriter.Write(json);
        streamWriter.Flush();
        streamWriter.Close();
      }
      //Print(request.Headers.ToString());
      return request;
    }
    catch (System.Net.WebException e)
    {
      Print("LobeCreateImageRequest WebException");
      Print(e.Message);
      return null;
    }
  }
# ---------- end c_script_7 ----------
panel_8 = Panel(c_script_7.out)
c_script_8 = CSharpScript(jsonResponse=c_script_7.jsonResponse)  # -> out, confidences, labels; inputs jsonResponse: String
# ---------- c_script_8: C# ----------
    if (jsonResponse == null) return;
    if (string.IsNullOrWhiteSpace(jsonResponse)) return;
    
    /*
    var pattern = @"\[(.*?)\]";
    var query = "H1-receptor antagonist [HSA:3269] [PATH:hsa04080(3269)]";
    var matches = System.Text.RegularExpressions.Regex.Matches(query, pattern);

    foreach (System.Text.RegularExpressions.Match m in matches) {
      //Print(m.Groups[1].ToString());
    }
    */

    var pattern = @"""confidences"": \[\[(.*?)\]]";
    var matches = System.Text.RegularExpressions.Regex.Matches(jsonResponse, pattern);

    //Print(matches[0].Groups[1].ToString());

    System.Text.RegularExpressions.Regex regex = new System.Text.RegularExpressions.Regex(@"\], \[");

    List<String> ks = new List<String>();
    List<double> vs = new List<double>();
    foreach (String str in regex.Split(matches[0].Groups[1].ToString()) ) {
      String[] sarr = str.Split(',');
      ks.Add(sarr[0].Trim('"'));
      vs.Add(Double.Parse(sarr[1], System.Globalization.NumberStyles.Float));
    }

    labels = ks;
    confidences = vs;
# ---------- end c_script_8 ----------
sort = SortList(Keys=c_script_8.confidences, ValuesA=c_script_8.labels)  # -> reverse(Keys), reverse(ValuesA)
panel_9 = Panel(sort.Keys)
panel_10 = Panel(sort.ValuesA)
c_script_9 = CSharpScript(confidences=c_script_8.confidences, labels=c_script_8.labels, label_desired=list_2)  # -> confidence, label; inputs confidences: list of Double, labels: list of String, label_desired: String
# ---------- c_script_9: C# ----------
    if (confidences.Count == 0) return;
    if (labels.Count == 0) return;
    //if (confidences[0] == null) return;
    if (labels[0] == null) return;

    

    for (int n = 0; n < labels.Count; n++){
      if (labels[n].Contains(label_desired)){
        confidence = confidences[n];
        label = labels[n];
        return;
      }
    }
# ---------- end c_script_9 ----------
item_3 = ListItem(List=sort.Keys, Index="1", Wrap=True)
fitness = Number(c_script_9.confidence)
panel_11 = Panel(fitness)
panel_12 = Panel(c_script_9.label)

# ==== cluster Cluster_3
site_w = ClusterInput()
site_d = ClusterInput()
chim_pos = ClusterInput()
chim_h = ClusterInput()
mass_h = ClusterInput()
mass_d = ClusterInput()
mass_w = ClusterInput()
roof_slope = ClusterInput()
roof_type = ClusterInput()
door_w = ClusterInput()
door_h = ClusterInput()
door_d = ClusterInput()
chim_h_2 = Number(chim_h)
roof_type_2 = Integer(roof_type)
site_d_2 = Number(site_d)
chim_pos_2 = Number(chim_pos)
site_w_2 = Number(site_w)
mass_d_2 = Number(mass_d)
roof_slope_2 = Number(roof_slope)
mass_h_2 = Number(mass_h)
mass_w_2 = Number(mass_w)
door_h_2 = Number(door_h)
door_d_2 = Number(door_d)
door_w_2 = Number(door_w)
pt = ConstructPoint(XCoordinate=expr("-x/2", site_w_2), YCoordinate=0, ZCoordinate=0)
max = Maximum(A=site_w_2, B=site_d_2)
rectangle = Rectangle(Plane=pt, XSize=site_w_2, YSize=max, Radius=0)  # -> Rectangle, Length
chim_pos_3 = Number(chim_pos_2)
site = Curve(rectangle.Rectangle)
num = Number(expr("1-x", chim_pos_3))
site_info = CSharpScript(site=site)  # -> out, w, d; inputs site: Rectangle3d
# ---------- site_info: C# ----------
    int ww = (int) (site.X.T1 - site.X.T0);
    int dd = (int) (site.Y.T1 - site.Y.T0);
    w = ww;
    d = dd;
# ---------- end site_info ----------
roof_slope_3 = Integer(roof_slope_2)
door_x_ratio = Number(door_w_2)
site_width = Number(site_info.w)
site_width_2 = Number(site_width)
multiplication = Multiplication(A=site_width_2, B=mass_w_2)
mass_x = Number(multiplication)
mass_x_2 = Number(mass_x)
site_depth = Number(site_info.d)
site_depth_2 = Number(site_depth)
multiplication_2 = Multiplication(A=site_depth_2, B=mass_d_2)
mass_y = Number(multiplication_2)
pt_2 = ConstructPoint(XCoordinate=0, YCoordinate=expr("x/2", site_depth_2), ZCoordinate=expr("x/2", mass_h_2))
box = CenterBox(Base=pt_2, X=expr("x/2", mass_x), Y=expr("x/2", mass_y), Z=expr("x/2", mass_h_2))
mass_box = Box(box)
mass_box_2 = Box(mass_box)
box_corners = BoxCorners(Box=mass_box_2)  # -> CornerA, CornerB, CornerC, CornerD, CornerE, CornerF, CornerG, CornerH
mass_y_2 = Number(mass_y)
rectangle_2 = Rectangle(Plane=box_corners.CornerE, XSize=mass_x_2, YSize=mass_y_2, Radius=0)  # -> Rectangle, Length
box_2 = EvaluateBox(Box=mass_box, UParameter=[chim_pos_3, num], VParameter=0.5, WParameter=1)  # -> Plane, Point, Include
box_3 = EvaluateBox(Box=mass_box, UParameter=0.5, VParameter=0, WParameter=0)  # -> Plane, Point, Include
mass_x_3 = Number(mass_x)

# ---- group: generates sloped roof planes
sloped_roof_planes = SLOPEDROOFPLANES(base_rect=rectangle_2.Rectangle, slope_x=roof_slope_3, slope_y=roof_slope_3)  # -> O_2, xy_2, xz_2, yz_2, Z_2, x0_2, x1_2, y0_2, y1_2

# ----
multiplication_3 = Multiplication(A=mass_x_3, B=door_x_ratio)
xz = XZPlane(Origin=box_3.Plane)
mass_x_4 = Number(mass_x)
mass_y_3 = Number(mass_y)
num_2 = Number(expr("-x", multiplication_3))
division = Division(A=mass_x_4, B="10")
division_2 = Division(A=mass_y_3, B="10")

# ---- group: generates gable breps
simple_gables = SIMPLEGABLES(
    base_rect=rectangle_2.Rectangle,
    Z=sloped_roof_planes.Z_2,
    x0=sloped_roof_planes.x0_2,
    x1=sloped_roof_planes.x1_2,
    y0=sloped_roof_planes.y0_2,
    y1=sloped_roof_planes.y1_2)  # -> side_gable_2, front_gable_2, cross_gable_2, hip_2

# ----
door_z_ratio = Number(door_h_2)
dom = ConstructDomain(DomainStart=expr("x/2", num_2), DomainEnd=expr("x/2", multiplication_3))
roof_type_3 = Integer(roof_type_2)
dom_2 = ConstructDomain(DomainStart=expr("-x", division), DomainEnd=division)
dom_3 = ConstructDomain(DomainStart=expr("-x", division_2), DomainEnd=division_2)
multiplication_4 = Multiplication(A=mass_h_2, B=door_z_ratio)
mass_height = Number(mass_h_2)
chim_z = Number(chim_h_2)
filter = StreamFilter(
    Gate=roof_type_3,
    Stream0=simple_gables.side_gable_2,
    Stream1=simple_gables.front_gable_2,
    Stream2=simple_gables.cross_gable_2,
    Stream3=simple_gables.hip_2)  # -> flatten(Stream)
rectangle_3 = Rectangle(Plane=box_2.Plane, XSize=dom_2, YSize=dom_3, Radius=0)  # -> Rectangle, Length
rectangle_4 = Rectangle(Plane=xz, XSize=dom, YSize=multiplication_4, Radius=0)  # -> Rectangle, Length
door_depth_ratio = Number(door_d_2)
multiplication_5 = Multiplication(A=chim_z, B=mass_height)
mass_y_4 = Number(mass_y)
Z = UnitZ(Factor=multiplication_5)
multiplication_6 = Multiplication(A=door_depth_ratio, B=mass_y_4)
Y = UnitY(Factor=multiplication_6)
extr = Extrude(Base=rectangle_3.Rectangle, Direction=Z)
extr_2 = Extrude(Base=rectangle_4.Rectangle, Direction=Y)
cap = CapHoles(Brep=extr)
cap_2 = CapHoles(Brep=extr_2)
merge = Merge(Data1=cap_2)
merge_2 = Merge(Data1=mass_box, Data2=filter, Data3=cap)
sunion = SolidUnion(Breps=merge_2)
sdiff = SolidDifference(BrepsA=sunion, BrepsB=merge)
site_w_3 = Number(site_width)
site_w_4 = ClusterOutput(site_w_3)
site_d_3 = Number(site_depth)
site_d_4 = ClusterOutput(site_d_3)
massing = Brep(sdiff)
massing_2 = ClusterOutput(massing)

# ==== cluster SLOPEDROOFPLANES
max_height = ClusterInput()
base_rect = ClusterInput()
max_height_2 = Number(max_height)
slope_y = ClusterInput()
slope_x = ClusterInput()
base_rect_2 = Rectangle(base_rect)
slope_y_2 = Number(slope_y)
slope_x_2 = Number(slope_x)
slope_y_3 = Number(slope_y_2)
drec = DeconstuctRectangle(Rectangle=base_rect_2)  # -> BasePlane, XInterval, YInterval
cluster = Cluster(rec=base_rect_2)
box = EvaluateBox(Box=base_rect_2, UParameter="0", VParameter="0", WParameter=0.5)  # -> Plane, Point, Include
slope_x_3 = Number(slope_x_2)
pt = ConstructPoint(XCoordinate="1", YCoordinate=0, ZCoordinate=slope_y_3)
Y = UnitY(Factor=1)
max_height_3 = Number(max_height_2)
pt_2 = ConstructPoint(XCoordinate=0, YCoordinate="1", ZCoordinate=slope_x_3)
X = UnitX(Factor=1)
multiplication = Multiplication(A=cluster, B="10")
xprod = CrossProduct(VectorA=pt, VectorB=Y, Unitize=True)  # -> Vector, Length
xprod_2 = CrossProduct(VectorA=pt_2, VectorB=X, Unitize=True)  # -> Vector, Length
plane_org = Plane(box.Plane)
dom_x = Domain(drec.XInterval)
dom_y = Domain(drec.YInterval)
null = NullItem(Item=max_height_3)  # -> NullFlags, InvalidFlags, Description
dom_y_2 = Domain(dom_y)
devec = DeconstructVector(Vector=xprod.Vector)  # -> XComponent, YComponent, ZComponent
area = Area(Geometry=base_rect_2)  # -> Area, Centroid
deplane = DeconstructPlane(Plane=plane_org)  # -> Origin, XAxis, YAxis, ZAxis
dom_x_2 = Domain(dom_x)
devec_2 = DeconstructVector(Vector=xprod_2.Vector)  # -> XComponent, YComponent, ZComponent
filter = StreamFilter(Gate=null.NullFlags, Stream0=max_height_3, Stream1=multiplication)
plane_org_2 = Plane(plane_org)
remap = RemapNumbers(Value="0.5", Source=Domain(0, 1), Target=dom_y_2)  # -> Mapped, Clipped
plane_org_3 = Plane(plane_org)
remap_2 = RemapNumbers(Value="0.5", Source=Domain(0, 1), Target=dom_x_2)  # -> Mapped, Clipped
align = AlignPlane(Plane=area.Centroid, Direction=deplane.XAxis)  # -> Plane, Angle
pt_3 = PointOriented(BasePlane=plane_org_2, UComponent=0, VComponent=remap.Clipped, WComponent=0)
height = Number(filter)
pt_4 = PointOriented(BasePlane=plane_org_3, UComponent=remap_2.Clipped, VComponent=0, WComponent=0)
plane_xy = Plane(align.Plane)
plane_xy_2 = Plane(plane_xy)
plane_xy_3 = Plane(plane_xy)
pt_5 = PointOriented(BasePlane=plane_xy_2, UComponent=devec.XComponent, VComponent=devec.YComponent, WComponent=devec.ZComponent)
pt_6 = PointOriented(BasePlane=plane_xy_3, UComponent=devec_2.XComponent, VComponent=devec_2.YComponent, WComponent=devec_2.ZComponent)
vec2pt = Vector2Pt(PointA=plane_xy_2, PointB=pt_5, Unitize=False)  # -> Vector, Length
vec2pt_2 = Vector2Pt(PointA=plane_xy_3, PointB=pt_6, Unitize=False)  # -> Vector, Length
plane_org_4 = Plane(plane_org)
amp = Amplitude(Vector=deplane.ZAxis, Amplitude=height)
plane_org_5 = Plane(plane_org)
pl = ConstructPlane(Origin=plane_xy, XAxis=deplane.XAxis, YAxis=deplane.ZAxis)
pl_2 = ConstructPlane(Origin=plane_xy, XAxis=deplane.YAxis, YAxis=deplane.ZAxis)
pl_3 = PlaneNormal(Origin=pt_3, ZAxis=vec2pt.Vector)
deplane_2 = DeconstructPlane(Plane=plane_org_4)  # -> Origin, XAxis, YAxis, ZAxis
move = Move(Geometry=plane_xy, Motion=amp)  # -> Geometry, Transform
pl_4 = PlaneNormal(Origin=pt_4, ZAxis=vec2pt_2.Vector)
deplane_3 = DeconstructPlane(Plane=plane_org_5)  # -> Origin, XAxis, YAxis, ZAxis
plane_xz = Plane(pl)
plane_yz = Plane(pl_2)
align_2 = AlignPlane(Plane=pl_3, Direction=expr("-x", deplane_2.YAxis))  # -> Plane, Angle
plane_z = Plane(move.Geometry)
align_3 = AlignPlane(Plane=pl_4, Direction=deplane_3.XAxis)  # -> Plane, Angle
plane_yz_2 = Plane(plane_yz)
plane_xz_2 = Plane(plane_xz)
mirror = Mirror(Geometry=align_2.Plane, Plane=plane_yz_2)  # -> Geometry, Transform
mirror_2 = Mirror(Geometry=align_3.Plane, Plane=plane_xz_2)  # -> Geometry, Transform
plane_y0 = Plane(align_2.Plane)
deplane_4 = DeconstructPlane(Plane=align_3.Plane)  # -> Origin, XAxis, YAxis, ZAxis
align_4 = AlignPlane(Plane=mirror_2.Geometry, Direction=expr("-x", deplane_3.XAxis))  # -> Plane, Angle
pl_5 = ConstructPlane(Origin=deplane_4.Origin, XAxis=deplane_4.XAxis, YAxis=expr("-x", deplane_4.YAxis))
align_5 = AlignPlane(Plane=mirror.Geometry, Direction=deplane_2.YAxis)  # -> Plane, Angle
plane_xz_3 = Plane(plane_xz)
plane_yz_3 = Plane(plane_yz)
plane_xy_4 = Plane(plane_xy)
plane_z_2 = Plane(plane_z)
plane_org_6 = Plane(plane_org)
plane_y0_2 = Plane(plane_y0)
plane_x0 = Plane(pl_5)
plane_x0_2 = Plane(plane_x0)
deplane_5 = DeconstructPlane(Plane=align_5.Plane)  # -> Origin, XAxis, YAxis, ZAxis
xy = Plane(plane_xy_4)
xz = Plane(plane_xz_3)
O = Plane(plane_org_6)
yz = Plane(plane_yz_3)
Z = Plane(plane_z_2)
x0 = Plane(plane_x0_2)
y0 = Plane(plane_y0_2)
pl_6 = ConstructPlane(Origin=deplane_5.Origin, XAxis=deplane_5.XAxis, YAxis=expr("-x", deplane_5.YAxis))
xy_2 = ClusterOutput(xy)
Z_2 = ClusterOutput(Z)
xz_2 = ClusterOutput(xz)
O_2 = ClusterOutput(O)
yz_2 = ClusterOutput(yz)
x0_2 = ClusterOutput(x0)
y0_2 = ClusterOutput(y0)
plane_x1 = Plane(align_4.Plane)
plane_x1_2 = Plane(plane_x1)
x1 = Plane(plane_x1_2)
x1_2 = ClusterOutput(x1)
plane_y1 = Plane(pl_6)
plane_y1_2 = Plane(plane_y1)
y1 = Plane(plane_y1_2)
y1_2 = ClusterOutput(y1)

# ==== cluster SIMPLEGABLES
base_rect = ClusterInput()
x0 = ClusterInput()
y0 = ClusterInput()
Z = ClusterInput()
x1 = ClusterInput()
y1 = ClusterInput()
base_rect_2 = Rectangle(base_rect)
Z_2 = Plane(Z)
x0_2 = Plane(x0)
y0_2 = Plane(y0)
x1_2 = Plane(x1)
y1_2 = Plane(y1)
cluster = Cluster_2(rec=base_rect_2, cut_pln=x0_2, limit_pln=Z_2)
cluster_2 = Cluster_2(rec=base_rect_2, cut_pln=x1_2, limit_pln=Z_2)
cluster_3 = Cluster_2(rec=base_rect_2, cut_pln=y0_2, limit_pln=Z_2)
cluster_4 = Cluster_2(rec=base_rect_2, cut_pln=y1_2, limit_pln=Z_2)
sint = SolidIntersection(BrepsA=cluster_3, BrepsB=cluster_4)
sint_2 = SolidIntersection(BrepsA=cluster, BrepsB=cluster_2)
sunion = SolidUnion(Breps=[sint_2, sint])
sint_3 = SolidIntersection(BrepsA=sint_2, BrepsB=sint)
side_gable = Brep(sint_2)
front_gable = Brep(sint)
cross_gable = Brep(sunion)
hip = Brep(sint_3)
hip_2 = ClusterOutput(hip)
side_gable_2 = ClusterOutput(side_gable)
front_gable_2 = ClusterOutput(front_gable)
cross_gable_2 = ClusterOutput(cross_gable)

# ==== cluster Cluster
rec = ClusterInput()
rec_2 = Rectangle(rec)
drec = DeconstuctRectangle(Rectangle=rec_2)  # -> BasePlane, XInterval, YInterval
dedomain = DeconstructDomain(Domain=drec.XInterval)  # -> Start, End
dedomain_2 = DeconstructDomain(Domain=drec.YInterval)  # -> Start, End
subtraction = Subtraction(A=dedomain.End, B=dedomain.Start)
subtraction_2 = Subtraction(A=dedomain_2.End, B=dedomain_2.Start)
max = Maximum(A=subtraction, B=subtraction_2)
max_2 = Number(max)
max_3 = ClusterOutput(max_2)

# ==== cluster Cluster_2
cut_pln = ClusterInput()
limit_pln = ClusterInput()
rec = ClusterInput()
rec_2 = Rectangle(rec)
limit_pln_2 = Plane(limit_pln)
cut_pln_2 = Plane(cut_pln)
area = Area(Geometry=rec_2)  # -> Area, Centroid
cp = PlaneClosestPoint(Point=area.Centroid, Plane=limit_pln_2)  # -> Point, UVPoint, Distance
abs = Absolute(Value=cp.Distance)
cluster = Cluster(rec=rec_2)
limit_dist = Number(abs)
max = Maximum(A=limit_dist, B=cluster)
Z = UnitZ(Factor=limit_dist)
multiplication = Multiplication(A=max, B="10")
extr = Extrude(Base=rec_2, Direction=Z)
cap = CapHoles(Brep=extr)  # -> graft(Brep)
big_num = Number(multiplication)
dom = ConstructDomain(DomainStart=expr("-x", big_num), DomainEnd=big_num)
dom_2 = ConstructDomain(DomainStart=0, DomainEnd=big_num)
box = DomainBox(Base=cut_pln_2, X=dom, Y=dom, Z=dom_2)  # -> graft(Box)
trim = TrimSolid(Shape=cap, Cutters=box)
cap_2 = CapHoles(Brep=trim)
brep = Brep(cap_2)
brep_2 = ClusterOutput(brep)
