# Grasshopper definition 180321 leaf generator.gh (Grasshopper 0.9.76)

roughness = Number(Slider(0.99, range=0.01..0.99))
rad = Number(Slider(10, range=1..10))
must_be_same_as_gene_pool_1 = Panel("40")
genes = GenePool(
    Decimals=2,
    Maximum=1,
    Minimum=0,
    Value=[1, 0.9720526822, 1, 1, 0.9159896746, 0.74, 0.5904929897, 0.5006749246, 0.6979363354, 0.6365902953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])
multiplication = Multiplication(A=roughness, B=rad)
genes_2 = Number(genes)
dom = ConstructDomain(DomainStart=expr("-x", multiplication), DomainEnd=multiplication)
genes_3 = Number(genes_2)
remap = RemapNumbers(Value=genes_3, Source=Domain(0, 1), Target=dom)  # -> Mapped, Clipped
range = Range(Domain="0 to 2*PI", Steps=must_be_same_as_gene_pool_1)
addition = Addition(A=remap.Mapped, B=rad)
split = SplitList(List=range, Index=1)  # -> ListA, ListB
pt = PointPolar(BasePlane=PlaneXY(0, 0, 0), XYAngle=split.ListB, ZAngle=0, Offset=addition)
intcrv = Interpolate(Vertices=pt, Degree=3, Periodic=True, KnotStyle=1)  # -> reparameterize(Curve), Length, Domain
boundary = BoundarySurfaces(Edges=intcrv.Curve)
cx = CurveSelf(Curve=intcrv.Curve)  # -> Points, Params
area = Area(Geometry=boundary)  # -> Area, Centroid
sort = SortList(Keys=area.Area, ValuesA=boundary)  # -> Keys, reverse(ValuesA)
item = ListItem(List=sort.ValuesA, Index=0, Wrap=True)
directory_to_save_to = Panel("C:\Users\ksteinfe\Desktop\TEMP")
preview = CustomPreview(Geometry=item, Shader=ColourSwatch(SwatchColor=RGB(0, 0, 0)))
filename = Panel("cap_{0}.png")
image_size_square = Panel("100")
saved_view_name = Panel("CAPTURE_ME")
# This component must be on "top" of any drawing that we want to appear in the image. If the image is blank, try cutting and re-pasting this group of components back onto the canvas.
toggle = BooleanToggle(True)
tao_leaf_v01a = Panel("034ce21d-d319-4270-996f-c9ec27981e34")
c_script = CSharpScript(size=image_size_square, Dir=directory_to_save_to, Name=filename, VP=saved_view_name, Capture=toggle, Trigger=item)  # -> out, img; inputs size: Int32, Dir: String, Name: String, VP: String, Capture: Boolean
# ---------- c_script: C# ----------
    if (!Capture) return;
    if (string.IsNullOrWhiteSpace(Dir)) return;
    if (string.IsNullOrWhiteSpace(Name)) return;


    // Make sure the directory ends with a \
    if (!Dir.EndsWith(System.IO.Path.DirectorySeparatorChar.ToString()))
      Dir += System.IO.Path.DirectorySeparatorChar;

    // Do not create directories, only use existing ones.
    if (!System.IO.Directory.Exists(Dir))
      return;

    // Assume index=0 for the first filename.
    string fileName = Dir + string.Format(Name, 0);

    // Try to increment the index until we find a name which doesn't exist yet.
    if (System.IO.File.Exists(fileName))
      for (int i = 1; i < int.MaxValue; i++)
      {
        string localName = Dir + string.Format(Name, i);
        if (localName == fileName)
          return;

        if (!System.IO.File.Exists(localName))
        {
          fileName = localName;
          break;
        }
      }

    System.Drawing.Size sz = new System.Drawing.Size(size, size);

    Rhino.Display.RhinoView view = RhinoDocument.Views.Find(VP, false);
    System.Drawing.Bitmap image = view.CaptureToBitmap(sz, false, false, false);
    //A = image.Width;
    image.Save(fileName);
    image.Dispose();

    //A = fileName;

    img = image;
# ---------- end c_script ----------
# Fitness
toggle_2 = BooleanToggle(True)
api_img = Data(c_script.img)
do_api_call = Boolean(toggle_2)
api_img_2 = Data(api_img)
apikey = Text(tao_leaf_v01a)
c_script_2 = CSharpScript(doIt=do_api_call, apikey=apikey, img=api_img_2)  # -> out, jsonResponse; inputs doIt: Boolean, apikey: String
# ---------- c_script_2: C# ----------
    //Stream imgStream = ImageToBase64((Bitmap) img, System.Drawing.Imaging.ImageFormat.Png);
    jsonResponse = null;
    Bitmap bmp = (Bitmap) img;

    if (doIt){
      System.Net.WebRequest request = LobeCreateImageRequest(apikey, bmp);
      if (request != null){
        jsonResponse = LobeGetSimplePrediction(request);
      }
    }
# ---------- c_script_2: C# additional code ----------
  public string ImageToBase64(System.Drawing.Image image)
  {

    string base64String = null;
    using(MemoryStream m = new MemoryStream())
    {
      image.Save(m, System.Drawing.Imaging.ImageFormat.Png);
      byte[] imageBytes = m.ToArray();
      base64String = Convert.ToBase64String(imageBytes);
      return base64String;
    }

  }

  public Stream ToStream(Image image, System.Drawing.Imaging.ImageFormat format) {
    var stream = new System.IO.MemoryStream();
    image.Save(stream, format);
    stream.Position = 0;
    return stream;
  }


  String LobeGetSimplePrediction(System.Net.WebRequest request){

    try
    {
      using (var response = request.GetResponse())
      {
        using (var stream = response.GetResponseStream())
        {
          var reader = new StreamReader(stream, System.Text.Encoding.UTF8);
          String jsonResponse = reader.ReadToEnd();
          return jsonResponse;

        }
      }
    }
    catch (System.Net.WebException e)
    {
      Print("WebException");
      Print(e.Message);
      return null;
    }

  }


  System.Net.WebRequest LobeCreateImageRequest(string apikey, Bitmap img){
    try
    {
      string baseURL = @"https://api.lobe.ai/predict?";
      string fullURL = baseURL + "apikey=" + apikey;
      Print(fullURL);
      System.Net.WebRequest request = System.Net.WebRequest.Create(fullURL);
      request.Method = "POST";
      request.ContentType = "application/json";
      //request.Timeout = 10000;

      //String imagestr = "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";
      //imagestr = " ";
      //String imagestr = Convert.ToBase64String(File.ReadAllBytes(imgpath));

      String imagestr = ImageToBase64(img);

      using(var streamWriter = new StreamWriter(request.GetRequestStream()))
      {
        string json = @"{
          ""inputs"":{
          ""image"":""" + imagestr +@"""
          }
          }";

        streamWriter.Write(json);
        streamWriter.Flush();
        streamWriter.Close();
      }
      //Print(request.Headers.ToString());
      return request;
    }
    catch (System.Net.WebException e)
    {
      Print("LobeCreateImageRequest WebException");
      Print(e.Message);
      return null;
    }
  }
# ---------- end c_script_2 ----------
list = ValueList({"01 - Shotgun", "02 - Patio", "03 - Saltbox", "04 - AFrame", "05 - Dogtrot", "06 - BayGable", "07 - Split", "08 - CapeCod", "10 - Ranch", "11 - QueenAnne", "12 - Eichler", "13 - Mission", "14 - Bungalow", "15 - Pueblo", "16 - Georgian", "AA - Cylindrical", "EE- Box"}, selected="03 - Saltbox")
panel = Panel(c_script_2.out)
c_script_3 = CSharpScript(jsonResponse=c_script_2.jsonResponse)  # -> out, confidences, labels; inputs jsonResponse: String
# ---------- c_script_3: C# ----------
    if (jsonResponse == null) return;
    /*
    var pattern = @"\[(.*?)\]";
    var query = "H1-receptor antagonist [HSA:3269] [PATH:hsa04080(3269)]";
    var matches = System.Text.RegularExpressions.Regex.Matches(query, pattern);

    foreach (System.Text.RegularExpressions.Match m in matches) {
      //Print(m.Groups[1].ToString());
    }
    */

    var pattern = @"""confidences"": \[\[(.*?)\]]";
    var matches = System.Text.RegularExpressions.Regex.Matches(jsonResponse, pattern);

    //Print(matches[0].Groups[1].ToString());

    System.Text.RegularExpressions.Regex regex = new System.Text.RegularExpressions.Regex(@"\], \[");

    List<String> ks = new List<String>();
    List<double> vs = new List<double>();
    foreach (String str in regex.Split(matches[0].Groups[1].ToString()) ) {
      String[] sarr = str.Split(',');
      ks.Add(sarr[0].Trim('"'));
      vs.Add(Double.Parse(sarr[1], System.Globalization.NumberStyles.Float));
    }

    labels = ks;
    confidences = vs;
# ---------- end c_script_3 ----------
sort_2 = SortList(Keys=c_script_3.confidences, ValuesA=c_script_3.labels)  # -> reverse(Keys), reverse(ValuesA)
c_script_4 = CSharpScript(confidences=c_script_3.confidences, labels=c_script_3.labels, label=list)  # -> out, confidence; inputs confidences: list of Double, labels: list of String, label: String
# ---------- c_script_4: C# ----------
    if (confidences.Count == 0) return;
    if (labels.Count == 0) return;
    //if (confidences[0] == null) return;
    if (labels[0] == null) return;

    for (int n = 0; n < labels.Count; n++){
      if (labels[n].Contains(label)){
        confidence = confidences[n];
        return;
      }
    }
# ---------- end c_script_4 ----------
fitness = Number(c_script_4.confidence)
