# Grasshopper definition 180321 view capture template.gh (Grasshopper 0.9.76)

number_slider = Slider(0.696, range=0..1)
pop2d = Populate2D(Region={Plane=PlaneXY(0, 0, 0), Size=Domain2(u=0..20, v=0..10)}, Count=100, Seed=1)
cir = Circle(Plane=pop2d, Radius=number_slider)
area = Area(Geometry=cir)  # -> Area, Centroid
num = Number(area.Area)
galapagos = Galapagos(fitness=num, gene=number_slider)

# ----
# View Capture
# view capture to file: Hook up a "Trigger" geometry that, when altered, will trigger the capturing of an image. Whatever display mode settings are active for the given viewport name will be used. These components must be on "top" of any drawing that we want to appear in the image. If the image is blank, try cutting and re-pasting this group of components back onto the canvas.
panel = Panel("C:\Users\kyle\Desktop\temp")
saved_view_name = Panel("Top")
size_always_square = Panel("200")
do_capture_img = Boolean(Toggle(False))
trigger = Data(cir)
c_script = CSharpScript(doCapture=do_capture_img, viewname=saved_view_name, size=size_always_square, trigger=trigger)  # -> out, img; inputs doCapture: Boolean, viewname: String, size: Int32, trigger: tree
# ---------- c_script: C# ----------
    if (!doCapture) return;
    
    System.Drawing.Size s = new System.Drawing.Size(size, size);
    Rhino.Display.RhinoView view = RhinoDocument.Views.Find(viewname, false);
    Bitmap image = view.CaptureToBitmap(s, false, false, false);
    img = image;
    //image.Dispose();
# ---------- end c_script ----------
do_save_img_file = Boolean(Toggle(False))
c_script_2 = CSharpScript(doSaveFile=do_save_img_file, path=panel, filename="capture_{0}.png", img=c_script.img)  # inputs doSaveFile: Boolean, path: String, filename: String
# ---------- c_script_2: C# ----------
    if (!doSaveFile) return;
    if (string.IsNullOrWhiteSpace(path)) return;
    if (string.IsNullOrWhiteSpace(filename)) return;

    // Make sure the directory ends with a \
    if (!path.EndsWith(System.IO.Path.DirectorySeparatorChar.ToString()))
      path += System.IO.Path.DirectorySeparatorChar;

    // Do not create directories, only use existing ones.
    if (!System.IO.Directory.Exists(path)){
      Component.AddRuntimeMessage(GH_RuntimeMessageLevel.Warning, "path does not exist");
      return;
    }

    // Assume index=0 for the first filename.
    int n = 0;
    string fmt = "D5";
    string name = n.ToString(fmt);
    string filepath = path + string.Format(filename, name);

    // Try to increment the index until we find a name which doesn't exist yet.
    if (System.IO.File.Exists(filepath))
      for (int i = 1; i < int.MaxValue; i++)
      {
        name = i.ToString(fmt);
        string localFilepath = path + string.Format(filename, name);
        if (localFilepath == filepath)
          return;

        if (!System.IO.File.Exists(localFilepath))
        {
          filepath = localFilepath;
          break;
        }
      }

    Component.Message = string.Format(filename, name);
    System.Drawing.Bitmap image = (System.Drawing.Bitmap) img;
    image.Save(filepath);
# ---------- end c_script_2 ----------
captured_img = Data(c_script.img)
