# Grasshopper definition 180323 blackblob to Tao Leaf v02 100.gh (Grasshopper 1.0.4)
# plug-ins: Opossum

do_capture_img = Boolean(Toggle(True))
do_save_img_file = Boolean(Toggle(True))
do_api_call = Boolean(Toggle(True))

roughness = Number(Slider(0.5, range=0.01..0.99))
rad = Number(Slider(10, range=1..10))
genes = GenePool(Decimals=2, Maximum=1, Minimum=0, Value=[1, 1, 1, 0.99, 1, 1, 1, 1, 1, 1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])
must_be_same_as_gene_pool_1 = Panel("40")
multiplication = Multiplication(A=roughness, B=rad)
genes_2 = Number(genes)
dom = ConstructDomain(DomainStart=expr("-x", multiplication), DomainEnd=multiplication)
genes_3 = Number(genes_2)
remap = RemapNumbers(Value=genes_3, Source=Domain(0, 1), Target=dom)  # -> Mapped, Clipped
range = Range(Domain="0 to 2*PI", Steps=must_be_same_as_gene_pool_1)
addition = Addition(A=remap.Mapped, B=rad)
split = SplitList(List=range, Index=1)  # -> ListA, ListB
pt = PointPolar(BasePlane=PlaneXY(0, 0, 0), XYAngle=split.ListB, ZAngle=0, Offset=addition)
intcrv = Interpolate(Vertices=pt, Degree=3, Periodic=True, KnotStyle=1)  # -> reparameterize(Curve), Length, Domain
cx = CurveSelf(Curve=intcrv.Curve)  # -> Points, Params
boundary = BoundarySurfaces(Edges=intcrv.Curve)
area = Area(Geometry=boundary)  # -> Area, Centroid
sort = SortList(Keys=area.Area, ValuesA=boundary)  # -> Keys, reverse(ValuesA)
item = ListItem(List=sort.ValuesA, Index=0, Wrap=True)
material = CreateMaterial(
    Diffuse=ColourSwatch(SwatchColor=RGB(0, 0, 0)),
    Specular=RGB(255, 255, 255),
    Emission=RGB(0, 0, 0),
    Transparency=0,
    Shine=0)
leaf_srf = Surface(item)
preview = CustomPreview(Geometry=leaf_srf, Shader=material)
area_2 = Area(Geometry=leaf_srf)  # -> Area, Centroid
dumb_fitness = Number(area_2.Area)

# ---- group: api key
# Fitness
panel = Panel("034ce21d-d319-4270-996f-c9ec27981e34")

# ---- group: doc id
tao_leaf_v02_100 = Panel("e7246467-51a6-48e8-84a4-4d500a572991")

# ----
# View Capture
# view capture to file: Hook up a "Trigger" geometry that, when altered, will trigger the capturing of an image. Whatever display mode settings are active for the given viewport name will be used. These components must be on "top" of any drawing that we want to appear in the image. If the image is blank, try cutting and re-pasting this group of components back onto the canvas.
panel_2 = Panel("C:\Users\ksteinfe\Desktop\TEMP")
saved_view_name = Panel("Top")
size_always_square = Panel("200")
do_capture_img_2 = Boolean(do_capture_img)
trigger = Data(leaf_srf)
c_script = CSharpScript(doCapture=do_capture_img_2, viewname=saved_view_name, size=size_always_square, trigger=trigger)  # -> out, img; inputs doCapture: Boolean, viewname: String, size: Int32, trigger: tree
# ---------- c_script: C# ----------
    if (!doCapture) return;
    
    System.Drawing.Size s = new System.Drawing.Size(size, size);
    Rhino.Display.RhinoView view = RhinoDocument.Views.Find(viewname, false);
    Bitmap image = view.CaptureToBitmap(s, false, false, false);
    img = image;
    //image.Dispose();
# ---------- end c_script ----------
do_save_img_file_2 = Boolean(do_save_img_file)
c_script_2 = CSharpScript(doSaveFile=do_save_img_file_2, path=panel_2, filename="capture_{0}.png", img=c_script.img)  # inputs doSaveFile: Boolean, path: String, filename: String
# ---------- c_script_2: C# ----------
    if (!doSaveFile) return;
    if (string.IsNullOrWhiteSpace(path)) return;
    if (string.IsNullOrWhiteSpace(filename)) return;

    // Make sure the directory ends with a \
    if (!path.EndsWith(System.IO.Path.DirectorySeparatorChar.ToString()))
      path += System.IO.Path.DirectorySeparatorChar;

    // Do not create directories, only use existing ones.
    if (!System.IO.Directory.Exists(path)){
      Component.AddRuntimeMessage(GH_RuntimeMessageLevel.Warning, "path does not exist");
      return;
    }

    // Assume index=0 for the first filename.
    int n = 0;
    string fmt = "D5";
    string name = n.ToString(fmt);
    string filepath = path + string.Format(filename, name);

    // Try to increment the index until we find a name which doesn't exist yet.
    if (System.IO.File.Exists(filepath))
      for (int i = 1; i < int.MaxValue; i++)
      {
        name = i.ToString(fmt);
        string localFilepath = path + string.Format(filename, name);
        if (localFilepath == filepath)
          return;

        if (!System.IO.File.Exists(localFilepath))
        {
          filepath = localFilepath;
          break;
        }
      }

    Component.Message = string.Format(filename, name);
    System.Drawing.Bitmap image = (System.Drawing.Bitmap) img;
    image.Save(filepath);
# ---------- end c_script_2 ----------
captured_img = Data(c_script.img)

do_api_call_2 = Boolean(do_api_call)
apikey = Text(panel)
docid = Text(tao_leaf_v02_100)
api_img = Data(captured_img)
api_img_2 = Data(api_img)
c_script_3 = CSharpScript(doIt=do_api_call_2, apikey=apikey, docid=docid, img=api_img_2)  # -> out, jsonResponse; inputs doIt: Boolean, apikey: String, docid: String
# ---------- c_script_3: C# ----------
    if (img == null) return;


    //Stream imgStream = ImageToBase64((Bitmap) img, System.Drawing.Imaging.ImageFormat.Png);
    jsonResponse = null;
    Bitmap bmp = (Bitmap) img;

    System.Net.WebRequest request = LobeCreateImageRequest(apikey, docid, bmp);
    Print(request.RequestUri.ToString());
    if (doIt){
      if (request != null){
        jsonResponse = LobeGetSimplePrediction(request);
      }
    }
# ---------- c_script_3: C# additional code ----------
  public string ImageToBase64(System.Drawing.Image image)
  {

    string base64String = null;
    using(MemoryStream m = new MemoryStream())
    {
      image.Save(m, System.Drawing.Imaging.ImageFormat.Png);
      byte[] imageBytes = m.ToArray();
      base64String = Convert.ToBase64String(imageBytes);
      return base64String;
    }

  }

  public Stream ToStream(Image image, System.Drawing.Imaging.ImageFormat format) {
    var stream = new System.IO.MemoryStream();
    image.Save(stream, format);
    stream.Position = 0;
    return stream;
  }


  String LobeGetSimplePrediction(System.Net.WebRequest request){

    try
    {
      using (var response = request.GetResponse())
      {
        using (var stream = response.GetResponseStream())
        {
          var reader = new StreamReader(stream, System.Text.Encoding.UTF8);
          String jsonResponse = reader.ReadToEnd();
          return jsonResponse;

        }
      }
    }
    catch (System.Net.WebException e)
    {
      Print("WebException");
      Print(e.Message);
      return null;
    }

  }


  System.Net.WebRequest LobeCreateImageRequest(string apikey, string docid, Bitmap img){
    try
    {


      string baseURL = @"https://api.lobe.ai/predict?";
      string fullURL = baseURL + "apikey=" + apikey + "&docid=" + docid;

      System.Net.WebRequest request = System.Net.WebRequest.Create(fullURL);
      request.Method = "POST";
      request.ContentType = "application/json";
      //request.Timeout = 10000;

      //String imagestr = "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";
      //imagestr = " ";
      //String imagestr = Convert.ToBase64String(File.ReadAllBytes(imgpath));

      String imagestr = ImageToBase64(img);

      using(var streamWriter = new StreamWriter(request.GetRequestStream()))
      {
        string json = @"{
          ""inputs"":{
          ""image"":""" + imagestr +@"""
          }
          }";

        streamWriter.Write(json);
        streamWriter.Flush();
        streamWriter.Close();
      }
      //Print(request.Headers.ToString());
      return request;
    }
    catch (System.Net.WebException e)
    {
      Print("LobeCreateImageRequest WebException");
      Print(e.Message);
      return null;
    }
  }
# ---------- end c_script_3 ----------
panel_3 = Panel(c_script_3.out)
c_script_4 = CSharpScript(jsonResponse=c_script_3.jsonResponse)  # -> out, confidences, labels; inputs jsonResponse: String
# ---------- c_script_4: C# ----------
    if (jsonResponse == null) return;
    /*
    var pattern = @"\[(.*?)\]";
    var query = "H1-receptor antagonist [HSA:3269] [PATH:hsa04080(3269)]";
    var matches = System.Text.RegularExpressions.Regex.Matches(query, pattern);

    foreach (System.Text.RegularExpressions.Match m in matches) {
      //Print(m.Groups[1].ToString());
    }
    */

    var pattern = @"""confidences"": \[\[(.*?)\]]";
    var matches = System.Text.RegularExpressions.Regex.Matches(jsonResponse, pattern);

    //Print(matches[0].Groups[1].ToString());

    System.Text.RegularExpressions.Regex regex = new System.Text.RegularExpressions.Regex(@"\], \[");

    List<String> ks = new List<String>();
    List<double> vs = new List<double>();
    foreach (String str in regex.Split(matches[0].Groups[1].ToString()) ) {
      String[] sarr = str.Split(',');
      ks.Add(sarr[0].Trim('"'));
      vs.Add(Double.Parse(sarr[1], System.Globalization.NumberStyles.Float));
    }

    labels = ks;
    confidences = vs;
# ---------- end c_script_4 ----------
list = ValueList({"almond", "fan", "heart", "long"}, selected="heart")
sort_2 = SortList(Keys=c_script_4.confidences, ValuesA=c_script_4.labels)  # -> reverse(Keys), reverse(ValuesA)
panel_4 = Panel(sort_2.Keys)
galapagos = Galapagos(fitness=fitness, gene=genes)
opitmization_solver_with_surrogate_model = Opossum(fitness=fitness, gene=genes)  # "Opitmization Solver with Surrogate Models"
panel_5 = Panel(sort_2.ValuesA)
c_script_5 = CSharpScript(confidences=c_script_4.confidences, labels=c_script_4.labels, label_desired=list)  # -> confidence, label; inputs confidences: list of Double, labels: list of String, label_desired: String
# ---------- c_script_5: C# ----------
    if (confidences.Count == 0) return;
    if (labels.Count == 0) return;
    //if (confidences[0] == null) return;
    if (labels[0] == null) return;

    

    for (int n = 0; n < labels.Count; n++){
      if (labels[n].Contains(label_desired)){
        confidence = confidences[n];
        label = labels[n];
        return;
      }
    }
# ---------- end c_script_5 ----------
item_2 = ListItem(List=sort_2.Keys, Index="1", Wrap=True)
fitness = Number(c_script_5.confidence)
panel_6 = Panel(fitness)
panel_7 = Panel(c_script_5.label)
