# Grasshopper definition 180422 json tester.gh (Grasshopper 1.0.5)
# plug-ins: FreshEyes

panel = Panel("""{
	"outputs": {
		"confidences": [
			[
				"AFrame",
				0.9999998807907104
			],
			[
				"BayGable",
				2.187500305720163e-17
			],
			[
				"Box",
				6.478594744008248e-11
			],
			[
				"Bungalow",
				1.587335991815042e-11
			],
			[
				"CapeCod",
				2.5903257403619984e-12
			],
			[
				"Cylindrical",
				6.846467143217794e-11
			],
			[
				"Dogtrot",
				5.820045834159515e-12
			],
			[
				"Eichler",
				1.874839835518203e-14
			],
			[
				"Georgian",
				1.6032510876621414e-13
			],
			[
				"Mission",
				5.631682250090652e-16
			],
			[
				"Patio",
				8.804615491952221e-18
			],
			[
				"Pueblo",
				4.003669276534186e-14
			],
			[
				"QueenAnne",
				5.1834953701274805e-14
			],
			[
				"Ranch",
				1.9254861377202004e-14
			],
			[
				"Saltbox",
				5.8771838951088284e-08
			],
			[
				"Shotgun",
				7.123516354567982e-08
			],
			[
				"Split",
				1.685642458948422e-10
			]
		],
		"prediction": "AFrame"
	}
}""")
panel_2 = Panel("""[
			[
				"AFrame",
				0.999998807907104
			],
			[
				"BayGable",
				2.187500305720163e-17
			],
			[
				"Box",
				6.478594744008248e-11
			],
			[
				"Bungalow",
				1.587335991815042e-11
			],
			[
				"CapeCod",
				2.5903257403619984e-12
			],
			[
				"Cylindrical",
				6.846467143217794e-11
			],
			[
				"Dogtrot",
				5.820045834159515e-12
			],
			[
				"Eichler",
				1.874839835518203e-14
			],
			[
				"Georgian",
				1.6032510876621414e-13
			],
			[
				"Mission",
				5.631682250090652e-16
			],
			[
				"Patio",
				8.804615491952221e-18
			],
			[
				"Pueblo",
				4.003669276534186e-14
			],
			[
				"QueenAnne",
				5.1834953701274805e-14
			],
			[
				"Ranch",
				1.9254861377202004e-14
			],
			[
				"Saltbox",
				5.8771838951088284e-08
			],
			[
				"Shotgun",
				7.123516354567982e-08
			],
			[
				"Split",
				1.685642458948422e-10
			]
		]""")
sel_tokn = SelectJSONToken(JSON=panel, Path="outputs.confidences")
prs_conf = ParseConfidences(JSON=sel_tokn)  # -> Labels, Confidences
lbl_conf = LabelConfidence(JSON=sel_tokn, Label="aframe")
panel_3 = Panel(prs_conf.Labels)
panel_4 = Panel(lbl_conf)
panel_5 = Panel(prs_conf.Confidences)
