# Grasshopper definition 180422 req tester.gh (Grasshopper 1.0.5)
# plug-ins: FreshEyes

path = FilePath("C:\GitHub\fresh-eyes\server\test_images\a_leaf.jpg")
c_script = CSharpScript(imgpath=path)  # -> out, A; inputs imgpath: String
# ---------- c_script: C# ----------
    
    
    if (System.IO.File.Exists(imgpath)) A = Image.FromFile(imgpath);
# ---------- end c_script ----------
api_img = Data(c_script.A)
img = Image(c_script.A)
panel = Panel(api_img)
panel_2 = Panel(img)
panel_3 = Panel("""10
20
30
40
50""")
api_img_2 = Data(api_img)
api_img_3 = Data(api_img)
req_local = LocalRequest(DoPost=Toggle(False), URL="http://localhost:5008/predict", Image=api_img_2)  # -> Messages, JSONRequest, JSONResponse
req_lobe = LobeRequest(
    DoPost=Toggle(False),
    APIKey="034ce21d-d319-4270-996f-c9ec27981e34",
    DocID="0e558949-a02d-4189-a8aa-68b292d7dfeb",
    Image=api_img_3)  # -> Messages, JSONRequest, JSONResponse
img_to_json = ImageToJSON(Image=api_img_3)
panel_4 = Panel(req_local.JSONRequest)
panel_5 = Panel(req_local.JSONResponse)
panel_6 = Panel(req_lobe.Messages)
panel_7 = Panel(req_lobe.JSONRequest)
panel_8 = Panel(req_local.Messages)
panel_9 = Panel(req_lobe.JSONResponse)
sel_token = SelectJSONToken(JSON=req_lobe.JSONResponse, Path="outputs.confidences")
sel_token_2 = SelectJSONToken(JSON=req_lobe.JSONResponse, Path="outputs['top label']")
sel_token_3 = SelectJSONToken(JSON=req_local.JSONResponse, Path="confidences")
sel_token_4 = SelectJSONToken(JSON=req_local.JSONResponse, Path="['top label']")
panel_10 = Panel(sel_token_2)
panel_11 = Panel(sel_token_4)
prs_conf = ParseConfidences(JSON=sel_token)  # -> Labels, ConfidenceValues
prs_conf_2 = ParseConfidences(JSON=sel_token_3)  # -> Labels, ConfidenceValues
panel_12 = Panel(prs_conf.Labels)
panel_13 = Panel(prs_conf_2.Labels)
panel_14 = Panel(prs_conf.ConfidenceValues)
panel_15 = Panel(prs_conf_2.ConfidenceValues)
