# Grasshopper definition 180423 isovist mapper.gh (Grasshopper 1.0.5)
# plug-ins: FreshEyes

sample_station_pts = Point([Point(2.168743082, -2.671934289, 0), Point(-2.234917557, 2.995949073, 0), Point(-2.960496152, -3.221362182, 0)])
sample_bounds = Curve(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)
sample_context = Box({Plane=Plane(origin=(1, 1, 0), x=(0, 1, 0), y=(1, 0, 0)), X=Domain(0, 4), Y=Domain(0, 4), Z=Domain(-4, 0)})

# ----
# CONSTANTS
# The following values should remain constant across a training set of all spatial types.
# KEEP WIDTH DIVISIBLE BY 4 TO MAKE EASY PANORAMA ROTATIONS
number_slider = Slider(0.333, range=0..0.333)
eye_height_in_meters = Panel("1.5")
px_height = Panel("40")
fixed_domain = Panel("0 to 50")
px_width = Panel("80")
px_width_2 = Integer(px_width)
px_height_2 = Integer(px_height)
hit_domain = Domain(fixed_domain)
eye_height = Number(eye_height_in_meters)
pi = Pi(Factor=number_slider)
theta_crop = Number(pi)

# ---- group: prefix for saved files
panel = Panel("sample_isovist")

# ----
station_pts = Point(flatten(sample_station_pts))
bounds_of_possible_positions = Curve(sample_bounds)
context = Brep(sample_context)

# ---- group: path to image save directory
path = FilePath("C:\Users\ksteinfe\Desktop\TEMP\")

# ----
do_save_images = Boolean(Toggle(True))
save_path = FilePath(path)
filename_prefix = Text(panel)
isovist_v2a = Panel("034ce21d-d319-4270-996f-c9ec27981e34")
isovist_v2a_2 = Panel("0e558949-a02d-4189-a8aa-68b292d7dfeb")
bounds_of_possible_positions_2 = Curve(bounds_of_possible_positions)
bounds_of_possible_positions_3 = Curve(bounds_of_possible_positions)
hit_domain_2 = Domain(hit_domain)
theta_crop_2 = Number(theta_crop)
theta_crop_3 = Number(theta_crop)
station_pts_2 = Point(station_pts)
eye_height_2 = Number(eye_height)
context_2 = Brep(context)
px_height_3 = Integer(px_height_2)
px_height_4 = Integer(px_height_2)
px_width_3 = Integer(px_width_2)
px_width_4 = Integer(px_width_2)

# ---- group: define ground
# The ground is defined at the lower edge of the bounding box of the given Breps. Ground box is sized to 1000 times the size of the bounding box. Maximum x-y dimension of bounding box is returned.
cluster = Cluster_2(bounds=bounds_of_possible_positions_2, breps=context_2)  # -> ground_2, max_dim_2

# ---- group: define sample planes
# The planes constructed here describe the location and orientation of the isovist samples. Planes are constructed at EYE HEIGHT above each STATION PT, and are oriented such that their x-axis points away from the center of the BOUNDS OF POSSIBLE POSITIONS
cluster_2 = Cluster(bnd_crv=bounds_of_possible_positions_3, pt2d=station_pts_2, eye_height=eye_height_2)

# ----
merge = Merge(Data1=cluster.ground_2, Data2=context_2)
sample_planes = Plane(cluster_2)
sample_planes_2 = Plane(sample_planes)
sample_planes_3 = Plane(sample_planes)
breps = Brep(merge)
breps_2 = Brep(breps)
breps_3 = Brep(breps)

# ---- group: visualize isovist rays
# We only use this to visualize and debug isovist rays. Disable when not using.
iso_ray = RayIsovist(
    PixelWidth=px_width_4,
    PixelHeight=px_height_4,
    VerticalCrop=theta_crop_3,
    BrepsToSample=breps_3,
    SampleLocations=sample_planes_3)  # disabled

# ---- group: calculate isovist
# Where the action is. Here an isovist of the given BREPS is taken at each of the defined SAMPLE PLANES. The number of rays calculated for each isovist is set by PX WIDTH and PX HEIGHT, with the rays distributed equally across a sphere. This sphere is cropped on the top and bottom at a value determined by THETA CROP.
# 
# A tree of values describing the distance travelled by each ray(normalized to the given HIT DOMAIN) is returned.
iso_norm = NormalizedIsovist(
    PixelWidth=px_width_3,
    PixelHeight=px_height_3,
    HitDomain=hit_domain_2,
    VerticalCrop=theta_crop_2,
    BrepsToSample=breps_2,
    SampleLocations=sample_planes_2)

# ---- group: this seems to help
sqrt = SquareRoot(Value=iso_norm)

# ----
nullrep = ReplaceNulls(Items=sqrt, Replacements="1.0")  # -> Items, Count
gradient = Gradient(LowerLimit=0, UpperLimit=1, Parameter=nullrep.Items, stops=[0: RGB(255, 255, 255), 1: RGB(0, 0, 0)])
panel_2 = Panel("""ResponseURI: http://localhost:5008/predict
ResponseStatus: Completed
StatusCode: InternalServerError

Something went wrong. 

 TensorArray was passed element_shape [128,128,3] which does not match the Tensor at index 0: [128,128,4]
	 [[Node: 49de2b04-ce65-48ee-b813-eb1dc1064b1a/map/TensorArrayStack/TensorArrayGatherV3 = TensorArrayGatherV3[_class=["loc:@49de2b04-ce65-48ee-b813-eb1dc1064b1a/map/TensorArray_1"], dtype=DT_FLOAT, element_shape=[128,128,3], _device="/job:localhost/replica:0/task:0/device:CPU:0"](49de2b04-ce65-48ee-b813-eb1dc1064b1a/map/TensorArray_1, 49de2b04-ce65-48ee-b813-eb1dc1064b1a/map/TensorArrayStack/range, 49de2b04-ce65-48ee-b813-eb1dc1064b1a/map/while/Exit_1)]]

Caused by op '49de2b04-ce65-48ee-b813-eb1dc1064b1a/map/TensorArrayStack/TensorArrayGatherV3', defined at:
  File "server.py", line 32, in <module>
    predictor = tf.contrib.predictor.from_saved_model(exported_path)
  File "C:\Anaconda3\envs\fresheyes\lib\site-packages\tensorflow\contrib\predictor\predictor_factories.py", line 129, in from_saved_model
    graph=graph)
  File "C:\Anaconda3\envs\fresheyes\lib\site-packages\tensorflow\contrib\predictor\saved_model_predictor.py", line 156, in __init__
    loader.load(self._session, tags.split(','), export_dir)
  File "C:\Anaconda3\envs\fresheyes\lib\site-packages\tensorflow\python\saved_model\loader_impl.py", line 216, in load
    saver = tf_saver.import_meta_graph(meta_graph_def_to_load, **saver_kwargs)
  File "C:\Anaconda3\envs\fresheyes\lib\site-packages\tensorflow\python\training\saver.py", line 1838, in import_meta_graph
    **kwargs)
  File "C:\Anaconda3\envs\fresheyes\lib\site-packages\tensorflow\python\framework\meta_graph.py", line 660, in import_scoped_meta_graph
    producer_op_list=producer_op_list)
  File "C:\Anaconda3\envs\fresheyes\lib\site-packages\tensorflow\python\util\deprecation.py", line 316, in new_func
    return func(*args, **kwargs)
  File "C:\Anaconda3\envs\fresheyes\lib\site-packages\tensorflow\python\framework\importer.py", line 554, in import_graph_def
    op_def=op_def)
  File "C:\Anaconda3\envs\fresheyes\lib\site-packages\tensorflow\python\framework\ops.py", line 3160, in create_op
    op_def=op_def)
  File "C:\Anaconda3\envs\fresheyes\lib\site-packages\tensorflow\python\framework\ops.py", line 1625, in __init__
    self._traceback = self._graph._extract_stack()  # pylint: disable=protected-access

InvalidArgumentError (see above for traceback): TensorArray was passed element_shape [128,128,3] which does not match the Tensor at index 0: [128,128,4]
	 [[Node: 49de2b04-ce65-48ee-b813-eb1dc1064b1a/map/TensorArrayStack/TensorArrayGatherV3 = TensorArrayGatherV3[_class=["loc:@49de2b04-ce65-48ee-b813-eb1dc1064b1a/map/TensorArray_1"], dtype=DT_FLOAT, element_shape=[128,128,3], _device="/job:localhost/replica:0/task:0/device:CPU:0"](49de2b04-ce65-48ee-b813-eb1dc1064b1a/map/TensorArray_1, 49de2b04-ce65-48ee-b813-eb1dc1064b1a/map/TensorArrayStack/range, 49de2b04-ce65-48ee-b813-eb1dc1064b1a/map/while/Exit_1)]]

ResponseURI: http://localhost:5008/predict
ResponseStatus: Completed
StatusCode: InternalServerError

Something went wrong. 

 TensorArray was passed element_shape [128,128,3] which does not match the Tensor at index 0: [128,128,4]
	 [[Node: 49de2b04-ce65-48ee-b813-eb1dc1064b1a/map/TensorArrayStack/TensorArrayGatherV3 = TensorArrayGatherV3[_class=["loc:@49de2b04-ce65-48ee-b813-eb1dc1064b1a/map/TensorArray_1"], dtype=DT_FLOAT, element_shape=[128,128,3], _device="/job:localhost/replica:0/task:0/device:CPU:0"](49de2b04-ce65-48ee-b813-eb1dc1064b1a/map/TensorArray_1, 49de2b04-ce65-48ee-b813-eb1dc1064b1a/map/TensorArrayStack/range, 49de2b04-ce65-48ee-b813-eb1dc1064b1a/map/while/Exit_1)]]

Caused by op '49de2b04-ce65-48ee-b813-eb1dc1064b1a/map/TensorArrayStack/TensorArrayGatherV3', defined at:
  File "server.py", line 32, in <module>
    predictor = tf.contrib.predictor.from_saved_model(exported_path)
  File "C:\Anaconda3\envs\fresheyes\lib\site-packages\tensorflow\contrib\predictor\predictor_factories.py", line 129, in from_saved_model
    graph=graph)
  File "C:\Anaconda3\envs\fresheyes\lib\site-packages\tensorflow\contrib\predictor\saved_model_predictor.py", line 156, in __init__
    loader.load(self._session, tags.split(','), export_dir)
  File "C:\Anaconda3\envs\fresheyes\lib\site-packages\tensorflow\python\saved_model\loader_impl.py", line 216, in load
    saver = tf_saver.import_meta_graph(meta_graph_def_to_load, **saver_kwargs)
  File "C:\Anaconda3\envs\fresheyes\lib\site-packages\tensorflow\python\training\saver.py", line 1838, in import_meta_graph
    **kwargs)
  File "C:\Anaconda3\envs\fresheyes\lib\site-packages\tensorflow\python\framework\meta_graph.py", line 660, in import_scoped_meta_graph
    producer_op_list=producer_op_list)
  File "C:\Anaconda3\envs\fresheyes\lib\site-packages\tensorflow\python\util\deprecation.py", line 316, in new_func
    return func(*args, **kwargs)
  File "C:\Anaconda3\envs\fresheyes\lib\site-packages\tensorflow\python\framework\importer.py", line 554, in import_graph_def
    op_def=op_def)
  File "C:\Anaconda3\envs\fresheyes\lib\site-packages\tensorflow\python\framework\ops.py", line 3160, in create_op
    op_def=op_def)
  File "C:\Anaconda3\envs\fresheyes\lib\site-packages\tensorflow\python\framework\ops.py", line 1625, in __init__
    self._traceback = self._graph._extract_stack()  # pylint: disable=protected-access

InvalidArgumentError (see above for traceback): TensorArray was passed element_shape [128,128,3] which does not match the Tensor at index 0: [128,128,4]
	 [[Node: 49de2b04-ce65-48ee-b813-eb1dc1064b1a/map/TensorArrayStack/TensorArrayGatherV3 = TensorArrayGatherV3[_class=["loc:@49de2b04-ce65-48ee-b813-eb1dc1064b1a/map/TensorArray_1"], dtype=DT_FLOAT, element_shape=[128,128,3], _device="/job:localhost/replica:0/task:0/device:CPU:0"](49de2b04-ce65-48ee-b813-eb1dc1064b1a/map/TensorArray_1, 49de2b04-ce65-48ee-b813-eb1dc1064b1a/map/TensorArrayStack/range, 49de2b04-ce65-48ee-b813-eb1dc1064b1a/map/while/Exit_1)]]

ResponseURI: http://localhost:5008/predict
ResponseStatus: Completed
StatusCode: InternalServerError

Something went wrong. 

 TensorArray was passed element_shape [128,128,3] which does not match the Tensor at index 0: [128,128,4]
	 [[Node: 49de2b04-ce65-48ee-b813-eb1dc1064b1a/map/TensorArrayStack/TensorArrayGatherV3 = TensorArrayGatherV3[_class=["loc:@49de2b04-ce65-48ee-b813-eb1dc1064b1a/map/TensorArray_1"], dtype=DT_FLOAT, element_shape=[128,128,3], _device="/job:localhost/replica:0/task:0/device:CPU:0"](49de2b04-ce65-48ee-b813-eb1dc1064b1a/map/TensorArray_1, 49de2b04-ce65-48ee-b813-eb1dc1064b1a/map/TensorArrayStack/range, 49de2b04-ce65-48ee-b813-eb1dc1064b1a/map/while/Exit_1)]]

Caused by op '49de2b04-ce65-48ee-b813-eb1dc1064b1a/map/TensorArrayStack/TensorArrayGatherV3', defined at:
  File "server.py", line 32, in <module>
    predictor = tf.contrib.predictor.from_saved_model(exported_path)
  File "C:\Anaconda3\envs\fresheyes\lib\site-packages\tensorflow\contrib\predictor\predictor_factories.py", line 129, in from_saved_model
    graph=graph)
  File "C:\Anaconda3\envs\fresheyes\lib\site-packages\tensorflow\contrib\predictor\saved_model_predictor.py", line 156, in __init__
    loader.load(self._session, tags.split(','), export_dir)
  File "C:\Anaconda3\envs\fresheyes\lib\site-packages\tensorflow\python\saved_model\loader_impl.py", line 216, in load
    saver = tf_saver.import_meta_graph(meta_graph_def_to_load, **saver_kwargs)
  File "C:\Anaconda3\envs\fresheyes\lib\site-packages\tensorflow\python\training\saver.py", line 1838, in import_meta_graph
    **kwargs)
  File "C:\Anaconda3\envs\fresheyes\lib\site-packages\tensorflow\python\framework\meta_graph.py", line 660, in import_scoped_meta_graph
    producer_op_list=producer_op_list)
  File "C:\Anaconda3\envs\fresheyes\lib\site-packages\tensorflow\python\util\deprecation.py", line 316, in new_func
    return func(*args, **kwargs)
  File "C:\Anaconda3\envs\fresheyes\lib\site-packages\tensorflow\python\framework\importer.py", line 554, in import_graph_def
    op_def=op_def)
  File "C:\Anaconda3\envs\fresheyes\lib\site-packages\tensorflow\python\framework\ops.py", line 3160, in create_op
    op_def=op_def)
  File "C:\Anaconda3\envs\fresheyes\lib\site-packages\tensorflow\python\framework\ops.py", line 1625, in __init__
    self._traceback = self._graph._extract_stack()  # pylint: disable=protected-access

InvalidArgumentError (see above for traceback): TensorArray was passed element_shape [128,128,3] which does not match the Tensor at index 0: [128,128,4]
	 [[Node: 49de2b04-ce65-48ee-b813-eb1dc1064b1a/map/TensorArrayStack/TensorArrayGatherV3 = TensorArrayGatherV3[_class=["loc:@49de2b04-ce65-48ee-b813-eb1dc1064b1a/map/TensorArray_1"], dtype=DT_FLOAT, element_shape=[128,128,3], _device="/job:localhost/replica:0/task:0/device:CPU:0"](49de2b04-ce65-48ee-b813-eb1dc1064b1a/map/TensorArray_1, 49de2b04-ce65-48ee-b813-eb1dc1064b1a/map/TensorArrayStack/range, 49de2b04-ce65-48ee-b813-eb1dc1064b1a/map/while/Exit_1)]]""")
px_height_5 = Integer(px_height_2)
px_width_5 = Integer(px_width_2)
px_to_img = PixelsToImage(PixelColors=gradient, ImageWidth=px_width_5, ImageHeight=px_height_5)  # -> flatten(Image)
api_img = FEImage(px_to_img)
api_img_2 = FEImage(api_img)
api_img_3 = FEImage(api_img)
req_local = LocalRequest(DoPost=Toggle(False), URL="http://localhost:5008/predict", Image=api_img_2)  # -> Messages, JSONRequest, JSONResponse
req_lobe = LobeRequest(DoPost=Toggle(False), APIKey=isovist_v2a, DocID=isovist_v2a_2, Image=api_img_3)  # -> Messages, JSONRequest, JSONResponse
panel_3 = Panel(req_local.JSONRequest)
sel_token = SelectJSONToken(JSON=req_lobe.JSONResponse, Path="outputs.confidences")
sel_token_2 = SelectJSONToken(JSON=req_local.JSONResponse, Path="outputs['top label']")
prs_conf = ParseConfidences(JSON=sel_token)  # -> Labels, ConfidenceValues
panel_4 = Panel(sel_token_2)
panel_5 = Panel(prs_conf.Labels)
panel_6 = Panel(prs_conf.ConfidenceValues)
panel_7 = Panel(api_img)

# ==== cluster Cluster
bnd_crv = ClusterInput()
eye_height = ClusterInput()
pt2d = ClusterInput()
bnd_crv_2 = Curve(bnd_crv)
eye_height_2 = Number(eye_height)
pt2d_2 = Point(pt2d)
area = Area(Geometry=bnd_crv_2)  # -> Area, Centroid
Z = UnitZ(Factor=eye_height_2)
move = Move(Geometry=pt2d_2, Motion=Z)  # -> Geometry, Transform
vec2pt = Vector2Pt(PointA=pt2d_2, PointB=area.Centroid, Unitize=False)  # -> Vector, Length
Z_2 = UnitZ(Factor=1)
rev = Reverse(Vector=vec2pt.Vector)
xprod = CrossProduct(VectorA=rev, VectorB=Z_2, Unitize=False)  # -> Vector, Length
rev_2 = Reverse(Vector=xprod.Vector)
pl = ConstructPlane(Origin=move.Geometry, XAxis=rev, YAxis=rev_2)
plns = Plane(pl)
plns_2 = ClusterOutput(plns)

# ==== cluster Cluster_2
bounds = ClusterInput()
breps = ClusterInput()
breps_2 = Brep(breps)
bounds_2 = Curve(bounds)
boundary = BoundarySurfaces(Edges=bounds_2)
merge = Merge(Data1=boundary, Data2=breps_2)
bbox = BoundingBox(Content=merge, Plane=PlaneXY(0, 0, 0), UnionBox=True)  # -> Box, Box_2
debox = DeconstructBox(Box=bbox.Box)  # -> Plane, X, Y, Z
dedomain = DeconstructDomain(Domain=debox.X)  # -> Start, End
dedomain_2 = DeconstructDomain(Domain=debox.Y)  # -> Start, End
avr = Average(Input=[dedomain.Start, dedomain.End])
subtraction = Subtraction(A=dedomain.End, B=dedomain.Start)
avr_2 = Average(Input=[dedomain_2.Start, dedomain_2.End])
subtraction_2 = Subtraction(A=dedomain_2.End, B=dedomain_2.Start)
multiplication = Multiplication(A=subtraction, B="1000")
multiplication_2 = Multiplication(A=subtraction_2, B="1000")
pt = ConstructPoint(XCoordinate=avr, YCoordinate=avr_2, ZCoordinate=expr("-x", "1"))
max = Maximum(A=subtraction, B=subtraction_2)
max_dim = Number(max)
box = CenterBox(Base=pt, X=multiplication, Y=multiplication_2, Z="1")
ground = Box(box)
max_dim_2 = ClusterOutput(max_dim)
ground_2 = ClusterOutput(ground)
