# Grasshopper definition 170202 isovist.gh (Grasshopper 1.0.4)

px_width = Panel("60")
px_height = Panel("40")
px_height_2 = Integer(px_height)
px_width_2 = Integer(px_width)
range = Range(Domain=Domain(0, 1), Steps=Slider(3, range=0..50))
line = Line(Line((-16076.64246, 882.7658353, 0), (27186.10615, -9334.611661, 0)))
ground = Box({Plane=Plane(origin=(-19513.84386, -32194.85694, 0), x=(0, 1, 0), y=(1, 0, 0)), X=Domain(0, 65788.25482), Y=Domain(0, 55757.17845), Z=Domain(0, 465.1985987)})

box = Box([{Plane=PlaneXY(-3201.942755, 155.6131349, 0), X=Domain(0, 1510.104349), Y=Domain(0, 1462.39236), Z=Domain(0, 3321.483523)}, {Plane=PlaneXY(-5721.749, -9005.671508, 0), X=Domain(0, 14880.3878), Y=Domain(0, 551.786445), Z=Domain(0, 946.6027618)}, {Plane=PlaneXY(14308.88262, -4041.761715, 0), X=Domain(0, 4195.325487), Y=Domain(0, 18402.82453), Z=Domain(0, 26855.07267)}])
brep = Brep([box, ground])

eye_height_in_mm = Panel("1500")
eval = EvaluateCurve(Curve=line, Parameter=Slider(0, range=0..1))  # -> Point, Tangent, Angle
station = Point(eval.Point)
Z = UnitZ(Factor=eye_height_in_mm)
move = Move(Geometry=station, Motion=Z)  # -> Geometry, Transform
pl_origin = PlaneOrigin(Base=PlaneXY(0, 0, 0), Origin=move.Geometry)
pi = Pi(Factor=Slider(0, range=-1..1))
eye = Point(move.Geometry)
rotate = Rotate(Geometry=pl_origin, Angle=pi, Plane=pl_origin)  # -> Geometry, Transform
sphere_radius_in_mm = Panel("1000")
px_width_3 = Integer(px_width_2)
px_height_3 = Integer(px_height_2)
c_script = CSharpScript(pxWidth=px_width_3, pxHeight=px_height_3, samplePlanes=rotate.Geometry, breps=brep, domPad="0.125")  # -> out, hitCounts, hitPts, hitDists, hitDom; inputs pxWidth: Int32, pxHeight: Int32, samplePlanes: list of Plane, breps: list of Brep, domPad: Double
# ---------- c_script: C# ----------
    Component.Message = "I do isovists!";

    //DataTree<Point3d> points = new DataTree<Point3d>();
    //points.Add(new Point3d(i * dist, j * dist, k * dist), new GH_Path(i, j));

    //A = points;

    Boolean showPts = false;

    DataTree<int> hCounts = new DataTree<int>();
    DataTree<object> hPts = new DataTree<object>();
    DataTree<object> hDists = new DataTree<object>();
    Interval dom = new Interval(Double.MinValue, Double.MaxValue);

    //List<int> hCounts = new List<int>();
    //List<object> hPts = new List<object>();
    //List<object> hTs = new List<object>();
    //List<object> hDists = new List<object>();

    Interval ivalPhi = new Interval(0, 2.0 * Math.PI);
    Interval ivalTheta = new Interval(0, Math.PI);
    Double divPhi = (ivalPhi.T1 - ivalPhi.T0) / (pxWidth);
    Double divTheta = (ivalTheta.T1 - ivalTheta.T0) / (pxHeight);
    Double nudPhi = divPhi / 1000;
    Double nudTheta = divTheta / 1000;

    for (int p = 0; p < samplePlanes.Count; p++){
      Plane samplePlane = samplePlanes[p];

      for (Double phi = ivalPhi.T0 + nudPhi; phi <= ivalPhi.T1 - nudPhi; phi += divPhi ){
        for (Double theta = ivalTheta.T0 + nudTheta; theta <= ivalTheta.T1 - nudTheta; theta += divTheta ){
          //Print(String.Format("{0},{1}", ivalPhi.NormalizedParameterAt(phi), ivalTheta.NormalizedParameterAt(theta)));

          Point3d xpt = new Point3d();
          Double xt = Double.MaxValue;

          Double radius = 1.0;
          Double x = radius * Math.Sin(theta) * Math.Cos(phi);
          Double y = radius * Math.Sin(theta) * Math.Sin(phi);
          Double z = radius * Math.Cos(theta);

          Ray3d ray = new Ray3d(samplePlane.PointAt(x, y, z), new Vector3d(x, y, z));
          Line seg = new Line(samplePlane.Origin, samplePlane.PointAt(x, y, z));

          var points = Rhino.Geometry.Intersect.Intersection.ProjectPointsToBreps(
            breps,
            new List<Point3d> {samplePlane.Origin},
            ray.Direction,
            doc.ModelAbsoluteTolerance
            );

          int validHits = 0;
          foreach (Point3d pt in points){
            Double t = seg.ClosestParameter(pt);
            if ((t >= 0) && (t < xt)){
              xt = t;
              xpt = pt;
            }

            if (t >= 0) validHits++;
          }

          if (xt < Double.MaxValue){
            hCounts.Add(validHits, new GH_Path(p));
            if (showPts) hPts.Add(xpt, new GH_Path(p));
            //hTs.Add(x, new GH_Path(p)t);
            Double dist = xt * seg.Length;
            hDists.Add(dist, new GH_Path(p));

            if ((dom.Min == Double.MinValue ) || (dist < dom.Min)) dom.T0 = dist;
            if ((dom.Max == Double.MaxValue ) || (dist > dom.Max)) dom.T1 = dist;

          } else {
            hCounts.Add(0, new GH_Path(p));
            if (showPts) hPts.Add(null, new GH_Path(p));
            //hTs.Add(null, new GH_Path(p));
            hDists.Add(null, new GH_Path(p));
          }



        }
      }

      Double delt = dom.Max - dom.Min;
      Interval dDom = new Interval(Math.Max(dom.Min - delt * domPad, 0), dom.Max + delt * domPad);

      hitCounts = hCounts;
      if (showPts) hitPts = hPts;
      hitDists = hDists;
      hitDom = dDom;
    }
# ---------- end c_script ----------
sph = Sphere(Base=rotate.Geometry, Radius=sphere_radius_in_mm)

panel = Panel(c_script.out)
panel_2 = Panel(c_script.hitCounts)
panel_3 = Panel(c_script.hitDom)
panel_4 = Panel(c_script.hitPts)
panel_5 = Panel(c_script.hitDists)

panel_6 = Panel("0 to 100000")
dedomain = DeconstructDomain(Domain=c_script.hitDom)  # -> Start, End
nullrep = ReplaceNulls(Items=c_script.hitDists, Replacements=dedomain.End)  # -> Items, Count
gradient = Gradient(
    LowerLimit=dedomain.Start,
    UpperLimit=dedomain.End,
    Parameter=nullrep.Items,
    stops=[0: RGB(234, 38, 0), 0.25: RGB(234, 126, 0), 0.5: RGB(254, 244, 84), 0.75: RGB(173, 203, 249), 1: RGB(75, 107, 169)])
tstat = TreeStatistics(Tree=simplify(gradient))  # -> Paths, Length, Count
filename = Panel("test")
series = Series(Start=0, Step=1, Count=tstat.Count)
expression = Expression(x=series, y=filename, Expression="Format(\"{1}_{0:0000}\", x, y)")
txt = Text(graft(expression))
px_height_4 = Integer(px_height_2)
px_width_4 = Integer(px_width_2)

# ---- group: PATH TO LOCAL IMAGE
path = FilePath("C:\Users\ksteinfe\Desktop\")

# ----
c_script_2 = CSharpScript(doSave=Button(), savepath=path, filename=txt, pxColors=gradient, pxWidth=px_width_4, pxHeight=px_height_4)  # -> out, A; inputs doSave: Boolean, savepath: String, filename: String, pxColors: list of Color, pxWidth: Int32, pxHeight: Int32
# ---------- c_script_2: C# ----------
    if (!doSave) return;

    if (pxColors.Count != pxWidth * pxHeight) {
      String msg = "Pixel dimension does not match number of colors provided!";
      Print(msg);
      Component.AddRuntimeMessage(GH_RuntimeMessageLevel.Error, msg);
      //GrasshopperDocument.RequestAbortSolution();
      return;
    }

    System.Drawing.Bitmap img = new Bitmap(pxWidth, pxHeight);

    for (var i = 0; i < pxColors.Count; i++) {
      int y = i % pxHeight;
      int x = i / pxHeight;
      //Print(String.Format("{0},{1}", x.ToString(), y.ToString()));
      img.SetPixel(x, y, pxColors[i]);
    }
    img.Save(savepath + filename + ".png", System.Drawing.Imaging.ImageFormat.Png);


    A = img;
# ---------- end c_script_2 ----------
