# Grasshopper definition 170207 T1 isovist trainerMT.gh (Grasshopper 1.0.4)

# GLOBALS
# The following values should be set for each spatial data type, and possibly for each run of parametric variation of the context.
filename = Panel("t1_07")
# CONTROLS
button = Button()
list = ValueList({"Debug": False, "Production": True}, selected="Debug")

# ---- group: path to image save directory
path = FilePath("C:\Users\ksteinfe\Desktop\")

# ----
do_production = Boolean(list)
do_save_images = Boolean(button)
save_path = FilePath(path)
filename_prefix = Text(filename)
do_production_2 = Boolean(do_production)
production_sample_count = Integer(Slider(20, range=3..20))
sphere_radius_in_meters = Panel("1.0")
col_wall_extent = Number(Slider(2.44, range=1..3))
col_wall_width = Number(Slider(0.45, range=0.1..0.75))
apx_col_count = Integer(Slider(46, range=9..64))
col_height = Number(Slider(6.5, range=0..10))
production_sample_count_2 = Integer(production_sample_count)
not = GateNot(A=do_production_2)
debug_station_pt = Point(Point(-6.386189072, -3.968153145, 0))
sqrt = SquareRoot(Value=apx_col_count)
debug_station_pt_2 = Point(debug_station_pt)
# CONSTANTS
# The following values should remain constant across a training set of all spatial types.
number_slider = Slider(0.25, range=0..0.333)
int = Integer(expr("x-1", sqrt))
eye_height_in_meters = Panel("1.5")
fixed_domain = Panel("0 to 30")
px_width = Panel("80")
px_height = Panel("40")
px_height_2 = Integer(px_height)
px_height_3 = Integer(px_height_2)
px_height_4 = Integer(px_height_2)
px_width_2 = Integer(px_width)
px_width_3 = Integer(px_width_2)
px_width_4 = Integer(px_width_2)
do_production_3 = Boolean(do_production)
hit_domain = Domain(fixed_domain)
hit_domain_2 = Domain(hit_domain)
hit_domain_3 = Domain(hit_domain)
dedomain = DeconstructDomain(Domain=hit_domain_3)  # -> Start, End
multiplication = Multiplication(A=dedomain.End, B=col_wall_extent)
eye_height = Number(eye_height_in_meters)
pt = ConstructPoint(XCoordinate=expr("-x/2", multiplication), YCoordinate=expr("-x/2", multiplication), ZCoordinate=0)
division = Division(A=multiplication, B=int)
pi = Pi(Factor=number_slider)
theta_crop = Number(pi)
theta_crop_2 = Number(theta_crop)
theta_crop_3 = Number(theta_crop)
recgrid = Rectangular(Plane=pt, SizeX=division, SizeY=division, ExtentX=int, ExtentY=int)  # -> Cells, flatten(Points)
hit_domain_4 = Domain(hit_domain)
pt_2 = Point(recgrid.Points)
Z = UnitZ(Factor=expr("x/2", col_height))
remap = RemapNumbers(Value=0.5, Source=Domain(0, 1), Target=hit_domain_4)  # -> Mapped, Clipped
pt_3 = ConstructPoint(XCoordinate=expr("3*x", remap.Mapped), YCoordinate=expr("3*x", remap.Mapped), ZCoordinate=0)
pt_4 = ConstructPoint(XCoordinate=expr("-x", remap.Mapped), YCoordinate=expr("-x", remap.Mapped), ZCoordinate=0)
pt_5 = ConstructPoint(XCoordinate=expr("-3*x", remap.Mapped), YCoordinate=expr("-3*x", remap.Mapped), ZCoordinate=0)
move = Move(Geometry=pt_2, Motion=Z)  # -> Geometry, Transform
column_grid = CenterBox(Base=move.Geometry, X=col_wall_width, Y=col_wall_width, Z=expr("x/2", col_height))
rectangle = Rectangle(Plane=pt_4, XSize=hit_domain_4, YSize=hit_domain_4, Radius=0)  # -> Rectangle, Length
rec_2pt = Rectangle2Pt(Plane=PlaneXY(0, 0, 0), PointA=pt_5, PointB=pt_3, Radius=0)  # -> Rectangle, Length
group = Group(Objects=column_grid)
in_bnds = Curve(rectangle.Rectangle)

# ---- group: choose
in_bnds_2 = Curve(in_bnds)
crv = Curve(<curve referenced from the Rhino model>)

# ----
bounds_of_possible_positions = Curve(in_bnds_2)
bounds_of_possible_positions_2 = Curve(bounds_of_possible_positions)
boundary = BoundarySurfaces(Edges=bounds_of_possible_positions_2)
popgeo = PopulateGeometry(Geometry=boundary, Count=production_sample_count_2, Seed=1)
cluster = Cluster_2(bnd_crv=bounds_of_possible_positions, pt2d=debug_station_pt_2, eye_height=eye_height)
cluster_2 = Cluster_2(bnd_crv=bounds_of_possible_positions_2, pt2d=popgeo, eye_height=eye_height)
c_script = CSharpScript(doProduction=do_production_3, debugPln=cluster, prodPln=cluster_2)  # -> out, A; inputs doProduction: Boolean, debugPln: Plane, prodPln: list of Plane
# ---------- c_script: C# ----------
    
    if (doProduction) A = prodPln;
    else A = debugPln;
# ---------- end c_script ----------
sample_planes = Plane(c_script.A)
sample_planes_2 = Plane(sample_planes)
c_script_2 = CSharpScript(
    thetaCrop=theta_crop_3,
    pxWidth=px_width_4,
    pxHeight=px_height_4,
    samplePlanes=sample_planes_2,
    radius=sphere_radius_in_meters)  # -> out, A; inputs thetaCrop: Double, pxWidth: Int32, pxHeight: Int32, samplePlanes: list of Plane, radius: Double
# ---------- c_script_2: C# ----------
    Double nudge = RhinoDocument.ModelAbsoluteTolerance;
    Interval ivalPhi = new Interval(nudge, 2.0 * Math.PI - nudge);
    Interval ivalTheta = new Interval(thetaCrop, Math.PI - thetaCrop);
    List<Brep> retBreps = new List<Brep>();
    List<Curve> retCrvs = new List<Curve>();

    for (int p = 0; p < samplePlanes.Count; p++){
      Plane samplePlane = samplePlanes[p];
      List<Curve> crvs = new List<Curve>();
      for (int xi = 0; xi < pxWidth; xi++){
        List<Point3d> pts = new List<Point3d>();
        for (int yi = 0; yi < pxHeight; yi++){
          Double phi = ivalPhi.ParameterAt((Double) xi / (Double) (pxWidth - 1));
          Double theta = ivalTheta.ParameterAt((Double) yi / (Double) (pxHeight - 1));

          Double x = radius * Math.Sin(theta) * Math.Cos(phi);
          Double y = radius * Math.Sin(theta) * Math.Sin(phi);
          Double z = radius * Math.Cos(theta);

          Point3d pt = samplePlane.PointAt(x, y, z);
          pts.Add(pt);


        }

        Curve cv = Curve.CreateInterpolatedCurve(pts, 3);
        crvs.Add(cv);
        retCrvs.Add(cv);
      }

      Brep[] breps = Brep.CreateFromLoft(crvs, Point3d.Unset, Point3d.Unset, LoftType.Normal, true);
      retBreps.Add(breps[0]);
    }

    A = retBreps;
    //B = retCrvs;
# ---------- end c_script_2 ----------
out_bnds = Curve(rec_2pt.Rectangle)
bbox = BoundingBox(Content=group, Plane=PlaneXY(0, 0, 0))  # -> Box, Box_2
filename_prefix_2 = Text(filename_prefix)
debrep = DeconstructBrep(Brep=bbox.Box)  # -> Faces, Edges, Vertices
split = SplitList(List=column_grid, Index=expr("x+1", int))  # -> ListA, ListB
lng = ListLength(List=column_grid)
single_column = ListItem(List=column_grid, Index=expr("x/2", lng), Wrap=True)
x_wall1 = ListItem(List=debrep.Faces, Index="0", Wrap=True)
ywall1 = ListItem(List=debrep.Faces, Index="1", Wrap=True)
xwall2 = ListItem(List=debrep.Faces, Index="2", Wrap=True)
ywall2 = ListItem(List=debrep.Faces, Index="3", Wrap=True)
roof = ListItem(List=debrep.Faces, Index="5", Wrap=True)
collonade = Brep(split.ListA)
_13_three_walls_roof = Brep([x_wall1, ywall1, ywall2, roof])
_12_three_walls = Brep([x_wall1, ywall1, ywall2])
_1_column = Brep(single_column)
_2_collonade = Brep(collonade)
_3_collonade_roof = Brep([collonade, roof])
_4_column_grid = Brep(column_grid)
_5_column_grid_roof = Brep([column_grid, roof])
_6_one_wall = Brep(ywall2)
_7_one_wall_roof = Brep([x_wall1, roof])
_8_two_parallel_walls = Brep([ywall1, ywall2])
_9_two_parallel_walls_roof = Brep([x_wall1, xwall2, roof])
_10_two_walls_corner = Brep([x_wall1, ywall2])
_11_two_walls_corner_roof = Brep([roof, ywall2, x_wall1])
_14_four_walls = Brep([ywall2, xwall2, ywall1, x_wall1])
_15_four_walls_roof_room = Brep([x_wall1, ywall1, xwall2, ywall2, roof])
do_save_images_2 = Boolean(do_save_images)
save_path_2 = FilePath(save_path)
px_height_5 = Integer(px_height_2)
px_width_5 = Integer(px_width_2)
context = Brep(_9_two_parallel_walls_roof)
context_2 = Brep(context)

# ---- group: define ground
# DEFINE GROUND: The ground is defined at the lower edge of the bounding box of the given Breps. Ground box is sized to 1000 times the size of the bounding box. Maximum x-y dimension of bounding box is returned.
cluster_3 = Cluster(breps=context_2)  # -> ground_2, max_dim_2

# ----
merge = Merge(Data1=cluster_3.ground_2, Data2=context_2)
breps = Brep(merge)
breps_2 = Brep(breps)
c_script_3 = CSharpScript(
    showPts=not,
    pxWidth=px_width_3,
    pxHeight=px_height_3,
    samplePlanes=sample_planes_2,
    breps=breps_2,
    hitDomain=hit_domain_2,
    thetaCrop=theta_crop_2)  # -> out, hitCounts, hitPts, hitDists, A; inputs showPts: Boolean, pxWidth: Int32, pxHeight: Int32, samplePlanes: list of Plane, breps: list of Brep, thetaCrop: Double
# ---------- c_script_3: C# ----------
    DataTree<int> hCounts = new DataTree<int>();
    DataTree<object> hPts = new DataTree<object>();
    DataTree<object> hDists = new DataTree<object>();
    Interval dom = new Interval(Double.MinValue, Double.MaxValue);

    Interval ivalPhi = new Interval(0, 2.0 * Math.PI);
    Interval ivalTheta = new Interval(thetaCrop, Math.PI - thetaCrop);

    for (int p = 0; p < samplePlanes.Count; p++){
      Plane samplePlane = samplePlanes[p];

      for (int xi = pxWidth; xi > 0; xi--){
        for (int yi = 0; yi < pxHeight; yi++){
          Double phi = ivalPhi.ParameterAt((Double) xi / (Double) (pxWidth - 1));
          Double theta = ivalTheta.ParameterAt((Double) yi / (Double) (pxHeight - 1));

          Point3d xpt = new Point3d();
          Double xt = Double.MaxValue;

          Double radius = 1.0;
          Double x = radius * Math.Sin(theta) * Math.Cos(phi);
          Double y = radius * Math.Sin(theta) * Math.Sin(phi);
          Double z = radius * Math.Cos(theta);

          Point3d plnPt = samplePlane.PointAt(x, y, z);
          Vector3d rayVec = plnPt - samplePlane.Origin;
          Ray3d ray = new Ray3d(plnPt, rayVec);
          Line seg = new Line(samplePlane.Origin, samplePlane.PointAt(x, y, z));

          var points = Rhino.Geometry.Intersect.Intersection.ProjectPointsToBreps(
            breps,
            new List<Point3d> {samplePlane.Origin},
            ray.Direction,
            doc.ModelAbsoluteTolerance
            );

          int validHits = 0;
          foreach (Point3d pt in points){
            Double t = seg.ClosestParameter(pt);
            if ((t >= 0) && (t < xt)){
              xt = t;
              xpt = pt;
            }

            if (t >= 0) validHits++;
          }

          if (xt < Double.MaxValue){
            hCounts.Add(validHits, new GH_Path(p));
            if (showPts) hPts.Add(xpt, new GH_Path(p));
            //hTs.Add(x, new GH_Path(p)t);
            Double dist = xt * seg.Length;
            Double domDist = hitDomain.NormalizedParameterAt(dist);
            if (domDist > 1.0) domDist = 1.0;
            hDists.Add(domDist, new GH_Path(p));

            if ((dom.Min == Double.MinValue ) || (dist < dom.Min)) dom.T0 = dist;
            if ((dom.Max == Double.MaxValue ) || (dist > dom.Max)) dom.T1 = dist;

          } else {
            hCounts.Add(0, new GH_Path(p));
            if (showPts) hPts.Add(null, new GH_Path(p));
            //hTs.Add(null, new GH_Path(p));
            hDists.Add(null, new GH_Path(p));
          }



        }
      }

      hitCounts = hCounts;
      if (showPts) hitPts = hPts;
      hitDists = hDists;
    }
# ---------- end c_script_3 ----------
panel = Panel(c_script_3.out)
sqrt_2 = SquareRoot(Value=c_script_3.hitDists)
nullrep = ReplaceNulls(Items=sqrt_2, Replacements="1.0")  # -> Items, Count
gradient = Gradient(LowerLimit=0, UpperLimit=1, Parameter=nullrep.Items, stops=[0: RGB(255, 255, 255), 1: RGB(0, 0, 0)])
tstat = TreeStatistics(Tree=simplify(gradient))  # -> Paths, Length, Count
series = Series(Start=0, Step=1, Count=tstat.Count)
expression = Expression(x=series, y=filename_prefix_2, Expression="Format(\"{1}_{0:0000}\", x, y)")
txt = Text(graft(expression))
c_script_4 = CSharpScript(doSave=do_save_images_2, savepath=save_path_2, filename=txt, pxColors=gradient, pxWidth=px_width_5, pxHeight=px_height_5)  # -> out, A; inputs doSave: Boolean, savepath: String, filename: String, pxColors: list of Color, pxWidth: Int32, pxHeight: Int32
# ---------- c_script_4: C# ----------
    if (!doSave) return;

    if (pxColors.Count != pxWidth * pxHeight) {
      String msg = "Pixel dimension does not match number of colors provided!";
      Print(msg);
      Component.AddRuntimeMessage(GH_RuntimeMessageLevel.Error, msg);
      //GrasshopperDocument.RequestAbortSolution();
      return;
    }

    System.Drawing.Bitmap img = new Bitmap(pxWidth, pxHeight);

    for (var i = 0; i < pxColors.Count; i++) {
      int y = i % pxHeight;
      int x = i / pxHeight;
      //Print(String.Format("{0},{1}", x.ToString(), y.ToString()));
      img.SetPixel(x, y, pxColors[i]);
    }
    img.Save(savepath + filename + ".png", System.Drawing.Imaging.ImageFormat.Png);


    A = img;
# ---------- end c_script_4 ----------

# ==== cluster Cluster
breps = ClusterInput()
breps_2 = Brep(breps)
bbox = BoundingBox(Content=breps_2, Plane=PlaneXY(0, 0, 0), UnionBox=True)  # -> Box, Box_2
debox = DeconstructBox(Box=bbox.Box)  # -> Plane, X, Y, Z
dedomain = DeconstructDomain(Domain=debox.X)  # -> Start, End
dedomain_2 = DeconstructDomain(Domain=debox.Y)  # -> Start, End
avr = Average(Input=[dedomain.Start, dedomain.End])
subtraction = Subtraction(A=dedomain.End, B=dedomain.Start)
avr_2 = Average(Input=[dedomain_2.Start, dedomain_2.End])
subtraction_2 = Subtraction(A=dedomain_2.End, B=dedomain_2.Start)
multiplication = Multiplication(A=subtraction, B="1000")
multiplication_2 = Multiplication(A=subtraction_2, B="1000")
pt = ConstructPoint(XCoordinate=avr, YCoordinate=avr_2, ZCoordinate=expr("-x", "1"))
max = Maximum(A=subtraction, B=subtraction_2)
max_dim = Number(max)
box = CenterBox(Base=pt, X=multiplication, Y=multiplication_2, Z="1")
ground = Box(box)
max_dim_2 = ClusterOutput(max_dim)
ground_2 = ClusterOutput(ground)

# ==== cluster Cluster_2
bnd_crv = ClusterInput()
eye_height = ClusterInput()
pt2d = ClusterInput()
bnd_crv_2 = Curve(bnd_crv)
eye_height_2 = Number(eye_height)
pt2d_2 = Point(pt2d)
area = Area(Geometry=bnd_crv_2)  # -> Area, Centroid
Z = UnitZ(Factor=eye_height_2)
move = Move(Geometry=pt2d_2, Motion=Z)  # -> Geometry, Transform
vec2pt = Vector2Pt(PointA=pt2d_2, PointB=area.Centroid, Unitize=False)  # -> Vector, Length
Z_2 = UnitZ(Factor=1)
rev = Reverse(Vector=vec2pt.Vector)
xprod = CrossProduct(VectorA=rev, VectorB=Z_2, Unitize=False)  # -> Vector, Length
rev_2 = Reverse(Vector=xprod.Vector)
pl = ConstructPlane(Origin=move.Geometry, XAxis=rev, YAxis=rev_2)
plns = Plane(pl)
plns_2 = ClusterOutput(plns)
