# Grasshopper definition 180420 Isovist Mapper.gh (Grasshopper 1.0.5)
# plug-ins: LunchBox

srf = Surface(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)
# CONSTANTS
# The following values should remain constant across a training set of all spatial types.
number_slider = Slider(0.25, range=0..0.333)
fixed_domain = Panel("0 to 50")
eye_height_in_meters = Panel("1.5")
px_width = Panel("80")
px_height = Panel("40")

# ---- group: calculate slices & API evaluate
# Calculates slices, cuts images, and pings API for prediction. Turn both off when developing the model, turn on when optimizing.
toggle = BooleanToggle(True)
do_local_calc = Boolean(toggle)
do_api_call = Boolean(Toggle(True))

# ----
pipeline = GeometryPipeline(
    GroupByLayer=False,
    GroupByType=False,
    IncludeHidden=True,
    IncludeLocked=True,
    LayerFilter="Context",
    NameFilter="*",
    SublayerFiltering=True,
    TypeFilter=1073741848)
save_path = FilePath("G:\Temp\")
mesh = MeshBrep(
    Brep=srf,
    Settings={GridMaxCount=0, GridMinCount=16, JaggedSeams=False, MaxEdgeLength=0, MinEdgeLength=0.0001, MinTolerance=0, Refine=True, RefineAngle=0, RelativeTolerance=0.65, SimplePlanes=True, Tolerance=0})
px_width_2 = Integer(px_width)
px_height_2 = Integer(px_height)
sample_pt_grid_cnt = Integer(Slider(1, range=1..15))
sample_pt_grid_cnt_2 = Integer(expr("x+1", sample_pt_grid_cnt))
sqr = Square(Value=sample_pt_grid_cnt_2)
custom_mesh_settings = SettingsCustom(
    StitchSeams=True,
    SimplePlanes=False,
    Refine=True,
    MinCount=sqr,
    MaxCount=400,
    AspectRatio=20,
    MaxDistance=0,
    MaxAngle=20,
    MinEdge=0,
    MaxEdge=0)
hit_domain = Domain(fixed_domain)
# KEEP WIDTH DIVISIBLE BY 4 TO MAKE EASY PANORAMA ROTATIONS
eye_height = Number(eye_height_in_meters)
medges = MeshEdges(Mesh=mesh)  # -> NakedEdges, InteriorEdges, NonManifoldEdges
pi = Pi(Factor=number_slider)
context = Brep([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])
len = Length(Curve=medges.NakedEdges)
theta_crop = Number(pi)

# ---- group: debug
# Saves iso image that is being fed to Lobe. Can only happen if slices and hits are calculated.
# Displays geometry related to the production of isovists.
toggle_2 = BooleanToggle(True)
do_save_sample_files = Boolean(toggle_2)
visualize_pts = Boolean(Toggle(False))

# ----
sort = SortList(Keys=len)  # -> Keys, ValuesA
pt = Point(Point(-27.66525647, 10, 0))
pt_2 = Point(Point(-13, -27, 0))
panel = Panel(sort.Keys)
item = ListItem(List=panel, Index="-1", Wrap=True)
item_2 = ListItem(List=panel, Index="0", Wrap=True)
division = Division(A=item, B="140")
division_2 = Division(A=item_2, B="140")
qgrid = QuadGrid(Surface=srf, UDivisions=division, VDivisions=division_2)  # -> CornerPoint1, CornerPoint2, CornerPoint3, CornerPoint4, MidPoint, Normals
panel_2 = Panel()
pt_3 = Point(flatten(qgrid.MidPoint))
preview = CustomPreview(Geometry=pt_3, Material=ColourSwatch(SwatchColor=RGB(79, 77, 77)))
Z = UnitZ(Factor=1)
move = Move(Geometry=pt_3, Motion=Z)  # -> Geometry, Transform
pl = PlaneNormal(Origin=move.Geometry, ZAxis=Z)
mspray = MeshSpray(Mesh=mesh, Points=pt_3, Colours=flatten(panel_2), SprayMode=0)  # disabled
sample_planes = Plane(pl)
sample_planes_surface = Plane(sample_planes)
do_local_calc_2 = Boolean(do_local_calc)
visualize_pts_2 = Boolean(visualize_pts)
hit_domain_2 = Domain(hit_domain)
theta_crop_2 = Number(theta_crop)
px_height_3 = Integer(px_height_2)
px_width_3 = Integer(px_width_2)

# ---- group: api key
panel_3 = Panel("034ce21d-d319-4270-996f-c9ec27981e34")

# ----
isovist_v2a = Panel("0e558949-a02d-4189-a8aa-68b292d7dfeb")

# ---- group: doc id
house_massing_v02a = Panel("2835d607-dffc-4f88-9f80-7861b4df0ee2")

# ----
context_2 = Brep(context)
context_3 = Brep(context)

# ---- group: define ground
# DEFINE GROUND: The ground is defined at the lower edge of the bounding box of the given Breps. Ground box is sized to 1000 times the size of the bounding box. Maximum x-y dimension of bounding box is returned.
cluster = Cluster(breps=context_2)  # -> ground_2, max_dim_2

# ----
bbox = BoundingBox(Content=context_3, Plane=PlaneXY(0, 0, 0), UnionBox=True)  # -> Box, Box_2
# Fitness
do_api_call_2 = Boolean(do_api_call)
apikey = Text(panel_3)
docid = Text(house_massing_v02a)
sample_pt_grid_cnt_3 = Integer(sample_pt_grid_cnt)
merge = Merge(Data1=cluster.ground_2, Data2=context_2)
area = Area(Geometry=bbox.Box)  # -> Area, Centroid
do_save_sample_files_2 = Boolean(do_save_sample_files)
range = Range(Domain=Domain(0, 1), Steps=sample_pt_grid_cnt_3)
range_2 = Range(Domain=Domain(0, 1), Steps=sample_pt_grid_cnt_3)
breps = Brep(merge)
breps_2 = Brep(breps)
context_4 = Brep(context)
scale = Scale(Geometry=bbox.Box, Center=area.Centroid, Factor="1.5")  # -> Geometry, Transform

# ---- group: kludge
X = UnitX(Factor="0.012")
move_2 = Move(Geometry=area.Centroid, Motion=X)  # -> Geometry, Transform

# ----
crossref = CrossReference(ListA=range, ListB=range_2, CrossMode=1)  # -> ListA, ListB
c_script = CSharpScript(nudge=context_4, doIt=do_save_sample_files_2)  # -> out, file, folder; inputs nudge: list, doIt: Boolean
# ---------- c_script: C# ----------
    if (!doIt) return;

    if (RhinoDocument.IsOpening){
      Print("document is opening");
      Component.ExpireSolution(true);
      return;
    }



    Print(RhinoDocument.Path.ToString());

    String label = System.IO.Directory.GetParent(RhinoDocument.Path).Name;
    if (label.Contains('-')) label = label.Split('-')[label.Split('-').Count() - 1].Trim();

    String filename = Path.GetFileNameWithoutExtension(RhinoDocument.Path);


    //A = label + "-" + filename;
    file = filename;
    folder = label;
# ---------- end c_script ----------
sample_rect = Rectangle(scale.Geometry)
sample_rect_2 = Rectangle(sample_rect)
boundary = BoundarySurfaces(Edges=sample_rect_2)
mesh_2 = MeshBrep(Brep=boundary, Settings=custom_mesh_settings)
mesh_3 = Mesh(mesh_2)
mspray_2 = MeshSpray(
    Mesh=mesh_3,
    Points=[pt, pt_2],
    Colours=[ColourSwatch(SwatchColor=RGB(66, 204, 255)), ColourSwatch(SwatchColor=RGB(158, 60, 255))],
    SprayMode=11)
box = EvaluateBox(Box=scale.Geometry, UParameter=crossref.ListA, VParameter=crossref.ListB, WParameter=0.5)  # -> Plane, Point, Include
eye_height_2 = Number(eye_height)
vec2pt = Vector2Pt(PointA=box.Plane, PointB=move_2.Geometry, Unitize=False)  # -> Vector, Length
Z_2 = UnitZ(Factor=eye_height_2)
filename_prefix = Text(c_script.file)
align = AlignPlane(Plane=box.Plane, Direction=vec2pt.Vector)  # -> Plane, Angle
move_3 = Move(Geometry=align.Plane, Motion=Z_2)  # -> Geometry, Transform
sample_planes_2 = Plane(move_3.Geometry)
sample_planes_bounding = Plane(sample_planes_2)
c_script_2 = CSharpScript(
    doCalc=do_local_calc_2,
    showPts=visualize_pts_2,
    pxWidth=px_width_3,
    pxHeight=px_height_3,
    samplePlanes=sample_planes_bounding,
    breps=breps_2,
    hitDomain=hit_domain_2,
    thetaCrop=theta_crop_2)  # -> out, hitCounts, hitPts, hitDists, hitNormDists, A; inputs doCalc: Boolean, showPts: Boolean, pxWidth: Int32, pxHeight: Int32, samplePlanes: list of Plane, breps: list of Brep, thetaCrop: Double
# ---------- c_script_2: C# ----------
    if (!doCalc) return;
    
    DataTree<int> hCounts = new DataTree<int>();
    DataTree<object> hPts = new DataTree<object>();
    DataTree<object> hDists = new DataTree<object>();
    DataTree<object> hNDists = new DataTree<object>();
    Interval dom = new Interval(Double.MinValue, Double.MaxValue);

    Interval ivalPhi = new Interval(0, 2.0 * Math.PI);
    Interval ivalTheta = new Interval(thetaCrop, Math.PI - thetaCrop);

    for (int p = 0; p < samplePlanes.Count; p++){
      Plane samplePlane = samplePlanes[p];

      for (int xi = pxWidth; xi > 0; xi--){
        for (int yi = 0; yi < pxHeight; yi++){
          Double phi = ivalPhi.ParameterAt((Double) xi / (Double) (pxWidth - 1));
          Double theta = ivalTheta.ParameterAt((Double) yi / (Double) (pxHeight - 1));

          Point3d xpt = new Point3d();
          Double xt = Double.MaxValue;

          Double radius = 1.0;
          Double x = radius * Math.Sin(theta) * Math.Cos(phi);
          Double y = radius * Math.Sin(theta) * Math.Sin(phi);
          Double z = radius * Math.Cos(theta);

          Point3d plnPt = samplePlane.PointAt(x, y, z);
          Vector3d rayVec = plnPt - samplePlane.Origin;
          Ray3d ray = new Ray3d(plnPt, rayVec);
          Line seg = new Line(samplePlane.Origin, samplePlane.PointAt(x, y, z));

          var points = Rhino.Geometry.Intersect.Intersection.ProjectPointsToBreps(
            breps,
            new List<Point3d> {samplePlane.Origin},
            ray.Direction,
            doc.ModelAbsoluteTolerance
            );

          int validHits = 0;
          foreach (Point3d pt in points){
            Double t = seg.ClosestParameter(pt);
            if ((t >= 0) && (t < xt)){
              xt = t;
              xpt = pt;
            }

            if (t >= 0) validHits++;
          }

          if (xt < Double.MaxValue){
            hCounts.Add(validHits, new GH_Path(p));
            if (showPts) hPts.Add(xpt, new GH_Path(p));
            //hTs.Add(x, new GH_Path(p)t);
            Double dist = xt * seg.Length;
            hDists.Add(dist, new GH_Path(p));

            Double normDist = hitDomain.NormalizedParameterAt(dist);
            if (normDist > 1.0) normDist = 1.0;
            hNDists.Add(normDist, new GH_Path(p));

            if ((dom.Min == Double.MinValue ) || (dist < dom.Min)) dom.T0 = dist;
            if ((dom.Max == Double.MaxValue ) || (dist > dom.Max)) dom.T1 = dist;

          } else {
            hCounts.Add(0, new GH_Path(p));
            if (showPts) hPts.Add(null, new GH_Path(p));
            hDists.Add(null, new GH_Path(p));
            hNDists.Add(null, new GH_Path(p));
          }



        }
      }

      hitCounts = hCounts;
      if (showPts) hitPts = hPts;
      hitNormDists = hNDists;
      hitDists = hDists;
    }
# ---------- end c_script_2 ----------
sqrt = SquareRoot(Value=c_script_2.hitNormDists)
bnd = Bounds(Numbers=c_script_2.hitDists)
nullrep = ReplaceNulls(Items=sqrt, Replacements="1.0")  # -> Items, Count
panel_4 = Panel(bnd)
gradient = Gradient(LowerLimit=0, UpperLimit=1, Parameter=nullrep.Items, stops=[0: RGB(255, 255, 255), 1: RGB(0, 0, 0)])
panel_5 = Panel(nullrep.Items)
tstat = TreeStatistics(Tree=simplify(gradient))  # -> Paths, Length, Count
series = Series(Start=0, Step=1, Count=tstat.Count)
expression = Expression(x=series, y=filename_prefix, Expression="Format(\"{1}-{0:0000}\", x, y)")
do_save_sample_files_3 = Boolean(do_save_sample_files)
do_local_calc_3 = Boolean(do_local_calc)
save_path_2 = FilePath(save_path)
txt = Text(graft(expression))
px_height_4 = Integer(px_height_2)
px_width_4 = Integer(px_width_2)
c_script_3 = CSharpScript(
    doCalc=do_local_calc_3,
    doSave=do_save_sample_files_3,
    savepath=save_path_2,
    filename=txt,
    pxColors=gradient,
    pxWidth=px_width_4,
    pxHeight=px_height_4)  # -> out, flatten(A); inputs doCalc: Boolean, doSave: Boolean, savepath: String, filename: String, pxColors: list of Color, pxWidth: Int32, pxHeight: Int32
# ---------- c_script_3: C# ----------
    if (!doCalc) return;

    if (pxColors.Count != pxWidth * pxHeight) {
      String msg = "Pixel dimension does not match number of colors provided!";
      Print(msg);
      Component.AddRuntimeMessage(GH_RuntimeMessageLevel.Error, msg);
      //GrasshopperDocument.RequestAbortSolution();
      return;
    }

    System.Drawing.Bitmap img = new Bitmap(pxWidth, pxHeight);

    for (var i = 0; i < pxColors.Count; i++) {
      int y = i % pxHeight;
      int x = i / pxHeight;
      //Print(String.Format("{0},{1}", x.ToString(), y.ToString()));
      img.SetPixel(x, y, pxColors[i]);
    }
    if (doSave) img.Save(savepath + filename + ".png", System.Drawing.Imaging.ImageFormat.Png);
    //Print(savepath + filename + ".png");

    A = img;
# ---------- end c_script_3 ----------
api_imgs = Data(c_script_3.A)
api_imgs_2 = Data(api_imgs)
c_script_4 = CSharpScript(doIt=do_api_call_2, apikey=apikey, docid=docid, img=api_imgs_2)  # -> out, jsonResponse; inputs doIt: Boolean, apikey: String, docid: String
# ---------- c_script_4: C# ----------
    if (img == null) return;
    if (!doIt) return;

    //string metadataString = string.Join(",", metadata);
    //Stream imgStream = ImageToBase64((Bitmap) img, System.Drawing.Imaging.ImageFormat.Png);
    jsonResponse = null;
    Bitmap bmp = (Bitmap) img;

    System.Net.WebRequest request = LobeCreateImageRequest(apikey, docid, bmp);
    Print(request.RequestUri.ToString());
    if (doIt){
      if (request != null){
        jsonResponse = LobeGetSimplePrediction(request);
      }
    }
# ---------- c_script_4: C# additional code ----------
  public string ImageToBase64(System.Drawing.Image image)
  {

    string base64String = null;
    using(MemoryStream m = new MemoryStream())
    {
      image.Save(m, System.Drawing.Imaging.ImageFormat.Png);
      byte[] imageBytes = m.ToArray();
      base64String = Convert.ToBase64String(imageBytes);
      return base64String;
    }

  }

  public Stream ToStream(Image image, System.Drawing.Imaging.ImageFormat format) {
    var stream = new System.IO.MemoryStream();
    image.Save(stream, format);
    stream.Position = 0;
    return stream;
  }


  String LobeGetSimplePrediction(System.Net.WebRequest request){

    try
    {
      using (var response = request.GetResponse())
      {
        using (var stream = response.GetResponseStream())
        {
          var reader = new StreamReader(stream, System.Text.Encoding.UTF8);
          String jsonResponse = reader.ReadToEnd();
          return jsonResponse;

        }
      }
    }
    catch (System.Net.WebException e)
    {
      Print("WebException");
      Print(e.Message);
      return null;
    }

  }


  System.Net.WebRequest LobeCreateImageRequest(string apikey, string docid, Bitmap img){
    try
    {


      string baseURL = @"https://api.lobe.ai/predict?";
      string fullURL = baseURL + "apikey=" + apikey + "&docid=" + docid;

      System.Net.WebRequest request = System.Net.WebRequest.Create(fullURL);
      request.Method = "POST";
      request.ContentType = "application/json";
      //request.Timeout = 10000;

      //String imagestr = "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";
      //imagestr = " ";
      //String imagestr = Convert.ToBase64String(File.ReadAllBytes(imgpath));

      String imagestr = ImageToBase64(img);

      using(var streamWriter = new StreamWriter(request.GetRequestStream()))
      {
        string json = @"{
          ""inputs"":{
          ""image"":""" + imagestr +@"""
          }
          }";

        streamWriter.Write(json);
        streamWriter.Flush();
        streamWriter.Close();
      }
      //Print(request.Headers.ToString());
      return request;
    }
    catch (System.Net.WebException e)
    {
      Print("LobeCreateImageRequest WebException");
      Print(e.Message);
      return null;
    }
  }
# ---------- end c_script_4 ----------
c_script_5 = CSharpScript(jsonResponse=c_script_4.jsonResponse)  # -> out, confidences, labels; inputs jsonResponse: String
# ---------- c_script_5: C# ----------
    if (jsonResponse == null) return;
    if (string.IsNullOrWhiteSpace(jsonResponse)) return;
    
    /*
    var pattern = @"\[(.*?)\]";
    var query = "H1-receptor antagonist [HSA:3269] [PATH:hsa04080(3269)]";
    var matches = System.Text.RegularExpressions.Regex.Matches(query, pattern);

    foreach (System.Text.RegularExpressions.Match m in matches) {
      //Print(m.Groups[1].ToString());
    }
    */

    var pattern = @"""confidences"": \[\[(.*?)\]]";
    var matches = System.Text.RegularExpressions.Regex.Matches(jsonResponse, pattern);

    //Print(matches[0].Groups[1].ToString());

    System.Text.RegularExpressions.Regex regex = new System.Text.RegularExpressions.Regex(@"\], \[");

    List<String> ks = new List<String>();
    List<double> vs = new List<double>();
    foreach (String str in regex.Split(matches[0].Groups[1].ToString()) ) {
      String[] sarr = str.Split(',');
      ks.Add(sarr[0].Trim('"'));
      vs.Add(Double.Parse(sarr[1], System.Globalization.NumberStyles.Float));
    }

    labels = ks;
    confidences = vs;
# ---------- end c_script_5 ----------
sort_2 = SortList(Keys=c_script_5.confidences, ValuesA=c_script_5.labels)  # -> reverse(Keys), reverse(ValuesA)
panel_6 = Panel(sort_2.Keys)
panel_7 = Panel(sort_2.ValuesA)
item_3 = ListItem(List=sort_2.ValuesA, Index="0", Wrap=True)  # -> flatten(Item)
item_4 = ListItem(List=sort_2.Keys, Index="0", Wrap=True)  # -> flatten(Item)

top_label = Text(item_3)
top_conf = Number(item_4)

# ==== cluster Cluster
breps = ClusterInput()
breps_2 = Brep(breps)
bbox = BoundingBox(Content=breps_2, Plane=PlaneXY(0, 0, 0), UnionBox=True)  # -> Box, Box_2
debox = DeconstructBox(Box=bbox.Box)  # -> Plane, X, Y, Z
dedomain = DeconstructDomain(Domain=debox.X)  # -> Start, End
dedomain_2 = DeconstructDomain(Domain=debox.Y)  # -> Start, End
avr = Average(Input=[dedomain.Start, dedomain.End])
subtraction = Subtraction(A=dedomain.End, B=dedomain.Start)
avr_2 = Average(Input=[dedomain_2.Start, dedomain_2.End])
subtraction_2 = Subtraction(A=dedomain_2.End, B=dedomain_2.Start)
multiplication = Multiplication(A=subtraction, B="1000")
multiplication_2 = Multiplication(A=subtraction_2, B="1000")
pt = ConstructPoint(XCoordinate=avr, YCoordinate=avr_2, ZCoordinate=expr("-x", "1"))
max = Maximum(A=subtraction, B=subtraction_2)
max_dim = Number(max)
box = CenterBox(Base=pt, X=multiplication, Y=multiplication_2, Z="1")
ground = Box(box)
max_dim_2 = ClusterOutput(max_dim)
ground_2 = ClusterOutput(ground)
