# Grasshopper definition 20180408 line mapping.gh (Grasshopper 1.0.5)
# plug-ins: LunchBox

panel = Panel("""50,0,0
50,0,0
50,0,0
50,0,0
50,0,0
0,50,0
50,0,0
0,50,0
50,0,0
0,50,0
200,200,200
40,40,40
55,55,55
200,200,200
40,40,40
55,55,55
200,200,200
40,40,40""")
mesh = Mesh([<mesh referenced from the Rhino model> x7])
crv = Curve(<curve referenced from the Rhino model>)
lng = ListLength(List=panel)
divide = DivideCurve(Curve=crv, Count=expr("x-1", lng), Kinks=False)  # -> Points, Tangents, Parameters
pull = PullPoint(Point=divide.Points, Geometry=mesh, ClosestOnly=True)  # -> ClosestPoint, Distance
nurbs = NurbsCurve(Vertices=pull.ClosestPoint, Degree=3, Periodic=False)  # -> Curve, Length, Domain
divide_2 = DivideCurve(Curve=nurbs.Curve, Count=lng, Kinks=False)  # -> Points, Tangents, Parameters
shatter = Shatter(Curve=nurbs.Curve, Parameters=divide_2.Parameters)
panel_2 = Panel(shatter)
bake = ObjectBake(
    BakeToggle=Button(),
    GeometryObjects=graft(shatter),
    Layer="color_route",
    ObjectName="GH_Obj",
    ObjectColor=graft(panel),
    LayerColor=RGB(255, 255, 255))
