# Grasshopper definition voxel-test.gh (Grasshopper 1.0.5)
# plug-ins: MeshEdit Components, Weaverbird

vec = VectorXYZ(XComponent=Slider(78.893, range=0..100), YComponent=Slider(73.356, range=0..100), ZComponent=Slider(700, range=0..1000))  # -> Vector, Length
# MASS
# Rectangle
pt = ConstructPoint(XCoordinate=0, YCoordinate=0, ZCoordinate=0)
vec2pt = Vector2Pt(PointA=pt, PointB=vec.Vector, Unitize=False)  # -> Vector, Length
box = Box2Pt(PointA=pt, PointB=vec2pt.Vector, Plane=PlaneXY(0, 0, 0))
mbox = MeshBox(Base=box, XCount=10, YCount=10, ZCount=10)

# ----
# Sphere
number_slider = Slider(36.602, range=0..100)
msphere = MeshSphere(Base=PlaneXY(0, 0, 0), Radius=number_slider, UCount=10, VCount=20)

scale_nu = ScaleNU(
    Geometry=mbox,
    Plane=PlaneXY(0, 0, 0),
    ScaleX=Slider(1, range=0..1),
    ScaleY=Slider(1, range=0..1),
    ScaleZ=Slider(1, range=0..1))  # -> Geometry, Transform
bbox = BoundingBox(Content=scale_nu.Geometry, Plane=PlaneXY(0, 0, 0))  # -> Box, Box_2
boxprop = BoxProperties(Box=bbox.Box)  # -> Center, Diagonal, Area, Volume, Degeneracy
multiplication = Multiplication(A=boxprop.Diagonal, B=Slider(0.05, range=-1.001..10))
devec = DeconstructVector(Vector=multiplication)  # -> XComponent, YComponent, ZComponent
expression = Expression(x=devec.XComponent, Expression="ceiling(x)")
expression_2 = Expression(x=devec.YComponent, Expression="ceiling(x)")
expression_3 = Expression(x=devec.ZComponent, Expression="ceiling(x)")
devec_2 = DeconstructVector(Vector=boxprop.Diagonal)  # -> XComponent, YComponent, ZComponent
expression_4 = Expression(x=devec_2.ZComponent, y=expression_3, Expression="x/(2*y)")
expression_5 = Expression(x=devec_2.XComponent, y=expression, Expression="x/(2*y)")
expression_6 = Expression(x=devec_2.YComponent, y=expression_2, Expression="x/(2*y)")
range = Range(Domain=Domain(0, 1), Steps=expression)
range_2 = Range(Domain=Domain(0, 1), Steps=expression_2)
range_3 = Range(Domain=Domain(0, 1), Steps=expression_3)
number_slider_2 = Slider(1, range=0..1)
crossref = CrossReference(ListA=range, ListB=range_2, ListC=range_3, CrossMode=1)  # -> ListA, ListB, ListC
box_2 = CenterBox(Base=PlaneXY(0, 0, 0), X=expression_5, Y=expression_6, Z=expression_4)
box_3 = EvaluateBox(Box=bbox.Box, UParameter=crossref.ListA, VParameter=crossref.ListB, WParameter=crossref.ListC)  # -> Plane, Point, Include
mbox_2 = MeshBox(Base=box_2, XCount=number_slider_2, YCount=number_slider_2, ZCount=number_slider_2)
meshcp = MeshClosestPoint(Point=box_3.Point, Mesh=scale_nu.Geometry)  # -> Point, Index, Parameter
expression_7 = Expression(x=expression_5, y=expression_6, z=expression_4, Expression="hypot(hypot(x,y),z)")
dist = Distance(PointA=box_3.Point, PointB=meshcp.Point)
smaller = SmallerThan(FirstNumber=dist, SecondNumber=expression_7)  # -> SmallerThan, OrEqualTo
cull = CullPattern(List=box_3.Point, CullPattern=smaller.SmallerThan)
move = Move(Geometry=mbox_2, Motion=cull)  # -> Geometry, Transform

# ----
# Turn Voxels into Surface Mesh
dam = DataDam(BufferDelay=10000000, BufferMode=0)
explode = MeshExplode(Mesh=dam, Interpolate=False)  # -> flatten(Faces)
facen = FaceNormals(Mesh=explode)  # -> flatten(Centers), Normals
cullpt = CullDuplicates(Points=facen.Centers, Tolerance=0.1, CullMode=2)  # -> Points, Indices, Valence
mindex = MemberIndex(Set=facen.Centers, Member=cullpt.Points)  # -> flatten(Index), Count
item = ListItem(List=explode, Index=mindex.Index, Wrap=True)
wbjoin = WeaverbirdsJoinMeshesAndWeld(Mesh=item, Weld=False)
weldvertices = MeshWeldVertices(Mesh=wbjoin, Tolerance=0.01)  # -> RuntimeMessage, Mesh
disjoint = DisjointMesh(Mesh=weldvertices.Mesh)
dispatch = Dispatch(List=disjoint, DispatchPattern=[True, False])  # -> ListA, ListB
wbcatmullclark = WeaverbirdsCatmullClarkSubdivision(MeshCurves=dispatch.ListA, Level=1, SmoothNakedEdges=1)
wblaplace = WeaverbirdsLaplacianSmoothing(MeshCurves=dispatch.ListA, Level=Slider(1, range=0..100), SmoothNakedEdges=1, Thin=1)
