# Grasshopper definition wind optimizer.gh (Grasshopper 1.0.5)
# plug-ins: Human

do_capture_img = Boolean(Toggle(True))
do_save_img_file = Boolean(Toggle(True))
do_api_call = Boolean(Toggle(True))

number_slider = Slider(578.466, range=0..1000)
vec = VectorXYZ(XComponent=Slider(10, range=0..100), YComponent=Slider(10, range=0..100), ZComponent=number_slider)  # -> Vector, Length
pt = ConstructPoint(XCoordinate=0, YCoordinate=0, ZCoordinate=0)
vec2pt = Vector2Pt(PointA=pt, PointB=vec.Vector, Unitize=False)  # -> Vector, Length
box = Box2Pt(PointA=pt, PointB=vec2pt.Vector, Plane=PlaneXY(0, 0, 0))

# ---- group: calculate slices
# Calculates slices and hit distances. Nothing else can happen if slices aren't calculated.
button = Button()
do_calc_slices = Boolean(Toggle(True))

# ---- group: save files
# Saves image and info files. Can only happen if slices and hits are calculated.
toggle = BooleanToggle(True)
button_2 = Button()
do_save_files = Boolean(toggle)

# ----
# The pixel dimension of each slice. All slice images are square.
pixel_count = Panel("60")
px_cnt = Integer(pixel_count)

save_small_tiles = Boolean(Toggle(False))
visualize_rays = Boolean(Toggle(False))
save_big_tiled = Boolean(Toggle(True))
save_text_file = Boolean(Toggle(False))

# ---- group: all values - not used
sampling = ValueList({"Extra Coarse": 1, "Coarse": 2, "Medium": 3, "Fine": 4, "Extra Fine": 5}, selected="Extra Coarse")

# ----
big_tiled = CSharpScript()  # -> out; inputs doSave: Boolean, tiles: tree, savepath: String, filename: String
# ---------- big_tiled: C# ----------
    if (!doSave) return;
    if (tiles == null) return;
    if (tiles.DataCount <= 1) return;
    if (filename == null) return;
    Print(tiles.DataCount.ToString());

    if (tiles.BranchCount != 5){
      raise("Data Tree isn't structured properly. There should be 5 branches - one for each slice direction");
      return;
    }
    var sliceCnts = from n in Enumerable.Range(0, tiles.BranchCount) select tiles.Branch(n).Count;
    if (sliceCnts.Any(i => i != 5 && i != 20 && i != 45 && i != 64 && i != tiles.Branch(0).Count)){
      raise("Data Tree isn't structured properly. There should be 5 or 20 or 45 or 64 slices per direction.");
      Print(String.Join(" ", sliceCnts));
      return;
    }

    int slicesPer = tiles.Branch(0).Count;
    int pxDimTile = ((System.Drawing.Bitmap) tiles.Branch(0)[0] ).Width;
    int pxDimBig = -1;
    List<Vector2d> offsets = new List<Vector2d>();
    Vector2d grpOffset = new Vector2d(0, pxDimTile);


    int tileRows = -1;
    if (slicesPer == 5) tileRows = 1;
    if (slicesPer == 20) tileRows = 2;
    if (slicesPer == 45) tileRows = 3;
    if (slicesPer == 80) tileRows = 4;
    if (slicesPer == 125) tileRows = 5;

    if (tileRows > 0){

      pxDimBig = pxDimTile * slicesPer / tileRows;
      for (int n = 0; n < slicesPer; n++) offsets.Add(new Vector2d((n % (slicesPer / tileRows)) * pxDimTile, (n / (slicesPer / tileRows) * pxDimTile)));
      grpOffset *= tileRows;

      System.Drawing.Bitmap bigImageOut = new System.Drawing.Bitmap(pxDimBig, pxDimBig);

      foreach(GH_Path pth in tiles.Paths){
        List<object> imgs = tiles.Branch(pth);
        for (int n = 0; n < slicesPer; n++){
          Bitmap img = (Bitmap) imgs[n];
          Vector2d offset = offsets[n] + grpOffset * pth.Indices[0];
          ImageToImageRegion(img, ref bigImageOut, new Rectangle(Convert.ToInt32(offset.X), Convert.ToInt32(offset.Y), pxDimTile, pxDimTile));
        }

      }


      bigImageOut.Save(savepath + filename + ".png", System.Drawing.Imaging.ImageFormat.Png);
    }
# ---------- big_tiled: C# additional code ----------
  public static void ImageToImageRegion(Bitmap srcBitmap, ref Bitmap destBitmap, Rectangle destRegion)
  {
    Rectangle srcRegion = new Rectangle(0, 0, srcBitmap.Width, srcBitmap.Height);
    using (Graphics grD = Graphics.FromImage(destBitmap))
    {
      grD.DrawImage(srcBitmap, destRegion, srcRegion, GraphicsUnit.Pixel);
    }
  }


  public void raise(String msg){
    Print(msg);
    Component.AddRuntimeMessage(GH_RuntimeMessageLevel.Error, msg);
  }
# ---------- end big_tiled ----------
galapagos = Galapagos(
    fitness=fitness,
    gene=[number_slider, number_slider_2, number_slider_3, number_slider_4, number_slider_9, number_slider_6, number_slider_7, number_slider_8, number_slider_13, number_slider_10, number_slider_11, number_slider_12, number_slider_17, number_slider_14, number_slider_15, number_slider_16])

# ---- group: api key
panel = Panel("034ce21d-d319-4270-996f-c9ec27981e34")

# ---- group: doc id
shapes3 = Panel("cc89e71f-f07a-4baf-97de-b7a6803ab021")

# ----
number_slider_2 = Slider(677.223, range=0..1000)
vec_2 = VectorXYZ(XComponent=Slider(30, range=0..100), YComponent=Slider(10, range=0..100), ZComponent=number_slider_2)  # -> Vector, Length

number_slider_3 = Slider(651.386, range=0..1000)
vec_3 = VectorXYZ(XComponent=Slider(50, range=0..100), YComponent=Slider(10, range=0..100), ZComponent=number_slider_3)  # -> Vector, Length

number_slider_4 = Slider(620.281, range=0..1000)
vec_4 = VectorXYZ(XComponent=Slider(70, range=0..100), YComponent=Slider(10, range=0..100), ZComponent=number_slider_4)  # -> Vector, Length

# ----
# Voxels
number_slider_5 = Slider(10, range=0..100)

pt_2 = ConstructPoint(XCoordinate=number_slider_5, YCoordinate=Slider(0, range=0..100), ZCoordinate=0)
vec2pt_2 = Vector2Pt(PointA=pt_2, PointB=vec_2.Vector, Unitize=False)  # -> Vector, Length
box_2 = Box2Pt(PointA=pt_2, PointB=vec2pt_2.Vector, Plane=PlaneXY(0, 0, 0))

pt_3 = ConstructPoint(XCoordinate=Slider(20, range=0..100), YCoordinate=Slider(0, range=0..100), ZCoordinate=0)
vec2pt_3 = Vector2Pt(PointA=pt_3, PointB=vec_3.Vector, Unitize=False)  # -> Vector, Length
box_3 = Box2Pt(PointA=pt_3, PointB=vec2pt_3.Vector, Plane=PlaneXY(0, 0, 0))

pt_4 = ConstructPoint(XCoordinate=Slider(30, range=0..100), YCoordinate=Slider(0, range=0..100), ZCoordinate=0)
vec2pt_4 = Vector2Pt(PointA=pt_4, PointB=vec_4.Vector, Unitize=False)  # -> Vector, Length
box_4 = Box2Pt(PointA=pt_4, PointB=vec2pt_4.Vector, Plane=PlaneXY(0, 0, 0))

number_slider_6 = Slider(945.841, range=0..1000)
vec_5 = VectorXYZ(XComponent=Slider(30, range=0..100), YComponent=Slider(30, range=0..100), ZComponent=number_slider_6)  # -> Vector, Length
pt_5 = ConstructPoint(XCoordinate=Slider(10, range=0..100), YCoordinate=Slider(10, range=0..100), ZCoordinate=0)
vec2pt_5 = Vector2Pt(PointA=pt_5, PointB=vec_5.Vector, Unitize=False)  # -> Vector, Length
box_5 = Box2Pt(PointA=pt_5, PointB=vec2pt_5.Vector, Plane=PlaneXY(0, 0, 0))

number_slider_7 = Slider(970, range=0..1000)
vec_6 = VectorXYZ(XComponent=Slider(50, range=0..100), YComponent=Slider(30, range=0..100), ZComponent=number_slider_7)  # -> Vector, Length
pt_6 = ConstructPoint(XCoordinate=Slider(20, range=0..100), YCoordinate=Slider(10, range=0..100), ZCoordinate=0)
vec2pt_6 = Vector2Pt(PointA=pt_6, PointB=vec_6.Vector, Unitize=False)  # -> Vector, Length
box_6 = Box2Pt(PointA=pt_6, PointB=vec2pt_6.Vector, Plane=PlaneXY(0, 0, 0))

number_slider_8 = Slider(673.203, range=0..1000)
vec_7 = VectorXYZ(XComponent=Slider(70, range=0..100), YComponent=Slider(30, range=0..100), ZComponent=number_slider_8)  # -> Vector, Length
pt_7 = ConstructPoint(XCoordinate=Slider(30, range=0..100), YCoordinate=Slider(10, range=0..100), ZCoordinate=0)
vec2pt_7 = Vector2Pt(PointA=pt_7, PointB=vec_7.Vector, Unitize=False)  # -> Vector, Length
box_7 = Box2Pt(PointA=pt_7, PointB=vec2pt_7.Vector, Plane=PlaneXY(0, 0, 0))

number_slider_9 = Slider(423.61, range=0..1000)
vec_8 = VectorXYZ(XComponent=Slider(10, range=0..100), YComponent=Slider(30, range=0..100), ZComponent=number_slider_9)  # -> Vector, Length
pt_8 = ConstructPoint(XCoordinate=Slider(0, range=0..100), YCoordinate=Slider(10, range=0..100), ZCoordinate=0)
vec2pt_8 = Vector2Pt(PointA=pt_8, PointB=vec_8.Vector, Unitize=False)  # -> Vector, Length
box_8 = Box2Pt(PointA=pt_8, PointB=vec2pt_8.Vector, Plane=PlaneXY(0, 0, 0))

number_slider_10 = Slider(1000, range=0..1000)
vec_9 = VectorXYZ(XComponent=Slider(30, range=0..100), YComponent=Slider(50, range=0..100), ZComponent=number_slider_10)  # -> Vector, Length
pt_9 = ConstructPoint(XCoordinate=Slider(10, range=0..100), YCoordinate=Slider(20, range=0..100), ZCoordinate=0)
vec2pt_9 = Vector2Pt(PointA=pt_9, PointB=vec_9.Vector, Unitize=False)  # -> Vector, Length
box_9 = Box2Pt(PointA=pt_9, PointB=vec2pt_9.Vector, Plane=PlaneXY(0, 0, 0))

number_slider_11 = Slider(941.177, range=0..1000)
vec_10 = VectorXYZ(XComponent=Slider(50, range=0..100), YComponent=Slider(50, range=0..100), ZComponent=number_slider_11)  # -> Vector, Length
pt_10 = ConstructPoint(XCoordinate=Slider(20, range=0..100), YCoordinate=Slider(20, range=0..100), ZCoordinate=0)
vec2pt_10 = Vector2Pt(PointA=pt_10, PointB=vec_10.Vector, Unitize=False)  # -> Vector, Length
box_10 = Box2Pt(PointA=pt_10, PointB=vec2pt_10.Vector, Plane=PlaneXY(0, 0, 0))

number_slider_12 = Slider(742.687, range=0..1000)
vec_11 = VectorXYZ(XComponent=Slider(70, range=0..100), YComponent=Slider(50, range=0..100), ZComponent=number_slider_12)  # -> Vector, Length
pt_11 = ConstructPoint(XCoordinate=Slider(30, range=0..100), YCoordinate=Slider(20, range=0..100), ZCoordinate=0)
vec2pt_11 = Vector2Pt(PointA=pt_11, PointB=vec_11.Vector, Unitize=False)  # -> Vector, Length
box_11 = Box2Pt(PointA=pt_11, PointB=vec2pt_11.Vector, Plane=PlaneXY(0, 0, 0))

number_slider_13 = Slider(756.942, range=0..1000)
vec_12 = VectorXYZ(XComponent=Slider(10, range=0..100), YComponent=Slider(50, range=0..100), ZComponent=number_slider_13)  # -> Vector, Length
pt_12 = ConstructPoint(XCoordinate=Slider(0, range=0..100), YCoordinate=Slider(20, range=0..100), ZCoordinate=0)
vec2pt_12 = Vector2Pt(PointA=pt_12, PointB=vec_12.Vector, Unitize=False)  # -> Vector, Length
box_12 = Box2Pt(PointA=pt_12, PointB=vec2pt_12.Vector, Plane=PlaneXY(0, 0, 0))

number_slider_14 = Slider(817.647, range=0..1000)
vec_13 = VectorXYZ(XComponent=Slider(30, range=0..100), YComponent=Slider(70, range=0..100), ZComponent=number_slider_14)  # -> Vector, Length
pt_13 = ConstructPoint(XCoordinate=Slider(10, range=0..100), YCoordinate=Slider(30, range=0..100), ZCoordinate=0)
vec2pt_13 = Vector2Pt(PointA=pt_13, PointB=vec_13.Vector, Unitize=False)  # -> Vector, Length
box_13 = Box2Pt(PointA=pt_13, PointB=vec2pt_13.Vector, Plane=PlaneXY(0, 0, 0))

number_slider_15 = Slider(751.001, range=0..1000)
vec_14 = VectorXYZ(XComponent=Slider(50, range=0..100), YComponent=Slider(70, range=0..100), ZComponent=number_slider_15)  # -> Vector, Length
pt_14 = ConstructPoint(XCoordinate=Slider(20, range=0..100), YCoordinate=Slider(30, range=0..100), ZCoordinate=0)
vec2pt_14 = Vector2Pt(PointA=pt_14, PointB=vec_14.Vector, Unitize=False)  # -> Vector, Length
box_14 = Box2Pt(PointA=pt_14, PointB=vec2pt_14.Vector, Plane=PlaneXY(0, 0, 0))

number_slider_16 = Slider(622.83, range=0..1000)
vec_15 = VectorXYZ(XComponent=Slider(70, range=0..100), YComponent=Slider(70, range=0..100), ZComponent=number_slider_16)  # -> Vector, Length
pt_15 = ConstructPoint(XCoordinate=Slider(30, range=0..100), YCoordinate=Slider(30, range=0..100), ZCoordinate=0)
vec2pt_15 = Vector2Pt(PointA=pt_15, PointB=vec_15.Vector, Unitize=False)  # -> Vector, Length
box_15 = Box2Pt(PointA=pt_15, PointB=vec2pt_15.Vector, Plane=PlaneXY(0, 0, 0))

number_slider_17 = Slider(770.588, range=0..1000)
vec_16 = VectorXYZ(XComponent=Slider(10, range=0..100), YComponent=Slider(70, range=0..100), ZComponent=number_slider_17)  # -> Vector, Length
pt_16 = ConstructPoint(XCoordinate=Slider(0, range=0..100), YCoordinate=Slider(30, range=0..100), ZCoordinate=0)
vec2pt_16 = Vector2Pt(PointA=pt_16, PointB=vec_16.Vector, Unitize=False)  # -> Vector, Length
box_16 = Box2Pt(PointA=pt_16, PointB=vec2pt_16.Vector, Plane=PlaneXY(0, 0, 0))

# ----
# Bake
toggle_2 = BooleanToggle(False)  # disabled
bake = Boolean(toggle_2)  # disabled
bake_2 = BakeGeometry(Bake=bake, Geometry=box_2, DeleteOldBakes=False, PreserveTrees=False)  # disabled
bake_3 = BakeGeometry(Bake=bake, Geometry=box, DeleteOldBakes=False, PreserveTrees=False)  # disabled
bake_4 = BakeGeometry(Bake=bake, Geometry=box_3, DeleteOldBakes=False, PreserveTrees=False)  # disabled
bake_5 = BakeGeometry(Bake=bake, Geometry=box_4, DeleteOldBakes=False, PreserveTrees=False)  # disabled
bake_6 = BakeGeometry(Bake=bake, Geometry=box_5, DeleteOldBakes=False, PreserveTrees=False)  # disabled
bake_7 = BakeGeometry(Bake=bake, Geometry=box_8, DeleteOldBakes=False, PreserveTrees=False)  # disabled
bake_8 = BakeGeometry(Bake=bake, Geometry=box_6, DeleteOldBakes=False, PreserveTrees=False)  # disabled
bake_9 = BakeGeometry(Bake=bake, Geometry=box_7, DeleteOldBakes=False, PreserveTrees=False)  # disabled
bake_10 = BakeGeometry(Bake=bake, Geometry=box_9, DeleteOldBakes=False, PreserveTrees=False)  # disabled
bake_11 = BakeGeometry(Bake=bake, Geometry=box_12, DeleteOldBakes=False, PreserveTrees=False)  # disabled
bake_12 = BakeGeometry(Bake=bake, Geometry=box_10, DeleteOldBakes=False, PreserveTrees=False)  # disabled
bake_13 = BakeGeometry(Bake=bake, Geometry=box_11, DeleteOldBakes=False, PreserveTrees=False)  # disabled
bake_14 = BakeGeometry(Bake=bake, Geometry=box_15, DeleteOldBakes=False, PreserveTrees=False)  # disabled
bake_15 = BakeGeometry(Bake=bake, Geometry=box_14, DeleteOldBakes=False, PreserveTrees=False)  # disabled
bake_16 = BakeGeometry(Bake=bake, Geometry=box_13, DeleteOldBakes=False, PreserveTrees=False)  # disabled
bake_17 = BakeGeometry(Bake=bake, Geometry=box_16, DeleteOldBakes=False, PreserveTrees=False)  # disabled

merge = Merge(
    Data1=box,
    Data2=box_2,
    Data3=box_3,
    Data4=box_4,
    Data5=box_8,
    Data6=box_5,
    Data7=box_6,
    Data8=box_7,
    Data9=box_12,
    Data10=box_9,
    Data11=box_10,
    Data12=box_11,
    Data13=box_16,
    Data14=box_13,
    Data15=box_14,
    Data16=box_15)

# ----
# Slicer
# Sizing
# SAMPLING SETTINGS: Extra Coarse = 25 slices
# Coarse = 100 slices
# Medium = 225 slices
# Fine = 400 slices
# Extra Fine = 625 slices
# Slices
# Metadata
# Filename
# Get filename from object name
pipeline = GeometryPipeline(
    GroupByLayer=False,
    GroupByType=False,
    IncludeHidden=True,
    IncludeLocked=True,
    LayerFilter="MASSING",
    NameFilter="*",
    SublayerFiltering=True,
    TypeFilter=1073741848)
sampling_2 = ValueList({"Extra Coarse": 1, "Coarse": 2}, selected="Extra Coarse")
save_path = FilePath("C:\Users\samantha.walker\Documents\00_Documents_SWalker\Extracurriculars\sg 2018\GD\wind shape optimizer\")
pipeline_2 = GeometryPipeline(
    GroupByLayer=False,
    GroupByType=False,
    IncludeHidden=True,
    IncludeLocked=True,
    LayerFilter="MASSING",
    NameFilter="*",
    SublayerFiltering=True,
    TypeFilter=1073741848)
pipeline_3 = GeometryPipeline(
    GroupByLayer=False,
    GroupByType=False,
    IncludeHidden=True,
    IncludeLocked=True,
    LayerFilter="SITE",
    NameFilter="*",
    SublayerFiltering=True,
    TypeFilter=4)
pipeline_4 = GeometryPipeline(
    GroupByLayer=False,
    GroupByType=False,
    IncludeHidden=True,
    IncludeLocked=True,
    LayerFilter="DOOR",
    NameFilter="*",
    SublayerFiltering=False,
    TypeFilter=4)
pipeline_5 = GeometryPipeline(
    GroupByLayer=False,
    GroupByType=False,
    IncludeHidden=True,
    IncludeLocked=True,
    LayerFilter="WINDOW",
    NameFilter="*",
    SublayerFiltering=False,
    TypeFilter=4)
objatts = ObjectAttributes(ObjectOrAttributes=pipeline)  # -> Name, LayerName, LayerFullPath, Color, MaterialName, LinetypeName, GroupIndices, PlotWeight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
rows_per = Integer(sampling_2)
windows = Curve()
site = Curve(pipeline_3)
doors = Curve()
brep = Brep(pipeline_2)
site_info = CSharpScript(site=site)  # -> out, w, d, r, n; inputs site: Rectangle3d
# ---------- site_info: C# ----------
    int ww = (int) (site.X.T1 - site.X.T0);
    int dd = (int) (site.Y.T1 - site.Y.T0);

    double rr = Math.Round((double) dd / (double) ww);

    String abr = "";

    if (ww == 18) abr = "A";
    else if (ww == 24) abr = "B";
    else if (ww == 32) abr = "C";
    else if (ww == 40) abr = "D";
    else if (ww == 48) abr = "E";
    else if (ww == 56) abr = "F";
    else if (ww == 64) abr = "G";
    else if (ww == 72) abr = "H";
    else if (ww == 80) abr = "I";
    else if (ww == 88) abr = "J";
    else if (ww == 96) abr = "K";
    else {
      w = false;
      d = false;
      r = false;
      n = false;
      return;
    }
    w = ww;
    d = dd;
    r = rr;
    n = abr + (rr * 10).ToString();
# ---------- end site_info ----------
panel_2 = Panel(objatts.Name)
panel_3 = Panel(site_info.n)
site_width = Number(site_info.w)
site_depth = Number(site_info.d)
item = ListItem(List=panel_2, Index=0, Wrap=True)
validator = CSharpScript(breps=merge)  # -> out, solids, unSolids, validity; inputs breps: list of Brep
# ---------- validator: C# ----------
    List<Brep> sBreps = new List<Brep>();
    List<Brep> oBreps = new List<Brep>();
    bool isValid = true;

    foreach (Brep b in breps){
      if (b.IsSolid) sBreps.Add(b);
      else {
        oBreps.Add(b);
        isValid = false;
      }
    }

    validity = isValid;
    solids = sBreps;
    unSolids = oBreps;
# ---------- end validator ----------
massings = Brep(validator.solids)
all_massings_valid = Boolean(validator.validity)
rows_per_2 = Integer(rows_per)
c_script = CSharpScript(rowsPer=rows_per_2)  # -> out, A; inputs rowsPer: Int32
# ---------- c_script: C# ----------
    if (rowsPer == 1) A = 5;
    else if (rowsPer == 2) A = 20;
    else if (rowsPer == 3) A = 45;
    else if (rowsPer == 4) A = 80;
    else if (rowsPer == 5) A = 125;
    else A = 5;
# ---------- end c_script ----------
division = Division(A=c_script.A, B=rows_per_2)
px_cnt_2 = Integer(px_cnt)
expression = Expression(x=px_cnt_2, y=division, Expression="Format(\"{0}x{0} px\", x*y)")
training_image_size = Text(expression)
training_image_size_2 = Panel(training_image_size)
tile_rows_per_plane = Panel(rows_per_2)
training_image_size_3 = Text(expression)
do_save_files_2 = Boolean(do_save_files)

# ---- group: file info
# we add DO CALC SLICES and MASSINGS here to ensure that any time slices change, the metadata file is updated too.
do_calc_slices_2 = Boolean(do_calc_slices)
do_save_files_3 = Boolean(do_save_files)
massings_2 = Brep(massings)
rowsper = Integer(rows_per_2)
c_script_2 = CSharpScript(nudge=massings_2, doCalcSlices=do_calc_slices_2, doSave=do_save_files_3, rowsPer=rowsper, objName="TEST")  # -> out, A, B; inputs nudge: list, doSave: Boolean, rowsPer: Int32, objName: String
# ---------- c_script_2: C# ----------
    if (RhinoDocument.IsOpening){
      Print("document is opening");
      Component.ExpireSolution(true);
      return;
    }



    Print(RhinoDocument.Path.ToString());

    //String filename = Path.GetFileNameWithoutExtension(RhinoDocument.Path);
    A = objName;
    //A = filename + "-" + rowsPer.ToString();


    String label = System.IO.Directory.GetParent(RhinoDocument.Path).Name;
    if (label.Contains('-')) label = label.Split('-')[label.Split('-').Count() - 1].Trim();

    B = label;
# ---------- c_script_2: C# additional code ----------
  /// <summary>
  /// This method will be called once every solution, before any calls to RunScript.
  /// </summary>
  public override void BeforeRunScript()
  { }
  /// <summary>
  /// This method will be called once every solution, after any calls to RunScript.
  /// </summary>
  public override void AfterRunScript()
  { }
# ---------- end c_script_2 ----------
panel_4 = Panel(c_script_2.out)
panel_5 = Panel(c_script_2.B)
filename = Text(c_script_2.A)
panel_6 = Panel(c_script_2.A)
label = Text(c_script_2.B)

# ---- group: cutbox and ground
massings_3 = Brep(massings)
c_script_3 = CSharpScript(masses=massings_3, pad="0.0625")  # -> out, cutBox, ground, maxDim; inputs masses: list of Brep, pad: Double
# ---------- c_script_3: C# ----------
    if (masses.Count == 0) return;
    
    // Construct bounding intervals on plane
    //

    BoundingBox bBox = masses[0].GetBoundingBox(true);
    for (int n = 1; n < masses.Count; n++) bBox.Union(masses[n].GetBoundingBox(true));
    maxDim = bBox.Diagonal.Length;
    cutBox = bBox;

    Double diagDim = (new Vector2d(bBox.Diagonal.X, bBox.Diagonal.Y)).Length;

    Interval ival_x = new Interval(bBox.Min.X, bBox.Max.X);
    Interval ival_y = new Interval(bBox.Min.Y, bBox.Max.Y);
    Interval ival_z = new Interval(bBox.Min.Z, bBox.Max.Z);

    ival_x = scaleIval(ival_x, (1 + pad));
    ival_y = scaleIval(ival_y, (1 + pad));
    ival_z.T1 = ival_z.T1 + ival_z.Length * pad;

    Box cBox = new Box(Plane.WorldXY, ival_x, ival_y, ival_z);
    cutBox = cBox;

    Double groundDepth = (cBox.Z.T1 - cBox.Z.T0) / 2;
    Plane basePlane = new Plane(cBox.PointAt(0.5, 0.5, 0), Plane.WorldXY.XAxis, Plane.WorldXY.YAxis);
    basePlane.Translate(new Vector3d(0, 0, -groundDepth));

    Cylinder cyl = new Rhino.Geometry.Cylinder(
      new Circle(basePlane, diagDim * (0.75 + pad)), // ensure overlap
      groundDepth - RhinoDocument.ModelAbsoluteTolerance * 10// this might ensure that the breps don't align perfectly, which is better for booleans.
      );

    //Mesh mCyl = Mesh.CreateFromBrep(cyl.ToBrep(true, true), new MeshingParameters())[0];
    //Mesh mCyl = Mesh.CreateFromCylinder(cyl, 1, 36);
    ground = cyl;
# ---------- c_script_3: C# additional code ----------
  Interval scaleIval(Interval ival, Double fac){
    Double delt = ival.Length * fac - ival.Length;
    //if (fixMin) return new Interval(ival.T0, ival.T1 + delt);
    return new Interval(ival.T0 - delt / 2, ival.T1 + delt / 2);
  }
# ---------- end c_script_3 ----------
cutbox = Box(c_script_3.cutBox)
ground = Brep(c_script_3.ground)

# ----
# The number of slices per orientation plane.
# 
# Due to tiling, is limited to specific numbers: 5,20,45,80,125
slice_cnt = Integer(c_script.A)

dom = ConstructDomain(DomainStart=0, DomainEnd=c_script_3.maxDim)
hit_domain = Domain(dom)
slices_per_plane = Panel(slice_cnt)

# ---- group: slices and hits
do_calc_slices_3 = Boolean(do_calc_slices)
visualize_rays_2 = Boolean(visualize_rays)
massings_4 = Brep(massings)
slice_cnt_2 = Integer(slice_cnt)
px_cnt_3 = Integer(px_cnt_2)
c_script_4 = CSharpScript(
    doIt=do_calc_slices_3,
    showRays=visualize_rays_2,
    cutBox=cutbox,
    pxCnt=px_cnt_3,
    sliceCnt=slice_cnt_2,
    masses=massings_4,
    ground=ground,
    hitDomain=hit_domain)  # -> out, basePlanes, sampleLines, hitDists, hitCounts; inputs doIt: Boolean, showRays: Boolean, cutBox: Box, pxCnt: Int32, sliceCnt: Int32, masses: list of Brep, ground: Brep
# ---------- c_script_4: C# ----------
    if (!doIt) return;
    
    List<Brep> allMasses = new List<Brep>(masses);
    allMasses.Add(ground);
    //Print(allMshs.Count.ToString());

    // DEFINE CUT PLANES
    //
    List<Plane> plns = new List<Plane>();
    Plane plnXY = new Plane(cutBox.PointAt(0.5, 0.5, 1.0), cutBox.Plane.XAxis, cutBox.Plane.YAxis);
    Plane plnXZ = new Plane(cutBox.PointAt(0.5, 0.0, 0.5), cutBox.Plane.XAxis, cutBox.Plane.ZAxis);
    Plane plnYZ = new Plane(cutBox.PointAt(0.0, 0.5, 0.5), -cutBox.Plane.YAxis, cutBox.Plane.ZAxis);
    Plane plnOA = new Plane(cutBox.PointAt(0.0, 0.0, 0.5), cutBox.PointAt(1, 0, 0) - cutBox.PointAt(0, 1, 0), cutBox.Plane.ZAxis);
    Plane plnOB = new Plane(cutBox.PointAt(1.0, 0.0, 0.5), cutBox.PointAt(1, 1, 0) - cutBox.PointAt(0, 0, 0), cutBox.Plane.ZAxis);
    plns.AddRange(new Plane[] {plnXY, plnXZ, plnYZ, plnOA, plnOB});

    basePlanes = plns; // OUT


    // PLOT RAYS
    //
    DataTree<Ray3d> rays = new DataTree<Ray3d>();
    rays.MergeTree(plotRays(0, plnXY, cutBox, pxCnt - 1, sliceCnt - 1));
    rays.MergeTree(plotRays(1, plnXZ, cutBox, pxCnt - 1, sliceCnt - 1));
    rays.MergeTree(plotRays(2, plnYZ, cutBox, pxCnt - 1, sliceCnt - 1));
    rays.MergeTree(plotRays(3, plnOA, cutBox, pxCnt - 1, sliceCnt - 1));
    rays.MergeTree(plotRays(4, plnOB, cutBox, pxCnt - 1, sliceCnt - 1));

    //if (showRays) sampleRays = rays; // OUT


    // TRACE RAYS
    //

    //DataTree<Point3d> ptsIn = new DataTree<Point3d>();
    //DataTree<Point3d> ptsOut = new DataTree<Point3d>();
    //DataTree<Point3d> ptsProj = new DataTree<Point3d>();
    DataTree<Line> segsProj = new DataTree<Line>();
    DataTree<Double> hDists = new DataTree<Double>();
    DataTree<int> hCounts = new DataTree<int>();

    foreach(GH_Path pth in rays.Paths){
      foreach(Ray3d ray in rays.Branch(pth)){
        bool isInside = false;
        if ( ground.IsPointInside(ray.Position, RhinoDocument.ModelAbsoluteTolerance, false)){
          //ptsIn.Add(ray.Position, pth);
          hDists.Add(-2, pth);
          segsProj.Add(new Line(ray.Position, ray.Position + ray.Direction), pth);
          hCounts.Add(0, pth);
          isInside = true;
          continue;
        }

        foreach(Brep mass in masses){
          if ( mass.IsPointInside(ray.Position, RhinoDocument.ModelAbsoluteTolerance, false)){
            //ptsIn.Add(ray.Position, pth);
            hDists.Add(-1, pth);
            segsProj.Add(new Line(ray.Position, ray.Position + ray.Direction), pth);
            hCounts.Add(0, pth);
            isInside = true;
            break;
          }
        }

        if (!isInside){
          //ptsOut.Add(ray.Position, pth);

          Point3d[] proj = Rhino.Geometry.Intersect.Intersection.ProjectPointsToBreps(
            allMasses,
            new List<Point3d> {ray.Position},
            ray.Direction,
            doc.ModelAbsoluteTolerance / 1000
            );
          if (proj.Length > 0) {
            Double[] dists = (from Point3d pt in proj select pt.DistanceTo(ray.Position)).ToArray();
            Array.Sort(dists, proj);

            Double normDist = hitDomain.NormalizedParameterAt(dists[0]);
            if (normDist > 1.0) normDist = 1.0;
            hDists.Add(normDist, pth);

            //ptsProj.Add(proj[0]);
            segsProj.Add(new Line(ray.Position, proj[0]), pth);
            hCounts.Add(proj.Length, pth);
          } else {
            segsProj.Add(new Line(ray.Position, ray.Position + ray.Direction), pth);
            hDists.Add(1.0, pth);
            hCounts.Add(0, pth);
          }

        }

      }
    }

    hitDists = hDists;
    if (showRays) sampleLines = segsProj;
    if (showRays) hitCounts = hCounts;
# ---------- c_script_4: C# additional code ----------
  private DataTree<Ray3d> plotRays(int pth, Plane pln, Box bx, int pxCount, int slCount){
    int cntU = pxCount;
    int cntV = cntU;
    int cntW = slCount;

    Interval[] ivals = boxIntervals(pln, bx);
    Interval ival_u = ivals[0];
    Interval ival_v = ivals[1];
    Interval ival_w = ivals[2];

    DataTree<Ray3d> pts = new DataTree<Ray3d>();

    //Print(ival_u.T0.ToString() + " -> " + ival_u.T1.ToString());
    //Print(ival_v.T0.ToString() + " -> " + ival_v.T1.ToString());

    int zi = 0;
    Double epsilon = 0.001; // relative to normalized intervals
    for (int wi = cntW; wi >= 0; wi--){
      Double w = ival_w.ParameterAt(wi / (Double) cntW);

      // back a bit off the first and last planes
      if (wi == cntW) w = ival_w.ParameterAt(1.0 - epsilon);
      if (wi == 0) w = ival_w.ParameterAt(epsilon);

      for (int ui = 0; ui <= cntU; ui++){
        Double u = ival_u.ParameterAt(ui / (Double) cntU);
        for (int vi = cntV; vi >= 0; vi--){
          Double v = ival_v.ParameterAt(vi / (Double) cntV);

          // back a bit off the y-direction at the bottom
          if (vi == 0) v = ival_v.ParameterAt(epsilon);

          pts.Add(new Ray3d(pln.PointAt(u, v, w), pln.Normal), new GH_Path(new int[] {pth, zi}));

        }
      }
      zi++;
    }
    return pts;

  }


  private Interval[] boxIntervals(Plane pln, Box bx){

    Interval ival_u = new Interval(Double.MaxValue, Double.MinValue);
    Interval ival_v = new Interval(Double.MaxValue, Double.MinValue);
    Interval ival_w = new Interval(Double.MaxValue, Double.MinValue);
    foreach (Point3d pt in bx.GetCorners()){
      Double u;
      Double v;
      pln.ClosestParameter(pt, out u, out v);
      Double w = pln.DistanceTo(pt);

      if (u < ival_u.T0) ival_u.T0 = u;
      if (u > ival_u.T1) ival_u.T1 = u;
      if (v < ival_v.T0) ival_v.T0 = v;
      if (v > ival_v.T1) ival_v.T1 = v;
      if (w < ival_w.T0) ival_w.T0 = w;
      if (w > ival_w.T1) ival_w.T1 = w;
    }

    return new Interval[]{ival_u,ival_v,ival_w};

  }
# ---------- end c_script_4 ----------

# ---- group: assign colors
swatch = ColourSwatch(SwatchColor=RGB(255, 0, 0))
c_script_5 = CSharpScript(
    hitDists=c_script_4.hitDists,
    clrNear=ColourSwatch(SwatchColor=RGB(255, 255, 255)),
    clrFar=ColourSwatch(SwatchColor=RGB(0, 0, 0)),
    clrGround=swatch,
    clrMass=swatch)  # -> out, pxColors; inputs hitDists: tree of Double, clrNear: Color, clrFar: Color, clrGround: Color, clrMass: Color
# ---------- c_script_5: C# ----------
    if (hitDists.DataCount <= 1) return; // trees may contain a single Null value

    DataTree<Color> clrOut = new DataTree<Color>();

    foreach(GH_Path pth in hitDists.Paths){
      foreach(Double dist in hitDists.Branch(pth)){
        Color clr = clrFar;
        if (dist >= 0){
          clr = ClrInterp(clrNear, clrFar, dist);
        } else if( dist == -1){
          clr = clrMass;
        } else if( dist == -2){
          clr = clrGround;
        }
        clrOut.Add(clr, pth);
      }
    }

    pxColors = clrOut;
# ---------- c_script_5: C# additional code ----------
  public static Color ClrInterp(Color c1, Color c2, double t) {
    if (t < 0 || t > 1) throw new ArgumentOutOfRangeException("t");
    return Color.FromArgb((int) (c1.R + (c2.R - c1.R) * t), (int) (c1.G + (c2.G - c1.G) * t), (int) (c1.B + (c2.R - c1.B) * t));
  }
# ---------- end c_script_5 ----------

# ---- group: visualize sample locations
number_slider_18 = Slider(2958, range=0..3600)
list = ValueList({"plnXY": 0, "plnXZ": 1, "plnYZ": 2, "plnOA": 3, "plnOB": 4}, selected="plnOA")
c_script_6 = CSharpScript(
    planeIdx=list,
    sliceIdx=Slider(0, range=0..10),
    sampleLines=c_script_4.sampleLines,
    pxColors=c_script_5.pxColors,
    hitCounts=c_script_4.hitCounts)  # -> out, A, B, C, D; inputs planeIdx: Int32, sliceIdx: Int32, sampleLines: tree of Line, pxColors: tree of Color, hitCounts: tree of Int32
# ---------- c_script_6: C# ----------
    if (!sampleLines.PathExists(new GH_Path(new int[] {planeIdx,sliceIdx}))) return;

    List<Line> lines = sampleLines.Branch(new GH_Path(new int[] {planeIdx,sliceIdx}));
    List<Color> colors = pxColors.Branch(new GH_Path(new int[] {planeIdx,sliceIdx}));
    List<int> hits = hitCounts.Branch(new GH_Path(new int[] {planeIdx,sliceIdx}));
    
    List<Point3d> pts = new List<Point3d>();
    //List<Line> segs = new List<Line>();
    //List<Color> clrs = new List<Color>();
    /*
    for (int n = 0; n < rays.Count; n++){
    Ray3d ray = (Ray3d) rays[n];
    pts.Add(ray.Position);
    segs.Add(new Line(ray.Position, ray.Position + ray.Direction));
    clrs.Add((Color) colors[n]);
    }
    */
    foreach (Line ln in lines){
      pts.Add(ln.PointAt(0));
    }


    A = pts;
    B = lines;
    C = colors;
    D = hits;
# ---------- end c_script_6 ----------
preview = CustomPreview(Geometry=c_script_6.A, Material=c_script_6.C)
preview_2 = CustomPreview(Geometry=c_script_6.B, Material=c_script_6.C)
item_2 = ListItem(List=c_script_6.D, Index=number_slider_18, Wrap=True)
item_3 = ListItem(List=c_script_6.A, Index=number_slider_18, Wrap=True)
tag = TextTag(Location=item_3, Text=item_2)

# ---- group: siting info
# we add TILES here to ensure that any time slices change, the metadata file is updated too.
all_massings_valid_2 = Boolean(all_massings_valid)
do_save_files_4 = Boolean(save_text_file)
site_width_2 = Number(site_width)
site_depth_2 = Number(site_depth)
and = GateAnd(A=all_massings_valid_2, B=do_save_files_4)
save_path_2 = FilePath(save_path)
cutbox_2 = Box(cutbox)

# ---- group: invalid masses report
# we add TILES here to ensure that any time slices change, the metadata file is updated too.
all_massings_valid_3 = Boolean(all_massings_valid)
do_save_files_5 = Boolean(save_text_file)
save_path_3 = FilePath(save_path)

# ----
gate = StreamGate(Stream=c_script_5.pxColors, Gate=do_save_files_2)  # -> Target0, Target1

# ---- group: save out images
all_massings_valid_4 = Boolean(all_massings_valid)
save_small_tiles_2 = Boolean(save_small_tiles)
save_path_4 = FilePath(save_path)
filename_2 = Text(filename)
and_2 = GateAnd(A=all_massings_valid_4, B=save_small_tiles_2)
small_tiles = CSharpScript(doSave=and_2, savepath=save_path_4, filename=filename_2, pxColors=gate.Target1)  # -> out, tiles; inputs doSave: Boolean, savepath: String, filename: String, pxColors: tree of Color
# ---------- small_tiles: C# ----------
    if(!Directory.Exists(savepath)){
      raise("Save path does not exist.");
      return;
    }
    if (filename == null) return;

    if (pxColors.DataCount <= 1) return;// trees may contain a single Null value

    int slicesPerDirection = validateSlices(pxColors);
    if (slicesPerDirection < 1) return;
    Print(slicesPerDirection.ToString() + " slices per each of 5 directions");


    DataTree<System.Drawing.Bitmap> imgsOut = new DataTree<System.Drawing.Bitmap>();


    foreach(GH_Path pth in pxColors.Paths){
      List<Color> pxColorLst = pxColors.Branch(pth);
      int pxDim = validatePixels(pxColorLst);

      System.Drawing.Bitmap img = new Bitmap(pxDim, pxDim);

      if (pxDim > 0){
        for (var i = 0; i < pxColorLst.Count; i++) {
          int y = i % pxDim;
          int x = i / pxDim;
          //Print(String.Format("{0},{1}", x.ToString(), y.ToString()));
          img.SetPixel(x, y, pxColorLst[i]);
        }

        //String pthStr = String.Join("", from num in pth.Indices select num );
        String pthStr = pth.Indices[0].ToString() + pth.Indices[1].ToString("D2");
        if(doSave) img.Save(savepath + filename + pthStr + ".png", System.Drawing.Imaging.ImageFormat.Png);

        imgsOut.Add(img, new GH_Path(pth.Indices[0]));

      }
    }

    tiles = imgsOut;
# ---------- small_tiles: C# additional code ----------
  public int validatePixels(List<Color> pxColors){
    Double cnt = Math.Sqrt(pxColors.Count());
    //Print((cnt % 1.0).ToString());
    if (cnt % 1.0 != 0){
      raise("Pixel count is all wrong. This image is not square.");
      return -1;
    }
    return Convert.ToInt32(cnt);
  }

  public int validateSlices(DataTree<Color> pxColors){

    int expectedDirectionCount = 5;

    if ( pxColors.Paths.Count % expectedDirectionCount != 0 ){
      raise("Data Tree isn't structured properly. Number of slices not divisible by expectedDirectionCount.");
      return -1;
    }
    int[] sliceCnts = new int[]{0,0,0,0,0}; // UPDATE THESE VALUES IF NEEDED
    int slicesPerDirection = -1;
    foreach(GH_Path pth in pxColors.Paths){
      //Print(pth.ToString());
      int idx = pth.Indices[0];
      if (idx > expectedDirectionCount - 1){
        raise("Data Tree isn't structured properly. Maybe not the right number of slice directions? First index greater than expectedDirectionCount.");
        return -1;
      }
      sliceCnts[idx]++;
    }

    //Print(String.Join("; ", sliceCnts));

    if (sliceCnts.Any(i => i != 5 && i != 20 && i != 45 && i != 80 && i != 125)){ // UPDATE THESE VALUES IF NEEDED
      Print(sliceCnts[0].ToString() + "," + sliceCnts[1].ToString() + "," + sliceCnts[2].ToString() + "," + sliceCnts[3].ToString());
      raise("Data Tree isn't structured properly. There should be 5, 20, 45, 80, or 125 slices per direction.");
      return -1;
    } else {
      slicesPerDirection = sliceCnts[0];
    }

    return slicesPerDirection;
  }


  public void raise(String msg){
    Print(msg);
    Component.AddRuntimeMessage(GH_RuntimeMessageLevel.Error, msg);
  }
# ---------- end small_tiles ----------
panel_7 = Panel(small_tiles.out)
all_massings_valid_5 = Boolean(all_massings_valid)
save_big_tiled_2 = Boolean(save_big_tiled)
tiles = Data(small_tiles.tiles)
and_3 = GateAnd(A=all_massings_valid_5, B=save_big_tiled_2)

# ---- group: siting info (continued)
tiles_2 = Data(tiles)
c_script_7 = CSharpScript(
    doSave=and,
    savepath=save_path_2,
    filename=filename,
    cutBox=cutbox_2,
    siteWidth=site_width_2,
    siteDepth=site_depth_2,
    label=label,
    tiles=tiles_2)  # -> out, A, B, C; inputs doSave: Boolean, savepath: String, cutBox: Box, siteWidth: Double, siteDepth: Double, label: String, tiles: tree
# ---------- c_script_7: C# ----------
    if (filename == null) return;

    Plane basePlane = new Plane(cutBox.PointAt(0.5, 0.5, 0), cutBox.PointAt(1.0, 0.5, 0), cutBox.PointAt(0.5, 1.0, 0));

    double x = basePlane.OriginX;
    double y = basePlane.OriginY;
    double z = basePlane.OriginZ;

    double vxx = basePlane.XAxis.X;
    double vxy = basePlane.XAxis.Y;

    double vyx = basePlane.YAxis.X;
    double vyy = basePlane.YAxis.Y;

    double w = cutBox.X.Max - cutBox.X.Min;
    double d = cutBox.Y.Max - cutBox.Y.Min;
    double h = cutBox.Z.Max - cutBox.Z.Min;

    Plane outPlane = new Plane(new Point3d(x, y, z), new Vector3d(vxx, vxy, 0), new Vector3d(vyx, vyy, 0));
    A = outPlane;

    Box bx = new Box(outPlane, new Interval(-w / 2, w / 2), new Interval(-d / 2, d / 2), new Interval(0, h));
    B = bx;

    string fmt = "{0:0.0000}";

    IList<string> strings = new List<string>{
        filename + ".png",
        string.Format(fmt, siteWidth),
        string.Format(fmt, siteDepth),
        string.Format(fmt, x),
        string.Format(fmt, y),
        string.Format(fmt, z),
        string.Format(fmt, vxx),
        string.Format(fmt, vxy),
        string.Format(fmt, vyx),
        string.Format(fmt, vyy),
        string.Format(fmt, w),
        string.Format(fmt, d),
        string.Format(fmt, h),
        label
        };

    /*
    IList<string> strings = new List<string>{
        filename + ".png",
        siteWidth.ToString(),
        siteDepth.ToString(),
        x.ToString(),
        y.ToString(),
        z.ToString(),
        vxx.ToString(),
        vxy.ToString(),
        vyx.ToString(),
        vyy.ToString(),
        w.ToString(),
        d.ToString(),
        h.ToString(),
        label
        };
    */


    string content = string.Join(",", strings);
    C = content;

        if (doSave){
          string path = savepath + filename + ".txt";
          System.IO.File.WriteAllText(path, content);

        }
# ---------- end c_script_7 ----------

# ---- group: invalid masses report (continued)
tiles_3 = Data(tiles)
c_script_8 = CSharpScript(doSave=do_save_files_5, massesValid=all_massings_valid_3, savepath=save_path_3, filename=filename, tiles=tiles_3)  # -> out; inputs doSave: Boolean, massesValid: Boolean, savepath: String, tiles: tree
# ---------- c_script_8: C# ----------
    if (filename == null) return;
    if (!doSave) return;

    if (massesValid) return;

    string path = savepath + "_INVALID " + filename + ".txt";
    System.IO.File.WriteAllText(path, "");
# ---------- end c_script_8 ----------

# ----
split = TextSplit(Text=c_script_7.C, Separators=",")
big_tiled_2 = CSharpScript(doSave=and_3, tiles=tiles, savepath=save_path_4, filename=filename_2)  # -> out, img; inputs doSave: Boolean, tiles: tree, savepath: String, filename: String
# ---------- big_tiled_2: C# ----------
    if (tiles == null) return;
    if (tiles.DataCount <= 1) return;
    if (filename == null) return;

    int pxDimTile = ((System.Drawing.Bitmap) tiles.Branch(0)[0] ).Width;


    // For a 25-tile image
    //
    int pxDimBig = pxDimTile * 5;
    System.Drawing.Bitmap bigImageOut = new System.Drawing.Bitmap(pxDimBig, pxDimBig);

    ImageToImageRegion((Bitmap) tiles.Branch(0)[0], ref bigImageOut, new Rectangle(0, 0, pxDimTile, pxDimTile));
    ImageToImageRegion((Bitmap) tiles.Branch(0)[1], ref bigImageOut, new Rectangle(pxDimTile, 0, pxDimTile, pxDimTile));
    ImageToImageRegion((Bitmap) tiles.Branch(0)[2], ref bigImageOut, new Rectangle(pxDimTile*2, 0, pxDimTile, pxDimTile));
    ImageToImageRegion((Bitmap) tiles.Branch(0)[3], ref bigImageOut, new Rectangle(pxDimTile*3, 0, pxDimTile, pxDimTile));
    ImageToImageRegion((Bitmap) tiles.Branch(0)[4], ref bigImageOut, new Rectangle(pxDimTile*4, 0, pxDimTile, pxDimTile));
    ImageToImageRegion((Bitmap) tiles.Branch(1)[0], ref bigImageOut, new Rectangle(0, pxDimTile, pxDimTile, pxDimTile));
    ImageToImageRegion((Bitmap) tiles.Branch(1)[1], ref bigImageOut, new Rectangle(pxDimTile, pxDimTile, pxDimTile, pxDimTile));
    ImageToImageRegion((Bitmap) tiles.Branch(1)[2], ref bigImageOut, new Rectangle(pxDimTile*2, pxDimTile, pxDimTile, pxDimTile));
    ImageToImageRegion((Bitmap) tiles.Branch(1)[3], ref bigImageOut, new Rectangle(pxDimTile*3, pxDimTile, pxDimTile, pxDimTile));
    ImageToImageRegion((Bitmap) tiles.Branch(1)[4], ref bigImageOut, new Rectangle(pxDimTile*4, pxDimTile, pxDimTile, pxDimTile));
    ImageToImageRegion((Bitmap) tiles.Branch(2)[0], ref bigImageOut, new Rectangle(0, pxDimTile*2, pxDimTile, pxDimTile));
    ImageToImageRegion((Bitmap) tiles.Branch(2)[1], ref bigImageOut, new Rectangle(pxDimTile, pxDimTile*2, pxDimTile, pxDimTile));
    ImageToImageRegion((Bitmap) tiles.Branch(2)[2], ref bigImageOut, new Rectangle(pxDimTile * 2, pxDimTile*2, pxDimTile, pxDimTile));
    ImageToImageRegion((Bitmap) tiles.Branch(2)[3], ref bigImageOut, new Rectangle(pxDimTile * 3, pxDimTile*2, pxDimTile, pxDimTile));
    ImageToImageRegion((Bitmap) tiles.Branch(2)[4], ref bigImageOut, new Rectangle(pxDimTile * 4, pxDimTile*2, pxDimTile, pxDimTile));
    ImageToImageRegion((Bitmap) tiles.Branch(3)[0], ref bigImageOut, new Rectangle(0, pxDimTile * 3, pxDimTile, pxDimTile));
    ImageToImageRegion((Bitmap) tiles.Branch(3)[1], ref bigImageOut, new Rectangle(pxDimTile, pxDimTile * 3, pxDimTile, pxDimTile));
    ImageToImageRegion((Bitmap) tiles.Branch(3)[2], ref bigImageOut, new Rectangle(pxDimTile * 2, pxDimTile * 3, pxDimTile, pxDimTile));
    ImageToImageRegion((Bitmap) tiles.Branch(3)[3], ref bigImageOut, new Rectangle(pxDimTile * 3, pxDimTile * 3, pxDimTile, pxDimTile));
    ImageToImageRegion((Bitmap) tiles.Branch(3)[4], ref bigImageOut, new Rectangle(pxDimTile * 4, pxDimTile * 3, pxDimTile, pxDimTile));
    ImageToImageRegion((Bitmap) tiles.Branch(4)[0], ref bigImageOut, new Rectangle(0, pxDimTile * 4, pxDimTile, pxDimTile));
    ImageToImageRegion((Bitmap) tiles.Branch(4)[1], ref bigImageOut, new Rectangle(pxDimTile, pxDimTile * 4, pxDimTile, pxDimTile));
    ImageToImageRegion((Bitmap) tiles.Branch(4)[2], ref bigImageOut, new Rectangle(pxDimTile * 2, pxDimTile * 4, pxDimTile, pxDimTile));
    ImageToImageRegion((Bitmap) tiles.Branch(4)[3], ref bigImageOut, new Rectangle(pxDimTile * 3, pxDimTile * 4, pxDimTile, pxDimTile));
    ImageToImageRegion((Bitmap) tiles.Branch(4)[4], ref bigImageOut, new Rectangle(pxDimTile * 4, pxDimTile * 4, pxDimTile, pxDimTile));
    
    
//    ImageToImageRegion((Bitmap) tiles.Branch(0)[2], ref bigImageOut, new Rectangle(0, pxDimTile, pxDimTile, pxDimTile));
//    ImageToImageRegion((Bitmap) tiles.Branch(0)[3], ref bigImageOut, new Rectangle(pxDimTile, pxDimTile, pxDimTile, pxDimTile));
//    ImageToImageRegion((Bitmap) tiles.Branch(0)[4], ref bigImageOut, new Rectangle(pxDimTile, pxDimTile, pxDimTile, pxDimTile));

    if (doSave) bigImageOut.Save(savepath + filename + ".png", System.Drawing.Imaging.ImageFormat.Png);

    img = bigImageOut;
# ---------- big_tiled_2: C# additional code ----------
  public static void ImageToImageRegion(Bitmap srcBitmap, ref Bitmap destBitmap, Rectangle destRegion)
  {
    Rectangle srcRegion = new Rectangle(0, 0, srcBitmap.Width, srcBitmap.Height);
    using (Graphics grD = Graphics.FromImage(destBitmap))
    {
      grD.DrawImage(srcBitmap, destRegion, srcRegion, GraphicsUnit.Pixel);
    }
  }


  public void raise(String msg){
    Print(msg);
    Component.AddRuntimeMessage(GH_RuntimeMessageLevel.Error, msg);
  }
# ---------- end big_tiled_2 ----------
api_img = Data(big_tiled_2.img)

# ---- group: verify
pln = Plane(c_script_7.A)
box_17 = Box(c_script_7.B)

# ---- group: siting information
# filename + ".png"
# siteWidth
# siteDepth
# basePlane.OriginX
# basePlane.OriginY
# basePlane.OriginZ
# basePlane.XAxis.X
# basePlane.XAxis.Y
# basePlane.YAxis.X
# basePlane.YAxis.Y
# boxWidth (-x/2 -> x/2)
# boxDepth (-y/2 -> y/2)
# boxHeight (0 -> z)
# Label
panel_8 = Panel(split)

# ----
# Fitness
do_api_call_2 = Boolean(do_api_call)
docid = Text(shapes3)
apikey = Text(panel)
api_img_2 = Data(api_img)
c_script_9 = CSharpScript(doIt=do_api_call_2, apikey=apikey, docid=docid, img=api_img_2)  # -> out, jsonResponse; inputs doIt: Boolean, apikey: String, docid: String
# ---------- c_script_9: C# ----------
    if (img == null) return;


    //Stream imgStream = ImageToBase64((Bitmap) img, System.Drawing.Imaging.ImageFormat.Png);
    jsonResponse = null;
    Bitmap bmp = (Bitmap) img;

    System.Net.WebRequest request = LobeCreateImageRequest(apikey, docid, bmp);
    Print(request.RequestUri.ToString());
    if (doIt){
      if (request != null){
        jsonResponse = LobeGetSimplePrediction(request);
      }
    }
# ---------- c_script_9: C# additional code ----------
  public string ImageToBase64(System.Drawing.Image image)
  {

    string base64String = null;
    using(MemoryStream m = new MemoryStream())
    {
      image.Save(m, System.Drawing.Imaging.ImageFormat.Png);
      byte[] imageBytes = m.ToArray();
      base64String = Convert.ToBase64String(imageBytes);
      return base64String;
    }

  }

  public Stream ToStream(Image image, System.Drawing.Imaging.ImageFormat format) {
    var stream = new System.IO.MemoryStream();
    image.Save(stream, format);
    stream.Position = 0;
    return stream;
  }


  String LobeGetSimplePrediction(System.Net.WebRequest request){

    try
    {
      using (var response = request.GetResponse())
      {
        using (var stream = response.GetResponseStream())
        {
          var reader = new StreamReader(stream, System.Text.Encoding.UTF8);
          String jsonResponse = reader.ReadToEnd();
          return jsonResponse;

        }
      }
    }
    catch (System.Net.WebException e)
    {
      Print("WebException");
      Print(e.Message);
      return null;
    }

  }


  System.Net.WebRequest LobeCreateImageRequest(string apikey, string docid, Bitmap img){
    try
    {


      string baseURL = @"https://api.lobe.ai/predict?";
      string fullURL = baseURL + "apikey=" + apikey + "&docid=" + docid;

      System.Net.WebRequest request = System.Net.WebRequest.Create(fullURL);
      request.Method = "POST";
      request.ContentType = "application/json";
      //request.Timeout = 10000;

      //String imagestr = "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";
      //imagestr = " ";
      //String imagestr = Convert.ToBase64String(File.ReadAllBytes(imgpath));

      String imagestr = ImageToBase64(img);

      using(var streamWriter = new StreamWriter(request.GetRequestStream()))
      {
        string json = @"{
          ""inputs"":{
          ""image"":""" + imagestr +@"""
          }
          }";

        streamWriter.Write(json);
        streamWriter.Flush();
        streamWriter.Close();
      }
      //Print(request.Headers.ToString());
      return request;
    }
    catch (System.Net.WebException e)
    {
      Print("LobeCreateImageRequest WebException");
      Print(e.Message);
      return null;
    }
  }
# ---------- end c_script_9 ----------
panel_9 = Panel(c_script_9.out)
c_script_10 = CSharpScript(jsonResponse=c_script_9.jsonResponse)  # -> out, confidences, labels; inputs jsonResponse: String
# ---------- c_script_10: C# ----------
    if (jsonResponse == null) return;
    /*
    var pattern = @"\[(.*?)\]";
    var query = "H1-receptor antagonist [HSA:3269] [PATH:hsa04080(3269)]";
    var matches = System.Text.RegularExpressions.Regex.Matches(query, pattern);

    foreach (System.Text.RegularExpressions.Match m in matches) {
      //Print(m.Groups[1].ToString());
    }
    */

    var pattern = @"""confidences"": \[\[(.*?)\]]";
    var matches = System.Text.RegularExpressions.Regex.Matches(jsonResponse, pattern);

    //Print(matches[0].Groups[1].ToString());

    System.Text.RegularExpressions.Regex regex = new System.Text.RegularExpressions.Regex(@"\], \[");

    List<String> ks = new List<String>();
    List<double> vs = new List<double>();
    foreach (String str in regex.Split(matches[0].Groups[1].ToString()) ) {
      String[] sarr = str.Split(',');
      ks.Add(sarr[0].Trim('"'));
      vs.Add(Double.Parse(sarr[1], System.Globalization.NumberStyles.Float));
    }

    labels = ks;
    confidences = vs;
# ---------- end c_script_10 ----------
list_2 = ValueList({"bad", "fair", "moderate", "good", "excellent"}, selected="excellent")
sort = SortList(Keys=c_script_10.confidences, ValuesA=c_script_10.labels)  # -> reverse(Keys), reverse(ValuesA)
panel_10 = Panel(sort.Keys)
panel_11 = Panel(sort.ValuesA)
c_script_11 = CSharpScript(confidences=c_script_10.confidences, labels=c_script_10.labels, label_desired=list_2)  # -> confidence, label; inputs confidences: list of Double, labels: list of String, label_desired: String
# ---------- c_script_11: C# ----------
    if (confidences.Count == 0) return;
    if (labels.Count == 0) return;
    //if (confidences[0] == null) return;
    if (labels[0] == null) return;

    

    for (int n = 0; n < labels.Count; n++){
      if (labels[n].Contains(label_desired)){
        confidence = confidences[n];
        label = labels[n];
        return;
      }
    }
# ---------- end c_script_11 ----------
item_4 = ListItem(List=sort.Keys, Index="1", Wrap=True)
fitness = Number(c_script_11.confidence)
panel_12 = Panel(fitness)
panel_13 = Panel(c_script_11.label)
