# Grasshopper definition wind trainer.gh (Grasshopper 1.0.5)
# plug-ins: Human

# ---- group: calculate slices
# Calculates slices and hit distances. Nothing else can happen if slices aren't calculated.
button = Button()
do_calc_slices = Boolean(Toggle(True))

# ----
# Filename
# Get filename from object name
pipeline = GeometryPipeline(
    GroupByLayer=False,
    GroupByType=False,
    IncludeHidden=True,
    IncludeLocked=True,
    LayerFilter="MASSING",
    NameFilter="*",
    SublayerFiltering=True,
    TypeFilter=1073741848)
save_path = FilePath("C:\Users\samantha.walker\Documents\00_Documents_SWalker\Extracurriculars\sg 2018\Datasets\wind massing\dataset\06 - label & metadata test_rot2\")
# SAMPLING SETTINGS: Extra Coarse = 25 slices
# Coarse = 100 slices
# Medium = 225 slices
# Fine = 400 slices
# Extra Fine = 625 slices
sampling = ValueList({"Extra Coarse": 1, "Coarse": 2}, selected="Extra Coarse")

# ---- group: save files
# Saves image and info files. Can only happen if slices and hits are calculated.
toggle = BooleanToggle(True)
button_2 = Button()
do_save_files = Boolean(toggle)

# ----
pipeline_2 = GeometryPipeline(
    GroupByLayer=False,
    GroupByType=False,
    IncludeHidden=True,
    IncludeLocked=True,
    LayerFilter="SITE",
    NameFilter="*",
    SublayerFiltering=True,
    TypeFilter=4)
pipeline_3 = GeometryPipeline(
    GroupByLayer=False,
    GroupByType=False,
    IncludeHidden=True,
    IncludeLocked=True,
    LayerFilter="MASSING",
    NameFilter="*",
    SublayerFiltering=True,
    TypeFilter=1073741848)
pipeline_4 = GeometryPipeline(
    GroupByLayer=False,
    GroupByType=False,
    IncludeHidden=True,
    IncludeLocked=True,
    LayerFilter="DOOR",
    NameFilter="*",
    SublayerFiltering=False,
    TypeFilter=4)
pipeline_5 = GeometryPipeline(
    GroupByLayer=False,
    GroupByType=False,
    IncludeHidden=True,
    IncludeLocked=True,
    LayerFilter="WINDOW",
    NameFilter="*",
    SublayerFiltering=False,
    TypeFilter=4)

# ----
# The pixel dimension of each slice. All slice images are square.
pixel_count = Panel("60")
px_cnt = Integer(pixel_count)

objatts = ObjectAttributes(ObjectOrAttributes=pipeline)  # -> Name, LayerName, LayerFullPath, Color, MaterialName, LinetypeName, GroupIndices, PlotWeight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
rows_per = Integer(sampling)
windows = Curve()
site = Curve(pipeline_2)
doors = Curve()
brep = Brep(pipeline_3)

save_small_tiles = Boolean(Toggle(False))
visualize_rays = Boolean(Toggle(False))
save_big_tiled = Boolean(Toggle(True))
save_text_file = Boolean(Toggle(False))

site_info = CSharpScript(site=site)  # -> out, w, d, r, n; inputs site: Rectangle3d
# ---------- site_info: C# ----------
    int ww = (int) (site.X.T1 - site.X.T0);
    int dd = (int) (site.Y.T1 - site.Y.T0);

    double rr = Math.Round((double) dd / (double) ww);

    String abr = "";

    if (ww == 18) abr = "A";
    else if (ww == 24) abr = "B";
    else if (ww == 32) abr = "C";
    else if (ww == 40) abr = "D";
    else if (ww == 48) abr = "E";
    else if (ww == 56) abr = "F";
    else if (ww == 64) abr = "G";
    else if (ww == 72) abr = "H";
    else if (ww == 80) abr = "I";
    else if (ww == 88) abr = "J";
    else if (ww == 96) abr = "K";
    else {
      w = false;
      d = false;
      r = false;
      n = false;
      return;
    }
    w = ww;
    d = dd;
    r = rr;
    n = abr + (rr * 10).ToString();
# ---------- end site_info ----------
panel = Panel(objatts.Name)
validator = CSharpScript(breps=brep)  # -> out, solids, unSolids, validity; inputs breps: list of Brep
# ---------- validator: C# ----------
    List<Brep> sBreps = new List<Brep>();
    List<Brep> oBreps = new List<Brep>();
    bool isValid = true;

    foreach (Brep b in breps){
      if (b.IsSolid) sBreps.Add(b);
      else {
        oBreps.Add(b);
        isValid = false;
      }
    }

    validity = isValid;
    solids = sBreps;
    unSolids = oBreps;
# ---------- end validator ----------
panel_2 = Panel(site_info.n)
site_width = Number(site_info.w)
site_depth = Number(site_info.d)
massings = Brep(validator.solids)
all_massings_valid = Boolean(validator.validity)
item = ListItem(List=panel, Index=0, Wrap=True)
panel_3 = Panel(item)
# Sizing
rows_per_2 = Integer(rows_per)

# ---- group: file info
# we add DO CALC SLICES and MASSINGS here to ensure that any time slices change, the metadata file is updated too.
do_calc_slices_2 = Boolean(do_calc_slices)
do_save_files_2 = Boolean(do_save_files)
massings_2 = Brep(massings)
rowsper = Integer(rows_per_2)
c_script = CSharpScript(nudge=massings_2, doCalcSlices=do_calc_slices_2, doSave=do_save_files_2, rowsPer=rowsper, objName=panel_3)  # -> out, A, B; inputs nudge: list, doSave: Boolean, rowsPer: Int32, objName: String
# ---------- c_script: C# ----------
    if (RhinoDocument.IsOpening){
      Print("document is opening");
      Component.ExpireSolution(true);
      return;
    }



    Print(RhinoDocument.Path.ToString());

    //String filename = Path.GetFileNameWithoutExtension(RhinoDocument.Path);
    A = objName;
    //A = filename + "-" + rowsPer.ToString();


    String label = System.IO.Directory.GetParent(RhinoDocument.Path).Name;
    if (label.Contains('-')) label = label.Split('-')[label.Split('-').Count() - 1].Trim();

    B = label;
# ---------- end c_script ----------
# Metadata
panel_4 = Panel(c_script.out)
panel_5 = Panel(c_script.B)
filename = Text(c_script.A)
label = Text(c_script.B)
panel_6 = Panel(c_script.A)

# ---- group: cutbox and ground
massings_3 = Brep(massings)
c_script_2 = CSharpScript(masses=massings_3, pad="0.0625")  # -> out, cutBox, ground, maxDim; inputs masses: list of Brep, pad: Double
# ---------- c_script_2: C# ----------
    if (masses.Count == 0) return;
    
    // Construct bounding intervals on plane
    //

    BoundingBox bBox = masses[0].GetBoundingBox(true);
    for (int n = 1; n < masses.Count; n++) bBox.Union(masses[n].GetBoundingBox(true));
    maxDim = bBox.Diagonal.Length;
    cutBox = bBox;

    Double diagDim = (new Vector2d(bBox.Diagonal.X, bBox.Diagonal.Y)).Length;

    Interval ival_x = new Interval(bBox.Min.X, bBox.Max.X);
    Interval ival_y = new Interval(bBox.Min.Y, bBox.Max.Y);
    Interval ival_z = new Interval(bBox.Min.Z, bBox.Max.Z);

    ival_x = scaleIval(ival_x, (1 + pad));
    ival_y = scaleIval(ival_y, (1 + pad));
    ival_z.T1 = ival_z.T1 + ival_z.Length * pad;

    Box cBox = new Box(Plane.WorldXY, ival_x, ival_y, ival_z);
    cutBox = cBox;

    Double groundDepth = (cBox.Z.T1 - cBox.Z.T0) / 2;
    Plane basePlane = new Plane(cBox.PointAt(0.5, 0.5, 0), Plane.WorldXY.XAxis, Plane.WorldXY.YAxis);
    basePlane.Translate(new Vector3d(0, 0, -groundDepth));

    Cylinder cyl = new Rhino.Geometry.Cylinder(
      new Circle(basePlane, diagDim * (0.75 + pad)), // ensure overlap
      groundDepth - RhinoDocument.ModelAbsoluteTolerance * 10// this might ensure that the breps don't align perfectly, which is better for booleans.
      );

    //Mesh mCyl = Mesh.CreateFromBrep(cyl.ToBrep(true, true), new MeshingParameters())[0];
    //Mesh mCyl = Mesh.CreateFromCylinder(cyl, 1, 36);
    ground = cyl;
# ---------- c_script_2: C# additional code ----------
  Interval scaleIval(Interval ival, Double fac){
    Double delt = ival.Length * fac - ival.Length;
    //if (fixMin) return new Interval(ival.T0, ival.T1 + delt);
    return new Interval(ival.T0 - delt / 2, ival.T1 + delt / 2);
  }
# ---------- end c_script_2 ----------
cutbox = Box(c_script_2.cutBox)
ground = Brep(c_script_2.ground)

# ---- group: all values - not used
# Slices
sampling_2 = ValueList({"Extra Coarse": 1, "Coarse": 2, "Medium": 3, "Fine": 4, "Extra Fine": 5}, selected="Extra Coarse")

# ----
c_script_3 = CSharpScript(rowsPer=rows_per_2)  # -> out, A; inputs rowsPer: Int32
# ---------- c_script_3: C# ----------
    if (rowsPer == 1) A = 5;
    else if (rowsPer == 2) A = 20;
    else if (rowsPer == 3) A = 45;
    else if (rowsPer == 4) A = 80;
    else if (rowsPer == 5) A = 125;
    else A = 5;
# ---------- end c_script_3 ----------
dom = ConstructDomain(DomainStart=0, DomainEnd=c_script_2.maxDim)
division = Division(A=c_script_3.A, B=rows_per_2)

# ----
# The number of slices per orientation plane.
# 
# Due to tiling, is limited to specific numbers: 5,20,45,80,125
slice_cnt = Integer(c_script_3.A)

hit_domain = Domain(dom)
px_cnt_2 = Integer(px_cnt)
expression = Expression(x=px_cnt_2, y=division, Expression="Format(\"{0}x{0} px\", x*y)")
training_image_size = Text(expression)
training_image_size_2 = Panel(training_image_size)
tile_rows_per_plane = Panel(rows_per_2)
slices_per_plane = Panel(slice_cnt)

# ---- group: slices and hits
do_calc_slices_3 = Boolean(do_calc_slices)
visualize_rays_2 = Boolean(visualize_rays)
massings_4 = Brep(massings)
slice_cnt_2 = Integer(slice_cnt)
px_cnt_3 = Integer(px_cnt_2)
c_script_4 = CSharpScript(
    doIt=do_calc_slices_3,
    showRays=visualize_rays_2,
    cutBox=cutbox,
    pxCnt=px_cnt_3,
    sliceCnt=slice_cnt_2,
    masses=massings_4,
    ground=ground,
    hitDomain=hit_domain)  # -> out, basePlanes, sampleLines, hitDists, hitCounts; inputs doIt: Boolean, showRays: Boolean, cutBox: Box, pxCnt: Int32, sliceCnt: Int32, masses: list of Brep, ground: Brep
# ---------- c_script_4: C# ----------
    if (!doIt) return;
    
    List<Brep> allMasses = new List<Brep>(masses);
    allMasses.Add(ground);
    //Print(allMshs.Count.ToString());

    // DEFINE CUT PLANES
    //
    List<Plane> plns = new List<Plane>();
    Plane plnXY = new Plane(cutBox.PointAt(0.5, 0.5, 1.0), cutBox.Plane.XAxis, cutBox.Plane.YAxis);
    Plane plnXZ = new Plane(cutBox.PointAt(0.5, 0.0, 0.5), cutBox.Plane.XAxis, cutBox.Plane.ZAxis);
    Plane plnYZ = new Plane(cutBox.PointAt(0.0, 0.5, 0.5), -cutBox.Plane.YAxis, cutBox.Plane.ZAxis);
    Plane plnOA = new Plane(cutBox.PointAt(0.0, 0.0, 0.5), cutBox.PointAt(1, 0, 0) - cutBox.PointAt(0, 1, 0), cutBox.Plane.ZAxis);
    Plane plnOB = new Plane(cutBox.PointAt(1.0, 0.0, 0.5), cutBox.PointAt(1, 1, 0) - cutBox.PointAt(0, 0, 0), cutBox.Plane.ZAxis);
    plns.AddRange(new Plane[] {plnXY, plnXZ, plnYZ, plnOA, plnOB});

    basePlanes = plns; // OUT


    // PLOT RAYS
    //
    DataTree<Ray3d> rays = new DataTree<Ray3d>();
    rays.MergeTree(plotRays(0, plnXY, cutBox, pxCnt - 1, sliceCnt - 1));
    rays.MergeTree(plotRays(1, plnXZ, cutBox, pxCnt - 1, sliceCnt - 1));
    rays.MergeTree(plotRays(2, plnYZ, cutBox, pxCnt - 1, sliceCnt - 1));
    rays.MergeTree(plotRays(3, plnOA, cutBox, pxCnt - 1, sliceCnt - 1));
    rays.MergeTree(plotRays(4, plnOB, cutBox, pxCnt - 1, sliceCnt - 1));

    //if (showRays) sampleRays = rays; // OUT


    // TRACE RAYS
    //

    //DataTree<Point3d> ptsIn = new DataTree<Point3d>();
    //DataTree<Point3d> ptsOut = new DataTree<Point3d>();
    //DataTree<Point3d> ptsProj = new DataTree<Point3d>();
    DataTree<Line> segsProj = new DataTree<Line>();
    DataTree<Double> hDists = new DataTree<Double>();
    DataTree<int> hCounts = new DataTree<int>();

    foreach(GH_Path pth in rays.Paths){
      foreach(Ray3d ray in rays.Branch(pth)){
        bool isInside = false;
        if ( ground.IsPointInside(ray.Position, RhinoDocument.ModelAbsoluteTolerance, false)){
          //ptsIn.Add(ray.Position, pth);
          hDists.Add(-2, pth);
          segsProj.Add(new Line(ray.Position, ray.Position + ray.Direction), pth);
          hCounts.Add(0, pth);
          isInside = true;
          continue;
        }

        foreach(Brep mass in masses){
          if ( mass.IsPointInside(ray.Position, RhinoDocument.ModelAbsoluteTolerance, false)){
            //ptsIn.Add(ray.Position, pth);
            hDists.Add(-1, pth);
            segsProj.Add(new Line(ray.Position, ray.Position + ray.Direction), pth);
            hCounts.Add(0, pth);
            isInside = true;
            break;
          }
        }

        if (!isInside){
          //ptsOut.Add(ray.Position, pth);

          Point3d[] proj = Rhino.Geometry.Intersect.Intersection.ProjectPointsToBreps(
            allMasses,
            new List<Point3d> {ray.Position},
            ray.Direction,
            doc.ModelAbsoluteTolerance / 1000
            );
          if (proj.Length > 0) {
            Double[] dists = (from Point3d pt in proj select pt.DistanceTo(ray.Position)).ToArray();
            Array.Sort(dists, proj);

            Double normDist = hitDomain.NormalizedParameterAt(dists[0]);
            if (normDist > 1.0) normDist = 1.0;
            hDists.Add(normDist, pth);

            //ptsProj.Add(proj[0]);
            segsProj.Add(new Line(ray.Position, proj[0]), pth);
            hCounts.Add(proj.Length, pth);
          } else {
            segsProj.Add(new Line(ray.Position, ray.Position + ray.Direction), pth);
            hDists.Add(1.0, pth);
            hCounts.Add(0, pth);
          }

        }

      }
    }

    hitDists = hDists;
    if (showRays) sampleLines = segsProj;
    if (showRays) hitCounts = hCounts;
# ---------- c_script_4: C# additional code ----------
  private DataTree<Ray3d> plotRays(int pth, Plane pln, Box bx, int pxCount, int slCount){
    int cntU = pxCount;
    int cntV = cntU;
    int cntW = slCount;

    Interval[] ivals = boxIntervals(pln, bx);
    Interval ival_u = ivals[0];
    Interval ival_v = ivals[1];
    Interval ival_w = ivals[2];

    DataTree<Ray3d> pts = new DataTree<Ray3d>();

    //Print(ival_u.T0.ToString() + " -> " + ival_u.T1.ToString());
    //Print(ival_v.T0.ToString() + " -> " + ival_v.T1.ToString());

    int zi = 0;
    Double epsilon = 0.001; // relative to normalized intervals
    for (int wi = cntW; wi >= 0; wi--){
      Double w = ival_w.ParameterAt(wi / (Double) cntW);

      // back a bit off the first and last planes
      if (wi == cntW) w = ival_w.ParameterAt(1.0 - epsilon);
      if (wi == 0) w = ival_w.ParameterAt(epsilon);

      for (int ui = 0; ui <= cntU; ui++){
        Double u = ival_u.ParameterAt(ui / (Double) cntU);
        for (int vi = cntV; vi >= 0; vi--){
          Double v = ival_v.ParameterAt(vi / (Double) cntV);

          // back a bit off the y-direction at the bottom
          if (vi == 0) v = ival_v.ParameterAt(epsilon);

          pts.Add(new Ray3d(pln.PointAt(u, v, w), pln.Normal), new GH_Path(new int[] {pth, zi}));

        }
      }
      zi++;
    }
    return pts;

  }


  private Interval[] boxIntervals(Plane pln, Box bx){

    Interval ival_u = new Interval(Double.MaxValue, Double.MinValue);
    Interval ival_v = new Interval(Double.MaxValue, Double.MinValue);
    Interval ival_w = new Interval(Double.MaxValue, Double.MinValue);
    foreach (Point3d pt in bx.GetCorners()){
      Double u;
      Double v;
      pln.ClosestParameter(pt, out u, out v);
      Double w = pln.DistanceTo(pt);

      if (u < ival_u.T0) ival_u.T0 = u;
      if (u > ival_u.T1) ival_u.T1 = u;
      if (v < ival_v.T0) ival_v.T0 = v;
      if (v > ival_v.T1) ival_v.T1 = v;
      if (w < ival_w.T0) ival_w.T0 = w;
      if (w > ival_w.T1) ival_w.T1 = w;
    }

    return new Interval[]{ival_u,ival_v,ival_w};

  }
# ---------- end c_script_4 ----------

# ----
training_image_size_3 = Text(expression)

# ---- group: assign colors
swatch = ColourSwatch(SwatchColor=RGB(255, 0, 0))
c_script_5 = CSharpScript(
    hitDists=c_script_4.hitDists,
    clrNear=ColourSwatch(SwatchColor=RGB(255, 255, 255)),
    clrFar=ColourSwatch(SwatchColor=RGB(0, 0, 0)),
    clrGround=swatch,
    clrMass=swatch)  # -> out, pxColors; inputs hitDists: tree of Double, clrNear: Color, clrFar: Color, clrGround: Color, clrMass: Color
# ---------- c_script_5: C# ----------
    if (hitDists.DataCount <= 1) return; // trees may contain a single Null value

    DataTree<Color> clrOut = new DataTree<Color>();

    foreach(GH_Path pth in hitDists.Paths){
      foreach(Double dist in hitDists.Branch(pth)){
        Color clr = clrFar;
        if (dist >= 0){
          clr = ClrInterp(clrNear, clrFar, dist);
        } else if( dist == -1){
          clr = clrMass;
        } else if( dist == -2){
          clr = clrGround;
        }
        clrOut.Add(clr, pth);
      }
    }

    pxColors = clrOut;
# ---------- c_script_5: C# additional code ----------
  public static Color ClrInterp(Color c1, Color c2, double t) {
    if (t < 0 || t > 1) throw new ArgumentOutOfRangeException("t");
    return Color.FromArgb((int) (c1.R + (c2.R - c1.R) * t), (int) (c1.G + (c2.G - c1.G) * t), (int) (c1.B + (c2.R - c1.B) * t));
  }
# ---------- end c_script_5 ----------

# ----
do_save_files_3 = Boolean(do_save_files)

# ---- group: visualize sample locations
number_slider = Slider(2958, range=0..3600)
list = ValueList({"plnXY": 0, "plnXZ": 1, "plnYZ": 2, "plnOA": 3, "plnOB": 4}, selected="plnOA")
c_script_6 = CSharpScript(
    planeIdx=list,
    sliceIdx=Slider(0, range=0..10),
    sampleLines=c_script_4.sampleLines,
    pxColors=c_script_5.pxColors,
    hitCounts=c_script_4.hitCounts)  # -> out, A, B, C, D; inputs planeIdx: Int32, sliceIdx: Int32, sampleLines: tree of Line, pxColors: tree of Color, hitCounts: tree of Int32
# ---------- c_script_6: C# ----------
    if (!sampleLines.PathExists(new GH_Path(new int[] {planeIdx,sliceIdx}))) return;

    List<Line> lines = sampleLines.Branch(new GH_Path(new int[] {planeIdx,sliceIdx}));
    List<Color> colors = pxColors.Branch(new GH_Path(new int[] {planeIdx,sliceIdx}));
    List<int> hits = hitCounts.Branch(new GH_Path(new int[] {planeIdx,sliceIdx}));
    
    List<Point3d> pts = new List<Point3d>();
    //List<Line> segs = new List<Line>();
    //List<Color> clrs = new List<Color>();
    /*
    for (int n = 0; n < rays.Count; n++){
    Ray3d ray = (Ray3d) rays[n];
    pts.Add(ray.Position);
    segs.Add(new Line(ray.Position, ray.Position + ray.Direction));
    clrs.Add((Color) colors[n]);
    }
    */
    foreach (Line ln in lines){
      pts.Add(ln.PointAt(0));
    }


    A = pts;
    B = lines;
    C = colors;
    D = hits;
# ---------- end c_script_6 ----------
preview = CustomPreview(Geometry=c_script_6.A, Material=c_script_6.C)
preview_2 = CustomPreview(Geometry=c_script_6.B, Material=c_script_6.C)
item_2 = ListItem(List=c_script_6.D, Index=number_slider, Wrap=True)
item_3 = ListItem(List=c_script_6.A, Index=number_slider, Wrap=True)
tag = TextTag(Location=item_3, Text=item_2)

# ----
gate = StreamGate(Stream=c_script_5.pxColors, Gate=do_save_files_3)  # -> Target0, Target1

# ---- group: save out images
all_massings_valid_2 = Boolean(all_massings_valid)
save_small_tiles_2 = Boolean(save_small_tiles)
save_path_2 = FilePath(save_path)
filename_2 = Text(filename)
and = GateAnd(A=all_massings_valid_2, B=save_small_tiles_2)
small_tiles = CSharpScript(doSave=and, savepath=save_path_2, filename=filename_2, pxColors=gate.Target1)  # -> out, tiles; inputs doSave: Boolean, savepath: String, filename: String, pxColors: tree of Color
# ---------- small_tiles: C# ----------
    if(!Directory.Exists(savepath)){
      raise("Save path does not exist.");
      return;
    }
    if (filename == null) return;

    if (pxColors.DataCount <= 1) return;// trees may contain a single Null value

    int slicesPerDirection = validateSlices(pxColors);
    if (slicesPerDirection < 1) return;
    Print(slicesPerDirection.ToString() + " slices per each of 5 directions");


    DataTree<System.Drawing.Bitmap> imgsOut = new DataTree<System.Drawing.Bitmap>();


    foreach(GH_Path pth in pxColors.Paths){
      List<Color> pxColorLst = pxColors.Branch(pth);
      int pxDim = validatePixels(pxColorLst);

      System.Drawing.Bitmap img = new Bitmap(pxDim, pxDim);

      if (pxDim > 0){
        for (var i = 0; i < pxColorLst.Count; i++) {
          int y = i % pxDim;
          int x = i / pxDim;
          //Print(String.Format("{0},{1}", x.ToString(), y.ToString()));
          img.SetPixel(x, y, pxColorLst[i]);
        }

        //String pthStr = String.Join("", from num in pth.Indices select num );
        String pthStr = pth.Indices[0].ToString() + pth.Indices[1].ToString("D2");
        if(doSave) img.Save(savepath + filename + pthStr + ".png", System.Drawing.Imaging.ImageFormat.Png);

        imgsOut.Add(img, new GH_Path(pth.Indices[0]));

      }
    }

    tiles = imgsOut;
# ---------- small_tiles: C# additional code ----------
  public int validatePixels(List<Color> pxColors){
    Double cnt = Math.Sqrt(pxColors.Count());
    //Print((cnt % 1.0).ToString());
    if (cnt % 1.0 != 0){
      raise("Pixel count is all wrong. This image is not square.");
      return -1;
    }
    return Convert.ToInt32(cnt);
  }

  public int validateSlices(DataTree<Color> pxColors){

    int expectedDirectionCount = 5;

    if ( pxColors.Paths.Count % expectedDirectionCount != 0 ){
      raise("Data Tree isn't structured properly. Number of slices not divisible by expectedDirectionCount.");
      return -1;
    }
    int[] sliceCnts = new int[]{0,0,0,0,0}; // UPDATE THESE VALUES IF NEEDED
    int slicesPerDirection = -1;
    foreach(GH_Path pth in pxColors.Paths){
      //Print(pth.ToString());
      int idx = pth.Indices[0];
      if (idx > expectedDirectionCount - 1){
        raise("Data Tree isn't structured properly. Maybe not the right number of slice directions? First index greater than expectedDirectionCount.");
        return -1;
      }
      sliceCnts[idx]++;
    }

    //Print(String.Join("; ", sliceCnts));

    if (sliceCnts.Any(i => i != 5 && i != 20 && i != 45 && i != 80 && i != 125)){ // UPDATE THESE VALUES IF NEEDED
      Print(sliceCnts[0].ToString() + "," + sliceCnts[1].ToString() + "," + sliceCnts[2].ToString() + "," + sliceCnts[3].ToString());
      raise("Data Tree isn't structured properly. There should be 5, 20, 45, 80, or 125 slices per direction.");
      return -1;
    } else {
      slicesPerDirection = sliceCnts[0];
    }

    return slicesPerDirection;
  }


  public void raise(String msg){
    Print(msg);
    Component.AddRuntimeMessage(GH_RuntimeMessageLevel.Error, msg);
  }
# ---------- end small_tiles ----------
panel_7 = Panel(small_tiles.out)
all_massings_valid_3 = Boolean(all_massings_valid)
save_big_tiled_2 = Boolean(save_big_tiled)
tiles = Data(small_tiles.tiles)
and_2 = GateAnd(A=all_massings_valid_3, B=save_big_tiled_2)
big_tiled = CSharpScript(doSave=and_2, tiles=tiles, savepath=save_path_2, filename=filename_2)  # -> out; inputs doSave: Boolean, tiles: tree, savepath: String, filename: String
# ---------- big_tiled: C# ----------
    if (!doSave) return;
    if (tiles == null) return;
    if (tiles.DataCount <= 1) return;
    if (filename == null) return;
    Print(tiles.DataCount.ToString());

    if (tiles.BranchCount != 5){
      raise("Data Tree isn't structured properly. There should be 5 branches - one for each slice direction");
      return;
    }
    var sliceCnts = from n in Enumerable.Range(0, tiles.BranchCount) select tiles.Branch(n).Count;
    if (sliceCnts.Any(i => i != 5 && i != 20 && i != 45 && i != 64 && i != tiles.Branch(0).Count)){
      raise("Data Tree isn't structured properly. There should be 5 or 20 or 45 or 64 slices per direction.");
      Print(String.Join(" ", sliceCnts));
      return;
    }

    int slicesPer = tiles.Branch(0).Count;
    int pxDimTile = ((System.Drawing.Bitmap) tiles.Branch(0)[0] ).Width;
    int pxDimBig = -1;
    List<Vector2d> offsets = new List<Vector2d>();
    Vector2d grpOffset = new Vector2d(0, pxDimTile);


    int tileRows = -1;
    if (slicesPer == 5) tileRows = 1;
    if (slicesPer == 20) tileRows = 2;
    if (slicesPer == 45) tileRows = 3;
    if (slicesPer == 80) tileRows = 4;
    if (slicesPer == 125) tileRows = 5;

    if (tileRows > 0){

      pxDimBig = pxDimTile * slicesPer / tileRows;
      for (int n = 0; n < slicesPer; n++) offsets.Add(new Vector2d((n % (slicesPer / tileRows)) * pxDimTile, (n / (slicesPer / tileRows) * pxDimTile)));
      grpOffset *= tileRows;

      System.Drawing.Bitmap bigImageOut = new System.Drawing.Bitmap(pxDimBig, pxDimBig);

      foreach(GH_Path pth in tiles.Paths){
        List<object> imgs = tiles.Branch(pth);
        for (int n = 0; n < slicesPer; n++){
          Bitmap img = (Bitmap) imgs[n];
          Vector2d offset = offsets[n] + grpOffset * pth.Indices[0];
          ImageToImageRegion(img, ref bigImageOut, new Rectangle(Convert.ToInt32(offset.X), Convert.ToInt32(offset.Y), pxDimTile, pxDimTile));
        }

      }


      bigImageOut.Save(savepath + filename + ".png", System.Drawing.Imaging.ImageFormat.Png);
    }
# ---------- big_tiled: C# additional code ----------
  public static void ImageToImageRegion(Bitmap srcBitmap, ref Bitmap destBitmap, Rectangle destRegion)
  {
    Rectangle srcRegion = new Rectangle(0, 0, srcBitmap.Width, srcBitmap.Height);
    using (Graphics grD = Graphics.FromImage(destBitmap))
    {
      grD.DrawImage(srcBitmap, destRegion, srcRegion, GraphicsUnit.Pixel);
    }
  }


  public void raise(String msg){
    Print(msg);
    Component.AddRuntimeMessage(GH_RuntimeMessageLevel.Error, msg);
  }
# ---------- end big_tiled ----------

# ---- group: siting info
# we add TILES here to ensure that any time slices change, the metadata file is updated too.
all_massings_valid_4 = Boolean(all_massings_valid)
do_save_files_4 = Boolean(save_text_file)
site_width_2 = Number(site_width)
site_depth_2 = Number(site_depth)
and_3 = GateAnd(A=all_massings_valid_4, B=do_save_files_4)
save_path_3 = FilePath(save_path)
tiles_2 = Data(tiles)
cutbox_2 = Box(cutbox)
c_script_7 = CSharpScript(
    doSave=and_3,
    savepath=save_path_3,
    filename=filename,
    cutBox=cutbox_2,
    siteWidth=site_width_2,
    siteDepth=site_depth_2,
    label=label,
    tiles=tiles_2)  # -> out, A, B, C; inputs doSave: Boolean, savepath: String, cutBox: Box, siteWidth: Double, siteDepth: Double, label: String, tiles: tree
# ---------- c_script_7: C# ----------
    if (filename == null) return;

    Plane basePlane = new Plane(cutBox.PointAt(0.5, 0.5, 0), cutBox.PointAt(1.0, 0.5, 0), cutBox.PointAt(0.5, 1.0, 0));

    double x = basePlane.OriginX;
    double y = basePlane.OriginY;
    double z = basePlane.OriginZ;

    double vxx = basePlane.XAxis.X;
    double vxy = basePlane.XAxis.Y;

    double vyx = basePlane.YAxis.X;
    double vyy = basePlane.YAxis.Y;

    double w = cutBox.X.Max - cutBox.X.Min;
    double d = cutBox.Y.Max - cutBox.Y.Min;
    double h = cutBox.Z.Max - cutBox.Z.Min;

    Plane outPlane = new Plane(new Point3d(x, y, z), new Vector3d(vxx, vxy, 0), new Vector3d(vyx, vyy, 0));
    A = outPlane;

    Box bx = new Box(outPlane, new Interval(-w / 2, w / 2), new Interval(-d / 2, d / 2), new Interval(0, h));
    B = bx;

    string fmt = "{0:0.0000}";

    IList<string> strings = new List<string>{
        filename + ".png",
        string.Format(fmt, siteWidth),
        string.Format(fmt, siteDepth),
        string.Format(fmt, x),
        string.Format(fmt, y),
        string.Format(fmt, z),
        string.Format(fmt, vxx),
        string.Format(fmt, vxy),
        string.Format(fmt, vyx),
        string.Format(fmt, vyy),
        string.Format(fmt, w),
        string.Format(fmt, d),
        string.Format(fmt, h),
        label
        };

    /*
    IList<string> strings = new List<string>{
        filename + ".png",
        siteWidth.ToString(),
        siteDepth.ToString(),
        x.ToString(),
        y.ToString(),
        z.ToString(),
        vxx.ToString(),
        vxy.ToString(),
        vyx.ToString(),
        vyy.ToString(),
        w.ToString(),
        d.ToString(),
        h.ToString(),
        label
        };
    */


    string content = string.Join(",", strings);
    C = content;

        if (doSave){
          string path = savepath + filename + ".txt";
          System.IO.File.WriteAllText(path, content);

        }
# ---------- end c_script_7 ----------

# ---- group: invalid masses report
# we add TILES here to ensure that any time slices change, the metadata file is updated too.
all_massings_valid_5 = Boolean(all_massings_valid)
do_save_files_5 = Boolean(save_text_file)
save_path_4 = FilePath(save_path)
tiles_3 = Data(tiles)
c_script_8 = CSharpScript(doSave=do_save_files_5, massesValid=all_massings_valid_5, savepath=save_path_4, filename=filename, tiles=tiles_3)  # -> out; inputs doSave: Boolean, massesValid: Boolean, savepath: String, tiles: tree
# ---------- c_script_8: C# ----------
    if (filename == null) return;
    if (!doSave) return;

    if (massesValid) return;

    string path = savepath + "_INVALID " + filename + ".txt";
    System.IO.File.WriteAllText(path, "");
# ---------- end c_script_8 ----------

# ----
split = TextSplit(Text=c_script_7.C, Separators=",")

# ---- group: verify
pln = Plane(c_script_7.A)
box = Box(c_script_7.B)

# ---- group: siting information
# filename + ".png"
# siteWidth
# siteDepth
# basePlane.OriginX
# basePlane.OriginY
# basePlane.OriginZ
# basePlane.XAxis.X
# basePlane.XAxis.Y
# basePlane.YAxis.X
# basePlane.YAxis.Y
# boxWidth (-x/2 -> x/2)
# boxDepth (-y/2 -> y/2)
# boxHeight (0 -> z)
# Label
panel_8 = Panel(split)
