# Grasshopper definition 180404_isovist trainer.gh (Grasshopper 1.0.4)

# ---- group: save files
# Saves image files. Can only happen if hits are calculated.
number_slider = Slider(20, range=3..20)
toggle = BooleanToggle(True)
production_sample_count = Integer(number_slider)

# ----
pipeline = GeometryPipeline(
    GroupByLayer=False,
    GroupByType=False,
    IncludeHidden=True,
    IncludeLocked=True,
    LayerFilter="ViewerBox",
    NameFilter="*",
    SublayerFiltering=True,
    TypeFilter=4)
pipeline_2 = GeometryPipeline(
    GroupByLayer=False,
    GroupByType=False,
    IncludeHidden=True,
    IncludeLocked=True,
    LayerFilter="Context",
    NameFilter="*",
    SublayerFiltering=True,
    TypeFilter=1073741848)
fixed_domain = Panel("0 to 50")

# ---- group: path to image save directory
path = FilePath("C:\Users\Matt\Desktop\Temp-Isovists\")

# ----
do_production = Boolean(toggle)
save_path = FilePath(path)
viewer_box = Curve(pipeline)
context = Brep(pipeline_2)
do_production_2 = Boolean(do_production)
do_production_3 = Boolean(do_production_2)
not = GateNot(A=do_production_3)
# CONSTANTS
# The following values should remain constant across a training set of all spatial types.
number_slider_2 = Slider(0.25, range=0..0.333)
fixed_domain_2 = Panel(fixed_domain)
eye_height_in_meters = Panel("1.5")
px_width = Panel("80")
px_height = Panel("40")
bounds_of_possible_positions = Curve(viewer_box)
px_width_2 = Integer(px_width)
px_width_3 = Integer(px_width_2)
px_height_2 = Integer(px_height)
px_height_3 = Integer(px_height_2)
context_2 = Brep(context)
hit_domain = Domain(fixed_domain_2)
hit_domain_2 = Domain(hit_domain)
remap = RemapNumbers(Value=hit_domain_2, Source=".35", Target=Domain(0, 1))  # -> Mapped, Clipped
# KEEP WIDTH DIVISIBLE BY 4 TO MAKE EASY PANORAMA ROTATIONS
eye_height = Number(eye_height_in_meters)
debug_station_pt = Point(Point(-4.217638571, 6.189115276, 0))
pi = Pi(Factor=number_slider_2)
production_sample_count_2 = Integer(production_sample_count)
seed = Number(188.3)
theta_crop = Number(pi)
theta_crop_2 = Number(theta_crop)
boundary = BoundarySurfaces(Edges=bounds_of_possible_positions)
seed_2 = Number(seed)
debug_station_pt_2 = Point(debug_station_pt)
popgeo = PopulateGeometry(Geometry=boundary, Count=production_sample_count_2, Seed=seed_2)
hit_domain_3 = Domain(hit_domain)
cluster = Cluster_2(bnd_crv=bounds_of_possible_positions, pt2d=debug_station_pt_2, eye_height=eye_height)
cluster_2 = Cluster_2(bnd_crv=bounds_of_possible_positions, pt2d=popgeo, eye_height=eye_height)
do_production_4 = Boolean(do_production_2)
do_save_files = Boolean(do_production_2)
remap_2 = RemapNumbers(Value=0.5, Source=Domain(0, 1), Target=hit_domain_3)  # -> Mapped, Clipped
context_3 = Brep(context)
pt = ConstructPoint(XCoordinate=expr("3*x", remap_2.Mapped), YCoordinate=expr("3*x", remap_2.Mapped), ZCoordinate=0)
pt_2 = ConstructPoint(XCoordinate=expr("-3*x", remap_2.Mapped), YCoordinate=expr("-3*x", remap_2.Mapped), ZCoordinate=0)
c_script = CSharpScript(nudge=context_3, doIt=do_save_files)  # -> out, A, B; inputs nudge: list, doIt: Boolean
# ---------- c_script: C# ----------
    if (!doIt) return;

    if (RhinoDocument.IsOpening){
      Print("document is opening");
      Component.ExpireSolution(true);
      return;
    }



    Print(RhinoDocument.Path.ToString());

    String label = System.IO.Directory.GetParent(RhinoDocument.Path).Name;
    if (label.Contains('-')) label = label.Split('-')[label.Split('-').Count() - 1].Trim();

    String filename = Path.GetFileNameWithoutExtension(RhinoDocument.Path);


    //A = label + "-" + filename;
    A = filename;
    B = label;
# ---------- end c_script ----------
pt_3 = ConstructPoint(XCoordinate=expr("-x", remap_2.Mapped), YCoordinate=expr("-x", remap_2.Mapped), ZCoordinate=0)
c_script_2 = CSharpScript(doProduction=do_production_4, debugPln=cluster, prodPln=cluster_2)  # -> out, A; inputs doProduction: Boolean, debugPln: Plane, prodPln: list of Plane
# ---------- c_script_2: C# ----------
    
    if (doProduction) A = prodPln;
    else A = debugPln;
# ---------- end c_script_2 ----------
rectangle = Rectangle(Plane=pt_3, XSize=hit_domain_3, YSize=hit_domain_3, Radius=0)  # -> Rectangle, Length
rec_2pt = Rectangle2Pt(Plane=PlaneXY(0, 0, 0), PointA=pt_2, PointB=pt, Radius=0)  # -> Rectangle, Length
in_bnds = Curve(rectangle.Rectangle)
sample_planes = Plane(c_script_2.A)
sample_planes_2 = Plane(sample_planes)
out_bnds = Curve(rec_2pt.Rectangle)
out_bnds_2 = Curve(out_bnds)

# ---- group: define ground
# DEFINE GROUND: The ground is defined at the lower edge of the bounding box of the given Breps. Ground box is sized to 1000 times the size of the bounding box. Maximum x-y dimension of bounding box is returned.
cluster_3 = Cluster(bounds=out_bnds_2, breps=context_2)  # -> ground_2, max_dim_2

# ----
merge = Merge(Data1=cluster_3.ground_2, Data2=context_2)
breps = Brep(merge)
breps_2 = Brep(breps)
c_script_3 = CSharpScript(
    showPts=not,
    pxWidth=px_width_3,
    pxHeight=px_height_3,
    samplePlanes=sample_planes_2,
    breps=breps_2,
    hitDomain=remap.Mapped,
    thetaCrop=theta_crop_2)  # -> out, hitCounts, hitPts, hitDists, hitNormDists, A; inputs showPts: Boolean, pxWidth: Int32, pxHeight: Int32, samplePlanes: list of Plane, breps: list of Brep, thetaCrop: Double
# ---------- c_script_3: C# ----------
    DataTree<int> hCounts = new DataTree<int>();
    DataTree<object> hPts = new DataTree<object>();
    DataTree<object> hDists = new DataTree<object>();
    DataTree<object> hNDists = new DataTree<object>();
    Interval dom = new Interval(Double.MinValue, Double.MaxValue);

    Interval ivalPhi = new Interval(0, 2.0 * Math.PI);
    Interval ivalTheta = new Interval(thetaCrop, Math.PI - thetaCrop);

    for (int p = 0; p < samplePlanes.Count; p++){
      Plane samplePlane = samplePlanes[p];

      for (int xi = pxWidth; xi > 0; xi--){
        for (int yi = 0; yi < pxHeight; yi++){
          Double phi = ivalPhi.ParameterAt((Double) xi / (Double) (pxWidth - 1));
          Double theta = ivalTheta.ParameterAt((Double) yi / (Double) (pxHeight - 1));

          Point3d xpt = new Point3d();
          Double xt = Double.MaxValue;

          Double radius = 1.0;
          Double x = radius * Math.Sin(theta) * Math.Cos(phi);
          Double y = radius * Math.Sin(theta) * Math.Sin(phi);
          Double z = radius * Math.Cos(theta);

          Point3d plnPt = samplePlane.PointAt(x, y, z);
          Vector3d rayVec = plnPt - samplePlane.Origin;
          Ray3d ray = new Ray3d(plnPt, rayVec);
          Line seg = new Line(samplePlane.Origin, samplePlane.PointAt(x, y, z));

          var points = Rhino.Geometry.Intersect.Intersection.ProjectPointsToBreps(
            breps,
            new List<Point3d> {samplePlane.Origin},
            ray.Direction,
            doc.ModelAbsoluteTolerance
            );

          int validHits = 0;
          foreach (Point3d pt in points){
            Double t = seg.ClosestParameter(pt);
            if ((t >= 0) && (t < xt)){
              xt = t;
              xpt = pt;
            }

            if (t >= 0) validHits++;
          }

          if (xt < Double.MaxValue){
            hCounts.Add(validHits, new GH_Path(p));
            if (showPts) hPts.Add(xpt, new GH_Path(p));
            //hTs.Add(x, new GH_Path(p)t);
            Double dist = xt * seg.Length;
            hDists.Add(dist, new GH_Path(p));
            
            Double normDist = hitDomain.NormalizedParameterAt(dist);
            if (normDist > 1.0) normDist = 1.0;
            hNDists.Add(normDist, new GH_Path(p));

            if ((dom.Min == Double.MinValue ) || (dist < dom.Min)) dom.T0 = dist;
            if ((dom.Max == Double.MaxValue ) || (dist > dom.Max)) dom.T1 = dist;

          } else {
            hCounts.Add(0, new GH_Path(p));
            if (showPts) hPts.Add(null, new GH_Path(p));
            hDists.Add(null, new GH_Path(p));
            hNDists.Add(null, new GH_Path(p));
          }



        }
      }

      hitCounts = hCounts;
      if (showPts) hitPts = hPts;
      hitNormDists = hNDists;
      hitDists = hDists;
    }
# ---------- end c_script_3 ----------
sqrt = SquareRoot(Value=c_script_3.hitNormDists)
bnd = Bounds(Numbers=c_script_3.hitDists)
nullrep = ReplaceNulls(Items=sqrt, Replacements="1.0")  # -> Items, Count
panel = Panel(bnd)
gradient = Gradient(LowerLimit=0, UpperLimit=1, Parameter=nullrep.Items, stops=[0: RGB(255, 255, 255), 1: RGB(0, 0, 0)])
panel_2 = Panel(nullrep.Items)
tstat = TreeStatistics(Tree=simplify(gradient))  # -> Paths, Length, Count
filename_prefix = Text(c_script.A)
series = Series(Start=0, Step=1, Count=tstat.Count)
expression = Expression(x=series, y=filename_prefix, Expression="Format(\"{1}-{0:0000}\", x, y)")
do_save_images = Boolean(Toggle(True))
save_path_2 = FilePath(save_path)
txt = Text(graft(expression))
px_height_4 = Integer(px_height_2)
px_width_4 = Integer(px_width_2)
c_script_4 = CSharpScript(doSave=do_save_images, savepath=save_path_2, filename=txt, pxColors=gradient, pxWidth=px_width_4, pxHeight=px_height_4)  # -> out, A; inputs doSave: Boolean, savepath: String, filename: String, pxColors: list of Color, pxWidth: Int32, pxHeight: Int32
# ---------- c_script_4: C# ----------
    if (!doSave) return;

    if (pxColors.Count != pxWidth * pxHeight) {
      String msg = "Pixel dimension does not match number of colors provided!";
      Print(msg);
      Component.AddRuntimeMessage(GH_RuntimeMessageLevel.Error, msg);
      //GrasshopperDocument.RequestAbortSolution();
      return;
    }

    System.Drawing.Bitmap img = new Bitmap(pxWidth, pxHeight);

    for (var i = 0; i < pxColors.Count; i++) {
      int y = i % pxHeight;
      int x = i / pxHeight;
      //Print(String.Format("{0},{1}", x.ToString(), y.ToString()));
      img.SetPixel(x, y, pxColors[i]);
    }
    img.Save(savepath + filename + ".png", System.Drawing.Imaging.ImageFormat.Png);
    Print(savepath + filename + ".png");

    A = img;
# ---------- end c_script_4 ----------
panel_3 = Panel(c_script_4.out)

# ==== cluster Cluster
bounds = ClusterInput()
breps = ClusterInput()
breps_2 = Brep(breps)
bounds_2 = Curve(bounds)
boundary = BoundarySurfaces(Edges=bounds_2)
merge = Merge(Data1=boundary, Data2=breps_2)
bbox = BoundingBox(Content=merge, Plane=PlaneXY(0, 0, 0), UnionBox=True)  # -> Box, Box_2
debox = DeconstructBox(Box=bbox.Box)  # -> Plane, X, Y, Z
dedomain = DeconstructDomain(Domain=debox.X)  # -> Start, End
dedomain_2 = DeconstructDomain(Domain=debox.Y)  # -> Start, End
avr = Average(Input=[dedomain.Start, dedomain.End])
subtraction = Subtraction(A=dedomain.End, B=dedomain.Start)
avr_2 = Average(Input=[dedomain_2.Start, dedomain_2.End])
subtraction_2 = Subtraction(A=dedomain_2.End, B=dedomain_2.Start)
multiplication = Multiplication(A=subtraction, B="1000")
multiplication_2 = Multiplication(A=subtraction_2, B="1000")
pt = ConstructPoint(XCoordinate=avr, YCoordinate=avr_2, ZCoordinate=expr("-x", "1"))
max = Maximum(A=subtraction, B=subtraction_2)
max_dim = Number(max)
box = CenterBox(Base=pt, X=multiplication, Y=multiplication_2, Z="1")
ground = Box(box)
max_dim_2 = ClusterOutput(max_dim)
ground_2 = ClusterOutput(ground)

# ==== cluster Cluster_2
bnd_crv = ClusterInput()
eye_height = ClusterInput()
pt2d = ClusterInput()
bnd_crv_2 = Curve(bnd_crv)
eye_height_2 = Number(eye_height)
pt2d_2 = Point(pt2d)
area = Area(Geometry=bnd_crv_2)  # -> Area, Centroid
Z = UnitZ(Factor=eye_height_2)
move = Move(Geometry=pt2d_2, Motion=Z)  # -> Geometry, Transform
vec2pt = Vector2Pt(PointA=pt2d_2, PointB=area.Centroid, Unitize=False)  # -> Vector, Length
Z_2 = UnitZ(Factor=1)
rev = Reverse(Vector=vec2pt.Vector)
xprod = CrossProduct(VectorA=rev, VectorB=Z_2, Unitize=False)  # -> Vector, Length
rev_2 = Reverse(Vector=xprod.Vector)
pl = ConstructPlane(Origin=move.Geometry, XAxis=rev, YAxis=rev_2)
plns = Plane(pl)
plns_2 = ClusterOutput(plns)
