# Grasshopper definition 20180217_isovist trainer.gh (Grasshopper 1.0.4)
# plug-ins: LunchBox

# SPATIAL CONTROLS
list = ValueList({"NONE": 0, "1 Column": 1, "2 Collonade": 2, "3 Collonade and Roof": 3, "4 Column Grid": 4, "5 Column Grid and Roof": 5, "6 One Wall": 6, "7 One Wall and Roof": 7, "8 Two Parallel Walls": 8, "9 Two Parallel Walls and Roof": 9, "10 Interior Corner": 10, "11 Interior Corner and Roof": 11, "12 Exterior Corner": 12, "13 Exterior Corner and Roof": 13, "14 Three Walls": 14, "15 Three Walls and Roof": 15, "16 Four Walls": 16, "17 Four Walls and Roof": 17}, selected="1 Column")
# GENERAL CONTROLS
button = Button()
list_2 = ValueList({"Debug": False, "Production": True}, selected="Debug")

# ---- group: path to image save directory
# GLOBALS
# The following values should be set for each spatial data type, and possibly for each run of parametric variation of the context.
path = FilePath("C:\Users\ksteinfe\Desktop\TEMP\")

# ----
do_production = Boolean(list_2)
do_save_images = Boolean(button)
rec = DataRecorder(do_save_images, DataLimit=-10, RecordData=True)
save_path = FilePath(path)
do_production_2 = Boolean(do_production)
cluster = Cluster_3(bool=rec)
production_sample_count = Integer(Slider(20, range=3..20))
x_col_count = Integer(Slider(6, range=4..8))
y_col_count = Integer(Slider(6, range=4..8))
space_type_idx = Integer(list)
x_offset = Number(Slider(0, range=0..20))
y_offset = Number(Slider(0, range=0..20))
x_length = Number(Slider(41.1, range=30..60))
y_length = Number(Slider(25, range=15..60))
height = Number(Slider(6, range=4..8))
col_width = Number(Slider(1, range=1..2))
sphere_radius_in_meters = Panel("1.0")
not = GateNot(A=do_production_2)
auto_run_number = Panel(cluster)
run_number = Panel("10")
debug_station_pt = Point(Point(-4.217638571, 6.189115276, 0))
int = Integer(auto_run_number)
expression = Expression(x=space_type_idx, y=int, Expression="Format(\"t{0:00}r{1:00}\", x, y)")
# CONSTANTS
# The following values should remain constant across a training set of all spatial types.
number_slider = Slider(0.25, range=0..0.333)
ma = MassAddition(Input=[x_offset, y_offset, x_length, y_length, height, x_col_count, y_col_count, col_width])  # -> Result, PartialResults
eye_height_in_meters = Panel("1.5")
fixed_domain = Panel("0 to 25")
px_width = Panel("80")
px_height = Panel("40")
px_width_2 = Integer(px_width)
px_width_3 = Integer(px_width_2)
px_width_4 = Integer(px_width_2)
px_height_2 = Integer(px_height)
px_height_3 = Integer(px_height_2)
px_height_4 = Integer(px_height_2)
seed = Number(ma.Result)
production_sample_count_2 = Integer(production_sample_count)
hit_domain = Domain(fixed_domain)
hit_domain_2 = Domain(hit_domain)
hit_domain_3 = Domain(hit_domain)
remap = RemapNumbers(Value=hit_domain_2, Source=".35", Target=Domain(0, 1))  # -> Mapped, Clipped
# KEEP WIDTH DIVISIBLE BY 4 TO MAKE EASY PANORAMA ROTATIONS
eye_height = Number(eye_height_in_meters)
pi = Pi(Factor=number_slider)
seed_2 = Number(seed)
debug_station_pt_2 = Point(debug_station_pt)
theta_crop = Number(pi)
theta_crop_2 = Number(theta_crop)
theta_crop_3 = Number(theta_crop)
panel = Panel(expression)
filename_prefix = Text(expression)
do_production_3 = Boolean(do_production)
hit_domain_4 = Domain(hit_domain)
remap_2 = RemapNumbers(Value=0.5, Source=Domain(0, 1), Target=hit_domain_4)  # -> Mapped, Clipped
button_2 = Button()
pt = ConstructPoint(XCoordinate=expr("3*x", remap_2.Mapped), YCoordinate=expr("3*x", remap_2.Mapped), ZCoordinate=0)
pt_2 = ConstructPoint(XCoordinate=expr("-3*x", remap_2.Mapped), YCoordinate=expr("-3*x", remap_2.Mapped), ZCoordinate=0)
pt_3 = ConstructPoint(XCoordinate=expr("-x", remap_2.Mapped), YCoordinate=expr("-x", remap_2.Mapped), ZCoordinate=0)
rectangle = Rectangle(Plane=pt_3, XSize=hit_domain_4, YSize=hit_domain_4, Radius=0)  # -> Rectangle, Length
rec_2pt = Rectangle2Pt(Plane=PlaneXY(0, 0, 0), PointA=pt_2, PointB=pt, Radius=0)  # -> Rectangle, Length
filename_prefix_2 = Text(filename_prefix)
swatch = ColourSwatch(SwatchColor=RGB(0, 0, 0))
in_bnds = Curve(rectangle.Rectangle)

# ---- group: choose
in_bnds_2 = Curve(in_bnds)
crv = Curve(<curve referenced from the Rhino model>)

# ----
scale = Scale(Geometry=in_bnds_2, Center=Point(0, 0, 0), Factor=0.5)  # -> Geometry, Transform
bounds_of_possible_positions = Curve(scale.Geometry)
bounds_of_possible_positions_2 = Curve(bounds_of_possible_positions)
boundary = BoundarySurfaces(Edges=bounds_of_possible_positions_2)
popgeo = PopulateGeometry(Geometry=boundary, Count=production_sample_count_2, Seed=seed_2)
cluster_2 = Cluster_2(bnd_crv=bounds_of_possible_positions, pt2d=debug_station_pt_2, eye_height=eye_height)
cluster_3 = Cluster_2(bnd_crv=bounds_of_possible_positions_2, pt2d=popgeo, eye_height=eye_height)
c_script = CSharpScript(doProduction=do_production_3, debugPln=cluster_2, prodPln=cluster_3)  # -> out, A; inputs doProduction: Boolean, debugPln: Plane, prodPln: list of Plane
# ---------- c_script: C# ----------
    
    if (doProduction) A = prodPln;
    else A = debugPln;
# ---------- end c_script ----------
sample_planes = Plane(c_script.A)
sample_planes_2 = Plane(sample_planes)
c_script_2 = CSharpScript(
    thetaCrop=theta_crop_3,
    pxWidth=px_width_4,
    pxHeight=px_height_4,
    samplePlanes=sample_planes_2,
    hitDomain=remap.Mapped,
    radius=sphere_radius_in_meters)  # -> out, A, B; inputs thetaCrop: Double, pxWidth: Int32, pxHeight: Int32, samplePlanes: list of Plane, radius: Double
# ---------- c_script_2: C# ----------
    Double nudge = RhinoDocument.ModelAbsoluteTolerance;
    Interval ivalPhi = new Interval(nudge, 2.0 * Math.PI - nudge);
    Interval ivalTheta = new Interval(thetaCrop, Math.PI - thetaCrop);
    List<Brep> retBreps = new List<Brep>();
    List<Curve> retCrvs = new List<Curve>();
    List<Circle> retCircs = new List<Circle>();

    for (int p = 0; p < samplePlanes.Count; p++){
      Plane samplePlane = samplePlanes[p];
      List<Curve> crvs = new List<Curve>();
      for (int xi = 0; xi < pxWidth; xi++){
        List<Point3d> pts = new List<Point3d>();
        for (int yi = 0; yi < pxHeight; yi++){
          Double phi = ivalPhi.ParameterAt((Double) xi / (Double) (pxWidth - 1));
          Double theta = ivalTheta.ParameterAt((Double) yi / (Double) (pxHeight - 1));

          Double x = radius * Math.Sin(theta) * Math.Cos(phi);
          Double y = radius * Math.Sin(theta) * Math.Sin(phi);
          Double z = radius * Math.Cos(theta);

          Point3d pt = samplePlane.PointAt(x, y, z);
          pts.Add(pt);


        }

        Curve cv = Curve.CreateInterpolatedCurve(pts, 3);
        crvs.Add(cv);
        retCrvs.Add(cv);
      }

      Brep[] breps = Brep.CreateFromLoft(crvs, Point3d.Unset, Point3d.Unset, LoftType.Normal, true);
      retBreps.Add(breps[0]);
      
      Circle circIn = new Rhino.Geometry.Circle(samplePlane.Origin, hitDomain.T0);
      Circle circOut = new Rhino.Geometry.Circle(samplePlane.Origin, hitDomain.T1);
      retCircs.Add(circIn);
      retCircs.Add(circOut);
    }

    A = retBreps;
    B = retCircs;
# ---------- end c_script_2 ----------
viewbox = Curve(in_bnds_2)
out_bnds = Curve(rec_2pt.Rectangle)
out_bnds_2 = Curve(out_bnds)
bake = ObjectBake(
    BakeToggle=button_2,
    GeometryObjects=viewbox,
    Layer="ViewerBox",
    ObjectName="GH_Obj",
    ObjectColor=swatch,
    LayerColor=swatch)
do_save_images_2 = Boolean(do_save_images)
save_path_2 = FilePath(save_path)
px_height_5 = Integer(px_height_2)
px_width_5 = Integer(px_width_2)
x_offset_2 = Number(x_offset)
y_offset_2 = Number(y_offset)
X = UnitX(Factor=x_offset_2)
Y = UnitY(Factor=y_offset_2)
addition = Addition(A=X, B=Y)
pt_4 = Point(Point(0, 0, 0))
move = Move(Geometry=pt_4, Motion=addition)  # -> Geometry, Transform
col_wall_width = Number(col_width)
x_length_2 = Number(x_length)
y_length_2 = Number(y_length)
Y_2 = UnitY(Factor=expr("x*-1", y_length_2))
X_2 = UnitX(Factor=expr("x*-1", x_length_2))
move_2 = Move(Geometry=pt_4, Motion=expr("x*0.1", addition))  # -> Geometry, Transform
x_col_count_2 = Integer(x_col_count)
y_col_count_2 = Integer(y_col_count)
col_width_2 = Number(col_width)
move_3 = Move(Geometry=move.Geometry, Motion=X_2)  # -> Geometry, Transform
move_4 = Move(Geometry=move.Geometry, Motion=Y_2)  # -> Geometry, Transform
height_2 = Number(height)
move_5 = Move(Geometry=move_2.Geometry, Motion=expr("x*-1", X_2))  # -> Geometry, Transform
move_6 = Move(Geometry=move_2.Geometry, Motion=expr("x*-1", Y_2))  # -> Geometry, Transform
ln = Line(StartPoint=move_4.Geometry, EndPoint=move.Geometry)
Z = UnitZ(Factor=height_2)
ln_2 = Line(StartPoint=move_3.Geometry, EndPoint=move.Geometry)
len = Length(Curve=ln)
ln_3 = Line(StartPoint=move_6.Geometry, EndPoint=move_2.Geometry)
ln_4 = Line(StartPoint=move_5.Geometry, EndPoint=move_2.Geometry)
divide = DivideCurve(Curve=ln_2, Count=expr("x-1", x_col_count_2), Kinks=False)  # -> Points, Tangents, Parameters
vec = VectorXYZ(XComponent=expr("x*-1", col_width_2), YComponent=expr("x*-1", col_width_2), ZComponent=Z)  # -> Vector, Length
division = Division(A=len, B=y_col_count_2)
extr = Extrude(Base=ln_4, Direction=Z)
extr_2 = Extrude(Base=ln_3, Direction=Z)
Y_3 = UnitY(Factor=division)
addition_2 = Addition(A=divide.Points, B=vec.Vector)
box = Box2Pt(PointA=divide.Points, PointB=addition_2, Plane=PlaneXY(0, 0, 0))
arrlinear = LinearArray(Geometry=box, Direction=expr("x*-1", Y_3), Count=expr("x+1", y_col_count_2))  # -> simplify(Geometry), Transform
lng = ListLength(List=flatten(divide.Points))  # -> expr("x-1", Length)
item = ListItem(List=box, Index=expr("x-1", x_col_count_2), Wrap=True)
branch = TreeBranch(Tree=arrlinear.Geometry, Path=lng, MaintainPaths=True)
column_grid = Box(flatten(arrlinear.Geometry))
group = Group(Objects=column_grid)
bbox = BoundingBox(Content=group, Plane=PlaneXY(0, 0, 0))  # -> Box, Box_2
debrep = DeconstructBrep(Brep=bbox.Box)  # -> Faces, Edges, Vertices
item_2 = ListItem(List=debrep.Faces, Index="2", Wrap=True)
item_3 = ListItem(List=debrep.Faces, Index="5", Wrap=True)
item_4 = ListItem(List=debrep.Faces, Index="1", Wrap=True)
item_5 = ListItem(List=debrep.Faces, Index="6", Wrap=True)
item_6 = ListItem(List=debrep.Faces, Index="3", Wrap=True)
roof = Surface(item_3)
collonade = Brep(branch)
wall_x1r = Surface(extr)
wall_y1r = Surface(extr_2)
wall_x1 = Surface(item_2)
wall_y1 = Surface(item_4)
wall_x2 = Surface(item_5)
wall_y2 = Surface(item_6)
column = Box(item)
_14_three_walls = Brep(flatten([wall_x1, wall_y1, wall_x2]))
_3_collonade_roof = Brep(flatten([collonade, roof]))
_5_column_grid_roof = Brep(flatten([column_grid, roof]))
_15_three_walls_roof = Brep(flatten([wall_x1, wall_y1, wall_x2, roof]))
_17_four_walls_roof_room = Brep(flatten([wall_x1, wall_y1, wall_x2, wall_y2, roof]))
_1_column = Brep(flatten(column))
_2_collonade = Brep(flatten(collonade))
_4_column_grid = Brep(flatten(column_grid))
_6_one_wall = Brep(flatten(wall_x1))
_7_one_wall_roof = Brep(flatten([wall_x1, roof]))
_8_two_parallel_walls = Brep(flatten([wall_x1, wall_x2]))
_9_two_parallel_walls_roof = Brep(flatten([wall_x1, wall_x2, roof]))
_16_four_walls = Brep(flatten([wall_x1, wall_y1, wall_x2, wall_y2]))
_0_nothing = Geometry()
_11_interior_corner_roof = Brep(flatten([wall_x1, wall_y1, roof]))
_13_exterior_corner_roof = Brep(flatten([wall_x1r, wall_y1r, roof]))
_10_interior_corner = Brep(flatten([wall_x1, wall_y1]))
_12_exterior_corner = Brep(flatten([wall_x1r, wall_y1r]))
space_type_idx_2 = Integer(space_type_idx)
filter = StreamFilter(
    Gate=space_type_idx_2,
    Stream0=_0_nothing,
    Stream1=_1_column,
    Stream2=_2_collonade,
    Stream3=_3_collonade_roof,
    Stream4=_4_column_grid,
    Stream5=_5_column_grid_roof,
    Stream6=_6_one_wall,
    Stream7=_7_one_wall_roof,
    Stream8=_8_two_parallel_walls,
    Stream9=_9_two_parallel_walls_roof,
    Stream10=_10_interior_corner,
    Stream11=_11_interior_corner_roof,
    Stream12=_12_exterior_corner,
    Stream13=_13_exterior_corner_roof,
    Stream14=_14_three_walls,
    Stream15=_15_three_walls_roof,
    Stream16=_16_four_walls,
    Stream17=_17_four_walls_roof_room)
context = Brep(filter)
context_2 = Brep(context)

# ---- group: define ground
# DEFINE GROUND: The ground is defined at the lower edge of the bounding box of the given Breps. Ground box is sized to 1000 times the size of the bounding box. Maximum x-y dimension of bounding box is returned.
cluster_4 = Cluster(bounds=out_bnds_2, breps=context_2)  # -> ground_2, max_dim_2

# ----
merge = Merge(Data1=cluster_4.ground_2, Data2=context_2)
breps = Brep(merge)
breps_2 = Brep(breps)
c_script_3 = CSharpScript(
    showPts=not,
    pxWidth=px_width_3,
    pxHeight=px_height_3,
    samplePlanes=sample_planes_2,
    breps=breps_2,
    hitDomain=remap.Mapped,
    thetaCrop=theta_crop_2)  # -> out, hitCounts, hitPts, hitDists, hitNormDists, A; inputs showPts: Boolean, pxWidth: Int32, pxHeight: Int32, samplePlanes: list of Plane, breps: list of Brep, thetaCrop: Double
# ---------- c_script_3: C# ----------
    DataTree<int> hCounts = new DataTree<int>();
    DataTree<object> hPts = new DataTree<object>();
    DataTree<object> hDists = new DataTree<object>();
    DataTree<object> hNDists = new DataTree<object>();
    Interval dom = new Interval(Double.MinValue, Double.MaxValue);

    Interval ivalPhi = new Interval(0, 2.0 * Math.PI);
    Interval ivalTheta = new Interval(thetaCrop, Math.PI - thetaCrop);

    for (int p = 0; p < samplePlanes.Count; p++){
      Plane samplePlane = samplePlanes[p];

      for (int xi = pxWidth; xi > 0; xi--){
        for (int yi = 0; yi < pxHeight; yi++){
          Double phi = ivalPhi.ParameterAt((Double) xi / (Double) (pxWidth - 1));
          Double theta = ivalTheta.ParameterAt((Double) yi / (Double) (pxHeight - 1));

          Point3d xpt = new Point3d();
          Double xt = Double.MaxValue;

          Double radius = 1.0;
          Double x = radius * Math.Sin(theta) * Math.Cos(phi);
          Double y = radius * Math.Sin(theta) * Math.Sin(phi);
          Double z = radius * Math.Cos(theta);

          Point3d plnPt = samplePlane.PointAt(x, y, z);
          Vector3d rayVec = plnPt - samplePlane.Origin;
          Ray3d ray = new Ray3d(plnPt, rayVec);
          Line seg = new Line(samplePlane.Origin, samplePlane.PointAt(x, y, z));

          var points = Rhino.Geometry.Intersect.Intersection.ProjectPointsToBreps(
            breps,
            new List<Point3d> {samplePlane.Origin},
            ray.Direction,
            doc.ModelAbsoluteTolerance
            );

          int validHits = 0;
          foreach (Point3d pt in points){
            Double t = seg.ClosestParameter(pt);
            if ((t >= 0) && (t < xt)){
              xt = t;
              xpt = pt;
            }

            if (t >= 0) validHits++;
          }

          if (xt < Double.MaxValue){
            hCounts.Add(validHits, new GH_Path(p));
            if (showPts) hPts.Add(xpt, new GH_Path(p));
            //hTs.Add(x, new GH_Path(p)t);
            Double dist = xt * seg.Length;
            hDists.Add(dist, new GH_Path(p));
            
            Double normDist = hitDomain.NormalizedParameterAt(dist);
            if (normDist > 1.0) normDist = 1.0;
            hNDists.Add(normDist, new GH_Path(p));

            if ((dom.Min == Double.MinValue ) || (dist < dom.Min)) dom.T0 = dist;
            if ((dom.Max == Double.MaxValue ) || (dist > dom.Max)) dom.T1 = dist;

          } else {
            hCounts.Add(0, new GH_Path(p));
            if (showPts) hPts.Add(null, new GH_Path(p));
            hDists.Add(null, new GH_Path(p));
            hNDists.Add(null, new GH_Path(p));
          }



        }
      }

      hitCounts = hCounts;
      if (showPts) hitPts = hPts;
      hitNormDists = hNDists;
      hitDists = hDists;
    }
# ---------- end c_script_3 ----------
sqrt = SquareRoot(Value=c_script_3.hitNormDists)
bnd = Bounds(Numbers=c_script_3.hitDists)
nullrep = ReplaceNulls(Items=sqrt, Replacements="1.0")  # -> Items, Count
panel_2 = Panel(bnd)
gradient = Gradient(LowerLimit=0, UpperLimit=1, Parameter=nullrep.Items, stops=[0: RGB(255, 255, 255), 1: RGB(0, 0, 0)])
panel_3 = Panel(nullrep.Items)
tstat = TreeStatistics(Tree=simplify(gradient))  # -> Paths, Length, Count
context_3 = Brep(context_2)
series = Series(Start=0, Step=1, Count=tstat.Count)
expression_2 = Expression(x=series, y=filename_prefix_2, Expression="Format(\"{1}-{0:0000}\", x, y)")
bake_2 = ObjectBake(
    BakeToggle=button_2,
    GeometryObjects=context_3,
    Layer="Context",
    ObjectName="GH_Obj",
    ObjectColor=swatch,
    LayerColor=swatch)
txt = Text(graft(expression_2))
c_script_4 = CSharpScript(doSave=do_save_images_2, savepath=save_path_2, filename=txt, pxColors=gradient, pxWidth=px_width_5, pxHeight=px_height_5)  # -> out, A; inputs doSave: Boolean, savepath: String, filename: String, pxColors: list of Color, pxWidth: Int32, pxHeight: Int32
# ---------- c_script_4: C# ----------
    if (!doSave) return;

    if (pxColors.Count != pxWidth * pxHeight) {
      String msg = "Pixel dimension does not match number of colors provided!";
      Print(msg);
      Component.AddRuntimeMessage(GH_RuntimeMessageLevel.Error, msg);
      //GrasshopperDocument.RequestAbortSolution();
      return;
    }

    System.Drawing.Bitmap img = new Bitmap(pxWidth, pxHeight);

    for (var i = 0; i < pxColors.Count; i++) {
      int y = i % pxHeight;
      int x = i / pxHeight;
      //Print(String.Format("{0},{1}", x.ToString(), y.ToString()));
      img.SetPixel(x, y, pxColors[i]);
    }
    img.Save(savepath + filename + ".png", System.Drawing.Imaging.ImageFormat.Png);
    Print(savepath + filename + ".png");

    A = img;
# ---------- end c_script_4 ----------
panel_4 = Panel(c_script_4.out)

# ==== cluster Cluster
bounds = ClusterInput()
breps = ClusterInput()
breps_2 = Brep(breps)
bounds_2 = Curve(bounds)
boundary = BoundarySurfaces(Edges=bounds_2)
merge = Merge(Data1=boundary, Data2=breps_2)
bbox = BoundingBox(Content=merge, Plane=PlaneXY(0, 0, 0), UnionBox=True)  # -> Box, Box_2
debox = DeconstructBox(Box=bbox.Box)  # -> Plane, X, Y, Z
dedomain = DeconstructDomain(Domain=debox.X)  # -> Start, End
dedomain_2 = DeconstructDomain(Domain=debox.Y)  # -> Start, End
avr = Average(Input=[dedomain.Start, dedomain.End])
subtraction = Subtraction(A=dedomain.End, B=dedomain.Start)
avr_2 = Average(Input=[dedomain_2.Start, dedomain_2.End])
subtraction_2 = Subtraction(A=dedomain_2.End, B=dedomain_2.Start)
multiplication = Multiplication(A=subtraction, B="1000")
multiplication_2 = Multiplication(A=subtraction_2, B="1000")
pt = ConstructPoint(XCoordinate=avr, YCoordinate=avr_2, ZCoordinate=expr("-x", "1"))
max = Maximum(A=subtraction, B=subtraction_2)
max_dim = Number(max)
box = CenterBox(Base=pt, X=multiplication, Y=multiplication_2, Z="1")
ground = Box(box)
max_dim_2 = ClusterOutput(max_dim)
ground_2 = ClusterOutput(ground)

# ==== cluster Cluster_2
bnd_crv = ClusterInput()
eye_height = ClusterInput()
pt2d = ClusterInput()
bnd_crv_2 = Curve(bnd_crv)
eye_height_2 = Number(eye_height)
pt2d_2 = Point(pt2d)
area = Area(Geometry=bnd_crv_2)  # -> Area, Centroid
Z = UnitZ(Factor=eye_height_2)
move = Move(Geometry=pt2d_2, Motion=Z)  # -> Geometry, Transform
vec2pt = Vector2Pt(PointA=pt2d_2, PointB=area.Centroid, Unitize=False)  # -> Vector, Length
Z_2 = UnitZ(Factor=1)
rev = Reverse(Vector=vec2pt.Vector)
xprod = CrossProduct(VectorA=rev, VectorB=Z_2, Unitize=False)  # -> Vector, Length
rev_2 = Reverse(Vector=xprod.Vector)
pl = ConstructPlane(Origin=move.Geometry, XAxis=rev, YAxis=rev_2)
plns = Plane(pl)
plns_2 = ClusterOutput(plns)

# ==== cluster Cluster_3
bool = ClusterInput()
bool_2 = Boolean(bool)
lng = ListLength(List=bool_2)  # -> expr("(x/2)", Length)
panel = Panel(lng)
null = NullItem(Item=lng)  # -> NullFlags, InvalidFlags, Description
filter = StreamFilter(Gate=null.NullFlags, Stream0=lng, Stream1="-1")
int = Integer(filter)
int_2 = ClusterOutput(int)
