# Grasshopper definition 170207 T1 isovist trainer.gh (Grasshopper 1.0.4)

# GLOBALS
# The following values should be set for each spatial data type, and possibly for each run of parametric variation of the context.
filename = Panel("t1_07")
# CONTROLS
button = Button()
list = ValueList({"Debug": False, "Production": True}, selected="Debug")

# ---- group: path to image save directory
path = FilePath("C:\Users\ksteinfe\Desktop\")

# ----
do_production = Boolean(list)
do_save_images = Boolean(button)
save_path = FilePath(path)
filename_prefix = Text(filename)
do_production_2 = Boolean(do_production)  # disabled
production_sample_count = Integer(Slider(20, range=3..20))
sphere_radius_in_meters = Panel("1.0")  # disabled
apx_col_count = Integer(Slider(64, range=9..64))
col_extent = Number(Slider(2, range=1..3))
col_height = Number(Slider(9.5, range=0..10))
col_wall_dim = Number(Slider(0.5, range=0.1..0.75))
production_sample_count_2 = Integer(production_sample_count)  # disabled
not = GateNot(A=do_production_2)  # disabled
debug_station_pt = Point(Point(-6.386189072, -3.968153145, 0))
sqrt = SquareRoot(Value=apx_col_count)
debug_station_pt_2 = Point(debug_station_pt)  # disabled
# CONSTANTS
# The following values should remain constant across a training set of all spatial types.
number_slider = Slider(0.25, range=0..0.333)
int = Integer(expr("x-1", sqrt))
eye_height_in_meters = Panel("1.5")
fixed_domain = Panel("0 to 30")
px_width = Panel("80")
px_height = Panel("40")
px_height_2 = Integer(px_height)
px_height_3 = Integer(px_height_2)  # disabled
px_height_4 = Integer(px_height_2)  # disabled
px_width_2 = Integer(px_width)
px_width_3 = Integer(px_width_2)  # disabled
px_width_4 = Integer(px_width_2)  # disabled
do_production_3 = Boolean(do_production)  # disabled
hit_domain = Domain(fixed_domain)
hit_domain_2 = Domain(hit_domain)  # disabled
hit_domain_3 = Domain(hit_domain)
dedomain = DeconstructDomain(Domain=hit_domain_3)  # -> Start, End
multiplication = Multiplication(A=dedomain.End, B=col_extent)
eye_height = Number(eye_height_in_meters)
pt = ConstructPoint(XCoordinate=expr("-x/2", multiplication), YCoordinate=expr("-x/2", multiplication), ZCoordinate=0)
division = Division(A=multiplication, B=int)
pi = Pi(Factor=number_slider)
panel = Panel("1.0")  # disabled
theta_crop = Number(pi)
theta_crop_2 = Number(theta_crop)  # disabled
theta_crop_3 = Number(theta_crop)  # disabled
recgrid = Rectangular(Plane=pt, SizeX=division, SizeY=division, ExtentX=int, ExtentY=int)  # -> Cells, flatten(Points)
sort_pt = SortPoints(Points=pt)  # -> Points, Indices
panel_2 = Panel("""1
-1""")
hit_domain_4 = Domain(hit_domain)
pt_2 = Point(recgrid.Points)
Z = UnitZ(Factor=expr("x/2", col_height))
remap = RemapNumbers(Value=0.5, Source=Domain(0, 1), Target=hit_domain_4)  # -> Mapped, Clipped
item = ListItem(List=sort_pt.Points, Index=panel_2, Wrap=True)
pt_3 = ConstructPoint(XCoordinate=expr("3*x", remap.Mapped), YCoordinate=expr("3*x", remap.Mapped), ZCoordinate=0)
pt_4 = ConstructPoint(XCoordinate=expr("-x", remap.Mapped), YCoordinate=expr("-x", remap.Mapped), ZCoordinate=0)
pt_5 = ConstructPoint(XCoordinate=expr("-3*x", remap.Mapped), YCoordinate=expr("-3*x", remap.Mapped), ZCoordinate=0)
move = Move(Geometry=pt_2, Motion=Z)  # -> Geometry, Transform
box = CenterBox(Base=move.Geometry, X=col_wall_dim, Y=col_wall_dim, Z=expr("x/2", col_height))
rectangle = Rectangle(Plane=pt_4, XSize=hit_domain_4, YSize=hit_domain_4, Radius=0)  # -> Rectangle, Length
rec_2pt = Rectangle2Pt(Plane=PlaneXY(0, 0, 0), PointA=pt_5, PointB=pt_3, Radius=0)  # -> Rectangle, Length
in_bnds = Curve(rectangle.Rectangle)

# ---- group: choose
in_bnds_2 = Curve(in_bnds)
crv = Curve(<curve referenced from the Rhino model>)

# ----
bounds_of_possible_positions = Curve(in_bnds_2)
bounds_of_possible_positions_2 = Curve(bounds_of_possible_positions)  # disabled
boundary = BoundarySurfaces(Edges=bounds_of_possible_positions_2)  # disabled
popgeo = PopulateGeometry(Geometry=boundary, Count=production_sample_count_2, Seed=1)  # disabled
cluster = Cluster_2(bnd_crv=bounds_of_possible_positions, pt2d=debug_station_pt_2, eye_height=eye_height)  # disabled
cluster_2 = Cluster_2(bnd_crv=bounds_of_possible_positions_2, pt2d=popgeo, eye_height=eye_height)  # disabled
c_script = CSharpScript(doProduction=do_production_3, debugPln=cluster, prodPln=cluster_2)  # -> out, A; inputs doProduction: Boolean, debugPln: Plane, prodPln: list of Plane; disabled
# ---------- c_script: C# ----------
    
    if (doProduction) A = prodPln;
    else A = debugPln;
# ---------- end c_script ----------
sample_planes = Plane(c_script.A)  # disabled
sample_planes_2 = Plane(sample_planes)  # disabled
c_script_2 = CSharpScript(
    thetaCrop=theta_crop_3,
    pxWidth=px_width_4,
    pxHeight=px_height_4,
    samplePlanes=sample_planes_2,
    radius=sphere_radius_in_meters)  # -> out, A; inputs thetaCrop: Double, pxWidth: Int32, pxHeight: Int32, samplePlanes: list of Plane, radius: Double; disabled
# ---------- c_script_2: C# ----------
    Double nudge = RhinoDocument.ModelAbsoluteTolerance;
    Interval ivalPhi = new Interval(nudge, 2.0 * Math.PI - nudge);
    Interval ivalTheta = new Interval(thetaCrop, Math.PI - thetaCrop);
    List<Brep> retBreps = new List<Brep>();
    List<Curve> retCrvs = new List<Curve>();

    for (int p = 0; p < samplePlanes.Count; p++){
      Plane samplePlane = samplePlanes[p];
      List<Curve> crvs = new List<Curve>();
      for (int xi = 0; xi < pxWidth; xi++){
        List<Point3d> pts = new List<Point3d>();
        for (int yi = 0; yi < pxHeight; yi++){
          Double phi = ivalPhi.ParameterAt((Double) xi / (Double) (pxWidth - 1));
          Double theta = ivalTheta.ParameterAt((Double) yi / (Double) (pxHeight - 1));

          Double x = radius * Math.Sin(theta) * Math.Cos(phi);
          Double y = radius * Math.Sin(theta) * Math.Sin(phi);
          Double z = radius * Math.Cos(theta);

          Point3d pt = samplePlane.PointAt(x, y, z);
          pts.Add(pt);


        }

        Curve cv = Curve.CreateInterpolatedCurve(pts, 3);
        crvs.Add(cv);
        retCrvs.Add(cv);
      }

      Brep[] breps = Brep.CreateFromLoft(crvs, Point3d.Unset, Point3d.Unset, LoftType.Normal, true);
      retBreps.Add(breps[0]);
    }

    A = retBreps;
    //B = retCrvs;
# ---------- end c_script_2 ----------
out_bnds = Curve(rec_2pt.Rectangle)
context = Brep([<brep referenced from the Rhino model> x64])
context_2 = Brep(context)  # disabled

# ---- group: define ground
# DEFINE GROUND: The ground is defined at the lower edge of the bounding box of the given Breps. Ground box is sized to 1000 times the size of the bounding box. Maximum x-y dimension of bounding box is returned.
cluster_3 = Cluster(breps=context_2)  # -> ground_2, max_dim_2; disabled

# ----
merge = Merge(Data1=cluster_3.ground_2, Data2=context_2)  # disabled
breps = Brep(merge)  # disabled
breps_2 = Brep(breps)  # disabled
c_script_3 = CSharpScript(
    showPts=not,
    pxWidth=px_width_3,
    pxHeight=px_height_3,
    samplePlanes=sample_planes_2,
    breps=breps_2,
    hitDomain=hit_domain_2,
    thetaCrop=theta_crop_2)  # -> out, hitCounts, hitPts, hitDists, A; inputs showPts: Boolean, pxWidth: Int32, pxHeight: Int32, samplePlanes: list of Plane, breps: list of Brep, thetaCrop: Double; disabled
# ---------- c_script_3: C# ----------
    DataTree<int> hCounts = new DataTree<int>();
    DataTree<object> hPts = new DataTree<object>();
    DataTree<object> hDists = new DataTree<object>();
    Interval dom = new Interval(Double.MinValue, Double.MaxValue);

    Interval ivalPhi = new Interval(0, 2.0 * Math.PI);
    Interval ivalTheta = new Interval(thetaCrop, Math.PI - thetaCrop);

    for (int p = 0; p < samplePlanes.Count; p++){
      Plane samplePlane = samplePlanes[p];

      for (int xi = pxWidth; xi > 0; xi--){
        for (int yi = 0; yi < pxHeight; yi++){
          Double phi = ivalPhi.ParameterAt((Double) xi / (Double) (pxWidth - 1));
          Double theta = ivalTheta.ParameterAt((Double) yi / (Double) (pxHeight - 1));

          Point3d xpt = new Point3d();
          Double xt = Double.MaxValue;

          Double radius = 1.0;
          Double x = radius * Math.Sin(theta) * Math.Cos(phi);
          Double y = radius * Math.Sin(theta) * Math.Sin(phi);
          Double z = radius * Math.Cos(theta);

          Point3d plnPt = samplePlane.PointAt(x, y, z);
          Vector3d rayVec = plnPt - samplePlane.Origin;
          Ray3d ray = new Ray3d(plnPt, rayVec);
          Line seg = new Line(samplePlane.Origin, samplePlane.PointAt(x, y, z));

          var points = Rhino.Geometry.Intersect.Intersection.ProjectPointsToBreps(
            breps,
            new List<Point3d> {samplePlane.Origin},
            ray.Direction,
            doc.ModelAbsoluteTolerance
            );

          int validHits = 0;
          foreach (Point3d pt in points){
            Double t = seg.ClosestParameter(pt);
            if ((t >= 0) && (t < xt)){
              xt = t;
              xpt = pt;
            }

            if (t >= 0) validHits++;
          }

          if (xt < Double.MaxValue){
            hCounts.Add(validHits, new GH_Path(p));
            if (showPts) hPts.Add(xpt, new GH_Path(p));
            //hTs.Add(x, new GH_Path(p)t);
            Double dist = xt * seg.Length;
            Double domDist = hitDomain.NormalizedParameterAt(dist);
            if (domDist > 1.0) domDist = 1.0;
            hDists.Add(domDist, new GH_Path(p));

            if ((dom.Min == Double.MinValue ) || (dist < dom.Min)) dom.T0 = dist;
            if ((dom.Max == Double.MaxValue ) || (dist > dom.Max)) dom.T1 = dist;

          } else {
            hCounts.Add(0, new GH_Path(p));
            if (showPts) hPts.Add(null, new GH_Path(p));
            //hTs.Add(null, new GH_Path(p));
            hDists.Add(null, new GH_Path(p));
          }



        }
      }

      hitCounts = hCounts;
      if (showPts) hitPts = hPts;
      hitDists = hDists;
    }
# ---------- end c_script_3 ----------
panel_3 = Panel(c_script_3.out)  # disabled
sqrt_2 = SquareRoot(Value=c_script_3.hitDists)  # disabled
nullrep = ReplaceNulls(Items=sqrt_2, Replacements=panel)  # -> Items, Count; disabled
gradient = Gradient(LowerLimit=0, UpperLimit=1, Parameter=nullrep.Items, stops=[0: RGB(255, 255, 255), 1: RGB(0, 0, 0)])  # disabled
tstat = TreeStatistics(Tree=simplify(gradient))  # -> Paths, Length, Count; disabled
filename_prefix_2 = Text(filename_prefix)  # disabled
series = Series(Start=0, Step=1, Count=tstat.Count)  # disabled
expression = Expression(x=series, y=filename_prefix_2, Expression="Format(\"{1}_{0:0000}\", x, y)")  # disabled
do_save_images_2 = Boolean(do_save_images)  # disabled
save_path_2 = FilePath(save_path)  # disabled
txt = Text(graft(expression))  # disabled
px_height_5 = Integer(px_height_2)  # disabled
px_width_5 = Integer(px_width_2)  # disabled
column_count_x = Slider(3, range=0..10)
column_count_y = Slider(3, range=0..10)
column_wall_height = Slider(12, range=0..20)
xz_wall_line = Curve(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)
yz_wall_line = Curve(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)
y_wall_length_ft = Slider(100, range=0..1000)
x_wall_length_ft = Slider(100, range=0..1000)
xy_column_base = Brep(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)
subtraction = Subtraction(A=column_count_x, B=1)
subtraction_2 = Subtraction(A=column_count_y, B=1)
Z_2 = UnitZ(Factor=column_wall_height)
division_2 = Division(A=x_wall_length_ft, B=subtraction_2)
division_3 = Division(A=y_wall_length_ft, B=subtraction)
yz_wall_plane = Extrude(Base=yz_wall_line, Direction=Z_2)
column = Extrude(Base=xy_column_base, Direction=Z_2)
addition = Addition(A=y_wall_length_ft, B="1")
addition_2 = Addition(A=x_wall_length_ft, B="1")
xz_wall_plane = Extrude(Base=xz_wall_line, Direction=Z_2)
Z_3 = UnitZ(Factor=column_wall_height)
X = UnitX(Factor=y_wall_length_ft)
rectangle_2 = Rectangle(Plane=PlaneXY(0, 0, 0), XSize=division_3, YSize=division_2, Radius=0)  # -> Rectangle, Length
Y = UnitY(Factor=x_wall_length_ft)
rectangle_3 = Rectangle(Plane=PlaneXY(0, 0, 0), XSize=addition, YSize=addition_2, Radius=0)  # -> Rectangle, Length
roof_rectangle = Move(Geometry=rectangle_3.Rectangle, Motion=Z_3)  # -> Geometry, Transform
boundary_2 = BoundarySurfaces(Edges=roof_rectangle.Geometry)
x_wall1 = Extrude(Base=xz_wall_plane, Direction=X)
y_wall1 = Extrude(Base=yz_wall_plane, Direction=Y)
arrrec = RectangularArray(Geometry=column, Cell=rectangle_2.Rectangle, XCount=column_count_x, YCount=column_count_y)  # -> Geometry, Transform
arrrec_2 = RectangularArray(Geometry=column, Cell=rectangle_2.Rectangle, XCount=column_count_x, YCount="1")  # -> Geometry, Transform
Z_4 = UnitZ(Factor="1")
X_2 = UnitX(Factor=x_wall_length_ft)
Y_2 = UnitY(Factor=y_wall_length_ft)
colonnade = Brep(arrrec_2.Geometry)
column_grid = Brep(arrrec.Geometry)
x_wall_2 = Move(Geometry=x_wall1, Motion=Y_2)  # -> Geometry, Transform
y_wall2 = Move(Geometry=y_wall1, Motion=X_2)  # -> Geometry, Transform
roof = Extrude(Base=boundary_2, Direction=Z_4)
_6_corner_wall_roof = Merge(Data1=x_wall1, Data2=y_wall1, Data3=roof)
_6_two_walls_roof = Merge(Data1=x_wall1, Data2=x_wall_2.Geometry, Data3=roof)
_6_three_walls_roof = Merge(Data1=x_wall1, Data2=x_wall_2.Geometry, Data3=y_wall1, Data4=roof)
_6_four_walls_roof_room = Merge(Data1=x_wall1, Data2=x_wall_2.Geometry, Data3=y_wall1, Data4=y_wall2.Geometry, Data5=roof)
_3_column_grid = Merge(Data1=column_grid)
_6_corner = Merge(Data1=x_wall1, Data2=y_wall1)
_5_column_grid_roof = Merge(Data1=column_grid, Data2=roof)
_2_colonnade = Merge(Data1=colonnade)
_1_column = Merge(Data1=column)
_6_two_walls = Merge(Data1=x_wall1, Data2=x_wall_2.Geometry)
_6_one_wall = Merge(Data1=x_wall1)
_6_three_walls = Merge(Data1=x_wall1, Data2=x_wall_2.Geometry, Data3=y_wall1)
_6_four_walls = Merge(Data1=x_wall1, Data2=x_wall_2.Geometry, Data3=y_wall1, Data4=y_wall2.Geometry)
_6_one_wall_roof = Merge(Data1=x_wall1, Data2=roof)
_4_colonnade_roof = Merge(Data1=colonnade, Data2=roof)
c_script_4 = CSharpScript(doSave=do_save_images_2, savepath=save_path_2, filename=txt, pxColors=gradient, pxWidth=px_width_5, pxHeight=px_height_5)  # -> out, A; inputs doSave: Boolean, savepath: String, filename: String, pxColors: list of Color, pxWidth: Int32, pxHeight: Int32; disabled
# ---------- c_script_4: C# ----------
    if (!doSave) return;

    if (pxColors.Count != pxWidth * pxHeight) {
      String msg = "Pixel dimension does not match number of colors provided!";
      Print(msg);
      Component.AddRuntimeMessage(GH_RuntimeMessageLevel.Error, msg);
      //GrasshopperDocument.RequestAbortSolution();
      return;
    }

    System.Drawing.Bitmap img = new Bitmap(pxWidth, pxHeight);

    for (var i = 0; i < pxColors.Count; i++) {
      int y = i % pxHeight;
      int x = i / pxHeight;
      //Print(String.Format("{0},{1}", x.ToString(), y.ToString()));
      img.SetPixel(x, y, pxColors[i]);
    }
    img.Save(savepath + filename + ".png", System.Drawing.Imaging.ImageFormat.Png);


    A = img;
# ---------- end c_script_4 ----------

# ---- group: Isovist Geometry
_6_one_wall_2 = Brep(_6_one_wall)
_11_two_walls_corner_roof = Brep(_6_corner_wall_roof)
_1_column_2 = Brep(_1_column)
_3_collonade_roof = Brep(_4_colonnade_roof)
_5_column_grid_roof_2 = Brep(_5_column_grid_roof)
_7_one_wall_roof = Brep(_6_one_wall_roof)
_8_two_parallel_walls = Brep(_6_two_walls)
_10_two_walls_corner = Brep(_6_corner)
_12_three_walls = Brep(_6_three_walls)
_13_three_walls_roof = Brep(_6_three_walls_roof)
_15_four_walls_roof_room = Brep(_6_four_walls_roof_room)
_2_collonade = Brep(_2_colonnade)
_4_column_grid = Brep(_3_column_grid)
_9_two_parallel_walls_roof = Brep(_6_two_walls_roof)
_14_four_walls = Brep(_6_four_walls)
brep = Brep(_3_collonade_roof)

# ==== cluster Cluster
breps = ClusterInput()
breps_2 = Brep(breps)
bbox = BoundingBox(Content=breps_2, Plane=PlaneXY(0, 0, 0), UnionBox=True)  # -> Box, Box_2
debox = DeconstructBox(Box=bbox.Box)  # -> Plane, X, Y, Z
dedomain = DeconstructDomain(Domain=debox.X)  # -> Start, End
dedomain_2 = DeconstructDomain(Domain=debox.Y)  # -> Start, End
avr = Average(Input=[dedomain.Start, dedomain.End])
subtraction = Subtraction(A=dedomain.End, B=dedomain.Start)
avr_2 = Average(Input=[dedomain_2.Start, dedomain_2.End])
subtraction_2 = Subtraction(A=dedomain_2.End, B=dedomain_2.Start)
multiplication = Multiplication(A=subtraction, B="1000")
multiplication_2 = Multiplication(A=subtraction_2, B="1000")
pt = ConstructPoint(XCoordinate=avr, YCoordinate=avr_2, ZCoordinate=expr("-x", "1"))
max = Maximum(A=subtraction, B=subtraction_2)
max_dim = Number(max)
box = CenterBox(Base=pt, X=multiplication, Y=multiplication_2, Z="1")
ground = Box(box)
max_dim_2 = ClusterOutput(max_dim)
ground_2 = ClusterOutput(ground)

# ==== cluster Cluster_2
bnd_crv = ClusterInput()
eye_height = ClusterInput()
pt2d = ClusterInput()
bnd_crv_2 = Curve(bnd_crv)
eye_height_2 = Number(eye_height)
pt2d_2 = Point(pt2d)
area = Area(Geometry=bnd_crv_2)  # -> Area, Centroid
Z = UnitZ(Factor=eye_height_2)
move = Move(Geometry=pt2d_2, Motion=Z)  # -> Geometry, Transform
vec2pt = Vector2Pt(PointA=pt2d_2, PointB=area.Centroid, Unitize=False)  # -> Vector, Length
Z_2 = UnitZ(Factor=1)
rev = Reverse(Vector=vec2pt.Vector)
xprod = CrossProduct(VectorA=rev, VectorB=Z_2, Unitize=False)  # -> Vector, Length
rev_2 = Reverse(Vector=xprod.Vector)
pl = ConstructPlane(Origin=move.Geometry, XAxis=rev, YAxis=rev_2)
plns = Plane(pl)
plns_2 = ClusterOutput(plns)
